# Grasshopper definition 04_bridge_letten.ghx (Grasshopper 1.0.7)
# plug-ins: Human

# ---- group: root nodes - positions
pt = Point([Point(4.092773445, 427.7339151, 2.9), Point(4.092773445, 433.8339151, 2.9), Point(12.89277345, 433.8339151, 2.9), Point(12.89277345, 427.7339151, 2.9)])
pt_2 = Point(Point(-70.00722655, 430.7839151, 0.6))
pt_3 = Point(Point(62.09277345, 430.7839151, 0))
pt_4 = Point(Point(8.492773445, 430.7839151, -6.8))
pt_5 = Point([Point(4.687773445, 430.7839151, 8.1), Point(12.29777345, 430.7839151, 8.1)])

panel = Panel("""0
2
18
20
22
24
54
56
58""")
entwine = Entwine(Branch00=pt_5, Branch01=pt, Branch02=pt_2, Branch03=pt_3, Branch04=pt_4, FlattenInputs=True)
flatten = FlattenTree(Tree=entwine, Path="{0}")
pt_6 = Point(flatten)
int = Integer(panel)

# ----
# Bridge Deck
# Auxiliary Structure
# Pylon Wipkingen
# Pylon Sihlquai
# Pylon Letten
# Lateral
# Hangers
trail_edges_pylon_letten = Curve(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)
deviation_edge_pylon_letten = Curve([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])
dev2_hangers = Curve([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])
trail_edges_pylon_sihlquai = Curve(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)
deviation_edge_pylon_sihlquai = Curve([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])
dev1_lateral = Curve([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])
trail_edges_pylon_wipkingen = Curve(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)
deviation_edges_pylon_wipkingen = Curve([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])
trail_edges_auxiliary = Curve([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])
deviation_edge_d_51_and_d_52 = Curve([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])
trail_edges_deck = Curve([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])
deviation_edge_d_53 = Curve(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)

# ---- group: supports
pt_7 = Point([Point(24.88642696, 56.59985935, 0), Point(25.38642696, 55.35104777, 0), Point(25.38642696, 53.89392697, 0), Point(-8.113573039, 56.59985935, 0), Point(-8.613573039, 55.35104777, 0), Point(-8.613573039, 53.89392697, 0), Point(-5.480277211, 52.99002215, 0), Point(8.386426961, 52.99002215, 0), Point(22.25313113, 52.99002215, 0)])

# ---- group: loads
pt_8 = Point([Point(7.886426961, 56.59985935, 0), Point(5.886426961, 56.59985935, 0), Point(3.886426961, 56.59985935, 0), Point(1.886426961, 56.59985935, 0), Point(-0.1135730391, 56.59985935, 0), Point(-2.113573039, 56.59985935, 0), Point(-4.113573039, 56.59985935, 0), Point(8.886426961, 56.59985935, 0), Point(10.88642696, 56.59985935, 0), Point(12.88642696, 56.59985935, 0), Point(14.88642696, 56.59985935, 0), Point(16.88642696, 56.59985935, 0), Point(18.88642696, 56.59985935, 0), Point(20.88642696, 56.59985935, 0)])

# ----
python = GhPythonScript(unload=Button())  # -> out; inputs unload: Boolean
# ---------- python: Python ----------
from compas_ghpython.utilities import unload_modules


if unload:
    
    unloaded = unload_modules("compas")
    print("Unloaded: {}".format(unloaded))
# ---------- end python ----------

vec = VectorXYZ(XComponent="0.0", YComponent="0.0", ZComponent=Slider(-1.522, range=-10..0))  # -> Vector, Length
vec_2 = Vector(vec.Vector)

length_trail_edges_t_32_to_t_47 = Slider(7.61, range=1.5..15)
force_deviation_edge_d_53 = Slider(14, range=0..20)
length_trail_edges_deck_t_0_to_t_29 = Slider(-7.34, range=-15..15)
length_trail_edges_deck_t_0_to_t_29_2 = Slider(-1.5, range=-15..15)
force_deviation_edge_d_51_and_d_52 = Slider(-20, range=-20..20)
trail = Slider(-1, range=-15..15)
force_deviation_edges_pylon_wipkingen = Slider(0, range=0..20)
trail_2 = Slider(-1, range=-15..15)
force_deviation_edges_pylon_sihlquai = Slider(0, range=0..20)
trail_3 = Slider(-1, range=-15..15)
force_deviation_edge_pylon_letten = Slider(-2.7, range=-20..20)
force_dev1_lateral = Slider(1.2, range=0..2)
force_dev2_hangers = Slider(-1.3, range=-2..2)
num = Number(length_trail_edges_t_32_to_t_47)
num_2 = Number(force_deviation_edge_d_53)
num_3 = Number(length_trail_edges_deck_t_0_to_t_29)
num_4 = Number(length_trail_edges_deck_t_0_to_t_29_2)
num_5 = Number(force_deviation_edge_d_51_and_d_52)
num_6 = Number(trail)
num_7 = Number(force_deviation_edges_pylon_wipkingen)
num_8 = Number(trail_2)
num_9 = Number(force_deviation_edges_pylon_sihlquai)
num_10 = Number(trail_3)
num_11 = Number(force_deviation_edge_pylon_letten)
num_12 = Number(force_dev1_lateral)
num_13 = Number(force_dev2_hangers)

export_json = BooleanToggle(False)
json_filepath = Panel("/Users/arpj/code/libraries/compas_cem/data/json/w2_cem_3d_bridge_rhino.json")
bool = Boolean(export_json)
txt = Text(json_filepath)

num_14 = Number(num_3)
crv = Curve(trail_edges_auxiliary)
num_15 = Number(num_4)
lng = ListLength(List=crv)
subtraction = Subtraction(A=lng, B="4")
dup = DuplicateData(Data=num_15, Number="4", Order=True)
dup_2 = DuplicateData(Data=num_14, Number=subtraction, Order=True)
merge = Merge(Data1=dup_2, Data2=dup)
num_16 = Number(merge)

crv_2 = Curve(flatten(deviation_edge_d_53))
num_17 = Number(num)
num_18 = Number(num_2)
crv_3 = Curve(trail_edges_deck)
python_2 = GhPythonScript(rhinoline=crv_2, force=num_18)  # -> out, deviation_edge; inputs rhinoline: Line
# ---------- python_2: Python ----------
from compas_cem.elements import DeviationEdge


deviation_edge = DeviationEdge.from_rhino_line(rhinoline, force)

print(deviation_edge)
# ---------- end python_2 ----------
python_3 = GhPythonScript(rhinoline=crv_3, length=num_17)  # -> out, trail_edge; inputs rhinoline: Line
# ---------- python_3: Python ----------
from compas_cem.elements import TrailEdge

trail_edge = TrailEdge.from_rhino_line(rhinoline, length)

print(trail_edge)
# ---------- end python_3 ----------
data = Data(python_3.trail_edge)
data_2 = Data(python_2.deviation_edge)

crv_4 = Curve(flatten(deviation_edge_d_51_and_d_52))
num_19 = Number(num_16)
crv_5 = Curve(trail_edges_auxiliary)
num_20 = Number(num_5)
python_4 = GhPythonScript(rhinoline=crv_4, force=num_20)  # -> out, deviation_edge; inputs rhinoline: Line; same code as python_2
python_5 = GhPythonScript(rhinoline=crv_5, length=num_19)  # -> out, trail_edge; inputs rhinoline: Line; same code as python_3
data_3 = Data(python_5.trail_edge)
data_4 = Data(python_4.deviation_edge)

crv_6 = Curve(flatten(deviation_edges_pylon_wipkingen))
num_21 = Number(num_6)
num_22 = Number(num_7)
crv_7 = Curve(trail_edges_pylon_wipkingen)
python_6 = GhPythonScript(rhinoline=crv_6, force=num_22)  # -> out, deviation_edge; inputs rhinoline: Line; same code as python_2
python_7 = GhPythonScript(rhinoline=crv_7, length=num_21)  # -> out, trail_edge; inputs rhinoline: Line; same code as python_3
data_5 = Data(python_7.trail_edge)
data_6 = Data(python_6.deviation_edge)

crv_8 = Curve(flatten(deviation_edge_pylon_letten))
num_23 = Number(num_10)
crv_9 = Curve(trail_edges_pylon_letten)
num_24 = Number(num_11)
python_8 = GhPythonScript(rhinoline=crv_8, force=num_24)  # -> out, deviation_edge; inputs rhinoline: Line; same code as python_2
python_9 = GhPythonScript(rhinoline=crv_9, length=num_23)  # -> out, trail_edge; inputs rhinoline: Line; same code as python_3
data_7 = Data(python_9.trail_edge)
data_8 = Data(python_8.deviation_edge)

crv_10 = Curve(flatten(deviation_edge_pylon_sihlquai))
crv_11 = Curve(trail_edges_pylon_sihlquai)
num_25 = Number(num_8)
num_26 = Number(num_9)
python_10 = GhPythonScript(rhinoline=crv_10, force=num_26)  # -> out, deviation_edge; inputs rhinoline: Line; same code as python_2
python_11 = GhPythonScript(rhinoline=crv_11, length=num_25)  # -> out, trail_edge; inputs rhinoline: Line; same code as python_3
data_9 = Data(python_11.trail_edge)
data_10 = Data(python_10.deviation_edge)

crv_12 = Curve(flatten(dev1_lateral))
num_27 = Number(num_12)
python_12 = GhPythonScript(rhinoline=crv_12, force=num_27)  # -> out, deviation_edge; inputs rhinoline: Line; same code as python_2
data_11 = Data(python_12.deviation_edge)

crv_13 = Curve(flatten(dev2_hangers))
num_28 = Number(num_13)
python_13 = GhPythonScript(rhinoline=crv_13, force=num_28)  # -> out, deviation_edge; inputs rhinoline: Line; same code as python_2
data_12 = Data(python_13.deviation_edge)

pt_9 = Point(pt_8)
vec_3 = Vector(vec_2)
python_14 = GhPythonScript(rhinopoint=pt_9, rhinovector=vec_3)  # -> out, node_load; inputs rhinopoint: Point3d, rhinovector: Vector3d
# ---------- python_14: Python ----------
from compas_cem.loads import NodeLoad


node_load = NodeLoad.from_rhino_point_and_vector(rhinopoint, rhinovector)
# ---------- end python_14 ----------
data_13 = Data(python_14.node_load)

pt_10 = Point(pt_7)
python_15 = GhPythonScript(rhinopoint=pt_10)  # -> out, node_support; inputs rhinopoint: Point3d
# ---------- python_15: Python ----------
from compas_cem.supports import NodeSupport


node_support = NodeSupport.from_rhino_point(rhinopoint)
# ---------- end python_15 ----------
data_14 = Data(python_15.node_support)

data_15 = Data(data)
data_16 = Data(data_3)
data_17 = Data(data_5)
data_18 = Data(data_9)
data_19 = Data(data_7)
data_20 = Data(data_2)
data_21 = Data(data_4)
data_22 = Data(data_6)
data_23 = Data(data_10)
data_24 = Data(data_8)
data_25 = Data(data_11)
data_26 = Data(data_12)
deviations = Merge(Data1=flatten(data_15), Data2=flatten(data_16), Data3=flatten(data_17), Data4=flatten(data_18), Data5=flatten(data_19))
deviations_2 = Merge(
    Data1=flatten(data_20),
    Data2=flatten(data_21),
    Data3=flatten(data_22),
    Data4=flatten(data_23),
    Data5=flatten(data_24),
    Data6=flatten(data_25),
    Data7=flatten(data_26))
data_27 = Data(deviations)
data_28 = Data(deviations_2)
data_29 = Data(data_27)
data_30 = Data(data_14)
data_31 = Data(data_28)
data_32 = Data(data_13)
python_16 = GhPythonScript(trail_edges=data_29, deviation_edges=data_31, loads=data_32, supports=data_30)  # -> out, form; inputs trail_edges: list, deviation_edges: list, loads: list, supports: list
# ---------- python_16: Python ----------
from compas_cem.diagrams import FormDiagram


form = FormDiagram()

for trail_edge in trail_edges:
    form.add_edge(trail_edge)
 
for deviation_edge in deviation_edges:
    form.add_edge(deviation_edge)

for load in loads:
    form.add_load(load)

for support in supports:
    form.add_support(support)

form.trails()
# ---------- end python_16 ----------
panel_2 = Panel(python_16.out)
data_33 = Data(python_16.form)
data_34 = Data(data_33)
int_2 = Integer(int)
pt_11 = Point(pt_6)
python_17 = GhPythonScript(form=data_34, node_key=int_2, node_xyz=pt_11)  # -> out, form; inputs node_key: list of Int32, node_xyz: list of Point3d
# ---------- python_17: Python ----------
from compas_cem.equilibrium import force_equilibrium


form = form.copy()

for node, xyz in zip(node_key, node_xyz):
    form.node_xyz(node, xyz)
# ---------- end python_17 ----------
data_35 = Data(python_17.form)
data_36 = Data(data_35)
python_18 = GhPythonScript(form=data_36, kmax="100")  # -> out, form; inputs kmax: Int32
# ---------- python_18: Python ----------
from compas_cem.equilibrium import force_equilibrium


form = form.copy()
force_equilibrium(form, kmax, verbose=True)
# ---------- end python_18 ----------
data_37 = Data(python_18.form)
data_38 = Data(data_37)
data_39 = Data(data_38)
python_19 = GhPythonScript(form=data_39, force_tol="0.001")  # -> out, edge_keys
# ---------- python_19: Python ----------
from math import fabs


edge_keys = []
for edge in form.edges():
    if fabs(form.edge_force(edge)) > force_tol:
        edge_keys.append("{}, {}".format(*edge))
# ---------- end python_19 ----------
data_40 = Data(python_19.edge_keys)
data_41 = Data(data_38)
txt_2 = Text(data_40)
data_42 = Data(data_38)
txt_3 = Text(data_40)
python_20 = GhPythonScript(form=data_41, edge_key=txt_2)  # -> out, edge_line; inputs edge_key: list
# ---------- python_20: Python ----------
import rhinoscriptsyntax as rs


if edge_key:
    keys = []
    for str_key in edge_key:
        key = str_key.split(", ")
        key = tuple([int(k) for k in key])
        keys.append(key)
else:
    keys = list(form.edges())

edge_line = []
for u, v in keys:
    xyz = form.edge_coordinates(u, v)
    edge_line.append(rs.AddLine(*xyz))
# ---------- end python_20 ----------
python_21 = GhPythonScript(form=data_42, edge_key=txt_3)  # -> out, forces; inputs edge_key: list
# ---------- python_21: Python ----------
if edge_key:
    keys = []
    for str_key in edge_key:
        key = str_key.split(", ")
        key = tuple([int(k) for k in key])
        keys.append(key)
else:
    keys = list(form.edges())

forces = form.edges_attribute(keys=keys, name="force")
# ---------- end python_21 ----------
crv_14 = Curve(python_20.edge_line)
panel_3 = Panel(python_20.out)
num_29 = Number(python_21.forces)

data_43 = Data(data_38)
python_22 = GhPythonScript(form=data_43)  # -> out, root_node_keys, root_node_xyz
# ---------- python_22: Python ----------
import rhinoscriptsyntax as rs


root_node_keys = []
root_node_xyz = []

for node in form.root_nodes():
    root_node_keys.append(node)
    xyz = form.node_coordinates(node)
    root_node_xyz.append(rs.AddPoint(*xyz))
# ---------- end python_22 ----------
pt_12 = Point(python_22.root_node_xyz)
int_3 = Integer(python_22.root_node_keys)
int_4 = Integer(int_3)
pt_13 = Point(pt_12)
tag = TextTag(Location=pt_13, Text=int_4, Colour=ColourSwatch(SwatchColor=RGB(194, 132, 0)))

crv_15 = Curve(crv_14)
bool_2 = Boolean(bool)
txt_4 = Text(txt)
data_44 = Data(data_38)
python_23 = GhPythonScript(export_json=bool_2, form=data_44, filepath=txt_4)  # -> out
# ---------- python_23: Python ----------
if export_json:
    
    form.to_json(filepath)
# ---------- end python_23 ----------
panel_4 = Panel(python_23)

num_30 = Number(num_29)
python_24 = GhPythonScript(values=num_30, color_neg=ColourSwatch(SwatchColor=RGB(0, 132, 255)), color_pos=ColourSwatch(SwatchColor=RGB(255, 0, 0)))  # -> out, colors; inputs values: list
# ---------- python_24: Python ----------
import rhinoscriptsyntax as rs


colors = []

for value in values:
    if value < 0:
        colors.append(color_neg)
    else:
        colors.append(color_pos)
# ---------- end python_24 ----------
col = Colour(python_24.colors)
num_31 = Number(num_29)
col_2 = Colour(col)
num_32 = Number(num_29)
previewlw = CustomPreviewLineweights(Geometry=crv_15, Shader=col_2, Thickness=num_32, Absolute=False)

data_45 = Data(data_38)
data_46 = Data(data_38)
python_25 = GhPythonScript(form=data_45)  # -> out, node_keys, node_xyz
# ---------- python_25: Python ----------
import rhinoscriptsyntax as rs


node_keys = []
node_xyz = []

for node in form.nodes():
    node_keys.append(node)
    xyz = form.node_coordinates(node)
    node_xyz.append(rs.AddPoint(*xyz))
# ---------- end python_25 ----------
python_26 = GhPythonScript(form=data_46)  # -> out, edge_keys, edge_line
# ---------- python_26: Python ----------
import rhinoscriptsyntax as rs


edge_keys = []
edge_line = []

for u, v in form.edges():
    edge_keys.append((u, v))
    xyz = form.edge_coordinates(u, v)
    edge_line.append(rs.AddLine(*xyz))
# ---------- end python_26 ----------
pt_14 = Point(python_25.node_xyz)
int_5 = Integer(python_25.node_keys)
data_47 = Data(python_26.edge_keys)
data_48 = Data(data_47)
int_6 = Integer(int_5)
pt_15 = Point(pt_14)
swatch = ColourSwatch(SwatchColor=RGB(158, 158, 158))
tag_2 = TextTag(Location=pt_15, Text=int_6, Colour=ColourSwatch(SwatchColor=RGB(0, 155, 194)))

crv_16 = Curve(python_26.edge_line)
crv_17 = Curve(crv_16)

crv_18 = Curve(crv_16)
midpt = CurveMiddle(Curve=crv_18)
tag_3 = TextTag(Location=midpt, Text=num_31, Colour=ColourSwatch(SwatchColor=RGB(237, 237, 237)))

midpt_2 = CurveMiddle(Curve=crv_17)
tag_4 = TextTag(Location=midpt_2, Text=data_48, Colour=swatch)
preview = CustomPreview(Geometry=crv_17, Material=swatch)
