# Grasshopper definition backup.gh (Grasshopper 1.0.7)

# ----
# COMPAS CEM
# Copyright (c) 2021 Rafael Pastrana
# Color Code
# Trail Edges
# Deviation Edges
# Loads
# Supports
# Optimization
# Topology/Form Diagram
# Topology Visualization
# Form Visualization
# JSON serialization
# Don’t modify (unless you know what you are doing)
inner_ring_radius = Slider(6, range=0..10)
outer_ring_radius = Slider(15, range=0..20)
of_trails = Slider(12, range=0..100)
deviation_edge_rings = Panel("4")
number = Number(inner_ring_radius)
number_2 = Number(outer_ring_radius)
integer = Integer(of_trails)
integer_2 = Integer(deviation_edge_rings)

# ---- group: Trail Edges - Level 1
internal_force_state = ValueList({"Tension": 1, "Compression": -1}, selected="Compression")
integer_3 = Integer(internal_force_state)

# ---- group: Trail Edges - Level 2
internal_force_state_2 = ValueList({"Tension": 1, "Compression": -1}, selected="Compression")
integer_4 = Integer(internal_force_state_2)

# ---- group: Trail Edges - Level 3
internal_force_state_3 = ValueList({"Tension": 1, "Compression": -1}, selected="Compression")
integer_5 = Integer(internal_force_state_3)

# ---- group: Trail Edges - Level 4
internal_force_state_4 = ValueList({"Tension": 1, "Compression": -1}, selected="Compression")
integer_6 = Integer(internal_force_state_4)

# ---- group: Deviation Edges - Ring 1
internal_force_state_5 = ValueList({"Tension": 1, "Compression": -1}, selected="Compression")
deviation_edge_force = Slider(0.6, range=0..10)
edge_cull_pattern = Panel("""1
1""")
integer_7 = Integer(internal_force_state_5)
number_3 = Number(deviation_edge_force)
integer_8 = Integer(edge_cull_pattern)

# ---- group: Deviaton Edges - Ring 2
internal_force_state_6 = ValueList({"Tension": 1, "Compression": -1}, selected="Compression")
deviation_edge_force_2 = Slider(1, range=0..10)
edge_cull_pattern_2 = Panel("""1
1""")
integer_9 = Integer(internal_force_state_6)
number_4 = Number(deviation_edge_force_2)
integer_10 = Integer(edge_cull_pattern_2)

# ---- group: Deviation Edges - Ring 3
internal_force_state_7 = ValueList({"Tension": 1, "Compression": -1}, selected="Compression")
deviation_edge_force_3 = Slider(0.7, range=0..10)
edge_cull_pattern_3 = Panel("""1
1""")
number_5 = Number(deviation_edge_force_3)
integer_11 = Integer(edge_cull_pattern_3)
integer_12 = Integer(internal_force_state_7)

# ---- group: Deviation Edges - Ring 4
internal_force_state_8 = ValueList({"Tension": 1, "Compression": -1}, selected="Compression")
deviation_edge_force_4 = Slider(1.1, range=0..10)
edge_cull_pattern_4 = Panel("""1
1""")
integer_13 = Integer(internal_force_state_8)
number_6 = Number(deviation_edge_force_4)
integer_14 = Integer(edge_cull_pattern_4)

# ---- group: Load
point_load = Slider(1, range=0..10)
number_7 = Number(point_load)

# ---- group: Generate Structure’s Geometry
number_8 = Number(number)
integer_15 = Integer(integer)
integer_16 = Integer(integer)
integer_17 = Integer(integer_2)
number_9 = Number(number_2)
polygon = Polygon(Plane=PlaneXY(0, 0, 0), Radius=number_9, Segments=integer_16, FilletRadius=0)  # -> Polygon, Length
polygon_2 = Polygon(Plane=PlaneXY(0, 0, 0), Radius=number_8, Segments=integer_15, FilletRadius=0)  # -> Polygon, Length
cluster = Cluster(curve=polygon_2.Polygon, count=integer_17, curve_2=polygon.Polygon)  # -> loads, segments, segments_2, supporets
curve = Curve(cluster.segments)
curve_2 = Curve(cluster.segments_2)
point = Point(cluster.supporets)
point_2 = Point(cluster.loads)

# ----
integer_18 = Integer(integer_3)
integer_19 = Integer(integer_4)
integer_20 = Integer(integer_5)
integer_21 = Integer(integer_6)
entwine = Entwine(Branch00=integer_18, Branch01=integer_19, Branch02=integer_20, Branch03=integer_21, FlattenInputs=True)
number_10 = Number(entwine)

integer_22 = Integer(integer_9)
integer_23 = Integer(integer_7)
integer_24 = Integer(integer_12)
integer_25 = Integer(integer_13)
entwine_2 = Entwine(Branch00=integer_23, Branch01=integer_22, Branch02=integer_24, Branch03=integer_25, FlattenInputs=True)
number_11 = Number(entwine_2)

integer_26 = Integer(integer_10)
integer_27 = Integer(integer_8)
integer_28 = Integer(integer_11)
integer_29 = Integer(integer_14)
entwine_3 = Entwine(Branch00=integer_27, Branch01=integer_26, Branch02=integer_28, Branch03=integer_29, FlattenInputs=True)
boolean = Boolean(entwine_3)

number_12 = Number(number_3)
number_13 = Number(number_4)
number_14 = Number(number_5)
number_15 = Number(number_6)
entwine_4 = Entwine(Branch00=number_12, Branch01=number_13, Branch02=number_14, Branch03=number_15, FlattenInputs=True)
number_16 = Number(entwine_4)

curve_3 = Curve(curve_2)
boolean_2 = Boolean(boolean)
cull_pattern = CullPattern(List=curve_3, CullPattern=boolean_2)
curve_4 = Curve(cull_pattern)

# ---- group: Trail Edges
curve_5 = Curve(curve)
number_17 = Number(number_10)
flip_matrix = FlipMatrix(Data=curve_5)
length = Length(Curve=flip_matrix)
multiplication = Multiplication(A=length, B=number_17)
trail_edge = TrailEdge(line=flip_matrix, length=multiplication)  # -> trail_edge; inputs line: Line, plane: Plane
#   port line: A line that defines the end nodes of the edge.
#   port length: The signed length of the edge. If negative, the edge is in compression. Otherwise, it is in tension. The length magnitude is ignored if a plane is supplied.
#   port plane: An optional plane to define the length of the trail edge relative to the projection of its start node onto the plane. The force state will be that specified by the length input parameter.
#   port trail_edge: A COMPAS CEM trail edge.
# ---------- trail_edge: Python ----------
"""
Create a trail edge from a rhino line.
"""
from ghpythonlib.componentbase import executingcomponent as component

from compas.geometry import Plane
from compas.geometry import cross_vectors

from compas_rhino.geometry import RhinoPlane

from compas_cem.elements import TrailEdge


class TrailEdgeComponent(component):
    def RunScript(self, line, length, plane):
        if plane is not None:
            plane = RhinoPlane.from_geometry(plane).to_compas()
            plane = Plane(plane.point, cross_vectors(plane.xaxis, plane.yaxis))
        if line and length is not None:
            return TrailEdge.from_rhino_line(line, length=length, plane=plane)
# ---------- end trail_edge ----------

# ---- group: Deviation Edges
curve_6 = Curve(curve_4)
number_18 = Number(number_11)
number_19 = Number(number_16)
multiplication_2 = Multiplication(A=number_18, B=number_19)
deviation_edge = DeviationEdge(line=curve_6, force=multiplication_2)  # -> deviation_edge; inputs line: Line
#   port line: A line that defines the end nodes of the edge.
#   port force: The desired force on the edge. If negative, the edge is in compression. Otherwise, it is in tension.
#   port deviation_edge: A COMPAS CEM deviation edge.
# ---------- deviation_edge: Python ----------
"""
Create a deviation edge from a rhino line.
"""
from ghpythonlib.componentbase import executingcomponent as component

from compas_cem.elements import DeviationEdge


class DeviationEdgeComponent(component):
    def RunScript(self, line, force):
        if line and force is not None:
            return DeviationEdge.from_rhino_line(line, force=force)
# ---------- end deviation_edge ----------

# ----
point_3 = Point(point_2)
number_20 = Number(number_7)
negative = Negative(Value=number_20)
unit_z = UnitZ(Factor=negative)
node_load = NodeLoad(point=point_3, vector=unit_z)  # -> node_load; inputs point: Point3d, vector: Vector3d
#   port point: The position of the node where to apply the load.
#   port vector: The load vector.
#   port node_load: A COMPAS CEM node load.
# ---------- node_load: Python ----------
"""
Create a load vector to be applied at a node.
"""
from ghpythonlib.componentbase import executingcomponent as component

from compas_cem.loads import NodeLoad


class NodeLoadComponent(component):
    def RunScript(self, point, vector):
        if point and vector:
            return NodeLoad.from_rhino_point_and_vector(point, vector)
# ---------- end node_load ----------

point_4 = Point(point)
node_support = NodeSupport(point=point_4)  # -> node_support; inputs point: Point3d
#   port point: The position of the node where to assign a support.
#   port node_support: A COMPAS CEM node support.
# ---------- node_support: Python ----------
"""
Create a node support from a Rhino point.
"""
from ghpythonlib.componentbase import executingcomponent as component

from compas_cem.supports import NodeSupport


class NodeSupportComponent(component):
    def RunScript(self, point):
        if point:
            return NodeSupport.from_rhino_point(point)
# ---------- end node_support ----------

assemble_topology_diagram = AssembleTopologyDiagram(
    trail_edges=flatten(trail_edge),
    deviation_edges=flatten(deviation_edge),
    loads=flatten(node_load),
    supports=flatten(node_support))  # -> topology; inputs trail_edges: list, deviation_edges: list, loads: list, supports: list, add_auxiliary_trails: Boolean
#   port trail_edges: The COMPAS CEM trail edges to add to the diagram.
#   port deviation_edges: The COMPAS CEM deviation edges to add to the diagram.
#   port loads: The COMPAS CEM loads to add to the diagram.
#   port supports: The COMPAS CEM supports to add to the diagram.
#   port add_auxiliary_trails: Append auxiliary trails to the free nodes of the topology diagram. Defaults to False.
#   port topology: A COMPAS CEM topology diagram.
# ---------- assemble_topology_diagram: Python ----------
"""
Assemble a topology diagram.
"""
from ghpythonlib.componentbase import executingcomponent as component

from compas_cem.diagrams import TopologyDiagram


class AssembleTopologyDiagramComponent(component):
    def RunScript(self, trail_edges, deviation_edges, loads, supports, add_auxiliary_trails):

        add_auxiliary_trails = add_auxiliary_trails or False
        topology = TopologyDiagram()

        if trail_edges:
            for trail_edge in trail_edges:
                if trail_edge:
                    topology.add_edge(trail_edge)

        if deviation_edges:
            for deviation_edge in deviation_edges:
                if deviation_edge:
                    topology.add_edge(deviation_edge)

        if loads:
            for load in loads:
                if load:
                    topology.add_load(load)

        if supports:
            for support in supports:
                if support:
                    topology.add_support(support)

        if trail_edges and supports:
            topology.build_trails(add_auxiliary_trails)

        elif deviation_edges and add_auxiliary_trails:
            topology.build_trails(add_auxiliary_trails)

        return topology
# ---------- end assemble_topology_diagram ----------
form_finding = FormFinding(topology=assemble_topology_diagram)  # -> form; inputs tmax: Int32
#   port topology: A COMPAS CEM topology diagram.
#   port tmax: The maximum number of iterations to run the form-finding algorithm for. Defaults to 100.
#   port eta: The convergence threshold of the form-finding algorithm. Default to 1e-6.
#   port form: A COMPAS CEM form diagram in static equilibrium.
# ---------- form_finding: Python ----------
"""
Generate a form diagram in static equilibrium.
"""
from ghpythonlib.componentbase import executingcomponent as component

from compas_cem.equilibrium import static_equilibrium


class FormFindingComponent(component):
    def RunScript(self, topology, tmax, eta):
        tmax = tmax or 100
        eta = eta or 1e-6
        if topology:
            return static_equilibrium(topology, tmax=tmax, eta=eta)
# ---------- end form_finding ----------
data = Data(form_finding)
data_2 = Data(assemble_topology_diagram)

# ==== cluster Cluster
curve = ClusterInput()
curve_2 = ClusterInput()
explode = Explode(Curve=curve, Recursive=True)  # -> Segments, Vertices
explode_2 = Explode(Curve=curve_2, Recursive=True)  # -> Segments, Vertices
line = Line(StartPoint=explode.Vertices, EndPoint=explode_2.Vertices)
count = ClusterInput()
divide_curve = DivideCurve(Curve=line, Count=count, Kinks=False)  # -> Points, Tangents, Parameters
cull_index = CullIndex(List=divide_curve.Points, Indices="-1", Wrap=True)
flip_matrix = FlipMatrix(Data=cull_index)
loads = ClusterOutput(explode.Vertices)
supporets = ClusterOutput(explode_2.Vertices)
polyline = PolyLine(Vertices=divide_curve.Points, Closed=False)
polyline_2 = PolyLine(Vertices=flip_matrix, Closed=False)
explode_3 = Explode(Curve=polyline, Recursive=True)  # -> Segments, Vertices
explode_4 = Explode(Curve=polyline_2, Recursive=True)  # -> Segments, Vertices
segments = ClusterOutput(explode_3.Segments)
segments_2 = ClusterOutput(explode_4.Segments)
