# Grasshopper definition 03_bridge_2d.ghx (Grasshopper 1.0.7)
# plug-ins: Human

# ---- group: Optimization Parameters
trail_edges_length_parameter_bounds_opti = Slider(10, range=0..100)  # "Trail Edges - Length Parameter Bounds (Optimization)"
deviation_edges_force_parameter_bounds_o = Slider(10, range=0..100)  # "Deviation Edges - Force Parameter Bounds (Optimization)"
number = Number(trail_edges_length_parameter_bounds_opti)
number_2 = Number(deviation_edges_force_parameter_bounds_o)

# ---- group: Trail Edges A - Parameters
internal_force_state = ValueList({"Compression": -1, "Tension": 1}, selected="Tension")
# 01-B Design Parameters
trail_edge_length = Slider(15, range=0..100)
number_3 = Number(trail_edge_length)
number_4 = Number(internal_force_state)

# ---- group: Trail Edges B - Parameters
internal_force_state_2 = ValueList({"Compression": -1, "Tension": 1}, selected="Tension")
trail_edge_length_2 = Slider(15, range=0..100)
number_5 = Number(internal_force_state_2)
number_6 = Number(trail_edge_length_2)

# ---- group: Deviation Edges A - Parameters
internal_force_state_3 = ValueList({"Compression": -1, "Tension": 1}, selected="Tension")
trail_edge_length_3 = Slider(5, range=0..100)
number_7 = Number(trail_edge_length_3)
number_8 = Number(internal_force_state_3)

# ---- group: Deviation Edges B - Parameters
internal_force_state_4 = ValueList({"Compression": -1, "Tension": 1}, selected="Compression")
trail_edge_length_4 = Slider(3, range=0..100)
number_9 = Number(internal_force_state_4)
number_10 = Number(trail_edge_length_4)

# ---- group: Loads - Parameters
load_magnitude = Slider(-10, range=-10..0)
number_11 = Number(load_magnitude)

# ----
geometry_pipeline = GeometryPipeline(
    GroupByLayer=False,
    GroupByType=False,
    IncludeHidden=True,
    IncludeLocked=True,
    LayerFilter="*::Supports",
    NameFilter="*",
    SublayerFiltering=True,
    TypeFilter=1)
point = Point(geometry_pipeline)

# ----
# Color Code
# Trail Edges
# Deviation Edges
# Supports
# Loads
# Optimization
# Topology/Form Diagram
# Topology Visualization
# Form Visualization
# Don’t modify (unless you know what you are doing)
# 01-A Geometry imports from Rhino
geometry_pipeline_2 = GeometryPipeline(
    GroupByLayer=False,
    GroupByType=False,
    IncludeHidden=True,
    IncludeLocked=True,
    LayerFilter="*::Trail Edges A",
    NameFilter="*",
    SublayerFiltering=True,
    TypeFilter=4)
geometry_pipeline_3 = GeometryPipeline(
    GroupByLayer=False,
    GroupByType=False,
    IncludeHidden=True,
    IncludeLocked=True,
    LayerFilter="*::Trail Edges B",
    NameFilter="*",
    SublayerFiltering=True,
    TypeFilter=4)
curve = Curve(geometry_pipeline_2)
curve_2 = Curve(geometry_pipeline_3)

geometry_pipeline_4 = GeometryPipeline(
    GroupByLayer=False,
    GroupByType=False,
    IncludeHidden=True,
    IncludeLocked=True,
    LayerFilter="*::Deviation Edges A",
    NameFilter="*",
    SublayerFiltering=True,
    TypeFilter=4)
geometry_pipeline_5 = GeometryPipeline(
    GroupByLayer=False,
    GroupByType=False,
    IncludeHidden=True,
    IncludeLocked=True,
    LayerFilter="*::Deviation Edges B",
    NameFilter="*",
    SublayerFiltering=True,
    TypeFilter=4)
curve_3 = Curve(geometry_pipeline_4)
curve_4 = Curve(geometry_pipeline_5)

geometry_pipeline_6 = GeometryPipeline(
    GroupByLayer=False,
    GroupByType=False,
    IncludeHidden=True,
    IncludeLocked=True,
    LayerFilter="*::Loads",
    NameFilter="*",
    SublayerFiltering=True,
    TypeFilter=1)
point_2 = Point(geometry_pipeline_6)

# ----
# 05-B Design Parameters
geometry_pipeline_7 = GeometryPipeline(
    GroupByLayer=False,
    GroupByType=False,
    IncludeHidden=True,
    IncludeLocked=True,
    LayerFilter="*::Target Points",
    NameFilter="*",
    SublayerFiltering=True,
    TypeFilter=1)
point_3 = Point(geometry_pipeline_7)

# ---- group: Shatter Trail Edges B
curve_5 = Curve(curve_2)
curve_6 = Curve([curve_4, curve_3])
cluster = Cluster(curve=curve_5, curve_2=curve_6)
curve_7 = Curve(cluster)

# ---- group: Shatter Trail Edges A
# 02 Geometry pre-processing
curve_8 = Curve(curve)
curve_9 = Curve([curve_3, curve_4])
cluster_2 = Cluster(curve=curve_8, curve_2=curve_9)
curve_10 = Curve(cluster_2)

# ----
pt = Point(point)
nodesupport = NodeSupport(point=pt)  # -> flatten(node_support); inputs point: Point3d
#   port point: The position of the node where to assign a support.
#   port node_support: A COMPAS CEM node support.
# ---------- nodesupport: Python ----------
"""
Create a node support from a rhino point.
"""
from ghpythonlib.componentbase import executingcomponent as component

from compas_cem.supports import NodeSupport


class NodeSupportComponent(component):
    def RunScript(self, point):
        if point:
            return NodeSupport.from_rhino_point(point)
# ---------- end nodesupport ----------

pt_2 = Point(point_2)
number_12 = Number(number_11)
Z = UnitZ(Factor=number_12)
nodeload = NodeLoad(point=pt_2, vector=Z)  # -> flatten(node_load); inputs point: Point3d, vector: Vector3d
#   port point: The position of the node where to apply the load.
#   port vector: The load vector.
#   port node_load: A COMPAS CEM node load.
# ---------- nodeload: Python ----------
"""
Create a load vector to be applied at a node.
"""
from ghpythonlib.componentbase import executingcomponent as component

from compas_cem.loads import NodeLoad


class NodeLoadComponent(component):
    def RunScript(self, point, vector):
        if point and vector:
            return NodeLoad.from_rhino_point_and_vector(point, vector)
# ---------- end nodeload ----------

# ---- group: Trail Edges B
number_13 = Number(number_5)
curve_11 = Curve(curve_7)
number_14 = Number(number_6)
multiplication = Multiplication(A=number_14, B=number_13)
trail_edge = TrailEdge(line=curve_11, length=multiplication)  # -> flatten(trail_edge); inputs line: Line, plane: Plane
#   port line: A line that defines the end nodes of the edge.
#   port length: The signed length of the edge. If negative, the edge is in compression. Otherwise, it is in tension. The length magnitude is ignored if a plane is supplied.
#   port plane: An optional plane to implicitly define the length of the trail edge. The force state will be that specified by the length input parameter.
#   port trail_edge: A COMPAS CEM trail edge.
# ---------- trail_edge: Python ----------
"""
Create a trail edge from a rhino line.
"""
from ghpythonlib.componentbase import executingcomponent as component

from compas.geometry import Plane
from compas.geometry import cross_vectors

from compas_rhino.geometry import RhinoPlane

from compas_cem.elements import TrailEdge


class TrailEdgeComponent(component):
    def RunScript(self, line, length, plane):
        if plane is not None:
            plane = RhinoPlane.from_geometry(plane).to_compas()
            plane = Plane(plane.point, cross_vectors(plane.xaxis, plane.yaxis))
        if line and length is not None:
            return TrailEdge.from_rhino_line(line, length=length, plane=plane)
# ---------- end trail_edge ----------

# ---- group: Deviation Edges A
number_15 = Number(number_8)
curve_12 = Curve(curve_3)
number_16 = Number(number_7)
multiplication_2 = Multiplication(A=number_16, B=number_15)
deviation_edge = DeviationEdge(line=curve_12, force=multiplication_2)  # -> flatten(deviation_edge); inputs line: Line
#   port line: A line that defines the end nodes of the edge.
#   port force: The desired force on the edge. If negative, the edge is in compression. Otherwise, it is in tension.
#   port deviation_edge: A COMPAS CEM deviation edge.
# ---------- deviation_edge: Python ----------
"""
Create a deviation edge from a rhino line.
"""
from ghpythonlib.componentbase import executingcomponent as component

from compas_cem.elements import DeviationEdge


class DeviationEdgeComponent(component):
    def RunScript(self, line, force):
        if line and force is not None:
            return DeviationEdge.from_rhino_line(line, force=force)
# ---------- end deviation_edge ----------

# ---- group: Deviation Edges B
curve_13 = Curve(curve_4)
number_17 = Number(number_10)
number_18 = Number(number_9)
multiplication_3 = Multiplication(A=number_17, B=number_18)
deviation_edge_2 = DeviationEdge(line=curve_13, force=multiplication_3)  # -> flatten(deviation_edge); inputs line: Line; same code as deviation_edge

# ---- group: Trail Edges A
# 03 Assemble a topology diagram
curve_14 = Curve(curve_10)
number_19 = Number(number_3)
number_20 = Number(number_4)
multiplication_4 = Multiplication(A=number_19, B=number_20)
trail_edge_2 = TrailEdge(line=curve_14, length=multiplication_4)  # -> flatten(trail_edge); inputs line: Line, plane: Plane; same code as trail_edge

# ----
assemble_topology_diagram = AssembleTopologyDiagram(
    trail_edges=flatten([trail_edge_2, trail_edge]),
    deviation_edges=flatten([deviation_edge, deviation_edge_2]),
    loads=flatten(nodeload),
    supports=flatten(nodesupport))  # -> topology; inputs trail_edges: list, deviation_edges: list, loads: list, supports: list, add_auxiliary_trails: Boolean
#   port trail_edges: The COMPAS CEM trail edges to add to the diagram.
#   port deviation_edges: The COMPAS CEM deviation edges to add to the diagram.
#   port loads: The COMPAS CEM loads to add to the diagram.
#   port supports: The COMPAS CEM supports to add to the diagram.
#   port add_auxiliary_trails: Append auxiliary trails to the free nodes of the topology diagram. Defaults to False.
#   port topology: A COMPAS CEM topology diagram.
# ---------- assemble_topology_diagram: Python ----------
"""
Assemble a topology diagram.
"""
from ghpythonlib.componentbase import executingcomponent as component

from compas_cem.diagrams import TopologyDiagram


class AssembleTopologyDiagramComponent(component):
    def RunScript(self, trail_edges, deviation_edges, loads, supports, add_auxiliary_trails):

        add_auxiliary_trails = add_auxiliary_trails or False
        topology = TopologyDiagram()

        if trail_edges:
            for trail_edge in trail_edges:
                if trail_edge:
                    topology.add_edge(trail_edge)

        if deviation_edges:
            for deviation_edge in deviation_edges:
                if deviation_edge:
                    topology.add_edge(deviation_edge)

        if loads:
            for load in loads:
                if load:
                    topology.add_load(load)

        if supports:
            for support in supports:
                if support:
                    topology.add_support(support)

        if trail_edges and supports:
            topology.build_trails(add_auxiliary_trails)

        elif deviation_edges and add_auxiliary_trails:
            topology.build_trails(add_auxiliary_trails)

        return topology
# ---------- end assemble_topology_diagram ----------
topology = Data(assemble_topology_diagram)
# 04 Generate a form diagram
topology_2 = Data(topology)
formfinding = FormFinding(topology=topology_2)  # -> form; inputs tmax: Int32
#   port topology: A COMPAS CEM topology diagram.
#   port tmax: The maximum number of iterations to run the form-finding algorithm for. Defaults to 100.
#   port eps_min: The convergence threshold of the form-finding algorithm. Default to 1e-6.
#   port form: A COMPAS CEM form diagram in static equilibrium.
# ---------- formfinding: Python ----------
"""
Generate a form diagram in static equilibrium.
"""
from ghpythonlib.componentbase import executingcomponent as component

from compas_cem.equilibrium import static_equilibrium


class FormFindingComponent(component):
    def RunScript(self, topology, tmax, eta_min):
        tmax = tmax or 100
        eta_min = eta_min or 1e-6
        if topology:
            return static_equilibrium(topology, tmax=tmax, eta=eta_min)
# ---------- end formfinding ----------
form = Data(formfinding)

number_21 = Number(number_2)
number_22 = Number(number)
pt_3 = Point(point)
pt_4 = Point(point_3)
# 05 Generate a constrained form diagram via optimization
form_2 = Data(topology)
topology_3 = Data(topology)
disassemble_topology_diagram = DisassembleTopologyDiagram(topology=topology_3)  # -> node_keys, origin_node_keys, support_node_keys, edge_keys, trail_edge_keys, deviation_edge_keys, trail_keys, auxiliary_trail_keys
#   port topology: A COMPAS CEM topology diagram.
#   port node_keys: All the node keys in the topology diagram.
#   port origin_node_keys: The keys of the origin nodes in the topology diagram.
#   port support_node_keys: The keys of the support nodes in the topology diagram.
#   port edge_keys: All the edge keys in the topology diagram.
#   port trail_edge_keys: The keys of the trail edges in the topology diagram.
#   port deviation_edge_keys: The keys of the deviation edges in the topology diagram.
#   port trail_keys: The keys of the trails in the topology diagram.
#   port auxiliary_trail_keys: The keys of the auxiliary trails in the topology diagram.
# ---------- disassemble_topology_diagram: Python ----------
"""
Disassemble a topology diagram into its constituent parts.
"""
from ghpythonlib.componentbase import executingcomponent as component


class TopologyDisassemblyComponent(component):
    def RunScript(self, topology):
        if topology:
            trail_keys = list(topology.trails())
            auxiliary_trail_keys = list(topology.auxiliary_trails())

            edge_keys = list(topology.edges())
            trail_edge_keys = list(topology.trail_edges())
            deviation_edge_keys = list(topology.deviation_edges())

            node_keys = list(topology.nodes())
            origin_node_keys = list(topology.origin_nodes())
            support_node_keys = list(topology.support_nodes())

            return node_keys, origin_node_keys, support_node_keys, edge_keys, trail_edge_keys, deviation_edge_keys, trail_keys, auxiliary_trail_keys
# ---------- end disassemble_topology_diagram ----------
node_search = NodeSearch(diagram=topology_3, point=pt_3)  # -> node_key; inputs point: Point3d
#   port diagram: A COMPAS CEM topology or form diagram.
#   port point: The point to search for in the diagram.
#   port node_key: The found node key.
# ---------- node_search: Python ----------
"""
Search a node key in a topology or a form diagram using a point.
"""
from ghpythonlib.componentbase import executingcomponent as component

from compas.utilities import geometric_key
from compas_rhino.geometry import RhinoPoint


class NodeSearchComponent(component):
    def RunScript(self, diagram, point):
        if point and diagram:
            pt = RhinoPoint.from_geometry(point).to_compas()
            gkey = geometric_key(pt, diagram.tol)
            return diagram.gkey_node[gkey]
# ---------- end node_search ----------
cp = ClosestPoint(Point=pt_4, Cloud=pt_3)  # -> ClosestPoint, CPIndex, Distance
item = ListItem(List=pt_4, Index=cp.CPIndex, Wrap=True)
deviationedgeforceparameter = DeviationEdgeForceParameter(edge_key=disassemble_topology_diagram.deviation_edge_keys, bound_low=number_21, bound_up=number_21)  # -> parameter
#   port edge_key: The key of a COMPAS CEM deviation edge.
#   port bound_low: The lower bound of the edge optimization parameter. Calculated as the initial edge parameter minus the absolute value of this bound.
#   port bound_up: The upper bound of the edge optimization parameter. Calculated as the initial edge parameter plus the absolute value of this bound.
#   port parameter: A COMPAS CEM deviation edge force parameter.
# ---------- deviationedgeforceparameter: Python ----------
"""
Set the force of a deviation edge as an optimization parameter.
"""
from ghpythonlib.componentbase import executingcomponent as component

from compas_cem.optimization import DeviationEdgeParameter


class DeviationEdgeParameterComponent(component):
    def RunScript(self, edge_key, bound_low, bound_up):
        if edge_key and bound_low is not None and bound_up is not None:
            return DeviationEdgeParameter(edge_key, bound_low, bound_up)
# ---------- end deviationedgeforceparameter ----------
trailedgelengthparameter = TrailEdgeLengthParameter(edge_key=disassemble_topology_diagram.trail_edge_keys, bound_low=number_22, bound_up=number_22)  # -> parameter
#   port edge_key: The key of a COMPAS CEM trail edge.
#   port bound_low: The lower bound of the edge optimization parameter. Calculated as the initial edge parameter minus the absolute value of this bound.
#   port bound_up: The upper bound of the edge optimization parameter. Calculated as the initial edge parameter plus the absolute value of this bound.
#   port parameter: A COMPAS CEM trail edge length parameter.
# ---------- trailedgelengthparameter: Python ----------
"""
Set the length of a trail edge as an optimization parameter.
"""
from ghpythonlib.componentbase import executingcomponent as component

from compas_cem.optimization import TrailEdgeParameter


class TrailEdgeParameterComponent(component):
    def RunScript(self, edge_key, bound_low, bound_up):
        if edge_key and bound_low is not None and bound_up is not None:
            return TrailEdgeParameter(edge_key, bound_low, bound_up)
# ---------- end trailedgelengthparameter ----------
pointconstraint = PointConstraint(node_key=node_search, point=item)  # -> constraint; inputs node_key: Int32, point: Point3d
#   port node_key: The key of a COMPAS CEM node.
#   port point: The target point.
#   port weight: The weight of the constraint in the optimization problem. Defaults to one.
#   port constraint: A COMPAS CEM node point constraint.
# ---------- pointconstraint: Python ----------
"""
Pull the position of a node to a target point.
"""
from ghpythonlib.componentbase import executingcomponent as component

from compas_cem.optimization import PointConstraint
from compas_rhino.geometry import RhinoPoint


class PointConstraintComponent(component):
    def RunScript(self, node_key, point, weight):
        weight = weight or 1.0
        if node_key is not None and point:
            point = RhinoPoint.from_geometry(point).to_compas()
            return PointConstraint(node_key, point, weight)
# ---------- end pointconstraint ----------
constrained_form_finding = ConstrainedFormFinding(topology=form_2, constraints=pointconstraint, parameters=[trailedgelengthparameter, deviationedgeforceparameter])  # -> form, objective, grad_norm, iters, time, status; inputs constraints: list, parameters: list, iters_max: Int32, tmax: Int32
#   port topology: A COMPAS CEM topology diagram.
#   port constraints: A list of COMPAS CEM optimization constraints.
#   port parameters: A list of COMPAS CEM optimization parameters.
#   port algorithm: The name of the gradient-based local optimization algorithm to use. Defaults to SLSQP. Currently supported algorithms are: - SLSQP: Sequential Least Squares Programming - LBFGS: Low-Storage Broyden-Fletcher-Goldfarb-Shanno - AUGLAG: Augmented Lagrangian - MMA: Method of Moving Asymptotes - TNEWTON: Preconditioned Truncated Newton
#   port iters_max: The maximum number of iterations to run the optimization algorithm for. Defaults to 100.
#   port eps: The minimum objective or norm of the gradient value to declare convergence. Defaults to 1e-6.
#   port tmax: The maximum number of iterations to run the form-finding algorithm for. Defaults to 100.
#   port eta: The convergence threshold of the form-finding algorithm. Defaults to 1e-6.
#   port form: A COMPAS CEM form diagram in static equilibrium.
#   port objective: The resulting output value of the objective function.
#   port grad_norm: The norm of the gradient of the objective function.
#   port iters: The elapsed number of optimization iterations.
#   port time: The optimization elapsed time.
#   port status: The final status of the optimization process.
# ---------- constrained_form_finding: Python ----------
"""
Generate a form diagram in static equilibrium.
"""
from ghpythonlib.componentbase import executingcomponent as component

from compas_cem import PROXY_PORT

from compas.rpc import Proxy


class ConstrainedFormFindingComponent(component):
    def RunScript(self, topology, constraints, parameters, algorithm, iters_max, eps, tmax, eta):
        algorithm = algorithm or "SLSQP"
        iters_max = iters_max or 100
        eps = eps or 1e-6
        tmax = tmax or 100
        eta = eta or 1e-6

        if topology and constraints and parameters:
            topology = topology.copy()

            # clean constraints and parameters from None
            constraints = [c for c in constraints if c is not None]
            parameters = [p for p in parameters if p is not None]

            with Proxy("compas_cem.optimization", port=PROXY_PORT) as opt:
                solution = opt.solve_nlopt_proxy(topology,
                                                 constraints,
                                                 parameters,
                                                 algorithm,
                                                 iters_max,
                                                 eps,
                                                 tmax,
                                                 eta)

            form, objective, grad_norm, iters, time, status = solution
            return form, objective, grad_norm, iters, time, status
# ---------- end constrained_form_finding ----------
panel = Panel(constrained_form_finding.grad_norm)
panel_2 = Panel(constrained_form_finding.iters)
panel_3 = Panel(constrained_form_finding.objective)
panel_4 = Panel(constrained_form_finding.time)
panel_5 = Panel(constrained_form_finding.status)
data = Data(constrained_form_finding.form)

forces_scale = Slider(1, range=0..1)
dash_length = Slider(0.1, range=0..0.1)
# 03-B Display topology diagram
sphere_radius = Slider(0.49, range=0..1)
forces_min = Slider(0.001, range=0..0.001)
number_23 = Number(forces_scale)
number_24 = Number(sphere_radius)
number_25 = Number(dash_length)
number_26 = Number(forces_min)

topology_4 = Data(topology)

topology_5 = Data(topology_4)
topology_artist = TopologyArtist(topology=topology_5)  # -> nodes, origin_nodes, support_nodes, edges, trail_edges, deviation_edges, trails, loads; inputs node_keys: list of Int32, edge_keys: list
#   port topology: A COMPAS CEM topology diagram.
#   port node_keys: A selection of the node keys in the diagram. Defaults to all the node keys.
#   port edge_keys: A selection of the edge keys in the diagram. Defaults to all the edge keys.
#   port force_min: The minimum force magnitude to plot. Defaults to 1e-3.
#   port force_scale: The scaling factor of the loads. Defaults to 1.
#   port nodes: The nodes in the diagram as points.
#   port origin_nodes: The origin nodes in the diagram as points.
#   port support_nodes: The support nodes in the diagram as points.
#   port edges: The edges in the diagram as lines.
#   port trail_edges: The trail edges in the diagram as lines.
#   port deviation_edges: The deviation edges in the diagram as lines.
#   port trails: The trails in the diagram as polylines.
#   port loads: The applied node loads as lines.
# ---------- topology_artist: Python ----------
"""
Draw a topology diagram.
"""
from ghpythonlib.componentbase import executingcomponent as component

from compas_cem.ghpython import TopologyArtist


class TopologyArtistComponent(component):
    def RunScript(self, topology, node_keys, edge_keys, force_min, force_scale):
        node_keys = node_keys or None
        edge_keys = edge_keys or None
        force_min = force_min or 1e-3
        force_scale = force_scale or 1.0
        if topology:
            artist = TopologyArtist(topology)

            nodes = artist.draw_nodes(node_keys)
            origin_nodes = artist.draw_nodes_origin(node_keys)
            support_nodes = artist.draw_nodes_support(node_keys)

            edges = artist.draw_edges(edge_keys)
            trail_edges = artist.draw_edges_trail(edge_keys)
            deviation_edges = artist.draw_edges_deviation(edge_keys)

            trails = artist.draw_trails()

            loads = artist.draw_loads(node_keys, min_load=force_min, scale=force_scale)

            return nodes, origin_nodes, support_nodes, edges, trail_edges, deviation_edges, trails, loads
# ---------- end topology_artist ----------
disassemble_topology_diagram_2 = DisassembleTopologyDiagram(topology=topology_5)  # -> node_keys, origin_node_keys, support_node_keys, edge_keys, trail_edge_keys, deviation_edge_keys, trail_keys, auxiliary_trail_keys; same code as disassemble_topology_diagram
curve_middle = CurveMiddle(Curve=topology_artist.edges)

topology_6 = Data(topology_4)
number_27 = Number(number_25)
cem_colors = CEMColors()  # -> color_tension, color_compression, color_edge, color_node, color_node_support, color_node_origin, color_load, color_reaction, color_trail, color_auxiliary_trail
#   port color_tension: The color for edges under a tension force.
#   port color_compression: The color for edges under a compression force.
#   port color_edge: The color for a regular edge.
#   port color_node: The color for a regular node.
#   port color_node_support: The color for a support node.
#   port color_node_origin: The color for an origin node.
#   port color_load: The color for an applied load.
#   port color_reaction: The color for a reaction force.
#   port color_trail: The color to paint a trail.
#   port color_auxiliary_trail: The color to paint an auxiliary trail.
# ---------- cem_colors: Python ----------
"""
Get the artists color scheme for the objects of the CEM framework.
"""
from ghpythonlib.componentbase import executingcomponent as component

from compas_cem import COLORS
import rhinoscriptsyntax as rs


class ArtistColorsComponent(component):
    def RunScript(self):
        colors = {key: rs.CreateColor(c) for key, c in COLORS.items()}

        color_tension = colors["tension"]
        color_compression = colors["compression"]
        color_edge = colors["edge"]
        color_node = colors["node"]
        color_node_support = colors["node_support"]
        color_node_origin = colors["node_origin"]
        color_load = colors["load"]
        color_reaction = colors["support_force"]
        color_trail = colors["trail"]
        color_auxiliary_trail = colors["auxiliary_trail"]

        colors = (color_tension, color_compression, color_edge, color_node, color_node_support, color_node_origin, color_load, color_reaction, color_trail, color_auxiliary_trail)

        return colors
# ---------- end cem_colors ----------
disassemble_topology_diagram_3 = DisassembleTopologyDiagram(topology=topology_6)  # -> node_keys, origin_node_keys, support_node_keys, edge_keys, trail_edge_keys, deviation_edge_keys, trail_keys, auxiliary_trail_keys; same code as disassemble_topology_diagram
python = GhPythonScript(
    trail=disassemble_topology_diagram_3.trail_edge_keys,
    auxiliary_trail=disassemble_topology_diagram_3.auxiliary_trail_keys)  # -> out, trail; inputs trail: list, auxiliary_trail: list
# ---------- python: Python ----------
trail = [tr for tr in trail if tr not in auxiliary_trail]
# ---------- end python ----------
python_2 = GhPythonScript(topology=topology_6, auxiliary_trail=disassemble_topology_diagram_3.auxiliary_trail_keys)  # -> out, auxiliary_trail; inputs auxiliary_trail: list
# ---------- python_2: Python ----------
from compas_cem.ghpython import TopologyArtist


if auxiliary_trail is not None:
    artist = TopologyArtist(topology)
   
    if auxiliary_trail is not None:
        auxiliary_trail = artist.draw_edges_trail(auxiliary_trail)
# ---------- end python_2 ----------
topology_artist_2 = TopologyArtist(topology=topology_6, edge_keys=python.trail)  # -> nodes, origin_nodes, support_nodes, edges, trail_edges, deviation_edges, trails, loads; inputs node_keys: list of Int32, edge_keys: list; same code as topology_artist
topology_artist_3 = TopologyArtist(topology=topology_6)  # -> nodes, origin_nodes, support_nodes, edges, trail_edges, deviation_edges, trails, loads; inputs node_keys: list of Int32, edge_keys: list; same code as topology_artist
edge_results = EdgeResults(form=topology_6, edge_keys=python.trail)  # -> lengths, forces; inputs edge_keys: list
#   port form: A COMPAS CEM form diagram.
#   port edge_keys: A selection of edge keys to query the results on. Defaults to all the edge keys.
#   port lengths: The edge lengths.
#   port forces: The edge forces.
# ---------- edge_results: Python ----------
"""
Extract the post form-finding results of the edges in a form diagram.
"""
from ghpythonlib.componentbase import executingcomponent as component


class EdgeResultsComponent(component):
    def RunScript(self, form, edge_keys):
        if form:
            edge_keys = edge_keys or list(form.edges())
            lengths = [form.edge_length_2(ed) for ed in edge_keys]
            forces = [form.edge_force(ed) for ed in edge_keys]
            return lengths, forces
# ---------- end edge_results ----------
edge_results_2 = EdgeResults(form=topology_6, edge_keys=disassemble_topology_diagram_3.deviation_edge_keys)  # -> lengths, forces; inputs edge_keys: list; same code as edge_results
merge = Merge(Data1=cem_colors.color_compression, Data2=cem_colors.color_tension)
larger = LargerThan(FirstNumber=edge_results_2.forces, SecondNumber=0)  # -> LargerThan, OrEqualTo
larger_2 = LargerThan(FirstNumber=edge_results.lengths, SecondNumber=0)  # -> LargerThan, OrEqualTo
list_item = ListItem(List=merge, Index=larger.OrEqualTo, Wrap=True)
list_item_2 = ListItem(List=merge, Index=larger_2.OrEqualTo, Wrap=True)
dash_pattern = DashPattern(Curve=topology_artist_3.deviation_edges, Pattern=number_27)  # -> Dashes, Gaps

number_28 = Number(number_24)
topology_7 = Data(topology_4)
cem_colors_2 = CEMColors()  # -> color_tension, color_compression, color_edge, color_node, color_node_support, color_node_origin, color_load, color_reaction, color_trail, color_auxiliary_trail; same code as cem_colors
topology_artist_4 = TopologyArtist(topology=topology_7)  # -> nodes, origin_nodes, support_nodes, edges, trail_edges, deviation_edges, trails, loads; inputs node_keys: list of Int32, edge_keys: list; same code as topology_artist
sphere = Sphere(Base=topology_artist_4.support_nodes, Radius=number_28)
sphere_2 = Sphere(Base=topology_artist_4.origin_nodes, Radius=number_28)

topology_8 = Data(topology_4)

topology_9 = Data(topology_4)
number_29 = Number(number_26)
number_30 = Number(number_23)
topology_artist_5 = TopologyArtist(topology=topology_9, force_min=number_29, force_scale=number_30)  # -> nodes, origin_nodes, support_nodes, edges, trail_edges, deviation_edges, trails, loads; inputs node_keys: list of Int32, edge_keys: list; same code as topology_artist
cem_colors_3 = CEMColors()  # -> color_tension, color_compression, color_edge, color_node, color_node_support, color_node_origin, color_load, color_reaction, color_trail, color_auxiliary_trail; same code as cem_colors
cluster_3 = Cluster_2(curve=topology_artist_5.loads)  # -> vector, geometry
vector_length = VectorLength(Vector=cluster_3.vector)
unit_vector = UnitVector(Vector=cluster_3.vector)
multiplication_5 = Multiplication(A=unit_vector, B=vector_length)
move = Move(Geometry=cluster_3.geometry, Motion=multiplication_5)  # -> Geometry, Transform

disassemble_topology_diagram_4 = DisassembleTopologyDiagram(topology=topology_8)  # -> node_keys, origin_node_keys, support_node_keys, edge_keys, trail_edge_keys, deviation_edge_keys, trail_keys, auxiliary_trail_keys; same code as disassemble_topology_diagram
python_3 = GhPythonScript(
    trail=disassemble_topology_diagram_4.trail_edge_keys,
    auxiliary_trail=disassemble_topology_diagram_4.auxiliary_trail_keys)  # -> out, trail; inputs trail: list, auxiliary_trail: list; same code as python
entwine = Entwine(Branch00=python_3.trail, Branch01=disassemble_topology_diagram_4.deviation_edge_keys, FlattenInputs=True)
topology_artist_6 = TopologyArtist(topology=topology_8, edge_keys=entwine)  # -> nodes, origin_nodes, support_nodes, edges, trail_edges, deviation_edges, trails, loads; inputs node_keys: list of Int32, edge_keys: list; same code as topology_artist
edge_results_3 = EdgeResults(form=topology_8, edge_keys=python_3.trail)  # -> lengths, forces; inputs edge_keys: list; same code as edge_results
edge_results_4 = EdgeResults(form=topology_8, edge_keys=disassemble_topology_diagram_4.deviation_edge_keys)  # -> lengths, forces; inputs edge_keys: list; same code as edge_results
curve_middle_2 = CurveMiddle(Curve=topology_artist_6.edges)
merge_2 = Merge(Data1=edge_results_3.lengths, Data2=edge_results_4.forces)  # -> flatten(Result)

# ---- group: Edges design parameters
text_tag = TextTag(Location=flatten(curve_middle_2), Text=merge_2, Colour=ColourSwatch(SwatchColor=RGBA(156, 156, 156, 195)))

# ---- group: Node keys
text_tag_2 = TextTag(
    Location=topology_artist.nodes,
    Text=disassemble_topology_diagram_2.node_keys,
    Colour=ColourSwatch(SwatchColor=RGBA(156, 156, 156, 195)))

# ---- group: Edge keys
text_tag_3 = TextTag(
    Location=curve_middle,
    Text=disassemble_topology_diagram_2.edge_keys,
    Colour=ColourSwatch(SwatchColor=RGBA(156, 156, 156, 195)))

# ---- group: Deviation edges
custom_preview = CustomPreview(Geometry=dash_pattern.Dashes, Material=graft(list_item))

# ---- group: Trail edges
custom_preview_2 = CustomPreview(Geometry=topology_artist_2.trail_edges, Material=list_item_2)

# ---- group: Trails
custom_preview_3 = CustomPreview(Geometry=topology_artist_3.trails, Material=cem_colors.color_trail)

# ---- group: Auxiliary Trails
custom_preview_4 = CustomPreview(Geometry=python_2.auxiliary_trail, Material=cem_colors.color_auxiliary_trail)

# ---- group: Support nodes
custom_preview_5 = CustomPreview(Geometry=sphere, Material=cem_colors_2.color_node_support)

# ---- group: Origin nodes
custom_preview_6 = CustomPreview(Geometry=sphere_2, Material=cem_colors_2.color_node_origin)

# ---- group: Loads
vector_display_ex = VectorDisplayEx(Point=cluster_3.geometry, Vector=cluster_3.vector, Colour=cem_colors_3.color_load, Width=2)

# ----
edge_result_to_display = ValueList({"Forces": 0, "Lengths": 1}, selected="Forces")
edge_thickness_factor = Slider(0.5, range=0..10)
forces_min_2 = Slider(0.001, range=0..0.001)
forces_scale_2 = Slider(1, range=0..1)
number_31 = Number(edge_thickness_factor)
integer = Integer(edge_result_to_display)
number_32 = Number(forces_min_2)
number_33 = Number(forces_scale_2)

# ---- group: Select what form diagram to display
# 03-A Display form diagram
what_to_display = ValueList({"Form": 0, "Constrained Form": 1}, selected="Constrained Form")
constrained_form = Data(data)
form_3 = Data(form)
filter = StreamFilter(Gate=what_to_display, Stream0=form_3, Stream1=constrained_form)
form_4 = Data(filter)

# ----
form_5 = Data(form_4)

form_6 = Data(form_5)
form_artist = FormArtist(form=form_6)  # -> nodes, support_nodes, edges, loads, reactions; inputs node_keys: list of Int32, edge_keys: list
#   port form: A COMPAS CEM topology diagram.
#   port node_keys: A selection of the node keys in the diagram. Defaults to all the node keys.
#   port edge_keys: A selection of the edge keys in the diagram. Defaults to all the edge keys.
#   port force_min: The smallest force magnitude to draw. Defaults to 1e-3
#   port force_scale: The scale of the loads and the reactions. Defaults to 1.
#   port nodes: The nodes of the diagram as points.
#   port support_nodes: The support nodes of the diagram as points
#   port edges: The edges of the diagram as lines.
#   port loads: The applied loads as lines.
#   port reactions: The reaction forces at the supports, as lines.
# ---------- form_artist: Python ----------
"""
Draw a form diagram.
"""
from ghpythonlib.componentbase import executingcomponent as component

from compas_cem.ghpython import FormArtist


class FormArtistComponent(component):
    def RunScript(self, form, node_keys, edge_keys, force_min, force_scale):
        node_keys = node_keys or None
        edge_keys = edge_keys or None
        force_min = force_min or 1e-3
        force_scale = force_scale or 1
        if form:
            artist = FormArtist(form)

            nodes = artist.draw_nodes(node_keys)
            edges = artist.draw_edges(edge_keys)
            support_nodes = artist.draw_nodes_support(node_keys)

            loads = artist.draw_loads(node_keys, min_load=force_min, scale=force_scale)
            reactions = artist.draw_reactions(node_keys, min_force=force_min, scale=force_scale)

            return nodes, support_nodes, edges, loads, reactions
# ---------- end form_artist ----------
control_points = ControlPoints(Curve=form_artist.edges)  # -> Points, Weights, Knots
deconstruct = Deconstruct(Point=flatten(control_points.Points))  # -> XComponent, YComponent, ZComponent
sort_list = SortList(Keys=deconstruct.ZComponent)  # -> Keys, ValuesValuesA
list_item_3 = ListItem(List=sort_list.Keys, Index=0, Wrap=True)
construct_point = ConstructPoint(XCoordinate=0, YCoordinate=0, ZCoordinate=list_item_3)
xy_plane = XYPlane(Origin=construct_point)
project = Project(Geometry=form_artist.edges, Plane=xy_plane)  # -> Geometry, Transform

form_7 = Data(form_5)
integer_2 = Integer(integer)
form_artist_2 = FormArtist(form=form_7)  # -> nodes, support_nodes, edges, loads, reactions; inputs node: list of Int32, edge: list
#   port form: A COMPAS CEM topology diagram.
#   port node: A selection of the nodes in the diagram. Defaults to all the nodes.
#   port edge: A selection of the edges in the diagram. Defaults to all the edges.
#   port force_min: The smallest force magnitude to draw. Defaults to 1e-3
#   port force_scale: The scale of the loads and the reactions. Defaults to 1.
#   port nodes: The nodes of the diagram as points.
#   port support_nodes: The support nodes of the diagram as points
#   port edges: The edges of the diagram as lines.
#   port loads: The applied loads as lines.
#   port reactions: The reaction forces at the supports, as lines.
# ---------- form_artist_2: Python ----------
"""
Draw a form diagram.
"""
from ghpythonlib.componentbase import executingcomponent as component

from compas_cem.ghpython import FormArtist


class FormArtistComponent(component):
    def RunScript(self, form, node, edge, force_min, force_scale):
        node = node or None
        edge = edge or None
        force_min = force_min or 1e-3
        force_scale = force_scale or 1
        if form:
            artist = FormArtist(form)

            nodes = artist.draw_nodes(node)
            edges = artist.draw_edges(edge)
            support_nodes = artist.draw_nodes_support(node)

            loads = artist.draw_loads(node, min_load=force_min, scale=force_scale)
            reactions = artist.draw_reactions(node, min_force=force_min, scale=force_scale)

            return nodes, support_nodes, edges, loads, reactions
# ---------- end form_artist_2 ----------
edgeresults = EdgeResults(form=form_7)  # -> length, force; inputs edge: list
#   port form: A COMPAS CEM form diagram.
#   port edge: A selection of edge keys to query the results on. Defaults to all the edges.
#   port length: The edge lengths.
#   port force: The edge forces.
# ---------- edgeresults: Python ----------
"""
Extract the post form-finding results of the edges in a form diagram.
"""
from ghpythonlib.componentbase import executingcomponent as component


class EdgeResultsComponent(component):
    def RunScript(self, form, edge):
        if form:
            edge = edge or list(form.edges())
            length = [form.edge_length_2(ed) for ed in edge]
            force = [form.edge_force(ed) for ed in edge]
            return length, force
# ---------- end edgeresults ----------
curve_middle_3 = CurveMiddle(Curve=form_artist_2.edges)
stream_filter = StreamFilter(Gate=integer_2, Stream0=edgeresults.force, Stream1=edgeresults.length)
ghpython_script = GhPythonScript(x=stream_filter)  # -> out, a
# ---------- ghpython_script: Python ----------
a = round(x, 3)
# ---------- end ghpython_script ----------

form_8 = Data(form_5)
disassemble_form_diagram = DisassembleFormDiagram(form=form_8)  # -> node_keys, support_node_keys, edge_keys
#   port form: A COMPAS CEM form diagram.
#   port node_keys: All the node keys in the form diagram.
#   port support_node_keys: The keys of the support nodes in the form diagram.
#   port edge_keys: All the edge keys in the form diagram.
# ---------- disassemble_form_diagram: Python ----------
"""
Disassemble a form diagram into its constituent parts.
"""
from ghpythonlib.componentbase import executingcomponent as component


class FormDisassemblyComponent(component):
    def RunScript(self, form):
        if form:
            edge_keys = list(form.edges())
            node_keys = list(form.nodes())
            support_node_keys = list(form.support_nodes())

            return node_keys, support_node_keys, edge_keys
# ---------- end disassemble_form_diagram ----------
form_artist_3 = FormArtist(form=form_8)  # -> nodes, support_nodes, edges, loads, reactions; inputs node_keys: list of Int32, edge_keys: list; same code as form_artist
curve_middle_4 = CurveMiddle(Curve=form_artist_3.edges)

number_34 = Number(number_32)
number_35 = Number(number_33)
form_9 = Data(form_5)
form_artist_4 = FormArtist(form=form_9, force_min=number_34, force_scale=number_35)  # -> nodes, support_nodes, edges, loads, reactions; inputs node_keys: list of Int32, edge_keys: list; same code as form_artist
cem_colors_4 = CEMColors()  # -> color_tension, color_compression, color_edge, color_node, color_node_support, color_node_origin, color_load, color_reaction, color_trail, color_auxiliary_trail; same code as cem_colors
cluster_4 = Cluster_2(curve=form_artist_4.loads)  # -> vector, geometry
unit_vector_2 = UnitVector(Vector=cluster_4.vector)
vector_length_2 = VectorLength(Vector=cluster_4.vector)
multiplication_6 = Multiplication(A=unit_vector_2, B=vector_length_2)
move_2 = Move(Geometry=cluster_4.geometry, Motion=multiplication_6)  # -> Geometry, Transform

form_10 = Data(form_5)
number_36 = Number(number_32)
number_37 = Number(number_33)
form_artist_5 = FormArtist(form=form_10, force_min=number_36, force_scale=number_37)  # -> nodes, support_nodes, edges, loads, reactions; inputs node_keys: list of Int32, edge_keys: list; same code as form_artist
cem_colors_5 = CEMColors()  # -> color_tension, color_compression, color_edge, color_node, color_node_support, color_node_origin, color_load, color_reaction, color_trail, color_auxiliary_trail; same code as cem_colors
cluster_5 = Cluster_2(curve=form_artist_5.reactions)  # -> vector, geometry
vector_length_3 = VectorLength(Vector=cluster_5.vector)
unit_vector_3 = UnitVector(Vector=cluster_5.vector)
multiplication_7 = Multiplication(A=unit_vector_3, B=vector_length_3)
move_3 = Move(Geometry=cluster_5.geometry, Motion=multiplication_7)  # -> Geometry, Transform
vector_display_ex_2 = VectorDisplayEx(Point=move_3.Geometry, Vector=cluster_5.vector, Colour=cem_colors_5.color_reaction, Width=2)

form_11 = Data(form_5)
number_38 = Number(number_31)
form_artist_6 = FormArtist(form=form_11)  # -> nodes, support_nodes, edges, loads, reactions; inputs node_keys: list of Int32, edge_keys: list; same code as form_artist
cem_colors_6 = CEMColors()  # -> color_tension, color_compression, color_edge, color_node, color_node_support, color_node_origin, color_load, color_reaction, color_trail, color_auxiliary_trail; same code as cem_colors
edgeresults_2 = EdgeResults(form=form_11)  # -> length, force; inputs edge: list; same code as edgeresults
merge_3 = Merge(Data1=cem_colors_6.color_compression, Data2=cem_colors_6.color_tension)
larger_than = LargerThan(FirstNumber=edgeresults_2.force, SecondNumber=0)  # -> LargerThan, OrEqualTo
absolute = Absolute(Value=edgeresults_2.force)
list_item_4 = ListItem(List=merge_3, Index=larger_than.OrEqualTo, Wrap=True)
multiplication_8 = Multiplication(A=absolute, B=number_38)

colour_swatch = ColourSwatch(SwatchColor=RGBA(156, 156, 156, 195))

custom_preview_lineweights = CustomPreviewLineweights(Geometry=project.Geometry, Shader=ColourSwatch(SwatchColor=RGB(102, 102, 102)), Thickness="0.5", Absolute=False)

# ---- group: Node keys
text_tag_4 = TextTag(Location=form_artist_3.nodes, Text=disassemble_form_diagram.node_keys, Colour=colour_swatch)

# ---- group: Edge keys
text_tag_5 = TextTag(Location=curve_middle_4, Text=disassemble_form_diagram.edge_keys, Colour=colour_swatch)

# ---- group: Edge results
text_tag_6 = TextTag(Location=curve_middle_3, Text=ghpython_script.a, Colour=ColourSwatch(SwatchColor=RGBA(94, 94, 94, 195)))

# ---- group: Edges
custom_preview_lineweights_2 = CustomPreviewLineweights(Geometry=form_artist_6.edges, Shader=list_item_4, Thickness=multiplication_8, Absolute=False)

# ---- group: Loads
vector_display_ex_3 = VectorDisplayEx(Point=move_2.Geometry, Vector=cluster_4.vector, Colour=cem_colors_4.color_load, Width=2)

# ==== cluster Cluster
curve = ClusterInput()
curve_2 = ClusterInput()
curve_3 = Curve(curve)
curve_4 = Curve(curve_2)
graft_tree = GraftTree(Tree=curve_3, IncludeEmptyLists=True, IncludeNullItems=True)
curve_curve = CurveCurve(CurveA=graft_tree, CurveB=curve_4)  # -> Points, ParamsA, ParamsB
trim_tree = TrimTree(Tree=curve_curve.ParamsA, Depth=1)
shatter = Shatter(Curve=graft_tree, Parameters=trim_tree)
end = EndPoints(Curve=shatter)  # -> Start, End
ln = Line(StartPoint=end.Start, EndPoint=end.End)  # -> flatten(Line)
curve_5 = Curve(ln)
curve_6 = ClusterOutput(curve_5)

# ==== cluster Cluster_2
curve = ClusterInput()
end_points = EndPoints(Curve=curve)  # -> Start, End
vector_2pt = Vector2Pt(PointA=end_points.Start, PointB=end_points.End, Unitize=False)  # -> Vector, Length
reverse = Reverse(Vector=vector_2pt.Vector)
vector = ClusterOutput(vector_2pt.Vector)
move = Move(Geometry=end_points.Start, Motion=reverse)  # -> Geometry, Transform
geometry = ClusterOutput(move.Geometry)
