# Grasshopper definition 06_bridge_3d.ghx (Grasshopper 1.0.7)
# plug-ins: Human

# ---- group: origin nodes - positions
pt = Point(Point(8.492773445, 430.7839151, -6.8))
pt_2 = Point([Point(4.092773445, 427.7339151, 2.9), Point(4.092773445, 433.8339151, 2.9), Point(12.89277345, 433.8339151, 2.9), Point(12.89277345, 427.7339151, 2.9)])
pt_3 = Point(Point(-70.00722655, 430.7839151, 0.6))
pt_4 = Point(Point(62.09277345, 430.7839151, 0))
pt_5 = Point([Point(4.687773445, 430.7839151, 8.1), Point(12.29777345, 430.7839151, 8.1)])

panel = Panel("""0
2
18
20
22
24
54
56
58""")
entwine = Entwine(Branch00=pt_5, Branch01=pt_2, Branch02=pt_3, Branch03=pt_4, Branch04=pt, FlattenInputs=True)
flatten = FlattenTree(Tree=entwine, Path="{0}")
Y = UnitY(Factor="-350")
move = Move(Geometry=flatten, Motion=Y)  # -> Geometry, Transform
int = Integer(panel)
pt_6 = Point(move.Geometry)

# ----
# Bridge Deck
# Auxiliary Structure
# Pylon Wipkingen
# Pylon Sihlquai
# Pylon Letten
# Lateral
# Hangers
trail_edges_pylon_letten = Curve(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)
deviation_edge_pylon_letten = Curve([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])
dev2_hangers = Curve([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])
trail_edges_pylon_sihlquai = Curve(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)
deviation_edge_pylon_sihlquai = Curve([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])
dev1_lateral = Curve([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])
trail_edges_pylon_wipkingen = Curve(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)
deviation_edges_pylon_wipkingen = Curve([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])
trail_edges_auxiliary = Curve([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])
deviation_edge_d_51_and_d_52 = Curve([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])
trail_edges_deck = Curve([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])
deviation_edge_d_53 = Curve(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)

# ---- group: loads
pt_7 = Point([Point(7.886426961, 56.59985935, 0), Point(5.886426961, 56.59985935, 0), Point(3.886426961, 56.59985935, 0), Point(1.886426961, 56.59985935, 0), Point(-0.1135730391, 56.59985935, 0), Point(-2.113573039, 56.59985935, 0), Point(-4.113573039, 56.59985935, 0), Point(8.886426961, 56.59985935, 0), Point(10.88642696, 56.59985935, 0), Point(12.88642696, 56.59985935, 0), Point(14.88642696, 56.59985935, 0), Point(16.88642696, 56.59985935, 0), Point(18.88642696, 56.59985935, 0), Point(20.88642696, 56.59985935, 0)])

# ---- group: supports
pt_8 = Point([Point(24.88642696, 56.59985935, 0), Point(25.38642696, 55.35104777, 0), Point(25.38642696, 53.89392697, 0), Point(-8.113573039, 56.59985935, 0), Point(-8.613573039, 55.35104777, 0), Point(-8.613573039, 53.89392697, 0), Point(-5.480277211, 52.99002215, 0), Point(8.386426961, 52.99002215, 0), Point(22.25313113, 52.99002215, 0)])

# ----
vec = VectorXYZ(XComponent="0.0", YComponent="0.0", ZComponent=Slider(-1.5, range=-10..0))  # -> Vector, Length
vec_2 = Vector(vec.Vector)

length_trail_edges_t_32_to_t_47 = Slider(7.61, range=1.5..15)
force_deviation_edge_d_53 = Slider(14, range=0..20)
length_trail_edges_deck_t_0_to_t_29 = Slider(-7.34, range=-15..15)
length_trail_edges_deck_t_0_to_t_29_2 = Slider(-1.5, range=-15..15)
force_deviation_edge_d_51_and_d_52 = Slider(-20, range=-20..20)
trail = Slider(-1, range=-15..15)
force_deviation_edges_pylon_wipkingen = Slider(0, range=0..20)
trail_2 = Slider(-1, range=-15..15)
force_deviation_edges_pylon_sihlquai = Slider(0, range=0..20)
trail_3 = Slider(-1, range=-15..15)
force_deviation_edge_pylon_letten = Slider(-2.7, range=-20..20)
force_dev1_lateral = Slider(1.2, range=0..2)
force_dev2_hangers = Slider(-1.3, range=-2..2)
num = Number(length_trail_edges_t_32_to_t_47)
num_2 = Number(force_deviation_edge_d_53)
num_3 = Number(length_trail_edges_deck_t_0_to_t_29)
num_4 = Number(length_trail_edges_deck_t_0_to_t_29_2)
num_5 = Number(force_deviation_edge_d_51_and_d_52)
num_6 = Number(trail)
num_7 = Number(force_deviation_edges_pylon_wipkingen)
num_8 = Number(trail_2)
num_9 = Number(force_deviation_edges_pylon_sihlquai)
num_10 = Number(force_deviation_edge_pylon_letten)
num_11 = Number(force_dev1_lateral)
num_12 = Number(force_dev2_hangers)
num_13 = Number(trail_3)

json_filepath = Panel("/Users/arpj/code/libraries/compas_cem/data/json/w2_cem_3d_bridge_rhino.json")
export_json = BooleanToggle(False)
bool = Boolean(export_json)
txt = Text(json_filepath)

num_14 = Number(num_3)
crv = Curve(trail_edges_auxiliary)
num_15 = Number(num_4)
lng = ListLength(List=crv)
subtraction = Subtraction(A=lng, B="4")
dup = DuplicateData(Data=num_15, Number="4", Order=True)
dup_2 = DuplicateData(Data=num_14, Number=subtraction, Order=True)
merge = Merge(Data1=dup_2, Data2=dup)
num_16 = Number(merge)

crv_2 = Curve(flatten(deviation_edge_d_53))
num_17 = Number(num)
num_18 = Number(num_2)
crv_3 = Curve(trail_edges_deck)
deviationedge = DeviationEdge(line=crv_2, force=num_18)  # -> deviation_edge; inputs line: Line
#   port line: A line that defines the end nodes of the edge.
#   port force: The desired force on the edge. If negative, the edge is in compression. Otherwise, it is in tension.
#   port deviation_edge: A COMPAS CEM deviation edge.
# ---------- deviationedge: Python ----------
"""
Create a deviation edge from a rhino line.
"""
from ghpythonlib.componentbase import executingcomponent as component

from compas_cem.elements import DeviationEdge


class DeviationEdgeComponent(component):
    def RunScript(self, line, force):
        if line and force:
            return DeviationEdge.from_rhino_line(line, force)
# ---------- end deviationedge ----------
trailedge = TrailEdge(line=crv_3, length=num_17)  # -> trail_edge; inputs line: Line
#   port line: A line that defines the end nodes of the edge.
#   port length: The desired length of the edge. If negative, the edge is in compression. Otherwise, it is in tension.
#   port trail_edge: A COMPAS CEM trail edge.
# ---------- trailedge: Python ----------
"""
Create a trail edge from a rhino line.
"""
from ghpythonlib.componentbase import executingcomponent as component

from compas_cem.elements import TrailEdge


class TrailEdgeComponent(component):
    def RunScript(self, line, length):
        if line and length:
            return TrailEdge.from_rhino_line(line, length)
# ---------- end trailedge ----------
data = Data(deviationedge)
data_2 = Data(trailedge)

crv_4 = Curve(flatten(deviation_edge_d_51_and_d_52))
num_19 = Number(num_16)
crv_5 = Curve(trail_edges_auxiliary)
num_20 = Number(num_5)
deviationedge_2 = DeviationEdge(line=crv_4, force=num_20)  # -> deviation_edge; inputs line: Line; same code as deviationedge
trailedge_2 = TrailEdge(line=crv_5, length=num_19)  # -> trail_edge; inputs line: Line; same code as trailedge
data_3 = Data(trailedge_2)
data_4 = Data(deviationedge_2)

crv_6 = Curve(flatten(deviation_edges_pylon_wipkingen))
num_21 = Number(num_6)
num_22 = Number(num_7)
crv_7 = Curve(trail_edges_pylon_wipkingen)
deviationedge_3 = DeviationEdge(line=crv_6, force=num_22)  # -> deviation_edge; inputs line: Line
#   port line: A line that defines the end nodes of the edge.
#   port force: The desired force on the edge. If negative, the edge is in compression. Otherwise, it is in tension.
#   port deviation_edge: A COMPAS CEM deviation edge.
# ---------- deviationedge_3: Python ----------
"""
Create a deviation edge from a rhino line.
"""
from ghpythonlib.componentbase import executingcomponent as component

from compas_cem.elements import DeviationEdge


class DeviationEdgeComponent(component):
    def RunScript(self, line, force):
        if line and force is not None:
            return DeviationEdge.from_rhino_line(line, force)
# ---------- end deviationedge_3 ----------
trailedge_3 = TrailEdge(line=crv_7, length=num_21)  # -> trail_edge; inputs line: Line; same code as trailedge
data_5 = Data(trailedge_3)
data_6 = Data(deviationedge_3)

crv_8 = Curve(flatten(deviation_edge_pylon_letten))
num_23 = Number(num_13)
crv_9 = Curve(trail_edges_pylon_letten)
num_24 = Number(num_10)
deviationedge_4 = DeviationEdge(line=crv_8, force=num_24)  # -> deviation_edge; inputs line: Line; same code as deviationedge
trailedge_4 = TrailEdge(line=crv_9, length=num_23)  # -> trail_edge; inputs line: Line
#   port line: A line that defines the end nodes of the edge.
#   port length: The desired length of the edge. If negative, the edge is in compression. Otherwise, it is in tension.
#   port trail_edge: A COMPAS CEM trail edge.
# ---------- trailedge_4: Python ----------
"""
Create a trail edge from a rhino line.
"""
from ghpythonlib.componentbase import executingcomponent as component

from compas_cem.elements import TrailEdge


class TrailEdgeComponent(component):
    def RunScript(self, line, length):
        if line and length is not None:
            return TrailEdge.from_rhino_line(line, length)
# ---------- end trailedge_4 ----------
data_7 = Data(trailedge_4)
data_8 = Data(deviationedge_4)

crv_10 = Curve(flatten(deviation_edge_pylon_sihlquai))
crv_11 = Curve(trail_edges_pylon_sihlquai)
num_25 = Number(num_8)
num_26 = Number(num_9)
deviationedge_5 = DeviationEdge(line=crv_10, force=num_26)  # -> deviation_edge; inputs line: Line; same code as deviationedge_3
trailedge_5 = TrailEdge(line=crv_11, length=num_25)  # -> trail_edge; inputs line: Line; same code as trailedge
data_9 = Data(trailedge_5)
data_10 = Data(deviationedge_5)

crv_12 = Curve(flatten(dev1_lateral))
num_27 = Number(num_11)
deviationedge_6 = DeviationEdge(line=crv_12, force=num_27)  # -> deviation_edge; inputs line: Line; same code as deviationedge
data_11 = Data(deviationedge_6)

crv_13 = Curve(flatten(dev2_hangers))
num_28 = Number(num_12)
deviationedge_7 = DeviationEdge(line=crv_13, force=num_28)  # -> deviation_edge; inputs line: Line; same code as deviationedge
data_12 = Data(deviationedge_7)

pt_9 = Point(pt_7)
vec_3 = Vector(vec_2)
nodeload = NodeLoad(point=pt_9, vector=vec_3)  # -> node_load; inputs point: Point3d, vector: Vector3d
#   port point: The position of the node where to apply the load.
#   port vector: The load vector.
#   port node_load: A COMPAS CEM node load.
# ---------- nodeload: Python ----------
"""
Create a load vector to be applied at a node.
"""
from ghpythonlib.componentbase import executingcomponent as component

from compas_cem.loads import NodeLoad


class NodeLoadComponent(component):
    def RunScript(self, point, vector):
        if point and vector:
            return NodeLoad.from_rhino_point_and_vector(point, vector)
# ---------- end nodeload ----------
data_13 = Data(nodeload)

pt_10 = Point(pt_8)
nodesupport = NodeSupport(point=pt_10)  # -> node_support; inputs point: Point3d
#   port point: The position of the node where to assign a support.
#   port node_support: A COMPAS CEM node support.
# ---------- nodesupport: Python ----------
"""
Create a node support from a rhino point.
"""
from ghpythonlib.componentbase import executingcomponent as component

from compas_cem.supports import NodeSupport


class NodeSupportComponent(component):
    def RunScript(self, point):
        if point:
            return NodeSupport.from_rhino_point(point)
# ---------- end nodesupport ----------
data_14 = Data(nodesupport)

data_15 = Data(data_2)
data_16 = Data(data_3)
data_17 = Data(data_5)
data_18 = Data(data_9)
data_19 = Data(data_7)
data_20 = Data(data)
data_21 = Data(data_4)
data_22 = Data(data_6)
data_23 = Data(data_10)
data_24 = Data(data_8)
data_25 = Data(data_11)
data_26 = Data(data_12)
deviations = Merge(Data1=flatten(data_15), Data2=flatten(data_16), Data3=flatten(data_17), Data4=flatten(data_18), Data5=flatten(data_19))
deviations_2 = Merge(
    Data1=flatten(data_20),
    Data2=flatten(data_21),
    Data3=flatten(data_22),
    Data4=flatten(data_23),
    Data5=flatten(data_24),
    Data6=flatten(data_25),
    Data7=flatten(data_26))
data_27 = Data(deviations)
data_28 = Data(deviations_2)
data_29 = Data(data_27)
data_30 = Data(data_14)
data_31 = Data(data_28)
data_32 = Data(data_13)
topologydiagram = TopologyDiagram(trail_edges=data_29, deviation_edges=data_31, loads=data_32, supports=data_30)  # -> topology; inputs nodes: list, trail_edges: list, deviation_edges: list, loads: list, supports: list
#   port nodes: A list of COMPAS CEM nodes to add to the diagram.
#   port trail_edges: A list of COMPAS CEM trail edges to add to the diagram.
#   port deviation_edges: A list of COMPAS CEM deviation edges to add to the diagram.
#   port loads: A list of COMPAS CEM loads to add to the diagram.
#   port supports: A list of COMPAS CEM supports to add to the diagram.
#   port topology: A COMPAS CEM topology diagram.
# ---------- topologydiagram: Python ----------
"""
Build a topology diagram.
"""
from ghpythonlib.componentbase import executingcomponent as component

from compas_cem.diagrams import TopologyDiagram


class BuildTopologyDiagramComponent(component):
    def RunScript(self, nodes, trail_edges, deviation_edges, loads, supports):

        topology = TopologyDiagram()

        if nodes:
            for node in nodes:
                topology.add_node(node)

        if trail_edges:
            for trail_edge in trail_edges:
                topology.add_edge(trail_edge)

        if deviation_edges:
            for deviation_edge in deviation_edges:
                topology.add_edge(deviation_edge)

        if loads:
            for load in loads:
                topology.add_load(load)

        if supports:
            for support in supports:
                topology.add_support(support)

        return topology
# ---------- end topologydiagram ----------
buildtrails = BuildTrails(topology=topologydiagram)  # -> topology, trails, auxiliary_trails; inputs add_auxiliary_trails: Boolean, auxiliary_trail_vector: Vector3d
#   port topology: A COMPAS CEM topology diagram.
#   port add_auxiliary_trails: Append auxiliary trail edges to the free nodes of the topology diagram. Defaults to False.
#   port auxiliary_trail_length: The length of the auxiliary trail edges to add. Defaults to 1.0.
#   port auxiliary_trail_vector: The direction to which the auxiliary trail edges will initially point to. Defaults to [1.0, 1.0, 1.0].
#   port topology: The input topology diagram. But now with computed trails.
#   port trails: The keys of the nodes in each of the found trails.
#   port auxiliary_trails: The keys of the appended auxiliary trail edges.
# ---------- buildtrails: Python ----------
"""
Automatically find the trails in a topology diagram. The diagram is modified in-place.
"""
from ghpythonlib.componentbase import executingcomponent as component

from compas_rhino.geometry import RhinoVector


class BuildTopologyDiagramComponent(component):
    def RunScript(self, topology, add_auxiliary_trails, auxiliary_trail_length, auxiliary_trail_vector):
        add_auxiliary_trails = add_auxiliary_trails or False

        if topology:

            topology = topology.copy()

            if auxiliary_trail_length:
                topology.auxiliary_trail_length = auxiliary_trail_length
            if auxiliary_trail_vector:
                topology.auxiliary_trail_vector = RhinoVector.from_geometry(auxiliary_trail_vector).to_compas()

            topology.build_trails(add_auxiliary_trails)

            trails = list(topology.trails())
            auxiliary_trails = list(topology.auxiliary_trail_edges())

            return topology, trails, auxiliary_trails
# ---------- end buildtrails ----------
data_33 = Data(buildtrails.topology)
data_34 = Data(data_33)
int_2 = Integer(int)
pt_11 = Point(pt_6)

# ---- group: Change the XYZ position of the origin nodes
python = GhPythonScript(topology=data_34, node=int_2, point=pt_11)  # -> out, topology; inputs node: list of Int32, point: list of Point3d
# ---------- python: Python ----------
topology = topology.copy()

for nd, pt in zip(node, point):
    topology.node_xyz(nd, pt)
# ---------- end python ----------

# ----
data_35 = Data(python.topology)
data_36 = Data(data_35)
formfinding = FormFinding(topology=data_36)  # -> form; inputs tmax: Int32
#   port topology: A COMPAS CEM topology diagram.
#   port tmax: The maximum number of iterations to run the form-finding algorithm for. Defaults to 100.
#   port eps_min: The convergence threshold of the form-finding algorithm. Default to 1e-6.
#   port form: A COMPAS CEM form diagram in static equilibrium.
# ---------- formfinding: Python ----------
"""
Generate a form diagram in static equilibrium.
"""
from ghpythonlib.componentbase import executingcomponent as component

from compas_cem.equilibrium import static_equilibrium


class FormFindingComponent(component):
    def RunScript(self, topology, tmax, eta_min):
        tmax = tmax or 100
        eta_min = eta_min or 1e-6
        if topology:
            return static_equilibrium(topology, tmax=tmax, eta=eta_min)
# ---------- end formfinding ----------
data_37 = Data(formfinding)
data_38 = Data(data_37)

# ---- group: Draw form diagram
thickness_scale = Panel("0.4")
data_39 = Data(data_38)
list = ValueList({"Forces": 0, "Lengths": 1}, selected="Forces")
edgeresults = EdgeResults(form=data_39)  # -> length, force; inputs edge: list
#   port form: A COMPAS CEM form diagram.
#   port edge: A selection of edge keys to query the results on. Defaults to all the edges.
#   port length: The edge lengths.
#   port force: The edge forces.
# ---------- edgeresults: Python ----------
"""
Extract the post form-finding results of the edges in a form diagram.
"""
from ghpythonlib.componentbase import executingcomponent as component


class EdgeResultsComponent(component):
    def RunScript(self, form, edge):
        if form:
            edge = edge or list(form.edges())
            length = [form.edge_length_2(ed) for ed in edge]
            force = [form.edge_force(ed) for ed in edge]
            return length, force
# ---------- end edgeresults ----------
formartist = FormArtist(form=data_39)  # -> nodes, support_nodes, edges, loads, reactions; inputs node: list of Int32, edge: list
#   port form: A COMPAS CEM topology diagram.
#   port node: A selection of the nodes in the diagram. Defaults to all the nodes.
#   port edge: A selection of the edges in the diagram. Defaults to all the edges.
#   port force_min: The smallest force magnitude to draw. Defaults to 1e-3
#   port force_scale: The scale of the loads and the reactions. Defaults to 1.
#   port nodes: The nodes of the diagram as points.
#   port support_nodes: The support nodes of the diagram as points
#   port edges: The edges of the diagram as lines.
#   port loads: The applied loads as lines.
#   port reactions: The reaction forces at the supports, as lines.
# ---------- formartist: Python ----------
"""
Draw a form diagram.
"""
from ghpythonlib.componentbase import executingcomponent as component

from compas_cem.ghpython import FormArtist


class FormArtistComponent(component):
    def RunScript(self, form, node, edge, force_min, force_scale):
        force_min = force_min or 1e-3
        force_scale = force_scale or 1
        if form:
            artist = FormArtist(form)

            nodes = artist.draw_nodes(node)
            edges = artist.draw_edges(edge)
            support_nodes = artist.draw_nodes_support(node)

            loads = artist.draw_loads(node, min_load=force_min, scale=force_scale)
            reactions = artist.draw_reactions(node, min_force=force_min, scale=force_scale)

            return nodes, support_nodes, edges, loads, reactions
# ---------- end formartist ----------
cem_colors = CEMColors()  # -> color_tension, color_compression, color_edge, color_node, color_node_support, color_node_origin, color_load, color_reaction, color_trail, color_auxiliary_trail
#   port color_tension: The color for edges under a tension force.
#   port color_compression: The color for edges under a compression force.
#   port color_edge: The color for a regular edge.
#   port color_node: The color for a regular node.
#   port color_node_support: The color for a support node.
#   port color_node_origin: The color for an origin node.
#   port color_load: The color for an applied load.
#   port color_reaction: The color for a reaction force.
#   port color_trail: The color to paint a trail.
#   port color_auxiliary_trail: The color to paint an auxiliary trail.
# ---------- cem_colors: Python ----------
"""
Get the artists color scheme for the objects of the CEM framework.
"""
from ghpythonlib.componentbase import executingcomponent as component

from compas_cem import COLORS
import rhinoscriptsyntax as rs


class ArtistColorsComponent(component):
    def RunScript(self):
        colors = {key: rs.CreateColor(c) for key, c in COLORS.items()}

        color_tension = colors["tension"]
        color_compression = colors["compression"]
        color_edge = colors["edge"]
        color_node = colors["node"]
        color_node_support = colors["node_support"]
        color_node_origin = colors["node_origin"]
        color_load = colors["load"]
        color_reaction = colors["support_force"]
        color_trail = colors["trail"]
        color_auxiliary_trail = colors["auxiliary_trail"]

        colors = (color_tension, color_compression, color_edge, color_node, color_node_support, color_node_origin, color_load, color_reaction, color_trail, color_auxiliary_trail)

        return colors
# ---------- end cem_colors ----------
abs = Absolute(Value=edgeresults.force)
filter = StreamFilter(Gate=list, Stream0=edgeresults.force, Stream1=edgeresults.force)
larger = LargerThan(FirstNumber=edgeresults.force, SecondNumber=0)  # -> LargerThan, OrEqualTo
multiplication = Multiplication(A=abs, B=thickness_scale)
merge_2 = Merge(Data1=cem_colors.color_compression, Data2=cem_colors.color_tension)
python_2 = GhPythonScript(x=filter)  # -> out, a
# ---------- python_2: Python ----------
a = round(x, 3)
# ---------- end python_2 ----------
end = EndPoints(Curve=formartist.loads)  # -> Start, End
midpt = CurveMiddle(Curve=formartist.edges)
item = ListItem(List=merge_2, Index=larger.OrEqualTo, Wrap=True)
end_2 = EndPoints(Curve=formartist.reactions)  # -> Start, End
swatch = ColourSwatch(SwatchColor=RGBA(156, 156, 156, 195))
vec2pt = Vector2Pt(PointA=end.Start, PointB=end.End, Unitize=False)  # -> Vector, Length
vec2pt_2 = Vector2Pt(PointA=end_2.Start, PointB=end_2.End, Unitize=False)  # -> Vector, Length

# ---- group: Draw topology diagram
dash_length = Panel("0.05")
sphere_scale = Panel("0.2")
data_40 = Data(data_33)
topologyartist = TopologyArtist(topology=data_40)  # -> nodes, origin_nodes, support_nodes, edges, trail_edges, deviation_edges, loads; inputs node: list of Int32, edge: list
#   port topology: A COMPAS CEM topology diagram.
#   port node: A selection of the nodes in the diagram. Defaults to all the nodes.
#   port edge: A selection of the edges in the diagram. Defaults to all the edges.
#   port load_min: The minimum load magnitude to plot. Defaults to 1e-3.
#   port load_scale: The scaling factor of the loads. Defaults to 1.
#   port nodes: The nodes in the diagram as points.
#   port origin_nodes: The origin nodes in the diagram as points.
#   port support_nodes: The position of the support nodes in the diagram.
#   port edges: The edges in the diagram as lines.
#   port trail_edges: The trail edges in the diagram as lines.
#   port deviation_edges: The deviation edges in the diagram as lines.
#   port loads: The applied node loads as lines.
# ---------- topologyartist: Python ----------
"""
Draw a topology diagram.
"""
from ghpythonlib.componentbase import executingcomponent as component

from compas_cem.ghpython import TopologyArtist


class TopologyArtistComponent(component):
    def RunScript(self, topology, node, edge, load_min, load_scale):
        node = node or None
        edge = edge or None
        load_min = load_min or 1e-3
        load_scale = load_scale or 1.0
        if topology:
            artist = TopologyArtist(topology)

            nodes = artist.draw_nodes(node)
            origin_nodes = artist.draw_nodes_origin(node)
            support_nodes = artist.draw_nodes_support(node)

            edges = artist.draw_edges(edge)
            trail_edges = artist.draw_edges_trail(node)
            deviation_edges = artist.draw_edges_deviation(node)

            loads = artist.draw_loads(node, min_load=load_min, scale=load_scale)

            return nodes, origin_nodes, support_nodes, edges, trail_edges, deviation_edges, loads
# ---------- end topologyartist ----------
cem_colors_2 = CEMColors()  # -> color_tension, color_compression, color_edge, color_node, color_node_support, color_node_origin, color_load, color_reaction, color_trail, color_auxiliary_trail; same code as cem_colors
dash = DashPattern(Curve=topologyartist.deviation_edges, Pattern=dash_length)  # -> Dashes, Gaps
entwine_2 = Entwine(Branch00=cem_colors_2.color_node_origin, Branch01=cem_colors_2.color_node_support, FlattenInputs=True)
entwine_3 = Entwine(Branch00=topologyartist.trail_edges, Branch01=dash.Dashes, FlattenInputs=True)
entwine_4 = Entwine(Branch00=topologyartist.origin_nodes, Branch01=topologyartist.support_nodes, FlattenInputs=True)
entwine_5 = Entwine(
    Branch00=ColourSwatch(SwatchColor=RGB(209, 2, 255)),
    Branch01=ColourSwatch(SwatchColor=RGB(255, 156, 0)),
    FlattenInputs=True)
sph = Sphere(Base=entwine_4, Radius=sphere_scale)

# ----
preview = CustomPreview(Geometry=entwine_3, Material=entwine_5)
preview_2 = CustomPreview(Geometry=sph, Material=entwine_2)

vdisex = VectorDisplayEx(Point=end_2.Start, Vector=vec2pt_2.Vector, Colour=cem_colors.color_load, Width=2)
vdisex_2 = VectorDisplayEx(Point=end.Start, Vector=vec2pt.Vector, Colour=cem_colors.color_load, Width=2)
previewlw = CustomPreviewLineweights(Geometry=formartist.edges, Shader=item, Thickness=multiplication, Absolute=False)

tag = TextTag(Location=midpt, Text=python_2.a, Colour=swatch)
