# Grasshopper definition bridge_2d.ghx (Grasshopper 1.0.7)

# ---- group: Optimization Parameters
deviation_edges_force_parameter_bounds = Slider(20, range=0..20)
trail_edges_length_parameter_bounds = Slider(20, range=0..20)
number = Number(trail_edges_length_parameter_bounds)
number_2 = Number(deviation_edges_force_parameter_bounds)

# ---- group: Trail Edges A - Parameters
internal_force_state = ValueList({"Compression": -1, "Tension": 1}, selected="Tension")
# 01-B Design Parameters
trail_edge_length = Slider(10, range=0..100)
number_3 = Number(trail_edge_length)
number_4 = Number(internal_force_state)

# ---- group: Trail Edges B - Parameters
internal_force_state_2 = ValueList({"Compression": -1, "Tension": 1}, selected="Tension")
trail_edge_length_2 = Slider(10, range=0..100)
number_5 = Number(trail_edge_length_2)
number_6 = Number(internal_force_state_2)

# ---- group: Deviation Edges A - Parameters
internal_force_state_3 = ValueList({"Compression": -1, "Tension": 1}, selected="Tension")
deviation_edge_force = Slider(2, range=0..25)
number_7 = Number(internal_force_state_3)
number_8 = Number(deviation_edge_force)

# ---- group: Deviation Edges B - Parameters
internal_force_state_4 = ValueList({"Compression": -1, "Tension": 1}, selected="Tension")
deviation_edge_force_2 = Slider(10, range=0..25)
number_9 = Number(deviation_edge_force_2)
number_10 = Number(internal_force_state_4)

# ---- group: Deviation Edges C - Parameters
internal_force_state_5 = ValueList({"Compression": -1, "Tension": 1}, selected="Tension")
deviation_edge_force_3 = Slider(5, range=0..100)
number_11 = Number(internal_force_state_5)
number_12 = Number(deviation_edge_force_3)

# ----
geometry_pipeline = GeometryPipeline(
    GroupByLayer=False,
    GroupByType=False,
    IncludeHidden=True,
    IncludeLocked=True,
    LayerFilter="*::Supports",
    NameFilter="*",
    SublayerFiltering=True,
    TypeFilter=1)
point = Point(geometry_pipeline)

# ---- group: Loads - Parameters
load_magnitude = Slider(-10, range=-10..0)
number_13 = Number(load_magnitude)

# ----
geometry_pipeline_2 = GeometryPipeline(
    GroupByLayer=False,
    GroupByType=False,
    IncludeHidden=True,
    IncludeLocked=True,
    LayerFilter="*::Deviation Edges A",
    NameFilter="*",
    SublayerFiltering=True,
    TypeFilter=4)
geometry_pipeline_3 = GeometryPipeline(
    GroupByLayer=False,
    GroupByType=False,
    IncludeHidden=True,
    IncludeLocked=True,
    LayerFilter="*::Deviation Edges B",
    NameFilter="*",
    SublayerFiltering=True,
    TypeFilter=4)
geometry_pipeline_4 = GeometryPipeline(
    GroupByLayer=False,
    GroupByType=False,
    IncludeHidden=True,
    IncludeLocked=True,
    LayerFilter="*::Deviation Edges C",
    NameFilter="*",
    SublayerFiltering=True,
    TypeFilter=4)
curve = Curve(geometry_pipeline_2)
curve_2 = Curve(geometry_pipeline_3)
curve_3 = Curve(geometry_pipeline_4)

geometry_pipeline_5 = GeometryPipeline(
    GroupByLayer=False,
    GroupByType=False,
    IncludeHidden=True,
    IncludeLocked=True,
    LayerFilter="*::Loads",
    NameFilter="*",
    SublayerFiltering=True,
    TypeFilter=1)
point_2 = Point(geometry_pipeline_5)

# ----
# Topology Visualization
# Form Visualization
# JSON serialization
# Don’t modify (unless you know what you are doing)
# 01-A Geometry imports from Rhino
geometry_pipeline_6 = GeometryPipeline(
    GroupByLayer=False,
    GroupByType=False,
    IncludeHidden=True,
    IncludeLocked=True,
    LayerFilter="*::Trail Edges A",
    NameFilter="*",
    SublayerFiltering=True,
    TypeFilter=4)
geometry_pipeline_7 = GeometryPipeline(
    GroupByLayer=False,
    GroupByType=False,
    IncludeHidden=True,
    IncludeLocked=True,
    LayerFilter="*::Trail Edges B",
    NameFilter="*",
    SublayerFiltering=True,
    TypeFilter=4)
curve_4 = Curve(geometry_pipeline_6)
curve_5 = Curve(geometry_pipeline_7)

# ----
# 05-B Design Parameters
geometry_pipeline_8 = GeometryPipeline(
    GroupByLayer=False,
    GroupByType=False,
    IncludeHidden=True,
    IncludeLocked=True,
    LayerFilter="*::Target Points",
    NameFilter="*",
    SublayerFiltering=True,
    TypeFilter=1)
point_3 = Point(geometry_pipeline_8)

# ---- group: Context
# COMPAS CEM
# Copyright (c) 2021 Rafael Pastrana
# Color Code
# Trail Edges
# Deviation Edges
# Loads
# Supports
# Optimization
# Topology/Form Diagram
geometry = Geometry([<curve referenced from the Rhino model> x116])

# ---- group: Shatter Trail Edges B
curve_6 = Curve(curve_5)
curve_7 = Curve([curve_2, curve, curve_3])
cluster = Cluster(curve=curve_6, curve_2=curve_7)
curve_8 = Curve(cluster)

# ---- group: Shatter Trail Edges A
# 02 Geometry pre-processing
curve_9 = Curve(curve_4)
curve_10 = Curve([curve, curve_2, curve_3])
cluster_2 = Cluster(curve=curve_9, curve_2=curve_10)
curve_11 = Curve(cluster_2)

# ---- group: Trail Edges A
# 03 Assemble a topology diagram
curve_12 = Curve(curve_11)
number_14 = Number(number_3)
number_15 = Number(number_4)
multiplication = Multiplication(A=number_14, B=number_15)
trailedge = TrailEdge(line=curve_12, length=multiplication)  # -> trail_edge; inputs line: Line, plane: Plane
#   port line: A line that defines the end nodes of the edge.
#   port length: The signed length of the edge. If negative, the edge is in compression. Otherwise, it is in tension. The length magnitude is ignored if a plane is supplied.
#   port plane: An optional plane to define the length of the trail edge relative to the projection of its start node onto the plane. The force state will be that specified by the length input parameter.
#   port trail_edge: A COMPAS CEM trail edge.
# ---------- trailedge: Python ----------
"""
Create a trail edge from a rhino line.
"""
from ghpythonlib.componentbase import executingcomponent as component

from compas_rhino.geometry import RhinoLine
from compas_rhino.geometry import RhinoPlane

from compas_cem.elements import TrailEdge


class TrailEdgeComponent(component):
    def RunScript(self, line, length, plane):
        if not line or length is None:
            return

        if plane is not None:
            plane = RhinoPlane.from_geometry(plane).to_compas()
        line = RhinoLine.from_geometry(line).to_compas()
        return TrailEdge.from_line(line, length=length, plane=plane)
# ---------- end trailedge ----------

# ---- group: Trail Edges B
curve_13 = Curve(curve_8)
number_16 = Number(number_5)
number_17 = Number(number_6)
multiplication_2 = Multiplication(A=number_16, B=number_17)
trailedge_2 = TrailEdge(line=curve_13, length=multiplication_2)  # -> trail_edge; inputs line: Line, plane: Plane; same code as trailedge

# ---- group: Deviation Edges A
curve_14 = Curve(curve)
number_18 = Number(number_8)
number_19 = Number(number_7)
multiplication_3 = Multiplication(A=number_18, B=number_19)
deviationedge = DeviationEdge(line=curve_14, force=multiplication_3)  # -> deviation_edge; inputs line: Line
#   port line: A line that defines the end nodes of the edge.
#   port force: The desired force on the edge. If negative, the edge is in compression. Otherwise, it is in tension.
#   port deviation_edge: A COMPAS CEM deviation edge.
# ---------- deviationedge: Python ----------
"""
Create a deviation edge from a line.
"""
from ghpythonlib.componentbase import executingcomponent as component

from compas_cem.elements import DeviationEdge

from compas_rhino.geometry import RhinoLine


class DeviationEdgeComponent(component):
    def RunScript(self, line, force):
        if not line or force is None:
            return
        line = RhinoLine.from_geometry(line).to_compas()
        return DeviationEdge.from_line(line, force=force)
# ---------- end deviationedge ----------

# ---- group: Deviation Edges B
curve_15 = Curve(curve_2)
number_20 = Number(number_9)
number_21 = Number(number_10)
multiplication_4 = Multiplication(A=number_20, B=number_21)
deviationedge_2 = DeviationEdge(line=curve_15, force=multiplication_4)  # -> deviation_edge; inputs line: Line; same code as deviationedge

# ---- group: Deviation Edges C
curve_16 = Curve(curve_3)
number_22 = Number(number_12)
number_23 = Number(number_11)
multiplication_5 = Multiplication(A=number_22, B=number_23)
deviationedge_3 = DeviationEdge(line=curve_16, force=multiplication_5)  # -> deviation_edge; inputs line: Line; same code as deviationedge

# ----
pt = Point(point_2)
number_24 = Number(number_13)
Z = UnitZ(Factor=number_24)
nodeload = NodeLoad(point=pt, vector=Z)  # -> node_load; inputs point: Point3d, vector: Vector3d
#   port point: The position of the node where to apply the load.
#   port vector: The load vector.
#   port node_load: A COMPAS CEM node load.
# ---------- nodeload: Python ----------
"""
Create a load vector to be applied at a node.
"""
from ghpythonlib.componentbase import executingcomponent as component

from compas_rhino.geometry import RhinoPoint
from compas_rhino.geometry import RhinoVector

from compas_cem.loads import NodeLoad


class NodeLoadComponent(component):
    def RunScript(self, point, vector):
        if not (point and vector):
            return

        point = RhinoPoint.from_geometry(point).to_compas()
        vector = RhinoVector.from_geometry(vector).to_compas()

        return NodeLoad.from_point_and_vector(point, vector)
# ---------- end nodeload ----------

pt_2 = Point(point)
nodesupport = NodeSupport(point=pt_2)  # -> node_support; inputs point: Point3d
#   port point: The position of the node where to assign a support.
#   port node_support: A COMPAS CEM node support.
# ---------- nodesupport: Python ----------
"""
Create a node support from a point.
"""
from ghpythonlib.componentbase import executingcomponent as component

from compas_rhino.geometry import RhinoPoint
from compas_cem.supports import NodeSupport


class NodeSupportComponent(component):
    def RunScript(self, point):
        if not point:
            return

        xyz = RhinoPoint.from_geometry(point).to_compas()
        return NodeSupport.from_point(xyz)
# ---------- end nodesupport ----------

assemble_topology_diagram = AssembleTopologyDiagram(
    trail_edges=flatten([trailedge, trailedge_2]),
    deviation_edges=flatten([deviationedge, deviationedge_2, deviationedge_3]),
    loads=flatten(nodeload),
    supports=flatten(nodesupport))  # -> topology; inputs trail_edges: list, deviation_edges: list, loads: list, supports: list, add_auxiliary_trails: Boolean
#   port trail_edges: The COMPAS CEM trail edges to add to the diagram.
#   port deviation_edges: The COMPAS CEM deviation edges to add to the diagram.
#   port loads: The COMPAS CEM loads to add to the diagram.
#   port supports: The COMPAS CEM supports to add to the diagram.
#   port add_auxiliary_trails: Append auxiliary trails to the free nodes of the topology diagram. Defaults to False.
#   port topology: A COMPAS CEM topology diagram.
# ---------- assemble_topology_diagram: Python ----------
"""
Assemble a topology diagram.
"""
from ghpythonlib.componentbase import executingcomponent as component

from compas_cem.diagrams import TopologyDiagram


class AssembleTopologyDiagramComponent(component):
    def RunScript(self, trail_edges, deviation_edges, loads, supports, add_auxiliary_trails):

        add_auxiliary_trails = add_auxiliary_trails or False
        topology = TopologyDiagram()

        if trail_edges:
            for trail_edge in trail_edges:
                if trail_edge:
                    topology.add_edge(trail_edge)

        if deviation_edges:
            for deviation_edge in deviation_edges:
                if deviation_edge:
                    topology.add_edge(deviation_edge)

        if loads:
            for load in loads:
                if load:
                    topology.add_load(load)

        if supports:
            for support in supports:
                if support:
                    topology.add_support(support)

        if trail_edges and supports:
            topology.build_trails(add_auxiliary_trails)

        elif deviation_edges and add_auxiliary_trails:
            topology.build_trails(add_auxiliary_trails)

        return topology
# ---------- end assemble_topology_diagram ----------
topology = Data(assemble_topology_diagram)

# ----
# 04 Generate a form diagram
topology_2 = Data(topology)
formfinding = FormFinding(topology=topology_2)  # -> form; inputs kmax: Int32, tmax: Int32
#   port topology: A COMPAS CEM topology diagram.
#   port kmax: The maximum number of sequences to run the form-finding algorithm for. Defaults to all the sequences in the diagram.
#   port tmax: The maximum number of iterations to run the form-finding algorithm for. Defaults to 100.
#   port eta: The convergence threshold of the form-finding algorithm. Default to 1e-6.
#   port form: A COMPAS CEM form diagram in static equilibrium.
# ---------- formfinding: Python ----------
"""
Generate a form diagram in static equilibrium.
"""
from ghpythonlib.componentbase import executingcomponent as component

from compas_cem.equilibrium import static_equilibrium


class FormFindingComponent(component):
    def RunScript(self, topology, kmax, tmax, eta):
        eta = eta or 1e-6
        tmax = tmax or 100

        if not topology:
            return

        return static_equilibrium(topology, kmax=kmax, tmax=tmax, eta=eta)
# ---------- end formfinding ----------
form = Data(formfinding)

# ----
# 03-B Display topology diagram
topology_3 = Data(topology)

forces_scale = Slider(1, range=0..1)
dash_length = Slider(0.2, range=0..0.2)
sphere_radius = Slider(0.5, range=0..1)
forces_min = Slider(0.001, range=0..0.001)
number_25 = Number(forces_scale)
number_26 = Number(sphere_radius)
number_27 = Number(dash_length)
number_28 = Number(forces_min)

topology_4 = Data(topology_3)

topology_5 = Data(topology_4)
disassemble_topology_diagram = DisassembleTopologyDiagram(topology=topology_5)  # -> node_keys, origin_node_keys, support_node_keys, edge_keys, trail_edge_keys, deviation_edge_keys, trail_keys, auxiliary_trail_keys
#   port topology: A COMPAS CEM topology diagram.
#   port node_keys: All the node keys in the topology diagram.
#   port origin_node_keys: The keys of the origin nodes in the topology diagram.
#   port support_node_keys: The keys of the support nodes in the topology diagram.
#   port edge_keys: All the edge keys in the topology diagram.
#   port trail_edge_keys: The keys of the trail edges in the topology diagram.
#   port deviation_edge_keys: The keys of the deviation edges in the topology diagram.
#   port trail_keys: The keys of the trails in the topology diagram.
#   port auxiliary_trail_keys: The keys of the auxiliary trails in the topology diagram.
# ---------- disassemble_topology_diagram: Python ----------
"""
Disassemble a topology diagram into its constituent parts.
"""
from ghpythonlib.componentbase import executingcomponent as component


class TopologyDisassemblyComponent(component):
    def RunScript(self, topology):
        if topology:
            trail_keys = list(topology.trails())
            auxiliary_trail_keys = list(topology.auxiliary_trails())

            edge_keys = list(topology.edges())
            trail_edge_keys = list(topology.trail_edges())
            deviation_edge_keys = list(topology.deviation_edges())

            node_keys = list(topology.nodes())
            origin_node_keys = list(topology.origin_nodes())
            support_node_keys = list(topology.support_nodes())

            return node_keys, origin_node_keys, support_node_keys, edge_keys, trail_edge_keys, deviation_edge_keys, trail_keys, auxiliary_trail_keys
# ---------- end disassemble_topology_diagram ----------
# 03-A Display form diagram
topology_artist = TopologyArtist(topology=topology_5)  # -> nodes, origin_nodes, support_nodes, edges, trail_edges, deviation_edges, trails, loads; inputs node_keys: list of Int32, edge_keys: list
#   port topology: A COMPAS CEM topology diagram.
#   port node_keys: A selection of the node keys in the diagram. Defaults to all the node keys.
#   port edge_keys: A selection of the edge keys in the diagram. Defaults to all the edge keys.
#   port force_min: The minimum force magnitude to plot. Defaults to 1e-3.
#   port force_scale: The scaling factor of the loads. Defaults to 1.
#   port nodes: The nodes in the diagram as points.
#   port origin_nodes: The origin nodes in the diagram as points.
#   port support_nodes: The support nodes in the diagram as points.
#   port edges: The edges in the diagram as lines.
#   port trail_edges: The trail edges in the diagram as lines.
#   port deviation_edges: The deviation edges in the diagram as lines.
#   port trails: The trails in the diagram as polylines.
#   port loads: The applied node loads as lines.
# ---------- topology_artist: Python ----------
"""
Draw a topology diagram.
"""
from ghpythonlib.componentbase import executingcomponent as component

from compas_cem.ghpython import TopologyArtist


class TopologyArtistComponent(component):
    def RunScript(self, topology, node_keys, edge_keys, force_min, force_scale):
        node_keys = node_keys or None
        edge_keys = edge_keys or None
        force_min = force_min or 1e-3
        force_scale = force_scale or 1.0
        if topology:
            artist = TopologyArtist(topology, artist_type=TopologyArtist)

            nodes = artist.draw_nodes(node_keys)
            origin_nodes = artist.draw_nodes_origin(node_keys)
            support_nodes = artist.draw_nodes_support(node_keys)

            edges = artist.draw_edges(edge_keys)
            trail_edges = artist.draw_edges_trail(edge_keys)
            deviation_edges = artist.draw_edges_deviation(edge_keys)

            trails = artist.draw_trails()

            loads = artist.draw_loads(node_keys, min_load=force_min, scale=force_scale)

            return nodes, origin_nodes, support_nodes, edges, trail_edges, deviation_edges, trails, loads
# ---------- end topology_artist ----------
curve_middle = CurveMiddle(Curve=topology_artist.edges)

topology_6 = Data(topology_4)
number_29 = Number(number_27)
disassemble_topology_diagram_2 = DisassembleTopologyDiagram(topology=topology_6)  # -> node_keys, origin_node_keys, support_node_keys, edge_keys, trail_edge_keys, deviation_edge_keys, trail_keys, auxiliary_trail_keys; same code as disassemble_topology_diagram
cem_colors = CEMColors()  # -> color_tension, color_compression, color_edge, color_node, color_node_support, color_node_origin, color_load, color_reaction, color_trail, color_auxiliary_trail
#   port color_tension: The color for edges under a tension force.
#   port color_compression: The color for edges under a compression force.
#   port color_edge: The color for a regular edge.
#   port color_node: The color for a regular node.
#   port color_node_support: The color for a support node.
#   port color_node_origin: The color for an origin node.
#   port color_load: The color for an applied load.
#   port color_reaction: The color for a reaction force.
#   port color_trail: The color to paint a trail.
#   port color_auxiliary_trail: The color to paint an auxiliary trail.
# ---------- cem_colors: Python ----------
"""
Get the artists color scheme for the objects of the CEM framework.
"""
from ghpythonlib.componentbase import executingcomponent as component

from compas_cem import COLORS
import rhinoscriptsyntax as rs


class ArtistColorsComponent(component):
    def RunScript(self):
        colors = {key: rs.CreateColor(c) for key, c in COLORS.items()}

        color_tension = colors["tension"]
        color_compression = colors["compression"]
        color_edge = colors["edge"]
        color_node = colors["node"]
        color_node_support = colors["node_support"]
        color_node_origin = colors["node_origin"]
        color_load = colors["load"]
        color_reaction = colors["support_force"]
        color_trail = colors["trail"]
        color_auxiliary_trail = colors["auxiliary_trail"]

        colors = (color_tension, color_compression, color_edge, color_node, color_node_support, color_node_origin, color_load, color_reaction, color_trail, color_auxiliary_trail)

        return colors
# ---------- end cem_colors ----------
python = GhPythonScript(
    trail=disassemble_topology_diagram_2.trail_edge_keys,
    auxiliary_trail=disassemble_topology_diagram_2.auxiliary_trail_keys)  # -> out, trail; inputs trail: list, auxiliary_trail: list
# ---------- python: Python ----------
trail = [tr for tr in trail if tr not in auxiliary_trail]
# ---------- end python ----------
topology_artist_2 = TopologyArtist(topology=topology_6, edge_keys=python.trail)  # -> nodes, origin_nodes, support_nodes, edges, trail_edges, deviation_edges, trails, loads; inputs node_keys: list of Int32, edge_keys: list; same code as topology_artist
topology_artist_3 = TopologyArtist(topology=topology_6)  # -> nodes, origin_nodes, support_nodes, edges, trail_edges, deviation_edges, trails, loads; inputs node_keys: list of Int32, edge_keys: list; same code as topology_artist
python_2 = GhPythonScript(topology=topology_6, auxiliary_trail=disassemble_topology_diagram_2.auxiliary_trail_keys)  # -> out, auxiliary_trail; inputs auxiliary_trail: list
# ---------- python_2: Python ----------
from compas_cem.ghpython import TopologyArtist


if auxiliary_trail is not None:
    artist = TopologyArtist(topology, artist_type=TopologyArtist)
   
    if auxiliary_trail is not None:
        auxiliary_trail = artist.draw_edges_trail(auxiliary_trail)
# ---------- end python_2 ----------
edge_results = EdgeResults(form=topology_6, edge_keys=python.trail)  # -> lengths, forces; inputs edge_keys: list; same code as edge_results
edge_results_2 = EdgeResults(form=topology_6, edge_keys=disassemble_topology_diagram_2.deviation_edge_keys)  # -> lengths, forces; inputs edge_keys: list; same code as edge_results
merge = Merge(Data1=cem_colors.color_compression, Data2=cem_colors.color_tension)
larger = LargerThan(FirstNumber=edge_results_2.forces, SecondNumber=0)  # -> LargerThan, OrEqualTo
larger_2 = LargerThan(FirstNumber=edge_results.lengths, SecondNumber=0)  # -> LargerThan, OrEqualTo
list_item = ListItem(List=merge, Index=larger.OrEqualTo, Wrap=True)
list_item_2 = ListItem(List=merge, Index=larger_2.OrEqualTo, Wrap=True)
dash_pattern = DashPattern(Curve=topology_artist_3.deviation_edges, Pattern=number_29)  # -> Dashes, Gaps

topology_7 = Data(topology_4)
number_30 = Number(number_28)
number_31 = Number(number_25)
topology_artist_4 = TopologyArtist(topology=topology_7, force_min=number_30, force_scale=number_31)  # -> nodes, origin_nodes, support_nodes, edges, trail_edges, deviation_edges, trails, loads; inputs node_keys: list of Int32, edge_keys: list; same code as topology_artist
cem_colors_2 = CEMColors()  # -> color_tension, color_compression, color_edge, color_node, color_node_support, color_node_origin, color_load, color_reaction, color_trail, color_auxiliary_trail; same code as cem_colors
cluster_3 = Cluster_6(curve=topology_artist_4.loads)  # -> vector, geometry
vector_length = VectorLength(Vector=cluster_3.vector)
unit_vector = UnitVector(Vector=cluster_3.vector)
multiplication_6 = Multiplication(A=unit_vector, B=vector_length)
move = Move(Geometry=cluster_3.geometry, Motion=multiplication_6)  # -> Geometry, Transform

topology_8 = Data(topology_4)

topology_9 = Data(topology_4)
number_32 = Number(number_26)
topology_artist_5 = TopologyArtist(topology=topology_9)  # -> nodes, origin_nodes, support_nodes, edges, trail_edges, deviation_edges, trails, loads; inputs node_keys: list of Int32, edge_keys: list; same code as topology_artist
cem_colors_3 = CEMColors()  # -> color_tension, color_compression, color_edge, color_node, color_node_support, color_node_origin, color_load, color_reaction, color_trail, color_auxiliary_trail; same code as cem_colors
mesh_sphere_ex = MeshSphereEx(Base=topology_artist_5.support_nodes, Radius=number_32, Count=2)

disassemble_topology_diagram_3 = DisassembleTopologyDiagram(topology=topology_8)  # -> node_keys, origin_node_keys, support_node_keys, edge_keys, trail_edge_keys, deviation_edge_keys, trail_keys, auxiliary_trail_keys; same code as disassemble_topology_diagram
python_3 = GhPythonScript(
    trail=disassemble_topology_diagram_3.trail_edge_keys,
    auxiliary_trail=disassemble_topology_diagram_3.auxiliary_trail_keys)  # -> out, trail; inputs trail: list, auxiliary_trail: list; same code as python
entwine = Entwine(Branch00=python_3.trail, Branch01=disassemble_topology_diagram_3.deviation_edge_keys, FlattenInputs=True)
topology_artist_6 = TopologyArtist(topology=topology_8, edge_keys=entwine)  # -> nodes, origin_nodes, support_nodes, edges, trail_edges, deviation_edges, trails, loads; inputs node_keys: list of Int32, edge_keys: list; same code as topology_artist
edge_results_3 = EdgeResults(form=topology_8, edge_keys=python_3.trail)  # -> lengths, forces; inputs edge_keys: list; same code as edge_results
edge_results_4 = EdgeResults(form=topology_8, edge_keys=disassemble_topology_diagram_3.deviation_edge_keys)  # -> lengths, forces; inputs edge_keys: list; same code as edge_results
curve_middle_2 = CurveMiddle(Curve=topology_artist_6.edges)
merge_2 = Merge(Data1=edge_results_3.lengths, Data2=edge_results_4.forces)  # -> flatten(Result)

mesh_sphere_ex_2 = MeshSphereEx(Base=topology_artist_5.origin_nodes, Radius=number_32, Count=2)
material = CreateMaterial(
    Diffuse=cem_colors_3.color_node_support,
    Specular=RGB(255, 255, 255),
    Emission=cem_colors_3.color_node_support,
    Transparency="0.2",
    Shine="100")
material_2 = CreateMaterial(
    Diffuse=cem_colors_3.color_node_origin,
    Specular=RGB(255, 255, 255),
    Emission=cem_colors_3.color_node_origin,
    Transparency="0.2",
    Shine="100")

# ---- group: Edges design parameters
text_tag = TextTag(Location=flatten(curve_middle_2), Text=merge_2, Colour=ColourSwatch(SwatchColor=RGBA(156, 156, 156, 195)))

# ---- group: Node keys
text_tag_2 = TextTag(
    Location=topology_artist.nodes,
    Text=disassemble_topology_diagram.node_keys,
    Colour=ColourSwatch(SwatchColor=RGBA(156, 156, 156, 195)))

# ---- group: Edge keys
text_tag_3 = TextTag(
    Location=curve_middle,
    Text=disassemble_topology_diagram.edge_keys,
    Colour=ColourSwatch(SwatchColor=RGBA(156, 156, 156, 195)))

# ---- group: Loads
vector_display_ex = VectorDisplayEx(Point=move.Geometry, Vector=cluster_3.vector, Colour=cem_colors_2.color_load, Width=2)

# ---- group: Deviation edges
custom_preview = CustomPreview(Geometry=dash_pattern.Dashes, Material=graft(list_item))

# ---- group: Trails
custom_preview_2 = CustomPreview(Geometry=topology_artist_3.trails, Material=cem_colors.color_trail)

# ---- group: Auxiliary Trails
custom_preview_3 = CustomPreview(Geometry=python_2.auxiliary_trail, Material=cem_colors.color_auxiliary_trail)

# ---- group: Support nodes
custom_preview_4 = CustomPreview(Geometry=mesh_sphere_ex, Material=material)

# ---- group: Origin nodes
custom_preview_5 = CustomPreview(Geometry=mesh_sphere_ex_2, Material=material_2)

# ---- group: Trail edges
custom_preview_6 = CustomPreview(Geometry=topology_artist_2.trail_edges, Material=list_item_2)

# ----
pipe_min_radius = Slider(0.02, range=0..0.1)
pipe_max_radius = Slider(0.3, range=0..0.4)
loads_radius_scale = Slider(0.5, range=0..1)
arrow_head_ratio = Slider(2, range=0..10)
reactions_radius_scale = Slider(0.6, range=0..1)
arrow_height_ratio = Slider(3, range=0..10)
number_33 = Number(pipe_min_radius)
number_34 = Number(pipe_max_radius)
number_35 = Number(loads_radius_scale)
number_36 = Number(reactions_radius_scale)
number_37 = Number(arrow_height_ratio)
number_38 = Number(arrow_head_ratio)

edge_result_to_display = ValueList({"Forces": 0, "Lengths": 1}, selected="Forces")
forces_min_2 = Slider(0.001, range=0..0.001)
forces_scale_2 = Slider(1, range=0..2)
number_39 = Number("65")
number_40 = Number(forces_min_2)
integer = Integer(edge_result_to_display)
number_41 = Number(forces_scale_2)

number_42 = Number(number_39)
point_4 = Point(point_3)
number_43 = Number(number_26)
curve_17 = Curve(geometry)
unit_x = UnitX(Factor=number_42)
mesh_sphere_ex_3 = MeshSphereEx(Base=point_4, Radius=number_43, Count=2)
move_2 = Move(Geometry=mesh_sphere_ex_3, Motion=unit_x)  # -> Geometry, Transform
move_3 = Move(Geometry=curve_17, Motion=unit_x)  # -> Geometry, Transform
colour_swatch = ColourSwatch(SwatchColor=RGB(255, 155, 15))
material_3 = CreateMaterial(Diffuse=colour_swatch, Specular=RGB(255, 255, 255), Emission=colour_swatch, Transparency="0.2", Shine="100")

colour_swatch_2 = ColourSwatch(SwatchColor=RGBA(156, 156, 156, 195))

# ---- group: Context
custom_preview_7 = CustomPreview(Geometry=move_3.Geometry, Material=ColourSwatch(SwatchColor=RGB(82, 82, 82)))

# ---- group: Point Constraitns
custom_preview_8 = CustomPreview(Geometry=move_2.Geometry, Material=material_3)

# ----
curve_18 = Curve([curve_12, curve_13])
number_44 = Number(number_2)
number_45 = Number(number)
pt_3 = Point(point)
pt_4 = Point(point_3)
# 05 Generate a constrained form diagram via optimization
form_2 = Data(topology)
topology_10 = Data(topology)
disassemble_topology_diagram_4 = DisassembleTopologyDiagram(topology=topology_10)  # -> node_keys, origin_node_keys, support_node_keys, edge_keys, trail_edge_keys, deviation_edge_keys, trail_keys, auxiliary_trail_keys; same code as disassemble_topology_diagram
node_search = NodeSearch(diagram=topology_10, point=pt_3)  # -> node_key; inputs point: Point3d
#   port diagram: A COMPAS CEM topology or form diagram.
#   port point: The point to search for in the diagram.
#   port node_key: The found node key.
# ---------- node_search: Python ----------
"""
Search a node key in a topology or a form diagram using a point.
"""
from ghpythonlib.componentbase import executingcomponent as component

from compas.utilities import geometric_key
from compas_rhino.geometry import RhinoPoint


class NodeSearchComponent(component):
    def RunScript(self, diagram, point):
        if point and diagram:
            pt = RhinoPoint.from_geometry(point).to_compas()
            gkey = geometric_key(pt, diagram.tol)
            return diagram.gkey_node[gkey]
# ---------- end node_search ----------
cp = ClosestPoint(Point=pt_4, Cloud=pt_3)  # -> ClosestPoint, CPIndex, Distance
item = ListItem(List=pt_4, Index=cp.CPIndex, Wrap=True)
pointconstraint = PointConstraint(node_key=node_search, point=item)  # -> constraint; inputs node_key: Int32, point: Point3d
#   port node_key: The key of a COMPAS CEM node.
#   port point: The target point.
#   port weight: The weight of the constraint in the optimization problem. Defaults to one.
#   port constraint: A COMPAS CEM node point constraint.
# ---------- pointconstraint: Python ----------
"""
Pull the position of a node to a target point.
"""
from ghpythonlib.componentbase import executingcomponent as component

from compas_cem.optimization import PointConstraint
from compas_rhino.geometry import RhinoPoint


class PointConstraintComponent(component):
    def RunScript(self, node_key, point, weight):
        weight = weight or 1.0
        if node_key is not None and point:
            point = RhinoPoint.from_geometry(point).to_compas()
            return PointConstraint(node_key, point, weight)
# ---------- end pointconstraint ----------
deviationedgeforceparameter = DeviationEdgeForceParameter(edge_key=disassemble_topology_diagram_4.deviation_edge_keys, bound_low=number_44, bound_up=number_44)  # -> parameter
#   port edge_key: The key of a COMPAS CEM deviation edge.
#   port bound_low: The lower bound of the edge optimization parameter. Calculated as the initial edge parameter minus the absolute value of this bound.
#   port bound_up: The upper bound of the edge optimization parameter. Calculated as the initial edge parameter plus the absolute value of this bound.
#   port parameter: A COMPAS CEM deviation edge force parameter.
# ---------- deviationedgeforceparameter: Python ----------
"""
Set the force of a deviation edge as an optimization parameter.
"""
from ghpythonlib.componentbase import executingcomponent as component

from compas_cem.optimization import DeviationEdgeParameter


class DeviationEdgeParameterComponent(component):
    def RunScript(self, edge_key, bound_low, bound_up):
        if edge_key and bound_low is not None and bound_up is not None:
            return DeviationEdgeParameter(edge_key, bound_low, bound_up)
# ---------- end deviationedgeforceparameter ----------
# 03-B Display topology diagram
toggle = BooleanToggle(True)
proxyserver = ProxyServer(start=toggle, stop=Toggle(False))  # inputs start: Boolean, stop: Boolean
#   port start: Launch the COMPAS CEM proxy server. The proxy is kept open to be re-used and thus save start up time.
#   port stop: Shut down the proxy server.
# ---------- proxyserver: Python ----------
"""
Create an RPC proxy server to solve a constrained form-finding problem via CPython"
"""
from ghpythonlib.componentbase import executingcomponent as component

from scriptcontext import sticky

from compas.rpc import Proxy
from compas_cem import PROXY_PORT


class CEMProxyComponent(component):
    def RunScript(self, start, stop):

        if not (start or stop):
            return

        if start:
            proxy = Proxy("compas_cem.optimization", port=PROXY_PORT)
            sticky["proxy_cem"] = proxy

        if stop:
            proxy = Proxy(port=PROXY_PORT)
            proxy.stop_server()
            if "proxy_cem" in sticky:
                del sticky["proxy_cem"]
# ---------- end proxyserver ----------

# ---- group: Exclude lowermost trail edges
cluster_4 = Cluster_2(curve=curve_18)

# ----
edge_search = EdgeSearch(diagram=topology_10, line=cluster_4)  # -> edge_key; inputs line: Line
#   port diagram: A COMPAS CEM topology or form diagram.
#   port line: The line to search for in the diagram.
#   port edge_key: The edge key in the diagram.
# ---------- edge_search: Python ----------
"""
Search for an edge key in a topology or a form diagram using a line.
"""
from ghpythonlib.componentbase import executingcomponent as component

from compas_rhino.geometry import RhinoLine
from compas.utilities import geometric_key


class EdgeSearchComponent(component):
    def RunScript(self, diagram, line):
        if diagram and line:

            line = RhinoLine.from_geometry(line).to_compas()

            eg = []
            for point in (line.start, line.end):
                gkey = geometric_key(point, diagram.tol)
                node = diagram.gkey_node[gkey]
                eg.append(node)

            return [tuple(eg)]
# ---------- end edge_search ----------

trailedgelengthparameter = TrailEdgeLengthParameter(edge_key=edge_search, bound_low=number_45, bound_up=number_45)  # -> parameter
#   port edge_key: The key of a COMPAS CEM trail edge.
#   port bound_low: The lower bound of the edge optimization parameter. Calculated as the initial edge parameter minus the absolute value of this bound.
#   port bound_up: The upper bound of the edge optimization parameter. Calculated as the initial edge parameter plus the absolute value of this bound.
#   port parameter: A COMPAS CEM trail edge length parameter.
# ---------- trailedgelengthparameter: Python ----------
"""
Set the length of a trail edge as an optimization parameter.
"""
from ghpythonlib.componentbase import executingcomponent as component

from compas_cem.optimization import TrailEdgeParameter


class TrailEdgeParameterComponent(component):
    def RunScript(self, edge_key, bound_low, bound_up):
        if edge_key and bound_low is not None and bound_up is not None:
            return TrailEdgeParameter(edge_key, bound_low, bound_up)
# ---------- end trailedgelengthparameter ----------

constrainedformfinding = ConstrainedFormFinding(
    solve=Toggle(True),
    topology=form_2,
    constraints=pointconstraint,
    parameters=flatten([trailedgelengthparameter, deviationedgeforceparameter]))  # -> topology, form, objective, grad_norm, iters, time, status; inputs solve: Boolean, constraints: list, parameters: list, iters_max: Int32, tmax: Int32
#   port solve: Kickstarts the solution of the constrained form-finding problem.
#   port topology: A COMPAS CEM topology diagram.
#   port constraints: A list of COMPAS CEM optimization constraints.
#   port parameters: A list of COMPAS CEM optimization parameters.
#   port algorithm: The name of the gradient-based local optimization algorithm to use. Defaults to SLSQP. Currently supported algorithms are: - SLSQP: Sequential Least Squares Programming - LBFGS: Low-Storage Broyden-Fletcher-Goldfarb-Shanno - MMA: Method of Moving Asymptotes - TNEWTON: Preconditioned Truncated Newton - AUGLAG: Augmented Lagrangian -VAR: Limited-Memory Variable-Metric Algorithm
#   port iters_max: The maximum number of iterations to run the optimization algorithm for. If it is equal to -1, then there is no iteration limit. Defaults to 100.
#   port eps: The convergence threshold for the output value of the objective function. Defaults to 1e-6.
#   port kappa: The convergence threshold for the norm of the gradient of the objective function. Defaults to 1e-8.
#   port tmax: The maximum number of iterations to run the form-finding algorithm for. Defaults to 100.
#   port eta: The convergence threshold of the form-finding algorithm. Defaults to 1e-6.
#   port topology: A COMPAS CEM topology diagram with optimized parameters.
#   port form: A COMPAS CEM form diagram in static equilibrium.
#   port objective: The resulting output value of the objective function.
#   port grad_norm: The norm of the gradient of the objective function.
#   port iters: The elapsed number of optimization iterations.
#   port time: The total optimization runtime in seconds.
#   port status: The final status of the optimization process.
# ---------- constrainedformfinding: Python ----------
"""
Generate a form diagram in static equilibrium such that it meets user-defined constraints.
"""
from ghpythonlib.componentbase import executingcomponent as component
from scriptcontext import sticky

from compas.rpc import Proxy


class ConstrainedFormFindingComponent(component):
    def RunScript(self, solve, topology, constraints, parameters, algorithm, iters_max, eps, kappa, tmax, eta):
        algorithm = algorithm or "SLSQP"
        iters_max = iters_max or 100
        eps = eps or 1e-6
        kappa = kappa or 1e-8
        tmax = tmax or 100
        eta = eta or 1e-6

        if not (solve and topology and constraints and parameters):
            return

        topology = topology.copy()

        # clean constraints and parameters from None
        constraints = [c for c in constraints if c is not None]
        parameters = [p for p in parameters if p is not None]

        # fetch optimization proxy from scriptcontext
        opt = sticky.get("proxy_cem")
        proxy_temp_exists = opt is not None

        # create temporary proxy server if unavailable from scriptcontext
        if not proxy_temp_exists:
            opt = Proxy("compas_cem.optimization")

        # solve constrained form-finding problem
        solution = opt.solve_proxy(topology=topology,
                                   constraints=constraints,
                                   parameters=parameters,
                                   algorithm=algorithm,
                                   iters=iters_max,
                                   eps=eps,
                                   kappa=kappa,
                                   tmax=tmax,
                                   eta=eta)

        # shut down temporary proxy
        if not proxy_temp_exists:
            opt.stop_server()

        # unpack solution
        topology, form, objective, grad_norm, iters, time, status = solution

        return topology, form, objective, grad_norm, iters, time, status
# ---------- end constrainedformfinding ----------

panel = Panel(constrainedformfinding.grad_norm)
panel_2 = Panel(constrainedformfinding.iters)
panel_3 = Panel(constrainedformfinding.objective)
panel_4 = Panel(constrainedformfinding.status)
panel_5 = Panel(constrainedformfinding.time)
data = Data(constrainedformfinding.form)

# ---- group: Select what form diagram to display
# 03-A Display form diagram
what_to_display = ValueList({"Form": 0, "Constrained Form": 1}, selected="Constrained Form")
constrained_form = Data(data)
form_3 = Data(form)
filter = StreamFilter(Gate=what_to_display, Stream0=form_3, Stream1=constrained_form)

# ---- group: Select what form diagram to display / Translate form diagram
ghpython_script = GhPythonScript(form=filter, x=number_39, y="0.0")  # -> out, form
# ---------- ghpython_script: Python ----------
from compas.geometry import Translation
from compas.datastructures import network_transformed


translation = Translation.from_vector([x, y, 0.0])
form = network_transformed(form, translation)
# ---------- end ghpython_script ----------

# ----
form_4 = Data(ghpython_script.form)

min_edge_force = Panel("0.001")
number_46 = Number(number_33)
number_47 = Number(number_34)
form_5 = Data(form_4)
cluster_5 = Cluster_3(data=form_5, second_number=min_edge_force)
cem_colors_4 = CEMColors()  # -> color_tension, color_compression, color_edge, color_node, color_node_support, color_node_origin, color_load, color_reaction, color_trail, color_auxiliary_trail; same code as cem_colors
edge_results_5 = EdgeResults(form=form_5, edge_keys=cluster_5)  # -> lengths, forces; inputs edge_keys: list; same code as edge_results
form_artist = FormArtist(form=form_5, edge_keys=cluster_5, force_min="0.01")  # -> nodes, support_nodes, edges, loads, reactions; inputs node_keys: list of Int32, edge_keys: list
#   port form: A COMPAS CEM topology diagram.
#   port node_keys: A selection of the node keys in the diagram. Defaults to all the node keys.
#   port edge_keys: A selection of the edge keys in the diagram. Defaults to all the edge keys.
#   port force_min: The smallest force magnitude to draw. Defaults to 1e-3
#   port force_scale: The scale of the loads and the reactions. Defaults to 1.
#   port nodes: The nodes of the diagram as points.
#   port support_nodes: The support nodes of the diagram as points
#   port edges: The edges of the diagram as lines.
#   port loads: The applied loads as lines.
#   port reactions: The reaction forces at the supports, as lines.
# ---------- form_artist: Python ----------
"""
Draw a form diagram.
"""
from ghpythonlib.componentbase import executingcomponent as component

from compas_cem.ghpython import FormArtist


class FormArtistComponent(component):
    def RunScript(self, form, node_keys, edge_keys, force_min, force_scale):
        node_keys = node_keys or None
        edge_keys = edge_keys or None
        force_min = force_min or 1e-3
        force_scale = force_scale or 1
        if form:
            artist = FormArtist(form, artist_type=FormArtist)

            nodes = artist.draw_nodes(node_keys)
            edges = artist.draw_edges(edge_keys)
            support_nodes = artist.draw_nodes_support(node_keys)

            loads = artist.draw_loads(node_keys, min_load=force_min, scale=force_scale)
            reactions = artist.draw_reactions(node_keys, min_force=force_min, scale=force_scale)

            return nodes, support_nodes, edges, loads, reactions
# ---------- end form_artist ----------
dom = ConstructDomain(DomainStart=number_46, DomainEnd=number_47)
abs = Absolute(Value=edge_results_5.forces)
merge_3 = Merge(Data1=cem_colors_4.color_compression, Data2=cem_colors_4.color_tension)
bnd = Bounds(Numbers=abs)
larger_than = LargerThan(FirstNumber=edge_results_5.forces, SecondNumber=0)  # -> LargerThan, OrEqualTo
length = Length(Curve=form_artist.edges)
remap = RemapNumbers(Value=abs, Source=bnd, Target=dom)  # -> Mapped, Clipped
larger_than_2 = LargerThan(FirstNumber=length, SecondNumber="0.01")  # -> LargerThan, OrEqualTo
list_item_3 = ListItem(List=merge_3, Index=larger_than.OrEqualTo, Wrap=True)
material_4 = CreateMaterial(Diffuse=list_item_3, Specular=RGB(255, 255, 255), Emission=list_item_3, Transparency=0, Shine="100")
cull_pattern = CullPattern(List=form_artist.edges, CullPattern=larger_than_2.LargerThan)
cull_pattern_2 = CullPattern(List=remap.Mapped, CullPattern=larger_than_2.LargerThan)
pipe = Pipe(Curve=cull_pattern, Radius=cull_pattern_2, Caps=2)  # -> flatten(Pipe)

number_48 = Number(number_41)
number_49 = Number(number_35)
form_6 = Data(form_4)
number_50 = Number(number_40)
number_51 = Number(number_37)
number_52 = Number(number_38)
cluster_6 = Cluster_5(form=form_6, force_min=number_50, force_scale=number_48, number=number_49, B=number_51, B_2=number_52)
cem_colors_5 = CEMColors()  # -> color_tension, color_compression, color_edge, color_node, color_node_support, color_node_origin, color_load, color_reaction, color_trail, color_auxiliary_trail; same code as cem_colors
unit_z = UnitZ(Factor="2")
move_4 = Move(Geometry=cluster_6, Motion=unit_z)  # -> Geometry, Transform
material_5 = CreateMaterial(
    Diffuse=cem_colors_5.color_load,
    Specular=RGB(255, 255, 255),
    Emission=cem_colors_5.color_load,
    Transparency="0.2",
    Shine="100")

form_7 = Data(form_4)
number_53 = Number(number_40)
number_54 = Number(number_41)
number_55 = Number(number_36)
number_56 = Number(number_37)
number_57 = Number(number_38)
division = Division(A=number_54, B="2")
cluster_7 = Cluster_4(form=form_7, force_min=number_53, force_scale=division, number=number_55, B=number_56, B_2=number_57)

form_8 = Data(form_4)
integer_2 = Integer(integer)
form_artist_2 = FormArtist(form=form_8)  # -> nodes, support_nodes, edges, loads, reactions; inputs node: list of Int32, edge: list
#   port form: A COMPAS CEM topology diagram.
#   port node: A selection of the nodes in the diagram. Defaults to all the nodes.
#   port edge: A selection of the edges in the diagram. Defaults to all the edges.
#   port force_min: The smallest force magnitude to draw. Defaults to 1e-3
#   port force_scale: The scale of the loads and the reactions. Defaults to 1.
#   port nodes: The nodes of the diagram as points.
#   port support_nodes: The support nodes of the diagram as points
#   port edges: The edges of the diagram as lines.
#   port loads: The applied loads as lines.
#   port reactions: The reaction forces at the supports, as lines.
# ---------- form_artist_2: Python ----------
"""
Draw a form diagram.
"""
from ghpythonlib.componentbase import executingcomponent as component

from compas_cem.ghpython import FormArtist


class FormArtistComponent(component):
    def RunScript(self, form, node, edge, force_min, force_scale):
        node = node or None
        edge = edge or None
        force_min = force_min or 1e-3
        force_scale = force_scale or 1
        if form:
            artist = FormArtist(form, artist_type=FormArtist)

            nodes = artist.draw_nodes(node)
            edges = artist.draw_edges(edge)
            support_nodes = artist.draw_nodes_support(node)

            loads = artist.draw_loads(node, min_load=force_min, scale=force_scale)
            reactions = artist.draw_reactions(node, min_force=force_min, scale=force_scale)

            return nodes, support_nodes, edges, loads, reactions
# ---------- end form_artist_2 ----------
curve_middle_3 = CurveMiddle(Curve=form_artist_2.edges)
edgeresults = EdgeResults(form=form_8)  # -> length, force; inputs edge: list
#   port form: A COMPAS CEM form diagram.
#   port edge: A selection of edge keys to query the results on. Defaults to all the edges.
#   port length: The edge lengths.
#   port force: The edge forces.
# ---------- edgeresults: Python ----------
"""
Extract the post form-finding results of the edges in a form diagram.
"""
from ghpythonlib.componentbase import executingcomponent as component


class EdgeResultsComponent(component):
    def RunScript(self, form, edge):
        if form:
            edge = edge or list(form.edges())
            length = [form.edge_length_2(ed) for ed in edge]
            force = [form.edge_force(ed) for ed in edge]
            return length, force
# ---------- end edgeresults ----------
stream_filter = StreamFilter(Gate=integer_2, Stream0=edgeresults.force, Stream1=edgeresults.length)
ghpython_script_2 = GhPythonScript(x=stream_filter)  # -> out, a
# ---------- ghpython_script_2: Python ----------
a = round(x, 2)
# ---------- end ghpython_script_2 ----------

form_9 = Data(form_4)
form_artist_3 = FormArtist(form=form_9)  # -> nodes, support_nodes, edges, loads, reactions; inputs node_keys: list of Int32, edge_keys: list; same code as form_artist
disassemble_form_diagram = DisassembleFormDiagram(form=form_9)  # -> node_keys, support_node_keys, edge_keys; same code as disassemble_form_diagram
curve_middle_4 = CurveMiddle(Curve=form_artist_3.edges)

form_10 = Data(form_4)
number_58 = Number(number_40)
number_59 = Number(number_41)
form_artist_4 = FormArtist(form=form_10, force_min=number_58, force_scale=number_59)  # -> nodes, support_nodes, edges, loads, reactions; inputs node_keys: list of Int32, edge_keys: list; same code as form_artist
cem_colors_6 = CEMColors()  # -> color_tension, color_compression, color_edge, color_node, color_node_support, color_node_origin, color_load, color_reaction, color_trail, color_auxiliary_trail; same code as cem_colors
cluster_8 = Cluster_6(curve=form_artist_4.loads)  # -> vector, geometry
unit_vector_2 = UnitVector(Vector=cluster_8.vector)
vector_length_2 = VectorLength(Vector=cluster_8.vector)
multiplication_7 = Multiplication(A=unit_vector_2, B=vector_length_2)
move_5 = Move(Geometry=cluster_8.geometry, Motion=multiplication_7)  # -> Geometry, Transform

form_11 = Data(form_4)
number_60 = Number(number_40)
number_61 = Number(number_41)
form_artist_5 = FormArtist(form=form_11, force_min=number_60, force_scale=number_61)  # -> nodes, support_nodes, edges, loads, reactions; inputs node_keys: list of Int32, edge_keys: list; same code as form_artist
cem_colors_7 = CEMColors()  # -> color_tension, color_compression, color_edge, color_node, color_node_support, color_node_origin, color_load, color_reaction, color_trail, color_auxiliary_trail; same code as cem_colors
cluster_9 = Cluster_6(curve=form_artist_5.reactions)  # -> vector, geometry
vector_length_3 = VectorLength(Vector=cluster_9.vector)
unit_vector_3 = UnitVector(Vector=cluster_9.vector)
multiplication_8 = Multiplication(A=unit_vector_3, B=vector_length_3)
move_6 = Move(Geometry=cluster_9.geometry, Motion=multiplication_8)  # -> Geometry, Transform

form_12 = Data(form_4)
form_artist_6 = FormArtist(form=form_12)  # -> nodes, support_nodes, edges, loads, reactions; inputs node_keys: list of Int32, edge_keys: list; same code as form_artist
edgeresults_2 = EdgeResults(form=form_12)  # -> length, force; inputs edge: list; same code as edgeresults
cem_colors_8 = CEMColors()  # -> color_tension, color_compression, color_edge, color_node, color_node_support, color_node_origin, color_load, color_reaction, color_trail, color_auxiliary_trail; same code as cem_colors
larger_than_3 = LargerThan(FirstNumber=edgeresults_2.force, SecondNumber=0)  # -> LargerThan, OrEqualTo
merge_4 = Merge(Data1=cem_colors_8.color_compression, Data2=cem_colors_8.color_tension)
list_item_4 = ListItem(List=merge_4, Index=larger_than_3.OrEqualTo, Wrap=True)

edgeresults_3 = EdgeResults(form=form_8)  # -> length, force; inputs edge: list; same code as edgeresults
larger_than_4 = LargerThan(FirstNumber=edgeresults_3.force, SecondNumber="0.001")  # -> LargerThan, OrEqualTo
cull_pattern_3 = CullPattern(List=material_4, CullPattern=larger_than_2.LargerThan)
colour = Colour(ColourSwatch(SwatchColor=RGB(76, 76, 76)))
material_6 = CreateMaterial(Diffuse=colour, Specular=RGB(255, 255, 255), Emission=colour, Transparency="0.2", Shine="100")

# ---- group: Edges
custom_preview_9 = CustomPreview(Geometry=form_artist_6.edges, Material=list_item_4)

# ---- group: Edge results
text_tag_4 = TextTag(Location=curve_middle_3, Text=ghpython_script_2.a, Colour=ColourSwatch(SwatchColor=RGBA(94, 94, 94, 195)))

# ---- group: Node keys
text_tag_5 = TextTag(Location=form_artist_3.nodes, Text=disassemble_form_diagram.node_keys, Colour=colour_swatch_2)

# ---- group: Edge keys
text_tag_6 = TextTag(Location=curve_middle_4, Text=disassemble_form_diagram.edge_keys, Colour=colour_swatch_2)

# ---- group: Loads
vector_display_ex_2 = VectorDisplayEx(Point=move_5.Geometry, Vector=cluster_8.vector, Colour=cem_colors_6.color_load, Width=2)

# ---- group: Reactions
vector_display_ex_3 = VectorDisplayEx(Point=move_6.Geometry, Vector=cluster_9.vector, Colour=cem_colors_7.color_reaction, Width=2)

# ---- group: Reactions - Piped
preview = CustomPreview(Geometry=cluster_7, Material=material_6)

# ---- group: Loads - Piped
preview_2 = CustomPreview(Geometry=move_4.Geometry, Material=material_5)

# ---- group: Edges - Piped
preview_3 = CustomPreview(Geometry=pipe, Material=cull_pattern_3)

# ==== cluster Cluster
curve = ClusterInput()
curve_2 = ClusterInput()
curve_3 = Curve(curve)
curve_4 = Curve(curve_2)
graft_tree = GraftTree(Tree=curve_3, IncludeEmptyLists=True, IncludeNullItems=True)
curve_curve = CurveCurve(CurveA=graft_tree, CurveB=curve_4)  # -> Points, ParamsA, ParamsB
trim_tree = TrimTree(Tree=curve_curve.ParamsA, Depth=1)
shatter = Shatter(Curve=graft_tree, Parameters=trim_tree)
end = EndPoints(Curve=shatter)  # -> Start, End
ln = Line(StartPoint=end.Start, EndPoint=end.End)  # -> flatten(Line)
curve_5 = Curve(ln)
curve_6 = ClusterOutput(curve_5)

# ==== cluster Cluster_2
curve = ClusterInput()
curve_2 = Curve(curve)
curve_middle = CurveMiddle(Curve=curve_2)
deconstruct = Deconstruct(Point=curve_middle)  # -> XComponent, YComponent, ZComponent
sort_list = SortList(Keys=deconstruct.ZComponent, ValuesValuesA=curve_2)  # -> Keys, ValuesValuesA
delete_consecutive = DeleteConsecutive(Set=sort_list.Keys, Wrap=False)  # -> Set, Count
list_item = ListItem(List=delete_consecutive.Set, Index=0, Wrap=True)
equality = Equality(FirstNumber=list_item, SecondNumber=sort_list.Keys)  # -> Equality, Inequality
cull_pattern = CullPattern(List=sort_list.ValuesValuesA, CullPattern=equality.Inequality)
list = ClusterOutput(cull_pattern)

# ==== cluster Cluster_3
data = ClusterInput()
data_2 = Data(data)
edge_results = EdgeResults(form=data_2)  # -> lengths, forces; inputs edge_keys: list
#   port form: A COMPAS CEM form diagram.
#   port edge_keys: A selection of edge keys to query the results on. Defaults to all the edge keys.
#   port lengths: The edge lengths.
#   port forces: The edge forces.
# ---------- edge_results: Python ----------
"""
Extract the post form-finding results of the edges in a form diagram.
"""
from ghpythonlib.componentbase import executingcomponent as component


class EdgeResultsComponent(component):
    def RunScript(self, form, edge_keys):
        if form:
            edge_keys = edge_keys or list(form.edges())
            lengths = [form.edge_length_2(ed) for ed in edge_keys]
            forces = [form.edge_force(ed) for ed in edge_keys]
            return lengths, forces
# ---------- end edge_results ----------
disassemble_form_diagram = DisassembleFormDiagram(form=data_2)  # -> node_keys, support_node_keys, edge_keys
#   port form: A COMPAS CEM form diagram.
#   port node_keys: All the node keys in the form diagram.
#   port support_node_keys: The keys of the support nodes in the form diagram.
#   port edge_keys: All the edge keys in the form diagram.
# ---------- disassemble_form_diagram: Python ----------
"""
Disassemble a form diagram into its constituent parts.
"""
from ghpythonlib.componentbase import executingcomponent as component


class FormDisassemblyComponent(component):
    def RunScript(self, form):
        if form:
            edge_keys = list(form.edges())
            node_keys = list(form.nodes())
            support_node_keys = list(form.support_nodes())

            return node_keys, support_node_keys, edge_keys
# ---------- end disassemble_form_diagram ----------
absolute = Absolute(Value=edge_results.forces)
second_number = ClusterInput()
larger_than = LargerThan(FirstNumber=absolute, SecondNumber=second_number)  # -> LargerThan, OrEqualTo
cull_pattern = CullPattern(List=disassemble_form_diagram.edge_keys, CullPattern=larger_than.LargerThan)
list = ClusterOutput(cull_pattern)

# ==== cluster Cluster_4
number = ClusterInput()
form = ClusterInput()
force_min = ClusterInput()
force_scale = ClusterInput()
number_2 = Number(number)
form_artist = FormArtist(form=form, force_min=force_min, force_scale=force_scale)  # -> nodes, support_nodes, edges, loads, reactions; inputs node_keys: list of Int32, edge_keys: list
#   port form: A COMPAS CEM topology diagram.
#   port node_keys: A selection of the node keys in the diagram. Defaults to all the node keys.
#   port edge_keys: A selection of the edge keys in the diagram. Defaults to all the edge keys.
#   port force_min: The smallest force magnitude to draw. Defaults to 1e-3
#   port force_scale: The scale of the loads and the reactions. Defaults to 1.
#   port nodes: The nodes of the diagram as points.
#   port support_nodes: The support nodes of the diagram as points
#   port edges: The edges of the diagram as lines.
#   port loads: The applied loads as lines.
#   port reactions: The reaction forces at the supports, as lines.
# ---------- form_artist: Python ----------
"""
Draw a form diagram.
"""
from ghpythonlib.componentbase import executingcomponent as component

from compas_cem.ghpython import FormArtist


class FormArtistComponent(component):
    def RunScript(self, form, node_keys, edge_keys, force_min, force_scale):
        node_keys = node_keys or None
        edge_keys = edge_keys or None
        force_min = force_min or 1e-3
        force_scale = force_scale or 1
        if form:
            artist = FormArtist(form)

            nodes = artist.draw_nodes(node_keys)
            edges = artist.draw_edges(edge_keys)
            support_nodes = artist.draw_nodes_support(node_keys)

            loads = artist.draw_loads(node_keys, min_load=force_min, scale=force_scale)
            reactions = artist.draw_reactions(node_keys, min_force=force_min, scale=force_scale)

            return nodes, support_nodes, edges, loads, reactions
# ---------- end form_artist ----------
B = ClusterInput()
B_2 = ClusterInput()
division = Division(A=number_2, B=B)
flip = FlipCurve(Curve=form_artist.reactions)  # -> Curve, Flag
eval = EvaluateLength(Curve=flip.Curve, Length=number_2, Normalized=False)  # -> Point, Tangent, Parameter
shatter = Shatter(Curve=graft(flip.Curve), Parameters=graft(eval.Parameter))
division_2 = Division(A=division, B=B_2)
pframe = PerpFrame(Curve=flip.Curve, Parameter=eval.Parameter)
item = ListItem(List=shatter, Index=0, Wrap=True)  # -> Item1, Item
pflip = FlipPlane(Plane=pframe, ReverseX=False, ReverseY=False, SwapAxes=True)
cone = Cone(Base=pflip, Radius=division, Length=number_2)  # -> Cone, Tip
pipe = Pipe(Curve=item.Item1, Radius=division_2, Caps=2)
cap_holes = CapHoles(Brep=cone.Cone)
brep = Brep(cap_holes)
brep_2 = Brep(pipe)
brep_3 = Brep([brep_2, brep])
brep_4 = ClusterOutput(brep_3)

# ==== cluster Cluster_5
number = ClusterInput()
form = ClusterInput()
force_min = ClusterInput()
force_scale = ClusterInput()
form_artist = FormArtist(form=form, force_min=force_min, force_scale=force_scale)  # -> nodes, support_nodes, edges, loads, reactions; inputs node_keys: list of Int32, edge_keys: list; same code as form_artist
number_2 = Number(number)
B = ClusterInput()
division = Division(A=number_2, B=B)
flip = FlipCurve(Curve=form_artist.loads)  # -> Curve, Flag
B_2 = ClusterInput()
eval = EvaluateLength(Curve=flip.Curve, Length=number_2, Normalized=False)  # -> Point, Tangent, Parameter
shatter = Shatter(Curve=graft(flip.Curve), Parameters=graft(eval.Parameter))
division_2 = Division(A=division, B=B_2)
pframe = PerpFrame(Curve=flip.Curve, Parameter=eval.Parameter)
item = ListItem(List=shatter, Index=0, Wrap=True)  # -> Item1, Item
pflip = FlipPlane(Plane=pframe, ReverseX=False, ReverseY=False, SwapAxes=True)
cone = Cone(Base=pflip, Radius=division, Length=number_2)  # -> Cone, Tip
pipe = Pipe(Curve=item.Item1, Radius=division_2, Caps=2)
cap_holes = CapHoles(Brep=cone.Cone)
brep = Brep(cap_holes)
brep_2 = Brep(pipe)
brep_3 = Brep([brep_2, brep])
brep_4 = ClusterOutput(brep_3)

# ==== cluster Cluster_6
curve = ClusterInput()
end_points = EndPoints(Curve=curve)  # -> Start, End
vector_2pt = Vector2Pt(PointA=end_points.Start, PointB=end_points.End, Unitize=False)  # -> Vector, Length
reverse = Reverse(Vector=vector_2pt.Vector)
vector = ClusterOutput(vector_2pt.Vector)
move = Move(Geometry=end_points.Start, Motion=reverse)  # -> Geometry, Transform
geometry = ClusterOutput(move.Geometry)
