# Grasshopper definition bridge_3d.ghx (Grasshopper 1.0.7)

trail_edges_pylon_letten = Curve(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)
deviation_edge_pylon_letten = Curve([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])

# ----
# Bridge Deck
# Auxiliary Structure
# Pylon Wipkingen
# Pylon Sihlquai
# Pylon Letten
# Lateral
# Hangers
dev2_hangers = Curve([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])
dev1_lateral = Curve([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])

trail_edges_pylon_sihlquai = Curve(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)
deviation_edge_pylon_sihlquai = Curve([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])

# ---- group: supports
pt = Point([Point(24.88642696, 56.59985935, 0), Point(25.38642696, 55.35104777, 0), Point(25.38642696, 53.89392697, 0), Point(-8.113573039, 56.59985935, 0), Point(-8.613573039, 55.35104777, 0), Point(-8.613573039, 53.89392697, 0), Point(-5.480277211, 52.99002215, 0), Point(8.386426961, 52.99002215, 0), Point(22.25313113, 52.99002215, 0)])

# ---- group: load positions
pt_2 = Point([Point(7.886426961, 56.59985935, 0), Point(5.886426961, 56.59985935, 0), Point(3.886426961, 56.59985935, 0), Point(1.886426961, 56.59985935, 0), Point(-0.1135730391, 56.59985935, 0), Point(-2.113573039, 56.59985935, 0), Point(-4.113573039, 56.59985935, 0), Point(8.886426961, 56.59985935, 0), Point(10.88642696, 56.59985935, 0), Point(12.88642696, 56.59985935, 0), Point(14.88642696, 56.59985935, 0), Point(16.88642696, 56.59985935, 0), Point(18.88642696, 56.59985935, 0), Point(20.88642696, 56.59985935, 0)])

# ----
trail_edges_pylon_wipkingen = Curve(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)
deviation_edges_pylon_wipkingen = Curve([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])

trail_edges_auxiliary = Curve([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])
deviation_edge_d_51_and_d_52 = Curve([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])

# ----
# COMPAS CEM
# Copyright (c) 2021 Rafael Pastrana
# Color Code
# Trail Edges
# Deviation Edges
# Loads
# Supports
# Optimization
# Topology/Form Diagram
# Topology Visualization
# Form Visualization
# JSON serialization
# Don’t modify (unless you know what you are doing)
trail_edges_deck = Curve([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])
deviation_edge_d_53 = Curve(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)

internal_state = ValueList({"Tension": 1, "Compression": -1}, selected="Compression")
number = Number(internal_state)

internal_state_2 = ValueList({"Tension": 1, "Compression": -1}, selected="Tension")

internal_state_3 = ValueList({"Tension": 1, "Compression": -1}, selected="Tension")
force_deviation_edge_deck = Slider(1.2, range=0..5)
num = Number(force_deviation_edge_deck)
number_2 = Number(internal_state_3)

internal_state_4 = ValueList({"Tension": 1, "Compression": -1}, selected="Compression")
force_deviation_edge_hangers = Slider(1.3, range=0..2)
num_2 = Number(force_deviation_edge_hangers)
number_3 = Number(internal_state_4)

internal_state_5 = ValueList({"Tension": 1, "Compression": -1}, selected="Compression")
length_trail_edge_pylon_letten = Slider(1, range=0..15)
number_4 = Number(internal_state_5)
num_3 = Number(length_trail_edge_pylon_letten)

internal_state_6 = ValueList({"Tension": 1, "Compression": -1}, selected="Compression")
force_deviation_edge_pylon_letten = Slider(3, range=0..20)
number_5 = Number(internal_state_6)
num_4 = Number(force_deviation_edge_pylon_letten)

internal_state_7 = ValueList({"Tension": 1, "Compression": -1}, selected="Compression")
length_trail_edge_pylon_wipkingen = Slider(0, range=0..15)
number_6 = Number(internal_state_7)
num_5 = Number(length_trail_edge_pylon_wipkingen)

internal_state_8 = ValueList({"Tension": 1, "Compression": -1}, selected="Tension")
force_deviation_edges_pylon_wipkingen = Slider(0, range=-10..20)
num_6 = Number(force_deviation_edges_pylon_wipkingen)
number_7 = Number(internal_state_8)

internal_state_9 = ValueList({"Tension": 1, "Compression": -1}, selected="Compression")
length_trail_edge_pylon_sihlquai = Slider(0, range=0..15)
number_8 = Number(internal_state_9)
num_7 = Number(length_trail_edge_pylon_sihlquai)

internal_state_10 = ValueList({"Tension": 1, "Compression": -1}, selected="Tension")
force_deviation_edges_pylon_sihlquai = Slider(0, range=0..20)
number_9 = Number(internal_state_10)
num_8 = Number(force_deviation_edges_pylon_sihlquai)

pt_3 = Point(Point(62.09277345, 430.7839151, 0))
pt_4 = Point(Point(8.492773445, 430.7839151, -6.8))
pt_5 = Point([Point(4.092773445, 427.7339151, 2.9), Point(4.092773445, 433.8339151, 2.9), Point(12.89277345, 433.8339151, 2.9), Point(12.89277345, 427.7339151, 2.9)])
pt_6 = Point(Point(-70.00722655, 430.7839151, 0.6))
pt_7 = Point([Point(4.687773445, 430.7839151, 8.1), Point(12.29777345, 430.7839151, 8.1)])

panel = Panel("""0
2
18
20
22
24
54
56
58""")
entwine = Entwine(Branch00=pt_7, Branch01=pt_5, Branch02=pt_6, Branch03=pt_3, Branch04=pt_4, FlattenInputs=True)
flatten = FlattenTree(Tree=entwine, Path="{0}")
Y = UnitY(Factor="-350")
move = Move(Geometry=flatten, Motion=Y)  # -> Geometry, Transform
int = Integer(panel)
pt_8 = Point(move.Geometry)

length_trail_edges_t_32_to_t_47 = Slider(7.5, range=1.5..15)
num_9 = Number(length_trail_edges_t_32_to_t_47)

force_deviation_edge_d_53 = Slider(15, range=0..20)
num_10 = Number(force_deviation_edge_d_53)

length_trail_edges_deck_t_0_to_t_29 = Slider(7.5, range=0..15)
length_trail_edges_deck_t_0_to_t_29_2 = Slider(7.5, range=0..15)
num_11 = Number(length_trail_edges_deck_t_0_to_t_29)
num_12 = Number(length_trail_edges_deck_t_0_to_t_29_2)

force_deviation_edge_d_51_and_d_52 = Slider(20, range=0..20)
num_13 = Number(force_deviation_edge_d_51_and_d_52)

vec = VectorXYZ(XComponent="0.0", YComponent="0.0", ZComponent=Slider(-1.5, range=-10..0))  # -> Vector, Length
vec_2 = Vector(vec.Vector)

number_10 = Number(internal_state_2)

num_14 = Number(num_11)
crv = Curve(trail_edges_auxiliary)
num_15 = Number(num_12)
lng = ListLength(List=crv)
subtraction = Subtraction(A=lng, B="4")
dup = DuplicateData(Data=num_15, Number="4", Order=True)
dup_2 = DuplicateData(Data=num_14, Number=subtraction, Order=True)
merge = Merge(Data1=dup_2, Data2=dup)
num_16 = Number(merge)

# ---- group: Side chords
crv_2 = Curve(flatten(deviation_edge_d_51_and_d_52))
num_17 = Number(num_13)
number_11 = Number(number)
multiplication = Multiplication(A=num_17, B=number_11)
deviationedge = DeviationEdge(line=crv_2, force=multiplication)  # -> deviation_edge; inputs line: Line
#   port line: A line that defines the end nodes of the edge.
#   port force: The desired force on the edge. If negative, the edge is in compression. Otherwise, it is in tension.
#   port deviation_edge: A COMPAS CEM deviation edge.
# ---------- deviationedge: Python ----------
"""
Create a deviation edge from a line.
"""
from ghpythonlib.componentbase import executingcomponent as component

from compas_cem.elements import DeviationEdge

from compas_rhino.geometry import RhinoLine


class DeviationEdgeComponent(component):
    def RunScript(self, line, force):
        if not line or force is None:
            return
        line = RhinoLine.from_geometry(line).to_compas()
        return DeviationEdge.from_line(line, force=force)
# ---------- end deviationedge ----------
data = Data(deviationedge)

# ---- group: Pylon Wipkingen
crv_3 = Curve(flatten(deviation_edges_pylon_wipkingen))
num_18 = Number(num_6)
number_12 = Number(number_7)
multiplication_2 = Multiplication(A=num_18, B=number_12)
deviationedge_2 = DeviationEdge(line=crv_3, force=multiplication_2)  # -> deviation_edge; inputs line: Line; same code as deviationedge

# ---- group: Deck bracing
crv_4 = Curve(flatten(dev1_lateral))
num_19 = Number(num)
number_13 = Number(number_2)
multiplication_3 = Multiplication(A=num_19, B=number_13)
deviationedge_3 = DeviationEdge(line=crv_4, force=multiplication_3)  # -> deviation_edge; inputs line: Line; same code as deviationedge
data_2 = Data(deviationedge_3)

# ---- group: Middle chord
crv_5 = Curve(flatten(deviation_edge_d_53))
num_20 = Number(num_10)
number_14 = Number(number_10)
multiplication_4 = Multiplication(A=num_20, B=number_14)
deviationedge_4 = DeviationEdge(line=crv_5, force=multiplication_4)  # -> deviation_edge; inputs line: Line; same code as deviationedge
data_3 = Data(deviationedge_4)

# ---- group: Pylon Letten
crv_6 = Curve(flatten(deviation_edge_pylon_letten))
num_21 = Number(num_4)
number_15 = Number(number_5)
multiplication_5 = Multiplication(A=num_21, B=number_15)
deviationedge_5 = DeviationEdge(line=crv_6, force=multiplication_5)  # -> deviation_edge; inputs line: Line; same code as deviationedge

# ---- group: Pylon Sihlquai
crv_7 = Curve(flatten(deviation_edge_pylon_sihlquai))
num_22 = Number(num_8)
number_16 = Number(number_9)
multiplication_6 = Multiplication(A=num_22, B=number_16)
deviationedge_6 = DeviationEdge(line=crv_7, force=multiplication_6)  # -> deviation_edge; inputs line: Line; same code as deviationedge
data_4 = Data(deviationedge_6)

# ---- group: Hangers
crv_8 = Curve(flatten(dev2_hangers))
num_23 = Number(num_2)
number_17 = Number(number_3)
multiplication_7 = Multiplication(A=num_23, B=number_17)
deviationedge_7 = DeviationEdge(line=crv_8, force=multiplication_7)  # -> deviation_edge; inputs line: Line; same code as deviationedge
data_5 = Data(deviationedge_7)

# ----
pt_9 = Point(pt_2)
vec_3 = Vector(vec_2)
nodeload = NodeLoad(point=pt_9, vector=vec_3)  # -> node_load; inputs point: Point3d, vector: Vector3d
#   port point: The position of the node where to apply the load.
#   port vector: The load vector.
#   port node_load: A COMPAS CEM node load.
# ---------- nodeload: Python ----------
"""
Create a load vector to be applied at a node.
"""
from ghpythonlib.componentbase import executingcomponent as component

from compas_rhino.geometry import RhinoPoint
from compas_rhino.geometry import RhinoVector

from compas_cem.loads import NodeLoad


class NodeLoadComponent(component):
    def RunScript(self, point, vector):
        if not (point and vector):
            return

        point = RhinoPoint.from_geometry(point).to_compas()
        vector = RhinoVector.from_geometry(vector).to_compas()

        return NodeLoad.from_point_and_vector(point, vector)
# ---------- end nodeload ----------
data_6 = Data(nodeload)

# ---- group: Middle chord
crv_9 = Curve(trail_edges_deck)
num_24 = Number(num_9)
number_18 = Number(number_10)
multiplication_8 = Multiplication(A=num_24, B=number_18)
trailedge = TrailEdge(line=crv_9, length=multiplication_8)  # -> trail_edge; inputs line: Line, plane: Plane
#   port line: A line that defines the end nodes of the edge.
#   port length: The signed length of the edge. If negative, the edge is in compression. Otherwise, it is in tension. The length magnitude is ignored if a plane is supplied.
#   port plane: An optional plane to define the length of the trail edge relative to the projection of its start node onto the plane. The force state will be that specified by the length input parameter.
#   port trail_edge: A COMPAS CEM trail edge.
# ---------- trailedge: Python ----------
"""
Create a trail edge from a rhino line.
"""
from ghpythonlib.componentbase import executingcomponent as component

from compas_rhino.geometry import RhinoLine
from compas_rhino.geometry import RhinoPlane

from compas_cem.elements import TrailEdge


class TrailEdgeComponent(component):
    def RunScript(self, line, length, plane):
        if not line or length is None:
            return

        if plane is not None:
            plane = RhinoPlane.from_geometry(plane).to_compas()
        line = RhinoLine.from_geometry(line).to_compas()
        return TrailEdge.from_line(line, length=length, plane=plane)
# ---------- end trailedge ----------
data_7 = Data(trailedge)

# ---- group: Side chords
crv_10 = Curve(trail_edges_auxiliary)
num_25 = Number(num_16)
number_19 = Number(number)
multiplication_9 = Multiplication(A=num_25, B=number_19)
trailedge_2 = TrailEdge(line=crv_10, length=multiplication_9)  # -> trail_edge; inputs line: Line, plane: Plane; same code as trailedge
data_8 = Data(trailedge_2)

# ---- group: Pylon Letten
crv_11 = Curve(trail_edges_pylon_letten)
num_26 = Number(num_3)
number_20 = Number(number_4)
multiplication_10 = Multiplication(A=num_26, B=number_20)
trailedge_3 = TrailEdge(line=crv_11, length=multiplication_10)  # -> trail_edge; inputs line: Line, plane: Plane; same code as trailedge
data_9 = Data(trailedge_3)

# ---- group: Pylon Wipkingen
crv_12 = Curve(trail_edges_pylon_wipkingen)
num_27 = Number(num_5)
number_21 = Number(number_6)
multiplication_11 = Multiplication(A=num_27, B=number_21)
trailedge_4 = TrailEdge(line=crv_12, length=multiplication_11)  # -> trail_edge; inputs line: Line, plane: Plane; same code as trailedge

# ---- group: Pylon Sihlquai
crv_13 = Curve(trail_edges_pylon_sihlquai)
num_28 = Number(num_7)
number_22 = Number(number_8)
multiplication_12 = Multiplication(A=num_28, B=number_22)
trailedge_5 = TrailEdge(line=crv_13, length=multiplication_12)  # -> trail_edge; inputs line: Line, plane: Plane; same code as trailedge
data_10 = Data(trailedge_5)

# ----
pt_10 = Point(pt)
nodesupport = NodeSupport(point=pt_10)  # -> node_support; inputs point: Point3d
#   port point: The position of the node where to assign a support.
#   port node_support: A COMPAS CEM node support.
# ---------- nodesupport: Python ----------
"""
Create a node support from a point.
"""
from ghpythonlib.componentbase import executingcomponent as component

from compas_rhino.geometry import RhinoPoint
from compas_cem.supports import NodeSupport


class NodeSupportComponent(component):
    def RunScript(self, point):
        if not point:
            return

        xyz = RhinoPoint.from_geometry(point).to_compas()
        return NodeSupport.from_point(xyz)
# ---------- end nodesupport ----------
data_11 = Data(nodesupport)

# ---- group: Pylon Letten
data_12 = Data(deviationedge_5)

# ---- group: Pylon Wipkingen
data_13 = Data(trailedge_4)
data_14 = Data(deviationedge_2)

# ----
data_15 = Data(data_7)
data_16 = Data(data_13)
data_17 = Data(data_10)
data_18 = Data(data_9)
data_19 = Data(data_8)
deviations = Merge(Data1=flatten(data_15), Data2=flatten(data_19), Data3=flatten(data_16), Data4=flatten(data_17), Data5=flatten(data_18))
data_20 = Data(deviations)

data_21 = Data(data_3)
data_22 = Data(data_14)
data_23 = Data(data_4)
data_24 = Data(data_12)
data_25 = Data(data_2)
data_26 = Data(data_5)
data_27 = Data(data)
deviations_2 = Merge(
    Data1=flatten(data_21),
    Data2=flatten(data_27),
    Data3=flatten(data_22),
    Data4=flatten(data_23),
    Data5=flatten(data_24),
    Data6=flatten(data_25),
    Data7=flatten(data_26))
data_28 = Data(deviations_2)

data_29 = Data(data_20)
data_30 = Data(data_11)
data_31 = Data(data_28)
data_32 = Data(data_6)
assemble_topology_diagram = AssembleTopologyDiagram(trail_edges=data_29, deviation_edges=data_31, loads=data_32, supports=data_30, add_auxiliary_trails=Toggle(False))  # -> topology; inputs trail_edges: list, deviation_edges: list, loads: list, supports: list, add_auxiliary_trails: Boolean
#   port trail_edges: The COMPAS CEM trail edges to add to the diagram.
#   port deviation_edges: The COMPAS CEM deviation edges to add to the diagram.
#   port loads: The COMPAS CEM loads to add to the diagram.
#   port supports: The COMPAS CEM supports to add to the diagram.
#   port add_auxiliary_trails: Append auxiliary trails to the free nodes of the topology diagram. Defaults to False.
#   port topology: A COMPAS CEM topology diagram.
# ---------- assemble_topology_diagram: Python ----------
"""
Assemble a topology diagram.
"""
from ghpythonlib.componentbase import executingcomponent as component

from compas_cem.diagrams import TopologyDiagram


class AssembleTopologyDiagramComponent(component):
    def RunScript(self, trail_edges, deviation_edges, loads, supports, add_auxiliary_trails):

        add_auxiliary_trails = add_auxiliary_trails or False
        topology = TopologyDiagram()

        if trail_edges:
            for trail_edge in trail_edges:
                if trail_edge:
                    topology.add_edge(trail_edge)

        if deviation_edges:
            for deviation_edge in deviation_edges:
                if deviation_edge:
                    topology.add_edge(deviation_edge)

        if loads:
            for load in loads:
                if load:
                    topology.add_load(load)

        if supports:
            for support in supports:
                if support:
                    topology.add_support(support)

        if trail_edges and supports:
            topology.build_trails(add_auxiliary_trails)

        elif deviation_edges and add_auxiliary_trails:
            topology.build_trails(add_auxiliary_trails)

        return topology
# ---------- end assemble_topology_diagram ----------
data_33 = Data(assemble_topology_diagram)

forces_scale = Slider(0.4, range=0..1)
dash_length = Slider(0.03, range=0..0.1)
sphere_radius = Slider(0.06, range=0..1)
forces_min = Slider(0.001, range=0..0.001)
number_23 = Number(forces_scale)
number_24 = Number(sphere_radius)
number_25 = Number(dash_length)
number_26 = Number(forces_min)

pipe_min_radius = Slider(0.02, range=0..0.1)
loads_radius_scale = Slider(0.5, range=0..1)
arrow_head_ratio = Slider(2, range=0..10)
pipe_max_radius = Slider(0.3, range=0..0.4)
reactions_radius_scale = Slider(0.6, range=0..1)
arrow_height_ratio = Slider(3, range=0..10)
number_27 = Number(pipe_min_radius)
number_28 = Number(pipe_max_radius)
number_29 = Number(reactions_radius_scale)
number_30 = Number(loads_radius_scale)
number_31 = Number(arrow_height_ratio)
number_32 = Number(arrow_head_ratio)

edge_result_to_display = ValueList({"Forces": 0, "Lengths": 1}, selected="Forces")
forces_min_2 = Slider(0.001, range=0..0.001)
forces_scale_2 = Slider(1, range=0..2)
number_33 = Number(forces_min_2)
number_34 = Number(forces_scale_2)
integer = Integer(edge_result_to_display)

min_edge_force = Panel("0.001")

colour_swatch = ColourSwatch(SwatchColor=RGBA(156, 156, 156, 195))

data_34 = Data(data_33)
int_2 = Integer(int)
pt_11 = Point(pt_8)

# ---- group: Change the XYZ position of the origin nodes
python = GhPythonScript(topology=data_34, node=int_2, point=pt_11)  # -> out, topology; inputs node: list of Int32, point: list of Point3d
# ---------- python: Python ----------
topology = topology.copy()

for nd, pt in zip(node, point):
    topology.node_xyz(nd, pt)
# ---------- end python ----------

# ----
data_35 = Data(python.topology)

data_36 = Data(data_35)
formfinding = FormFinding(topology=data_36)  # -> form; inputs kmax: Int32, tmax: Int32
#   port topology: A COMPAS CEM topology diagram.
#   port kmax: The maximum number of sequences to run the form-finding algorithm for. Defaults to all the sequences in the diagram.
#   port tmax: The maximum number of iterations to run the form-finding algorithm for. Defaults to 100.
#   port eta: The convergence threshold of the form-finding algorithm. Default to 1e-6.
#   port form: A COMPAS CEM form diagram in static equilibrium.
# ---------- formfinding: Python ----------
"""
Generate a form diagram in static equilibrium.
"""
from ghpythonlib.componentbase import executingcomponent as component

from compas_cem.equilibrium import static_equilibrium


class FormFindingComponent(component):
    def RunScript(self, topology, kmax, tmax, eta):
        eta = eta or 1e-6
        tmax = tmax or 100

        if not topology:
            return

        return static_equilibrium(topology, kmax=kmax, tmax=tmax, eta=eta)
# ---------- end formfinding ----------
data_37 = Data(formfinding)

# ---- group: Select what form diagram to display
# 03-A Display form diagram
what_to_display = ValueList({"Form": 0, "Constrained Form": 1}, selected="Form")
constrained_form = Data()
form = Data(data_37)
filter = StreamFilter(Gate=what_to_display, Stream0=form, Stream1=constrained_form)
form_2 = Data(filter)

# ----
form_3 = Data(form_2)

min_edge_force_2 = Panel("0.001")
number_35 = Number(number_27)
number_36 = Number(number_28)
form_4 = Data(form_3)
cluster = Cluster(data=form_4, second_number=min_edge_force_2)
cem_colors = CEMColors()  # -> color_tension, color_compression, color_edge, color_node, color_node_support, color_node_origin, color_load, color_reaction, color_trail, color_auxiliary_trail
#   port color_tension: The color for edges under a tension force.
#   port color_compression: The color for edges under a compression force.
#   port color_edge: The color for a regular edge.
#   port color_node: The color for a regular node.
#   port color_node_support: The color for a support node.
#   port color_node_origin: The color for an origin node.
#   port color_load: The color for an applied load.
#   port color_reaction: The color for a reaction force.
#   port color_trail: The color to paint a trail.
#   port color_auxiliary_trail: The color to paint an auxiliary trail.
# ---------- cem_colors: Python ----------
"""
Get the artists color scheme for the objects of the CEM framework.
"""
from ghpythonlib.componentbase import executingcomponent as component

from compas_cem import COLORS
import rhinoscriptsyntax as rs


class ArtistColorsComponent(component):
    def RunScript(self):
        colors = {key: rs.CreateColor(c) for key, c in COLORS.items()}

        color_tension = colors["tension"]
        color_compression = colors["compression"]
        color_edge = colors["edge"]
        color_node = colors["node"]
        color_node_support = colors["node_support"]
        color_node_origin = colors["node_origin"]
        color_load = colors["load"]
        color_reaction = colors["support_force"]
        color_trail = colors["trail"]
        color_auxiliary_trail = colors["auxiliary_trail"]

        colors = (color_tension, color_compression, color_edge, color_node, color_node_support, color_node_origin, color_load, color_reaction, color_trail, color_auxiliary_trail)

        return colors
# ---------- end cem_colors ----------
edge_results = EdgeResults(form=form_4, edge_keys=cluster)  # -> lengths, forces; inputs edge_keys: list; same code as edge_results
form_artist = FormArtist(form=form_4, edge_keys=cluster, force_min="0.01")  # -> nodes, support_nodes, edges, loads, reactions; inputs node_keys: list of Int32, edge_keys: list
#   port form: A COMPAS CEM topology diagram.
#   port node_keys: A selection of the node keys in the diagram. Defaults to all the node keys.
#   port edge_keys: A selection of the edge keys in the diagram. Defaults to all the edge keys.
#   port force_min: The smallest force magnitude to draw. Defaults to 1e-3
#   port force_scale: The scale of the loads and the reactions. Defaults to 1.
#   port nodes: The nodes of the diagram as points.
#   port support_nodes: The support nodes of the diagram as points
#   port edges: The edges of the diagram as lines.
#   port loads: The applied loads as lines.
#   port reactions: The reaction forces at the supports, as lines.
# ---------- form_artist: Python ----------
"""
Draw a form diagram.
"""
from ghpythonlib.componentbase import executingcomponent as component

from compas_cem.ghpython import FormArtist


class FormArtistComponent(component):
    def RunScript(self, form, node_keys, edge_keys, force_min, force_scale):
        node_keys = node_keys or None
        edge_keys = edge_keys or None
        force_min = force_min or 1e-3
        force_scale = force_scale or 1
        if form:
            artist = FormArtist(form, artist_type=FormArtist)

            nodes = artist.draw_nodes(node_keys)
            edges = artist.draw_edges(edge_keys)
            support_nodes = artist.draw_nodes_support(node_keys)

            loads = artist.draw_loads(node_keys, min_load=force_min, scale=force_scale)
            reactions = artist.draw_reactions(node_keys, min_force=force_min, scale=force_scale)

            return nodes, support_nodes, edges, loads, reactions
# ---------- end form_artist ----------
dom = ConstructDomain(DomainStart=number_35, DomainEnd=number_36)
abs = Absolute(Value=edge_results.forces)
merge_2 = Merge(Data1=cem_colors.color_compression, Data2=cem_colors.color_tension)
bnd = Bounds(Numbers=abs)
larger_than = LargerThan(FirstNumber=edge_results.forces, SecondNumber=0)  # -> LargerThan, OrEqualTo
length = Length(Curve=form_artist.edges)
remap = RemapNumbers(Value=abs, Source=bnd, Target=dom)  # -> Mapped, Clipped
larger_than_2 = LargerThan(FirstNumber=length, SecondNumber="0.01")  # -> LargerThan, OrEqualTo
list_item = ListItem(List=merge_2, Index=larger_than.OrEqualTo, Wrap=True)
material = CreateMaterial(Diffuse=list_item, Specular=RGB(255, 255, 255), Emission=list_item, Transparency=0, Shine="100")
cull_pattern = CullPattern(List=form_artist.edges, CullPattern=larger_than_2.LargerThan)
cull_pattern_2 = CullPattern(List=remap.Mapped, CullPattern=larger_than_2.LargerThan)
pipe = Pipe(Curve=cull_pattern, Radius=cull_pattern_2, Caps=2)  # -> flatten(Pipe)

number_37 = Number(number_34)
number_38 = Number(number_30)
form_5 = Data(form_3)
number_39 = Number(number_33)
number_40 = Number(number_31)
number_41 = Number(number_32)
cluster_2 = Cluster_3(form=form_5, force_min=number_39, force_scale=number_37, number=number_38, B=number_40, B_2=number_41)
cem_colors_2 = CEMColors()  # -> color_tension, color_compression, color_edge, color_node, color_node_support, color_node_origin, color_load, color_reaction, color_trail, color_auxiliary_trail; same code as cem_colors
unit_z = UnitZ(Factor="2")
move_2 = Move(Geometry=cluster_2, Motion=unit_z)  # -> Geometry, Transform
material_2 = CreateMaterial(
    Diffuse=cem_colors_2.color_load,
    Specular=RGB(255, 255, 255),
    Emission=cem_colors_2.color_load,
    Transparency="0.2",
    Shine="100")

form_6 = Data(form_3)
number_42 = Number(number_33)
number_43 = Number(number_34)
number_44 = Number(number_29)
number_45 = Number(number_31)
number_46 = Number(number_32)
division = Division(A=number_43, B="2")
cluster_3 = Cluster_2(form=form_6, force_min=number_42, force_scale=division, number=number_44, B=number_45, B_2=number_46)

form_7 = Data(form_3)
integer_2 = Integer(integer)
form_artist_2 = FormArtist(form=form_7)  # -> nodes, support_nodes, edges, loads, reactions; inputs node: list of Int32, edge: list
#   port form: A COMPAS CEM topology diagram.
#   port node: A selection of the nodes in the diagram. Defaults to all the nodes.
#   port edge: A selection of the edges in the diagram. Defaults to all the edges.
#   port force_min: The smallest force magnitude to draw. Defaults to 1e-3
#   port force_scale: The scale of the loads and the reactions. Defaults to 1.
#   port nodes: The nodes of the diagram as points.
#   port support_nodes: The support nodes of the diagram as points
#   port edges: The edges of the diagram as lines.
#   port loads: The applied loads as lines.
#   port reactions: The reaction forces at the supports, as lines.
# ---------- form_artist_2: Python ----------
"""
Draw a form diagram.
"""
from ghpythonlib.componentbase import executingcomponent as component

from compas_cem.ghpython import FormArtist


class FormArtistComponent(component):
    def RunScript(self, form, node, edge, force_min, force_scale):
        node = node or None
        edge = edge or None
        force_min = force_min or 1e-3
        force_scale = force_scale or 1
        if form:
            artist = FormArtist(form, artist_type=FormArtist)

            nodes = artist.draw_nodes(node)
            edges = artist.draw_edges(edge)
            support_nodes = artist.draw_nodes_support(node)

            loads = artist.draw_loads(node, min_load=force_min, scale=force_scale)
            reactions = artist.draw_reactions(node, min_force=force_min, scale=force_scale)

            return nodes, support_nodes, edges, loads, reactions
# ---------- end form_artist_2 ----------
curve_middle = CurveMiddle(Curve=form_artist_2.edges)
edgeresults = EdgeResults(form=form_7)  # -> length, force; inputs edge: list
#   port form: A COMPAS CEM form diagram.
#   port edge: A selection of edge keys to query the results on. Defaults to all the edges.
#   port length: The edge lengths.
#   port force: The edge forces.
# ---------- edgeresults: Python ----------
"""
Extract the post form-finding results of the edges in a form diagram.
"""
from ghpythonlib.componentbase import executingcomponent as component


class EdgeResultsComponent(component):
    def RunScript(self, form, edge):
        if form:
            edge = edge or list(form.edges())
            length = [form.edge_length_2(ed) for ed in edge]
            force = [form.edge_force(ed) for ed in edge]
            return length, force
# ---------- end edgeresults ----------
stream_filter = StreamFilter(Gate=integer_2, Stream0=edgeresults.force, Stream1=edgeresults.length)
ghpython_script = GhPythonScript(x=stream_filter)  # -> out, a
# ---------- ghpython_script: Python ----------
a = round(x, 2)
# ---------- end ghpython_script ----------

form_8 = Data(form_3)
form_artist_3 = FormArtist(form=form_8)  # -> nodes, support_nodes, edges, loads, reactions; inputs node_keys: list of Int32, edge_keys: list; same code as form_artist
disassemble_form_diagram = DisassembleFormDiagram(form=form_8)  # -> node_keys, support_node_keys, edge_keys; same code as disassemble_form_diagram
curve_middle_2 = CurveMiddle(Curve=form_artist_3.edges)

form_9 = Data(form_3)
number_47 = Number(number_33)
number_48 = Number(number_34)
form_artist_4 = FormArtist(form=form_9, force_min=number_47, force_scale=number_48)  # -> nodes, support_nodes, edges, loads, reactions; inputs node_keys: list of Int32, edge_keys: list; same code as form_artist
cem_colors_3 = CEMColors()  # -> color_tension, color_compression, color_edge, color_node, color_node_support, color_node_origin, color_load, color_reaction, color_trail, color_auxiliary_trail; same code as cem_colors
cluster_4 = Cluster_4(curve=form_artist_4.loads)  # -> vector, geometry
unit_vector = UnitVector(Vector=cluster_4.vector)
vector_length = VectorLength(Vector=cluster_4.vector)
multiplication_13 = Multiplication(A=unit_vector, B=vector_length)
move_3 = Move(Geometry=cluster_4.geometry, Motion=multiplication_13)  # -> Geometry, Transform

form_10 = Data(form_3)
number_49 = Number(number_33)
number_50 = Number(number_34)
form_artist_5 = FormArtist(form=form_10, force_min=number_49, force_scale=number_50)  # -> nodes, support_nodes, edges, loads, reactions; inputs node_keys: list of Int32, edge_keys: list; same code as form_artist
cem_colors_4 = CEMColors()  # -> color_tension, color_compression, color_edge, color_node, color_node_support, color_node_origin, color_load, color_reaction, color_trail, color_auxiliary_trail; same code as cem_colors
cluster_5 = Cluster_4(curve=form_artist_5.reactions)  # -> vector, geometry
vector_length_2 = VectorLength(Vector=cluster_5.vector)
unit_vector_2 = UnitVector(Vector=cluster_5.vector)
multiplication_14 = Multiplication(A=unit_vector_2, B=vector_length_2)
move_4 = Move(Geometry=cluster_5.geometry, Motion=multiplication_14)  # -> Geometry, Transform

form_11 = Data(form_3)
form_artist_6 = FormArtist(form=form_11)  # -> nodes, support_nodes, edges, loads, reactions; inputs node_keys: list of Int32, edge_keys: list; same code as form_artist
edgeresults_2 = EdgeResults(form=form_11)  # -> length, force; inputs edge: list; same code as edgeresults
cem_colors_5 = CEMColors()  # -> color_tension, color_compression, color_edge, color_node, color_node_support, color_node_origin, color_load, color_reaction, color_trail, color_auxiliary_trail; same code as cem_colors
larger_than_3 = LargerThan(FirstNumber=edgeresults_2.force, SecondNumber=0)  # -> LargerThan, OrEqualTo
merge_3 = Merge(Data1=cem_colors_5.color_compression, Data2=cem_colors_5.color_tension)
list_item_2 = ListItem(List=merge_3, Index=larger_than_3.OrEqualTo, Wrap=True)

edgeresults_3 = EdgeResults(form=form_7)  # -> length, force; inputs edge: list; same code as edgeresults
larger_than_4 = LargerThan(FirstNumber=edgeresults_3.force, SecondNumber="0.001")  # -> LargerThan, OrEqualTo
cull_pattern_3 = CullPattern(List=material, CullPattern=larger_than_2.LargerThan)
colour = Colour(ColourSwatch(SwatchColor=RGB(76, 76, 76)))
material_3 = CreateMaterial(Diffuse=colour, Specular=RGB(255, 255, 255), Emission=colour, Transparency="0.2", Shine="100")

# ---- group: Edges
custom_preview = CustomPreview(Geometry=form_artist_6.edges, Material=list_item_2)

# ---- group: Node keys
text_tag = TextTag(Location=form_artist_3.nodes, Text=disassemble_form_diagram.node_keys, Colour=colour_swatch)

# ---- group: Edge keys
text_tag_2 = TextTag(Location=curve_middle_2, Text=disassemble_form_diagram.edge_keys, Colour=colour_swatch)

# ---- group: Edge results
text_tag_3 = TextTag(Location=curve_middle, Text=ghpython_script.a, Colour=ColourSwatch(SwatchColor=RGBA(94, 94, 94, 195)))

# ---- group: Loads
vector_display_ex = VectorDisplayEx(Point=move_3.Geometry, Vector=cluster_4.vector, Colour=cem_colors_3.color_load, Width=2)

# ---- group: Reactions
vector_display_ex_2 = VectorDisplayEx(Point=move_4.Geometry, Vector=cluster_5.vector, Colour=cem_colors_4.color_reaction, Width=2)

# ---- group: Reactions - Piped
preview = CustomPreview(Geometry=cluster_3, Material=material_3)

# ---- group: Loads - Piped
preview_2 = CustomPreview(Geometry=move_2.Geometry, Material=material_2)

# ---- group: Edges - Piped
preview_3 = CustomPreview(Geometry=pipe, Material=cull_pattern_3)

# ----
# 03-B Display topology diagram
topology = Data(data_33)
translation_x = Slider(0, range=0..100)
translation_y = Slider(3, range=0..10)
number_51 = Number(translation_x)
number_52 = Number(number_51)
negative = Negative(Value=number_52)
number_53 = Number(translation_y)
number_54 = Number(number_53)
negative_2 = Negative(Value=number_54)

# ---- group: Translate topology diagram
ghpython_script_2 = GhPythonScript(topology=topology, x=negative, y=negative_2)  # -> out, topology
# ---------- ghpython_script_2: Python ----------
from compas.geometry import Translation
from compas.datastructures import network_transformed



translation = Translation.from_vector([x, y, 0.0])
topology = network_transformed(topology, translation)
# ---------- end ghpython_script_2 ----------

# ----
topology_2 = Data(ghpython_script_2.topology)

# ---- group: Display all edges in gray
topology_3 = Data(topology_2)
topology_artist = TopologyArtist(topology=topology_3)  # -> nodes, origin_nodes, support_nodes, edges, trail_edges, deviation_edges, trails, loads; inputs node_keys: list of Int32, edge_keys: list
#   port topology: A COMPAS CEM topology diagram.
#   port node_keys: A selection of the node keys in the diagram. Defaults to all the node keys.
#   port edge_keys: A selection of the edge keys in the diagram. Defaults to all the edge keys.
#   port force_min: The minimum force magnitude to plot. Defaults to 1e-3.
#   port force_scale: The scaling factor of the loads. Defaults to 1.
#   port nodes: The nodes in the diagram as points.
#   port origin_nodes: The origin nodes in the diagram as points.
#   port support_nodes: The support nodes in the diagram as points.
#   port edges: The edges in the diagram as lines.
#   port trail_edges: The trail edges in the diagram as lines.
#   port deviation_edges: The deviation edges in the diagram as lines.
#   port trails: The trails in the diagram as polylines.
#   port loads: The applied node loads as lines.
# ---------- topology_artist: Python ----------
"""
Draw a topology diagram.
"""
from ghpythonlib.componentbase import executingcomponent as component

from compas_cem.ghpython import TopologyArtist


class TopologyArtistComponent(component):
    def RunScript(self, topology, node_keys, edge_keys, force_min, force_scale):
        node_keys = node_keys or None
        edge_keys = edge_keys or None
        force_min = force_min or 1e-3
        force_scale = force_scale or 1.0
        if topology:
            artist = TopologyArtist(topology, artist_type=TopologyArtist)
            nodes = artist.draw_nodes(node_keys)
            origin_nodes = artist.draw_nodes_origin(node_keys)
            support_nodes = artist.draw_nodes_support(node_keys)

            edges = artist.draw_edges(edge_keys)
            trail_edges = artist.draw_edges_trail(edge_keys)
            deviation_edges = artist.draw_edges_deviation(edge_keys)

            trails = artist.draw_trails()

            loads = artist.draw_loads(node_keys, min_load=force_min, scale=force_scale)

            return nodes, origin_nodes, support_nodes, edges, trail_edges, deviation_edges, trails, loads
# ---------- end topology_artist ----------
custom_preview_2 = CustomPreview(Geometry=topology_artist.edges, Material=ColourSwatch(SwatchColor=RGB(0, 0, 0)))

# ----
topology_4 = Data(topology_2)
number_55 = Number(number_26)
number_56 = Number(number_23)
topology_artist_2 = TopologyArtist(topology=topology_4, force_min=number_55, force_scale=number_56)  # -> nodes, origin_nodes, support_nodes, edges, trail_edges, deviation_edges, trails, loads; inputs node_keys: list of Int32, edge_keys: list
#   port topology: A COMPAS CEM topology diagram.
#   port node_keys: A selection of the node keys in the diagram. Defaults to all the node keys.
#   port edge_keys: A selection of the edge keys in the diagram. Defaults to all the edge keys.
#   port force_min: The minimum force magnitude to plot. Defaults to 1e-3.
#   port force_scale: The scaling factor of the loads. Defaults to 1.
#   port nodes: The nodes in the diagram as points.
#   port origin_nodes: The origin nodes in the diagram as points.
#   port support_nodes: The support nodes in the diagram as points.
#   port edges: The edges in the diagram as lines.
#   port trail_edges: The trail edges in the diagram as lines.
#   port deviation_edges: The deviation edges in the diagram as lines.
#   port trails: The trails in the diagram as polylines.
#   port loads: The applied node loads as lines.
# ---------- topology_artist_2: Python ----------
"""
Draw a topology diagram.
"""
from ghpythonlib.componentbase import executingcomponent as component

from compas_cem.ghpython import TopologyArtist


class TopologyArtistComponent(component):
    def RunScript(self, topology, node_keys, edge_keys, force_min, force_scale):
        node_keys = node_keys or None
        edge_keys = edge_keys or None
        force_min = force_min or 1e-3
        force_scale = force_scale or 1.0
        if topology:
            artist = TopologyArtist(topology, artist_type=TopologyArtist)

            nodes = artist.draw_nodes(node_keys)
            origin_nodes = artist.draw_nodes_origin(node_keys)
            support_nodes = artist.draw_nodes_support(node_keys)

            edges = artist.draw_edges(edge_keys)
            trail_edges = artist.draw_edges_trail(edge_keys)
            deviation_edges = artist.draw_edges_deviation(edge_keys)

            trails = artist.draw_trails()

            loads = artist.draw_loads(node_keys, min_load=force_min, scale=force_scale)

            return nodes, origin_nodes, support_nodes, edges, trail_edges, deviation_edges, trails, loads
# ---------- end topology_artist_2 ----------
cem_colors_6 = CEMColors()  # -> color_tension, color_compression, color_edge, color_node, color_node_support, color_node_origin, color_load, color_reaction, color_trail, color_auxiliary_trail; same code as cem_colors
cluster_6 = Cluster_4(curve=topology_artist_2.loads)  # -> vector, geometry
vector_length_3 = VectorLength(Vector=cluster_6.vector)
unit_vector_3 = UnitVector(Vector=cluster_6.vector)
multiplication_15 = Multiplication(A=unit_vector_3, B=vector_length_3)
move_5 = Move(Geometry=cluster_6.geometry, Motion=multiplication_15)  # -> Geometry, Transform

topology_5 = Data(topology_2)
topology_artist_3 = TopologyArtist(topology=topology_5)  # -> nodes, origin_nodes, support_nodes, edges, trail_edges, deviation_edges, trails, loads; inputs node_keys: list of Int32, edge_keys: list; same code as topology_artist_2
disassemble_topology_diagram = DisassembleTopologyDiagram(topology=topology_5)  # -> node_keys, origin_node_keys, support_node_keys, edge_keys, trail_edge_keys, deviation_edge_keys, trail_keys, auxiliary_trail_keys
#   port topology: A COMPAS CEM topology diagram.
#   port node_keys: All the node keys in the topology diagram.
#   port origin_node_keys: The keys of the origin nodes in the topology diagram.
#   port support_node_keys: The keys of the support nodes in the topology diagram.
#   port edge_keys: All the edge keys in the topology diagram.
#   port trail_edge_keys: The keys of the trail edges in the topology diagram.
#   port deviation_edge_keys: The keys of the deviation edges in the topology diagram.
#   port trail_keys: The keys of the trails in the topology diagram.
#   port auxiliary_trail_keys: The keys of the auxiliary trails in the topology diagram.
# ---------- disassemble_topology_diagram: Python ----------
"""
Disassemble a topology diagram into its constituent parts.
"""
from ghpythonlib.componentbase import executingcomponent as component


class TopologyDisassemblyComponent(component):
    def RunScript(self, topology):
        if topology:
            trail_keys = list(topology.trails())
            auxiliary_trail_keys = list(topology.auxiliary_trails())

            edge_keys = list(topology.edges())
            trail_edge_keys = list(topology.trail_edges())
            deviation_edge_keys = list(topology.deviation_edges())

            node_keys = list(topology.nodes())
            origin_node_keys = list(topology.origin_nodes())
            support_node_keys = list(topology.support_nodes())

            return node_keys, origin_node_keys, support_node_keys, edge_keys, trail_edge_keys, deviation_edge_keys, trail_keys, auxiliary_trail_keys
# ---------- end disassemble_topology_diagram ----------
curve_middle_3 = CurveMiddle(Curve=topology_artist_3.edges)

topology_6 = Data(topology_2)

topology_7 = Data(topology_2)
number_57 = Number(number_25)
disassemble_topology_diagram_2 = DisassembleTopologyDiagram(topology=topology_7)  # -> node_keys, origin_node_keys, support_node_keys, edge_keys, trail_edge_keys, deviation_edge_keys, trail_keys, auxiliary_trail_keys; same code as disassemble_topology_diagram
cem_colors_7 = CEMColors()  # -> color_tension, color_compression, color_edge, color_node, color_node_support, color_node_origin, color_load, color_reaction, color_trail, color_auxiliary_trail; same code as cem_colors
python_2 = GhPythonScript(
    trail=disassemble_topology_diagram_2.trail_edge_keys,
    auxiliary_trail=disassemble_topology_diagram_2.auxiliary_trail_keys)  # -> out, trail; inputs trail: list, auxiliary_trail: list
# ---------- python_2: Python ----------
trail = [tr for tr in trail if tr not in auxiliary_trail]
# ---------- end python_2 ----------
topology_artist_4 = TopologyArtist(topology=topology_7, edge_keys=python_2.trail)  # -> nodes, origin_nodes, support_nodes, edges, trail_edges, deviation_edges, trails, loads; inputs node_keys: list of Int32, edge_keys: list; same code as topology_artist_2
topology_artist_5 = TopologyArtist(topology=topology_7)  # -> nodes, origin_nodes, support_nodes, edges, trail_edges, deviation_edges, trails, loads; inputs node_keys: list of Int32, edge_keys: list; same code as topology_artist_2
python_3 = GhPythonScript(topology=topology_7, auxiliary_trail=disassemble_topology_diagram_2.auxiliary_trail_keys)  # -> out, auxiliary_trail; inputs auxiliary_trail: list
# ---------- python_3: Python ----------
from compas_cem.ghpython import TopologyArtist


if auxiliary_trail is not None:
    artist = TopologyArtist(topology, artist_type=TopologyArtist)
   
    if auxiliary_trail is not None:
        auxiliary_trail = artist.draw_edges_trail(auxiliary_trail)
# ---------- end python_3 ----------
edge_results_2 = EdgeResults(form=topology_7, edge_keys=python_2.trail)  # -> lengths, forces; inputs edge_keys: list; same code as edge_results
edge_results_3 = EdgeResults(form=topology_7, edge_keys=disassemble_topology_diagram_2.deviation_edge_keys)  # -> lengths, forces; inputs edge_keys: list; same code as edge_results
merge_4 = Merge(Data1=cem_colors_7.color_compression, Data2=cem_colors_7.color_tension)
larger = LargerThan(FirstNumber=edge_results_3.forces, SecondNumber=0)  # -> LargerThan, OrEqualTo
larger_2 = LargerThan(FirstNumber=edge_results_2.lengths, SecondNumber=0)  # -> LargerThan, OrEqualTo
list_item_3 = ListItem(List=merge_4, Index=larger.OrEqualTo, Wrap=True)
list_item_4 = ListItem(List=merge_4, Index=larger_2.OrEqualTo, Wrap=True)
dash_pattern = DashPattern(Curve=topology_artist_5.deviation_edges, Pattern=number_57)  # -> Dashes, Gaps

topology_8 = Data(topology_2)
number_58 = Number(number_24)
topology_artist_6 = TopologyArtist(topology=topology_8)  # -> nodes, origin_nodes, support_nodes, edges, trail_edges, deviation_edges, trails, loads; inputs node_keys: list of Int32, edge_keys: list; same code as topology_artist_2
cem_colors_8 = CEMColors()  # -> color_tension, color_compression, color_edge, color_node, color_node_support, color_node_origin, color_load, color_reaction, color_trail, color_auxiliary_trail; same code as cem_colors
mesh_sphere_ex = MeshSphereEx(Base=topology_artist_6.support_nodes, Radius=number_58, Count=2)

disassemble_topology_diagram_3 = DisassembleTopologyDiagram(topology=topology_6)  # -> node_keys, origin_node_keys, support_node_keys, edge_keys, trail_edge_keys, deviation_edge_keys, trail_keys, auxiliary_trail_keys; same code as disassemble_topology_diagram
python_4 = GhPythonScript(
    trail=disassemble_topology_diagram_3.trail_edge_keys,
    auxiliary_trail=disassemble_topology_diagram_3.auxiliary_trail_keys)  # -> out, trail; inputs trail: list, auxiliary_trail: list; same code as python_2
entwine_2 = Entwine(Branch00=python_4.trail, Branch01=disassemble_topology_diagram_3.deviation_edge_keys, FlattenInputs=True)
topology_artist_7 = TopologyArtist(topology=topology_6, edge_keys=entwine_2)  # -> nodes, origin_nodes, support_nodes, edges, trail_edges, deviation_edges, trails, loads; inputs node_keys: list of Int32, edge_keys: list; same code as topology_artist_2
edge_results_4 = EdgeResults(form=topology_6, edge_keys=python_4.trail)  # -> lengths, forces; inputs edge_keys: list; same code as edge_results
edge_results_5 = EdgeResults(form=topology_6, edge_keys=disassemble_topology_diagram_3.deviation_edge_keys)  # -> lengths, forces; inputs edge_keys: list; same code as edge_results
curve_middle_4 = CurveMiddle(Curve=topology_artist_7.edges)
merge_5 = Merge(Data1=edge_results_4.lengths, Data2=edge_results_5.forces)  # -> flatten(Result)

mesh_sphere_ex_2 = MeshSphereEx(Base=topology_artist_6.origin_nodes, Radius=number_58, Count=2)
material_4 = CreateMaterial(
    Diffuse=cem_colors_8.color_node_origin,
    Specular=RGB(255, 255, 255),
    Emission=cem_colors_8.color_node_origin,
    Transparency="0.2",
    Shine="100")
material_5 = CreateMaterial(
    Diffuse=cem_colors_8.color_node_support,
    Specular=RGB(255, 255, 255),
    Emission=cem_colors_8.color_node_support,
    Transparency="0.2",
    Shine="100")

# ---- group: Edges design parameters
text_tag_4 = TextTag(Location=flatten(curve_middle_4), Text=merge_5, Colour=ColourSwatch(SwatchColor=RGBA(156, 156, 156, 195)))

# ---- group: Node keys
text_tag_5 = TextTag(
    Location=topology_artist_3.nodes,
    Text=disassemble_topology_diagram.node_keys,
    Colour=ColourSwatch(SwatchColor=RGBA(156, 156, 156, 195)))

# ---- group: Edge keys
text_tag_6 = TextTag(
    Location=curve_middle_3,
    Text=disassemble_topology_diagram.edge_keys,
    Colour=ColourSwatch(SwatchColor=RGBA(156, 156, 156, 195)))

# ---- group: Loads
vector_display_ex_3 = VectorDisplayEx(Point=move_5.Geometry, Vector=cluster_6.vector, Colour=cem_colors_6.color_load, Width=2)

# ---- group: Deviation edges
custom_preview_3 = CustomPreview(Geometry=dash_pattern.Dashes, Material=graft(list_item_3))

# ---- group: Trails
custom_preview_4 = CustomPreview(Geometry=topology_artist_5.trails, Material=cem_colors_7.color_trail)

# ---- group: Auxiliary Trails
custom_preview_5 = CustomPreview(Geometry=python_3.auxiliary_trail, Material=cem_colors_7.color_auxiliary_trail)

# ---- group: Support nodes
custom_preview_6 = CustomPreview(Geometry=mesh_sphere_ex, Material=material_5)

# ---- group: Origin nodes
custom_preview_7 = CustomPreview(Geometry=mesh_sphere_ex_2, Material=material_4)

# ---- group: Trail edges
custom_preview_8 = CustomPreview(Geometry=topology_artist_4.trail_edges, Material=list_item_4)

# ----
form_12 = Data(form_3)

cluster_7 = Cluster(data=form_12, second_number=min_edge_force)

form_artist_7 = FormArtist(form=form_12, edge_keys=cluster_7)  # -> nodes, support_nodes, edges, loads, reactions; inputs node_keys: list of Int32, edge_keys: list; same code as form_artist
control_points = ControlPoints(Curve=form_artist_7.edges)  # -> Points, Weights, Knots
deconstruct = Deconstruct(Point=flatten(control_points.Points))  # -> XComponent, YComponent, ZComponent
sort_list = SortList(Keys=deconstruct.ZComponent)  # -> Keys, ValuesValuesA
list_item_5 = ListItem(List=sort_list.Keys, Index=0, Wrap=True)
construct_point = ConstructPoint(XCoordinate=0, YCoordinate=0, ZCoordinate=list_item_5)
xy_plane = XYPlane(Origin=construct_point)
project = Project(Geometry=form_artist_7.edges, Plane=xy_plane)  # -> Geometry, Transform

# ---- group: Projection 2d
custom_preview_9 = CustomPreview(Geometry=project.Geometry, Material=ColourSwatch(SwatchColor=RGB(82, 82, 82)))

# ==== cluster Cluster
data = ClusterInput()
data_2 = Data(data)
edge_results = EdgeResults(form=data_2)  # -> lengths, forces; inputs edge_keys: list
#   port form: A COMPAS CEM form diagram.
#   port edge_keys: A selection of edge keys to query the results on. Defaults to all the edge keys.
#   port lengths: The edge lengths.
#   port forces: The edge forces.
# ---------- edge_results: Python ----------
"""
Extract the post form-finding results of the edges in a form diagram.
"""
from ghpythonlib.componentbase import executingcomponent as component


class EdgeResultsComponent(component):
    def RunScript(self, form, edge_keys):
        if form:
            edge_keys = edge_keys or list(form.edges())
            lengths = [form.edge_length_2(ed) for ed in edge_keys]
            forces = [form.edge_force(ed) for ed in edge_keys]
            return lengths, forces
# ---------- end edge_results ----------
disassemble_form_diagram = DisassembleFormDiagram(form=data_2)  # -> node_keys, support_node_keys, edge_keys
#   port form: A COMPAS CEM form diagram.
#   port node_keys: All the node keys in the form diagram.
#   port support_node_keys: The keys of the support nodes in the form diagram.
#   port edge_keys: All the edge keys in the form diagram.
# ---------- disassemble_form_diagram: Python ----------
"""
Disassemble a form diagram into its constituent parts.
"""
from ghpythonlib.componentbase import executingcomponent as component


class FormDisassemblyComponent(component):
    def RunScript(self, form):
        if form:
            edge_keys = list(form.edges())
            node_keys = list(form.nodes())
            support_node_keys = list(form.support_nodes())

            return node_keys, support_node_keys, edge_keys
# ---------- end disassemble_form_diagram ----------
absolute = Absolute(Value=edge_results.forces)
second_number = ClusterInput()
larger_than = LargerThan(FirstNumber=absolute, SecondNumber=second_number)  # -> LargerThan, OrEqualTo
cull_pattern = CullPattern(List=disassemble_form_diagram.edge_keys, CullPattern=larger_than.LargerThan)
list = ClusterOutput(cull_pattern)

# ==== cluster Cluster_2
number = ClusterInput()
form = ClusterInput()
force_min = ClusterInput()
force_scale = ClusterInput()
number_2 = Number(number)
form_artist = FormArtist(form=form, force_min=force_min, force_scale=force_scale)  # -> nodes, support_nodes, edges, loads, reactions; inputs node_keys: list of Int32, edge_keys: list
#   port form: A COMPAS CEM topology diagram.
#   port node_keys: A selection of the node keys in the diagram. Defaults to all the node keys.
#   port edge_keys: A selection of the edge keys in the diagram. Defaults to all the edge keys.
#   port force_min: The smallest force magnitude to draw. Defaults to 1e-3
#   port force_scale: The scale of the loads and the reactions. Defaults to 1.
#   port nodes: The nodes of the diagram as points.
#   port support_nodes: The support nodes of the diagram as points
#   port edges: The edges of the diagram as lines.
#   port loads: The applied loads as lines.
#   port reactions: The reaction forces at the supports, as lines.
# ---------- form_artist: Python ----------
"""
Draw a form diagram.
"""
from ghpythonlib.componentbase import executingcomponent as component

from compas_cem.ghpython import FormArtist


class FormArtistComponent(component):
    def RunScript(self, form, node_keys, edge_keys, force_min, force_scale):
        node_keys = node_keys or None
        edge_keys = edge_keys or None
        force_min = force_min or 1e-3
        force_scale = force_scale or 1
        if form:
            artist = FormArtist(form)

            nodes = artist.draw_nodes(node_keys)
            edges = artist.draw_edges(edge_keys)
            support_nodes = artist.draw_nodes_support(node_keys)

            loads = artist.draw_loads(node_keys, min_load=force_min, scale=force_scale)
            reactions = artist.draw_reactions(node_keys, min_force=force_min, scale=force_scale)

            return nodes, support_nodes, edges, loads, reactions
# ---------- end form_artist ----------
B = ClusterInput()
B_2 = ClusterInput()
division = Division(A=number_2, B=B)
flip = FlipCurve(Curve=form_artist.reactions)  # -> Curve, Flag
eval = EvaluateLength(Curve=flip.Curve, Length=number_2, Normalized=False)  # -> Point, Tangent, Parameter
shatter = Shatter(Curve=graft(flip.Curve), Parameters=graft(eval.Parameter))
division_2 = Division(A=division, B=B_2)
pframe = PerpFrame(Curve=flip.Curve, Parameter=eval.Parameter)
item = ListItem(List=shatter, Index=0, Wrap=True)  # -> Item1, Item
pflip = FlipPlane(Plane=pframe, ReverseX=False, ReverseY=False, SwapAxes=True)
cone = Cone(Base=pflip, Radius=division, Length=number_2)  # -> Cone, Tip
pipe = Pipe(Curve=item.Item1, Radius=division_2, Caps=2)
cap_holes = CapHoles(Brep=cone.Cone)
brep = Brep(cap_holes)
brep_2 = Brep(pipe)
brep_3 = Brep([brep_2, brep])
brep_4 = ClusterOutput(brep_3)

# ==== cluster Cluster_3
number = ClusterInput()
form = ClusterInput()
force_min = ClusterInput()
force_scale = ClusterInput()
form_artist = FormArtist(form=form, force_min=force_min, force_scale=force_scale)  # -> nodes, support_nodes, edges, loads, reactions; inputs node_keys: list of Int32, edge_keys: list; same code as form_artist
number_2 = Number(number)
B = ClusterInput()
division = Division(A=number_2, B=B)
flip = FlipCurve(Curve=form_artist.loads)  # -> Curve, Flag
B_2 = ClusterInput()
eval = EvaluateLength(Curve=flip.Curve, Length=number_2, Normalized=False)  # -> Point, Tangent, Parameter
shatter = Shatter(Curve=graft(flip.Curve), Parameters=graft(eval.Parameter))
division_2 = Division(A=division, B=B_2)
pframe = PerpFrame(Curve=flip.Curve, Parameter=eval.Parameter)
item = ListItem(List=shatter, Index=0, Wrap=True)  # -> Item1, Item
pflip = FlipPlane(Plane=pframe, ReverseX=False, ReverseY=False, SwapAxes=True)
cone = Cone(Base=pflip, Radius=division, Length=number_2)  # -> Cone, Tip
pipe = Pipe(Curve=item.Item1, Radius=division_2, Caps=2)
cap_holes = CapHoles(Brep=cone.Cone)
brep = Brep(cap_holes)
brep_2 = Brep(pipe)
brep_3 = Brep([brep_2, brep])
brep_4 = ClusterOutput(brep_3)

# ==== cluster Cluster_4
curve = ClusterInput()
end_points = EndPoints(Curve=curve)  # -> Start, End
vector_2pt = Vector2Pt(PointA=end_points.Start, PointB=end_points.End, Unitize=False)  # -> Vector, Length
reverse = Reverse(Vector=vector_2pt.Vector)
vector = ClusterOutput(vector_2pt.Vector)
move = Move(Geometry=end_points.Start, Motion=reverse)  # -> Geometry, Transform
geometry = ClusterOutput(move.Geometry)
