# Grasshopper definition dome.ghx (Grasshopper 1.0.7)

# ---- group: Trail Edges - Level 1
internal_force_state = ValueList({"Tension": 1, "Compression": -1}, selected="Compression")
integer = Integer(internal_force_state)

# ---- group: Trail Edges - Level 2
internal_force_state_2 = ValueList({"Tension": 1, "Compression": -1}, selected="Compression")
integer_2 = Integer(internal_force_state_2)

# ---- group: Trail Edges - Level 3
internal_force_state_3 = ValueList({"Tension": 1, "Compression": -1}, selected="Compression")
integer_3 = Integer(internal_force_state_3)

# ---- group: Trail Edges - Level 4
internal_force_state_4 = ValueList({"Tension": 1, "Compression": -1}, selected="Compression")
integer_4 = Integer(internal_force_state_4)

# ---- group: Deviation Edges - Ring 1
internal_force_state_5 = ValueList({"Tension": 1, "Compression": -1}, selected="Compression")
deviation_edge_force = Slider(0.6, range=0..10)
edge_cull_pattern = Panel("""1
1""")
integer_5 = Integer(internal_force_state_5)
number = Number(deviation_edge_force)
integer_6 = Integer(edge_cull_pattern)

# ---- group: Deviaton Edges - Ring 2
internal_force_state_6 = ValueList({"Tension": 1, "Compression": -1}, selected="Compression")
deviation_edge_force_2 = Slider(1.3, range=0..10)
edge_cull_pattern_2 = Panel("""1
1""")
integer_7 = Integer(internal_force_state_6)
number_2 = Number(deviation_edge_force_2)
integer_8 = Integer(edge_cull_pattern_2)

# ---- group: Deviation Edges - Ring 3
internal_force_state_7 = ValueList({"Tension": 1, "Compression": -1}, selected="Compression")
deviation_edge_force_3 = Slider(0.7, range=0..10)
edge_cull_pattern_3 = Panel("""1
1""")
number_3 = Number(deviation_edge_force_3)
integer_9 = Integer(edge_cull_pattern_3)
integer_10 = Integer(internal_force_state_7)

# ---- group: Deviation Edges - Ring 4
internal_force_state_8 = ValueList({"Tension": 1, "Compression": -1}, selected="Compression")
deviation_edge_force_4 = Slider(1.1, range=0..10)
edge_cull_pattern_4 = Panel("""1
1""")
integer_11 = Integer(internal_force_state_8)
number_4 = Number(deviation_edge_force_4)
integer_12 = Integer(edge_cull_pattern_4)

# ----
# COMPAS CEM
# Copyright (c) 2021 Rafael Pastrana
# Color Code
# Trail Edges
# Deviation Edges
# Loads
# Supports
# Optimization
# Topology/Form Diagram
# Topology Visualization
# Form Visualization
# JSON serialization
# Don’t modify (unless you know what you are doing)
inner_ring_radius = Slider(6, range=0..10)
outer_ring_radius = Slider(15, range=0..20)
of_trails = Slider(12, range=0..100)
deviation_edge_rings = Panel("4")
number_5 = Number(inner_ring_radius)
number_6 = Number(outer_ring_radius)
integer_13 = Integer(of_trails)
integer_14 = Integer(deviation_edge_rings)

# ---- group: Load
point_load = Slider(1, range=0..10)
number_7 = Number(point_load)

# ---- group: Generate Structure’s Geometry
number_8 = Number(number_5)
integer_15 = Integer(integer_13)
integer_16 = Integer(integer_13)
integer_17 = Integer(integer_14)
number_9 = Number(number_6)
polygon = Polygon(Plane=PlaneXY(0, 0, 0), Radius=number_9, Segments=integer_16, FilletRadius=0)  # -> Polygon, Length
polygon_2 = Polygon(Plane=PlaneXY(0, 0, 0), Radius=number_8, Segments=integer_15, FilletRadius=0)  # -> Polygon, Length
cluster = Cluster(curve=polygon_2.Polygon, count=integer_17, curve_2=polygon.Polygon)  # -> loads, segments, segments_2, supporets
curve = Curve(cluster.segments)
curve_2 = Curve(cluster.segments_2)
point = Point(cluster.supporets)
point_2 = Point(cluster.loads)

# ----
integer_18 = Integer(integer)
integer_19 = Integer(integer_2)
integer_20 = Integer(integer_3)
integer_21 = Integer(integer_4)
entwine = Entwine(Branch00=integer_18, Branch01=integer_19, Branch02=integer_20, Branch03=integer_21, FlattenInputs=True)
number_10 = Number(entwine)

integer_22 = Integer(integer_7)
integer_23 = Integer(integer_5)
integer_24 = Integer(integer_10)
integer_25 = Integer(integer_11)
entwine_2 = Entwine(Branch00=integer_23, Branch01=integer_22, Branch02=integer_24, Branch03=integer_25, FlattenInputs=True)
number_11 = Number(entwine_2)

integer_26 = Integer(integer_8)
integer_27 = Integer(integer_6)
integer_28 = Integer(integer_9)
integer_29 = Integer(integer_12)
entwine_3 = Entwine(Branch00=integer_27, Branch01=integer_26, Branch02=integer_28, Branch03=integer_29, FlattenInputs=True)
boolean = Boolean(entwine_3)

number_12 = Number(number)
number_13 = Number(number_2)
number_14 = Number(number_3)
number_15 = Number(number_4)
entwine_4 = Entwine(Branch00=number_12, Branch01=number_13, Branch02=number_14, Branch03=number_15, FlattenInputs=True)
number_16 = Number(entwine_4)

curve_3 = Curve(curve_2)
boolean_2 = Boolean(boolean)
cull_pattern = CullPattern(List=curve_3, CullPattern=boolean_2)
curve_4 = Curve(cull_pattern)

# ---- group: Trail Edges
curve_5 = Curve(curve)
number_17 = Number(number_10)
flip_matrix = FlipMatrix(Data=curve_5)
length = Length(Curve=flip_matrix)
multiplication = Multiplication(A=length, B=number_17)
trailedge = TrailEdge(line=flip_matrix, length=multiplication)  # -> flatten(trail_edge); inputs line: Line, plane: Plane
#   port line: A line that defines the end nodes of the edge.
#   port length: The signed length of the edge. If negative, the edge is in compression. Otherwise, it is in tension. The length magnitude is ignored if a plane is supplied.
#   port plane: An optional plane to define the length of the trail edge relative to the projection of its start node onto the plane. The force state will be that specified by the length input parameter.
#   port trail_edge: A COMPAS CEM trail edge.
# ---------- trailedge: Python ----------
"""
Create a trail edge from a rhino line.
"""
from ghpythonlib.componentbase import executingcomponent as component

from compas_rhino.geometry import RhinoLine
from compas_rhino.geometry import RhinoPlane

from compas_cem.elements import TrailEdge


class TrailEdgeComponent(component):
    def RunScript(self, line, length, plane):
        if not line or length is None:
            return

        if plane is not None:
            plane = RhinoPlane.from_geometry(plane).to_compas()
        line = RhinoLine.from_geometry(line).to_compas()
        return TrailEdge.from_line(line, length=length, plane=plane)
# ---------- end trailedge ----------

# ---- group: Deviation Edges
curve_6 = Curve(curve_4)
number_18 = Number(number_11)
number_19 = Number(number_16)
multiplication_2 = Multiplication(A=number_18, B=number_19)
deviationedge = DeviationEdge(line=curve_6, force=multiplication_2)  # -> flatten(deviation_edge); inputs line: Line
#   port line: A line that defines the end nodes of the edge.
#   port force: The desired force on the edge. If negative, the edge is in compression. Otherwise, it is in tension.
#   port deviation_edge: A COMPAS CEM deviation edge.
# ---------- deviationedge: Python ----------
"""
Create a deviation edge from a line.
"""
from ghpythonlib.componentbase import executingcomponent as component

from compas_cem.elements import DeviationEdge

from compas_rhino.geometry import RhinoLine


class DeviationEdgeComponent(component):
    def RunScript(self, line, force):
        if not line or force is None:
            return
        line = RhinoLine.from_geometry(line).to_compas()
        return DeviationEdge.from_line(line, force=force)
# ---------- end deviationedge ----------

# ----
point_3 = Point(point_2)
number_20 = Number(number_7)
negative = Negative(Value=number_20)
unit_z = UnitZ(Factor=negative)
nodeload = NodeLoad(point=point_3, vector=unit_z)  # -> flatten(node_load); inputs point: Point3d, vector: Vector3d
#   port point: The position of the node where to apply the load.
#   port vector: The load vector.
#   port node_load: A COMPAS CEM node load.
# ---------- nodeload: Python ----------
"""
Create a load vector to be applied at a node.
"""
from ghpythonlib.componentbase import executingcomponent as component

from compas_rhino.geometry import RhinoPoint
from compas_rhino.geometry import RhinoVector

from compas_cem.loads import NodeLoad


class NodeLoadComponent(component):
    def RunScript(self, point, vector):
        if not (point and vector):
            return

        point = RhinoPoint.from_geometry(point).to_compas()
        vector = RhinoVector.from_geometry(vector).to_compas()

        return NodeLoad.from_point_and_vector(point, vector)
# ---------- end nodeload ----------

point_4 = Point(point)
nodesupport = NodeSupport(point=point_4)  # -> flatten(node_support); inputs point: Point3d
#   port point: The position of the node where to assign a support.
#   port node_support: A COMPAS CEM node support.
# ---------- nodesupport: Python ----------
"""
Create a node support from a point.
"""
from ghpythonlib.componentbase import executingcomponent as component

from compas_rhino.geometry import RhinoPoint
from compas_cem.supports import NodeSupport


class NodeSupportComponent(component):
    def RunScript(self, point):
        if not point:
            return

        xyz = RhinoPoint.from_geometry(point).to_compas()
        return NodeSupport.from_point(xyz)
# ---------- end nodesupport ----------

forces_scale = Slider(1, range=0..1)
dash_length = Slider(0.1, range=0..0.1)
sphere_radius = Slider(0.21, range=0..1)
forces_min = Slider(0.001, range=0..0.001)
number_21 = Number(forces_scale)
number_22 = Number(sphere_radius)
number_23 = Number(dash_length)
number_24 = Number(forces_min)

pipe_min_radius = Slider(0.02, range=0..0.1)
loads_radius_scale = Slider(0.25, range=0..1)
arrow_head_ratio = Slider(2, range=0..10)
pipe_max_radius = Slider(0.15, range=0..0.4)
reactions_radius_scale = Slider(0.5, range=0..1)
arrow_height_ratio = Slider(3, range=0..10)
number_25 = Number(pipe_min_radius)
number_26 = Number(pipe_max_radius)
number_27 = Number(reactions_radius_scale)
number_28 = Number(loads_radius_scale)
number_29 = Number(arrow_height_ratio)
number_30 = Number(arrow_head_ratio)

edge_result_to_display = ValueList({"Forces": 0, "Lengths": 1}, selected="Forces")
forces_min_2 = Slider(0.001, range=0..0.001)
forces_scale_2 = Slider(1.5, range=0..2)
number_31 = Number(forces_min_2)
number_32 = Number(forces_scale_2)
integer_30 = Integer(edge_result_to_display)

python = GhPythonScript()  # -> out, a
# ---------- python: Python ----------
from compas_ghpython.utilities import unload_modules


unload_modules("compas_cem")
# ---------- end python ----------
min_edge_force = Panel("0.001")

colour_swatch = ColourSwatch(SwatchColor=RGBA(156, 156, 156, 195))

assemble_topology_diagram = AssembleTopologyDiagram(
    trail_edges=flatten(trailedge),
    deviation_edges=flatten(deviationedge),
    loads=flatten(nodeload),
    supports=flatten(nodesupport))  # -> topology; inputs trail_edges: list, deviation_edges: list, loads: list, supports: list, add_auxiliary_trails: Boolean
#   port trail_edges: The COMPAS CEM trail edges to add to the diagram.
#   port deviation_edges: The COMPAS CEM deviation edges to add to the diagram.
#   port loads: The COMPAS CEM loads to add to the diagram.
#   port supports: The COMPAS CEM supports to add to the diagram.
#   port add_auxiliary_trails: Append auxiliary trails to the free nodes of the topology diagram. Defaults to False.
#   port topology: A COMPAS CEM topology diagram.
# ---------- assemble_topology_diagram: Python ----------
"""
Assemble a topology diagram.
"""
from ghpythonlib.componentbase import executingcomponent as component

from compas_cem.diagrams import TopologyDiagram


class AssembleTopologyDiagramComponent(component):
    def RunScript(self, trail_edges, deviation_edges, loads, supports, add_auxiliary_trails):

        add_auxiliary_trails = add_auxiliary_trails or False
        topology = TopologyDiagram()

        if trail_edges:
            for trail_edge in trail_edges:
                if trail_edge:
                    topology.add_edge(trail_edge)

        if deviation_edges:
            for deviation_edge in deviation_edges:
                if deviation_edge:
                    topology.add_edge(deviation_edge)

        if loads:
            for load in loads:
                if load:
                    topology.add_load(load)

        if supports:
            for support in supports:
                if support:
                    topology.add_support(support)

        if trail_edges and supports:
            topology.build_trails(add_auxiliary_trails)

        elif deviation_edges and add_auxiliary_trails:
            topology.build_trails(add_auxiliary_trails)

        return topology
# ---------- end assemble_topology_diagram ----------
form_finding = FormFinding(topology=assemble_topology_diagram)  # -> form; inputs tmax: Int32
#   port topology: A COMPAS CEM topology diagram.
#   port tmax: The maximum number of iterations to run the form-finding algorithm for. Defaults to 100.
#   port eta: The convergence threshold of the form-finding algorithm. Default to 1e-6.
#   port form: A COMPAS CEM form diagram in static equilibrium.
# ---------- form_finding: Python ----------
"""
Generate a form diagram in static equilibrium.
"""
from ghpythonlib.componentbase import executingcomponent as component

from compas_cem.equilibrium import static_equilibrium


class FormFindingComponent(component):
    def RunScript(self, topology, tmax, eta):
        tmax = tmax or 100
        eta = eta or 1e-6
        if topology:
            return static_equilibrium(topology, tmax=tmax, eta=eta)
# ---------- end form_finding ----------
data = Data(assemble_topology_diagram)

formfinding = FormFinding(topology=assemble_topology_diagram, kmax=Slider(1, range=0..10))  # -> form; inputs kmax: Int32, tmax: Int32
#   port topology: A COMPAS CEM topology diagram.
#   port kmax: The maximum number of sequences to run the form-finding algorithm for. Defaults to all the sequences in the diagram.
#   port tmax: The maximum number of iterations to run the form-finding algorithm for. Defaults to 100.
#   port eta: The convergence threshold of the form-finding algorithm. Default to 1e-6.
#   port form: A COMPAS CEM form diagram in static equilibrium.
# ---------- formfinding: Python ----------
"""
Generate a form diagram in static equilibrium.
"""
from ghpythonlib.componentbase import executingcomponent as component

from compas_cem.equilibrium import static_equilibrium


class FormFindingComponent(component):
    def RunScript(self, topology, kmax, tmax, eta):
        eta = eta or 1e-6
        tmax = tmax or 100

        if not topology:
            return

        return static_equilibrium(topology, kmax=kmax, tmax=tmax, eta=eta)
# ---------- end formfinding ----------

data_2 = Data(formfinding)

# ---- group: Select what form diagram to display
# 03-A Display form diagram
what_to_display = ValueList({"Form": 0, "Constrained Form": 1}, selected="Form")
constrained_form = Data()
form = Data(data_2)
filter = StreamFilter(Gate=what_to_display, Stream0=form, Stream1=constrained_form)
form_2 = Data(filter)

# ----
form_3 = Data(form_2)

min_edge_force_2 = Panel("0.001")
number_33 = Number(number_25)
number_34 = Number(number_26)
form_4 = Data(form_3)
cluster_2 = Cluster_2(data=form_4, second_number=min_edge_force_2)
cem_colors = CEMColors()  # -> color_tension, color_compression, color_edge, color_node, color_node_support, color_node_origin, color_load, color_reaction, color_trail, color_auxiliary_trail
#   port color_tension: The color for edges under a tension force.
#   port color_compression: The color for edges under a compression force.
#   port color_edge: The color for a regular edge.
#   port color_node: The color for a regular node.
#   port color_node_support: The color for a support node.
#   port color_node_origin: The color for an origin node.
#   port color_load: The color for an applied load.
#   port color_reaction: The color for a reaction force.
#   port color_trail: The color to paint a trail.
#   port color_auxiliary_trail: The color to paint an auxiliary trail.
# ---------- cem_colors: Python ----------
"""
Get the artists color scheme for the objects of the CEM framework.
"""
from ghpythonlib.componentbase import executingcomponent as component

from compas_cem import COLORS
import rhinoscriptsyntax as rs


class ArtistColorsComponent(component):
    def RunScript(self):
        colors = {key: rs.CreateColor(c) for key, c in COLORS.items()}

        color_tension = colors["tension"]
        color_compression = colors["compression"]
        color_edge = colors["edge"]
        color_node = colors["node"]
        color_node_support = colors["node_support"]
        color_node_origin = colors["node_origin"]
        color_load = colors["load"]
        color_reaction = colors["support_force"]
        color_trail = colors["trail"]
        color_auxiliary_trail = colors["auxiliary_trail"]

        colors = (color_tension, color_compression, color_edge, color_node, color_node_support, color_node_origin, color_load, color_reaction, color_trail, color_auxiliary_trail)

        return colors
# ---------- end cem_colors ----------
form_artist = FormArtist(form=form_4, edge_keys=cluster_2, force_min="0.01")  # -> nodes, support_nodes, edges, loads, reactions; inputs node_keys: list of Int32, edge_keys: list
#   port form: A COMPAS CEM topology diagram.
#   port node_keys: A selection of the node keys in the diagram. Defaults to all the node keys.
#   port edge_keys: A selection of the edge keys in the diagram. Defaults to all the edge keys.
#   port force_min: The smallest force magnitude to draw. Defaults to 1e-3
#   port force_scale: The scale of the loads and the reactions. Defaults to 1.
#   port nodes: The nodes of the diagram as points.
#   port support_nodes: The support nodes of the diagram as points
#   port edges: The edges of the diagram as lines.
#   port loads: The applied loads as lines.
#   port reactions: The reaction forces at the supports, as lines.
# ---------- form_artist: Python ----------
"""
Draw a form diagram.
"""
from ghpythonlib.componentbase import executingcomponent as component

from compas_cem.ghpython import FormArtist


class FormArtistComponent(component):
    def RunScript(self, form, node_keys, edge_keys, force_min, force_scale):
        node_keys = node_keys or None
        edge_keys = edge_keys or None
        force_min = force_min or 1e-3
        force_scale = force_scale or 1
        if form:
            artist = FormArtist(form, artist_type=FormArtist)

            nodes = artist.draw_nodes(node_keys)
            edges = artist.draw_edges(edge_keys)
            support_nodes = artist.draw_nodes_support(node_keys)

            loads = artist.draw_loads(node_keys, min_load=force_min, scale=force_scale)
            reactions = artist.draw_reactions(node_keys, min_force=force_min, scale=force_scale)

            return nodes, support_nodes, edges, loads, reactions
# ---------- end form_artist ----------
dom = ConstructDomain(DomainStart=number_33, DomainEnd=number_34)
edge_results = EdgeResults(form=form_4, edge_keys=cluster_2)  # -> lengths, forces; inputs edge_keys: list; same code as edge_results
abs = Absolute(Value=edge_results.forces)
merge = Merge(Data1=cem_colors.color_compression, Data2=cem_colors.color_tension)
bnd = Bounds(Numbers=abs)
larger_than = LargerThan(FirstNumber=edge_results.forces, SecondNumber=0)  # -> LargerThan, OrEqualTo
length_2 = Length(Curve=form_artist.edges)
remap = RemapNumbers(Value=abs, Source=bnd, Target=dom)  # -> Mapped, Clipped
larger_than_2 = LargerThan(FirstNumber=length_2, SecondNumber="0.01")  # -> LargerThan, OrEqualTo
list_item = ListItem(List=merge, Index=larger_than.OrEqualTo, Wrap=True)
material = CreateMaterial(Diffuse=list_item, Specular=RGB(255, 255, 255), Emission=RGB(0, 0, 0), Transparency=0, Shine="100")
cull_pattern_2 = CullPattern(List=form_artist.edges, CullPattern=larger_than_2.LargerThan)
cull_pattern_3 = CullPattern(List=remap.Mapped, CullPattern=larger_than_2.LargerThan)
pipe = Pipe(Curve=cull_pattern_2, Radius=cull_pattern_3, Caps=2)  # -> flatten(Pipe)

number_35 = Number(number_32)
number_36 = Number(number_28)
form_5 = Data(form_3)
number_37 = Number(number_31)
number_38 = Number(number_29)
number_39 = Number(number_30)
load_offset = Panel("1.75")
cluster_3 = Cluster_4(form=form_5, force_min=number_37, force_scale=number_35, number=number_36, B=number_38, B_2=number_39)
cem_colors_2 = CEMColors()  # -> color_tension, color_compression, color_edge, color_node, color_node_support, color_node_origin, color_load, color_reaction, color_trail, color_auxiliary_trail; same code as cem_colors
unit_z_2 = UnitZ(Factor=load_offset)
move = Move(Geometry=cluster_3, Motion=unit_z_2)  # -> Geometry, Transform
material_2 = CreateMaterial(Diffuse=cem_colors_2.color_load, Specular=RGB(255, 255, 255), Emission=RGB(0, 0, 0), Transparency="0.2", Shine="100")

form_6 = Data(form_3)
number_40 = Number(number_31)
number_41 = Number(number_32)
number_42 = Number(number_27)
number_43 = Number(number_29)
number_44 = Number(number_30)
cluster_4 = Cluster_3(form=form_6, force_min=number_40, force_scale=number_41, number=number_42, B=number_43, B_2=number_44)

form_7 = Data(form_3)
integer_31 = Integer(integer_30)
form_artist_2 = FormArtist(form=form_7)  # -> nodes, support_nodes, edges, loads, reactions; inputs node: list of Int32, edge: list
#   port form: A COMPAS CEM topology diagram.
#   port node: A selection of the nodes in the diagram. Defaults to all the nodes.
#   port edge: A selection of the edges in the diagram. Defaults to all the edges.
#   port force_min: The smallest force magnitude to draw. Defaults to 1e-3
#   port force_scale: The scale of the loads and the reactions. Defaults to 1.
#   port nodes: The nodes of the diagram as points.
#   port support_nodes: The support nodes of the diagram as points
#   port edges: The edges of the diagram as lines.
#   port loads: The applied loads as lines.
#   port reactions: The reaction forces at the supports, as lines.
# ---------- form_artist_2: Python ----------
"""
Draw a form diagram.
"""
from ghpythonlib.componentbase import executingcomponent as component

from compas_cem.ghpython import FormArtist


class FormArtistComponent(component):
    def RunScript(self, form, node, edge, force_min, force_scale):
        node = node or None
        edge = edge or None
        force_min = force_min or 1e-3
        force_scale = force_scale or 1
        if form:
            artist = FormArtist(form, artist_type=FormArtist)

            nodes = artist.draw_nodes(node)
            edges = artist.draw_edges(edge)
            support_nodes = artist.draw_nodes_support(node)

            loads = artist.draw_loads(node, min_load=force_min, scale=force_scale)
            reactions = artist.draw_reactions(node, min_force=force_min, scale=force_scale)

            return nodes, support_nodes, edges, loads, reactions
# ---------- end form_artist_2 ----------
curve_middle = CurveMiddle(Curve=form_artist_2.edges)
edgeresults = EdgeResults(form=form_7)  # -> length, force; inputs edge: list
#   port form: A COMPAS CEM form diagram.
#   port edge: A selection of edge keys to query the results on. Defaults to all the edges.
#   port length: The edge lengths.
#   port force: The edge forces.
# ---------- edgeresults: Python ----------
"""
Extract the post form-finding results of the edges in a form diagram.
"""
from ghpythonlib.componentbase import executingcomponent as component


class EdgeResultsComponent(component):
    def RunScript(self, form, edge):
        if form:
            edge = edge or list(form.edges())
            length = [form.edge_length_2(ed) for ed in edge]
            force = [form.edge_force(ed) for ed in edge]
            return length, force
# ---------- end edgeresults ----------
stream_filter = StreamFilter(Gate=integer_31, Stream0=edgeresults.force, Stream1=edgeresults.length)
ghpython_script = GhPythonScript(x=stream_filter)  # -> out, a
# ---------- ghpython_script: Python ----------
a = round(x, 2)
# ---------- end ghpython_script ----------

form_8 = Data(form_3)
form_artist_3 = FormArtist(form=form_8)  # -> nodes, support_nodes, edges, loads, reactions; inputs node_keys: list of Int32, edge_keys: list; same code as form_artist
disassemble_form_diagram = DisassembleFormDiagram(form=form_8)  # -> node_keys, support_node_keys, edge_keys; same code as disassemble_form_diagram
curve_middle_2 = CurveMiddle(Curve=form_artist_3.edges)

form_9 = Data(form_3)
number_45 = Number(number_31)
number_46 = Number(number_32)
form_artist_4 = FormArtist(form=form_9, force_min=number_45, force_scale=number_46)  # -> nodes, support_nodes, edges, loads, reactions; inputs node_keys: list of Int32, edge_keys: list; same code as form_artist
cem_colors_3 = CEMColors()  # -> color_tension, color_compression, color_edge, color_node, color_node_support, color_node_origin, color_load, color_reaction, color_trail, color_auxiliary_trail; same code as cem_colors
cluster_5 = Cluster_5(curve=form_artist_4.loads)  # -> vector, geometry
unit_vector = UnitVector(Vector=cluster_5.vector)
vector_length = VectorLength(Vector=cluster_5.vector)
multiplication_3 = Multiplication(A=unit_vector, B=vector_length)
move_2 = Move(Geometry=cluster_5.geometry, Motion=multiplication_3)  # -> Geometry, Transform

form_10 = Data(form_3)
number_47 = Number(number_31)
number_48 = Number(number_32)
form_artist_5 = FormArtist(form=form_10, force_min=number_47, force_scale=number_48)  # -> nodes, support_nodes, edges, loads, reactions; inputs node_keys: list of Int32, edge_keys: list; same code as form_artist
cem_colors_4 = CEMColors()  # -> color_tension, color_compression, color_edge, color_node, color_node_support, color_node_origin, color_load, color_reaction, color_trail, color_auxiliary_trail; same code as cem_colors
cluster_6 = Cluster_5(curve=form_artist_5.reactions)  # -> vector, geometry
vector_length_2 = VectorLength(Vector=cluster_6.vector)
unit_vector_2 = UnitVector(Vector=cluster_6.vector)
multiplication_4 = Multiplication(A=unit_vector_2, B=vector_length_2)
move_3 = Move(Geometry=cluster_6.geometry, Motion=multiplication_4)  # -> Geometry, Transform

form_11 = Data(form_3)
form_artist_6 = FormArtist(form=form_11)  # -> nodes, support_nodes, edges, loads, reactions; inputs node_keys: list of Int32, edge_keys: list; same code as form_artist
edgeresults_2 = EdgeResults(form=form_11)  # -> length, force; inputs edge: list; same code as edgeresults
cem_colors_5 = CEMColors()  # -> color_tension, color_compression, color_edge, color_node, color_node_support, color_node_origin, color_load, color_reaction, color_trail, color_auxiliary_trail; same code as cem_colors
larger_than_3 = LargerThan(FirstNumber=edgeresults_2.force, SecondNumber=0)  # -> LargerThan, OrEqualTo
merge_2 = Merge(Data1=cem_colors_5.color_compression, Data2=cem_colors_5.color_tension)
list_item_2 = ListItem(List=merge_2, Index=larger_than_3.OrEqualTo, Wrap=True)

edgeresults_3 = EdgeResults(form=form_7)  # -> length, force; inputs edge: list; same code as edgeresults
larger_than_4 = LargerThan(FirstNumber=edgeresults_3.force, SecondNumber="0.001")  # -> LargerThan, OrEqualTo
panel = Panel(form_artist_5.reactions)
cull_pattern_4 = CullPattern(List=material, CullPattern=larger_than_2.LargerThan)
colour = Colour(ColourSwatch(SwatchColor=RGB(76, 76, 76)))
material_3 = CreateMaterial(Diffuse=colour, Specular=RGB(255, 255, 255), Emission=RGB(0, 0, 0), Transparency="0.2", Shine="100")

# ---- group: Edges
custom_preview = CustomPreview(Geometry=form_artist_6.edges, Material=list_item_2)

# ---- group: Node keys
text_tag = TextTag(Location=form_artist_3.nodes, Text=disassemble_form_diagram.node_keys, Colour=colour_swatch)

# ---- group: Edge keys
text_tag_2 = TextTag(Location=curve_middle_2, Text=disassemble_form_diagram.edge_keys, Colour=colour_swatch)

# ---- group: Edge results
text_tag_3 = TextTag(Location=curve_middle, Text=ghpython_script.a, Colour=ColourSwatch(SwatchColor=RGBA(94, 94, 94, 195)))

# ---- group: Loads
vector_display_ex = VectorDisplayEx(Point=move_2.Geometry, Vector=cluster_5.vector, Colour=cem_colors_3.color_load, Width=2)

# ---- group: Reactions
vector_display_ex_2 = VectorDisplayEx(Point=move_3.Geometry, Vector=cluster_6.vector, Colour=cem_colors_4.color_reaction, Width=2)

# ---- group: Reactions - Piped
preview = CustomPreview(Geometry=cluster_4, Material=material_3)

# ---- group: Loads - Piped
preview_2 = CustomPreview(Geometry=move.Geometry, Material=material_2)

# ---- group: Edges - Piped
preview_3 = CustomPreview(Geometry=pipe, Material=cull_pattern_4)

# ----
# 03-B Display topology diagram
topology = Data(data)
translation_x = Slider(0, range=0..100)
translation_y = Slider(30, range=0..30)
number_49 = Number(translation_x)
number_50 = Number(number_49)
negative_2 = Negative(Value=number_50)
number_51 = Number(translation_y)
number_52 = Number(number_51)
negative_3 = Negative(Value=number_52)

# ---- group: Translate topology diagram
ghpython_script_2 = GhPythonScript(topology=topology, x=negative_2, y=negative_3)  # -> out, topology
# ---------- ghpython_script_2: Python ----------
from compas.geometry import Translation
from compas.datastructures import network_transformed



translation = Translation.from_vector([x, y, 0.0])
topology = network_transformed(topology, translation)
# ---------- end ghpython_script_2 ----------

# ----
topology_2 = Data(ghpython_script_2.topology)

# ---- group: Display all edges in gray
topology_3 = Data(topology_2)
topology_artist = TopologyArtist(topology=topology_3)  # -> nodes, origin_nodes, support_nodes, edges, trail_edges, deviation_edges, trails, loads; inputs node_keys: list of Int32, edge_keys: list
#   port topology: A COMPAS CEM topology diagram.
#   port node_keys: A selection of the node keys in the diagram. Defaults to all the node keys.
#   port edge_keys: A selection of the edge keys in the diagram. Defaults to all the edge keys.
#   port force_min: The minimum force magnitude to plot. Defaults to 1e-3.
#   port force_scale: The scaling factor of the loads. Defaults to 1.
#   port nodes: The nodes in the diagram as points.
#   port origin_nodes: The origin nodes in the diagram as points.
#   port support_nodes: The support nodes in the diagram as points.
#   port edges: The edges in the diagram as lines.
#   port trail_edges: The trail edges in the diagram as lines.
#   port deviation_edges: The deviation edges in the diagram as lines.
#   port trails: The trails in the diagram as polylines.
#   port loads: The applied node loads as lines.
# ---------- topology_artist: Python ----------
"""
Draw a topology diagram.
"""
from ghpythonlib.componentbase import executingcomponent as component

from compas_cem.ghpython import TopologyArtist


class TopologyArtistComponent(component):
    def RunScript(self, topology, node_keys, edge_keys, force_min, force_scale):
        node_keys = node_keys or None
        edge_keys = edge_keys or None
        force_min = force_min or 1e-3
        force_scale = force_scale or 1.0
        if topology:
            artist = TopologyArtist(topology, artist_type=TopologyArtist)

            nodes = artist.draw_nodes(node_keys)
            origin_nodes = artist.draw_nodes_origin(node_keys)
            support_nodes = artist.draw_nodes_support(node_keys)

            edges = artist.draw_edges(edge_keys)
            trail_edges = artist.draw_edges_trail(edge_keys)
            deviation_edges = artist.draw_edges_deviation(edge_keys)

            trails = artist.draw_trails()

            loads = artist.draw_loads(node_keys, min_load=force_min, scale=force_scale)

            return nodes, origin_nodes, support_nodes, edges, trail_edges, deviation_edges, trails, loads
# ---------- end topology_artist ----------
custom_preview_2 = CustomPreview(Geometry=topology_artist.edges, Material=ColourSwatch(SwatchColor=RGB(0, 0, 0)))

# ----
topology_4 = Data(topology_2)
topology_artist_2 = TopologyArtist(topology=topology_4)  # -> nodes, origin_nodes, support_nodes, edges, trail_edges, deviation_edges, trails, loads; inputs node_keys: list of Int32, edge_keys: list; same code as topology_artist
disassemble_topology_diagram = DisassembleTopologyDiagram(topology=topology_4)  # -> node_keys, origin_node_keys, support_node_keys, edge_keys, trail_edge_keys, deviation_edge_keys, trail_keys, auxiliary_trail_keys
#   port topology: A COMPAS CEM topology diagram.
#   port node_keys: All the node keys in the topology diagram.
#   port origin_node_keys: The keys of the origin nodes in the topology diagram.
#   port support_node_keys: The keys of the support nodes in the topology diagram.
#   port edge_keys: All the edge keys in the topology diagram.
#   port trail_edge_keys: The keys of the trail edges in the topology diagram.
#   port deviation_edge_keys: The keys of the deviation edges in the topology diagram.
#   port trail_keys: The keys of the trails in the topology diagram.
#   port auxiliary_trail_keys: The keys of the auxiliary trails in the topology diagram.
# ---------- disassemble_topology_diagram: Python ----------
"""
Disassemble a topology diagram into its constituent parts.
"""
from ghpythonlib.componentbase import executingcomponent as component


class TopologyDisassemblyComponent(component):
    def RunScript(self, topology):
        if topology:
            trail_keys = list(topology.trails())
            auxiliary_trail_keys = list(topology.auxiliary_trails())

            edge_keys = list(topology.edges())
            trail_edge_keys = list(topology.trail_edges())
            deviation_edge_keys = list(topology.deviation_edges())

            node_keys = list(topology.nodes())
            origin_node_keys = list(topology.origin_nodes())
            support_node_keys = list(topology.support_nodes())

            return node_keys, origin_node_keys, support_node_keys, edge_keys, trail_edge_keys, deviation_edge_keys, trail_keys, auxiliary_trail_keys
# ---------- end disassemble_topology_diagram ----------
curve_middle_3 = CurveMiddle(Curve=topology_artist_2.edges)

topology_5 = Data(topology_2)
number_53 = Number(number_23)
disassemble_topology_diagram_2 = DisassembleTopologyDiagram(topology=topology_5)  # -> node_keys, origin_node_keys, support_node_keys, edge_keys, trail_edge_keys, deviation_edge_keys, trail_keys, auxiliary_trail_keys; same code as disassemble_topology_diagram
cem_colors_6 = CEMColors()  # -> color_tension, color_compression, color_edge, color_node, color_node_support, color_node_origin, color_load, color_reaction, color_trail, color_auxiliary_trail; same code as cem_colors
python_2 = GhPythonScript(
    trail=disassemble_topology_diagram_2.trail_edge_keys,
    auxiliary_trail=disassemble_topology_diagram_2.auxiliary_trail_keys)  # -> out, trail; inputs trail: list, auxiliary_trail: list
# ---------- python_2: Python ----------
trail = [tr for tr in trail if tr not in auxiliary_trail]
# ---------- end python_2 ----------
topology_artist_3 = TopologyArtist(topology=topology_5, edge_keys=python_2.trail)  # -> nodes, origin_nodes, support_nodes, edges, trail_edges, deviation_edges, trails, loads; inputs node_keys: list of Int32, edge_keys: list; same code as topology_artist
topology_artist_4 = TopologyArtist(topology=topology_5)  # -> nodes, origin_nodes, support_nodes, edges, trail_edges, deviation_edges, trails, loads; inputs node_keys: list of Int32, edge_keys: list; same code as topology_artist
python_3 = GhPythonScript(topology=topology_5, auxiliary_trail=disassemble_topology_diagram_2.auxiliary_trail_keys)  # -> out, auxiliary_trail; inputs auxiliary_trail: list
# ---------- python_3: Python ----------
from compas_cem.ghpython import TopologyArtist


if auxiliary_trail is not None:
    artist = TopologyArtist(topology, artist_type=TopologyArtist)
   
    if auxiliary_trail is not None:
        auxiliary_trail = artist.draw_edges_trail(auxiliary_trail)
# ---------- end python_3 ----------
edge_results_2 = EdgeResults(form=topology_5, edge_keys=python_2.trail)  # -> lengths, forces; inputs edge_keys: list; same code as edge_results
edge_results_3 = EdgeResults(form=topology_5, edge_keys=disassemble_topology_diagram_2.deviation_edge_keys)  # -> lengths, forces; inputs edge_keys: list; same code as edge_results
merge_3 = Merge(Data1=cem_colors_6.color_compression, Data2=cem_colors_6.color_tension)
larger = LargerThan(FirstNumber=edge_results_3.forces, SecondNumber=0)  # -> LargerThan, OrEqualTo
larger_2 = LargerThan(FirstNumber=edge_results_2.lengths, SecondNumber=0)  # -> LargerThan, OrEqualTo
list_item_3 = ListItem(List=merge_3, Index=larger.OrEqualTo, Wrap=True)
list_item_4 = ListItem(List=merge_3, Index=larger_2.OrEqualTo, Wrap=True)
dash_pattern = DashPattern(Curve=topology_artist_4.deviation_edges, Pattern=number_53)  # -> Dashes, Gaps

topology_6 = Data(topology_2)
number_54 = Number(number_24)
number_55 = Number(number_21)
topology_artist_5 = TopologyArtist(topology=topology_6, force_min=number_54, force_scale=number_55)  # -> nodes, origin_nodes, support_nodes, edges, trail_edges, deviation_edges, trails, loads; inputs node_keys: list of Int32, edge_keys: list; same code as topology_artist
cem_colors_7 = CEMColors()  # -> color_tension, color_compression, color_edge, color_node, color_node_support, color_node_origin, color_load, color_reaction, color_trail, color_auxiliary_trail; same code as cem_colors
cluster_7 = Cluster_5(curve=topology_artist_5.loads)  # -> vector, geometry
vector_length_3 = VectorLength(Vector=cluster_7.vector)
unit_vector_3 = UnitVector(Vector=cluster_7.vector)
multiplication_5 = Multiplication(A=unit_vector_3, B=vector_length_3)
move_4 = Move(Geometry=cluster_7.geometry, Motion=multiplication_5)  # -> Geometry, Transform

topology_7 = Data(topology_2)

topology_8 = Data(topology_2)
number_56 = Number(number_22)
topology_artist_6 = TopologyArtist(topology=topology_8)  # -> nodes, origin_nodes, support_nodes, edges, trail_edges, deviation_edges, trails, loads; inputs node_keys: list of Int32, edge_keys: list; same code as topology_artist
cem_colors_8 = CEMColors()  # -> color_tension, color_compression, color_edge, color_node, color_node_support, color_node_origin, color_load, color_reaction, color_trail, color_auxiliary_trail; same code as cem_colors
mesh_sphere_ex = MeshSphereEx(Base=topology_artist_6.support_nodes, Radius=number_56, Count=2)

disassemble_topology_diagram_3 = DisassembleTopologyDiagram(topology=topology_7)  # -> node_keys, origin_node_keys, support_node_keys, edge_keys, trail_edge_keys, deviation_edge_keys, trail_keys, auxiliary_trail_keys; same code as disassemble_topology_diagram
python_4 = GhPythonScript(
    trail=disassemble_topology_diagram_3.trail_edge_keys,
    auxiliary_trail=disassemble_topology_diagram_3.auxiliary_trail_keys)  # -> out, trail; inputs trail: list, auxiliary_trail: list; same code as python_2
entwine_5 = Entwine(Branch00=python_4.trail, Branch01=disassemble_topology_diagram_3.deviation_edge_keys, FlattenInputs=True)
topology_artist_7 = TopologyArtist(topology=topology_7, edge_keys=entwine_5)  # -> nodes, origin_nodes, support_nodes, edges, trail_edges, deviation_edges, trails, loads; inputs node_keys: list of Int32, edge_keys: list; same code as topology_artist
edge_results_4 = EdgeResults(form=topology_7, edge_keys=python_4.trail)  # -> lengths, forces; inputs edge_keys: list; same code as edge_results
edge_results_5 = EdgeResults(form=topology_7, edge_keys=disassemble_topology_diagram_3.deviation_edge_keys)  # -> lengths, forces; inputs edge_keys: list; same code as edge_results
curve_middle_4 = CurveMiddle(Curve=topology_artist_7.edges)
merge_4 = Merge(Data1=edge_results_4.lengths, Data2=edge_results_5.forces)  # -> flatten(Result)

mesh_sphere_ex_2 = MeshSphereEx(Base=topology_artist_6.origin_nodes, Radius=number_56, Count=2)
material_4 = CreateMaterial(
    Diffuse=cem_colors_8.color_node_origin,
    Specular=RGB(255, 255, 255),
    Emission=cem_colors_8.color_node_origin,
    Transparency="0.2",
    Shine="100")
material_5 = CreateMaterial(
    Diffuse=cem_colors_8.color_node_support,
    Specular=RGB(255, 255, 255),
    Emission=cem_colors_8.color_node_support,
    Transparency="0.2",
    Shine="100")

# ---- group: Edges design parameters
text_tag_4 = TextTag(Location=flatten(curve_middle_4), Text=merge_4, Colour=ColourSwatch(SwatchColor=RGBA(156, 156, 156, 195)))

# ---- group: Node keys
text_tag_5 = TextTag(
    Location=topology_artist_2.nodes,
    Text=disassemble_topology_diagram.node_keys,
    Colour=ColourSwatch(SwatchColor=RGBA(156, 156, 156, 195)))

# ---- group: Edge keys
text_tag_6 = TextTag(
    Location=curve_middle_3,
    Text=disassemble_topology_diagram.edge_keys,
    Colour=ColourSwatch(SwatchColor=RGBA(156, 156, 156, 195)))

# ---- group: Deviation edges
custom_preview_3 = CustomPreview(Geometry=dash_pattern.Dashes, Material=graft(list_item_3))

# ---- group: Loads
vector_display_ex_3 = VectorDisplayEx(Point=move_4.Geometry, Vector=cluster_7.vector, Colour=cem_colors_7.color_load, Width=2)

# ---- group: Trails
custom_preview_4 = CustomPreview(Geometry=topology_artist_4.trails, Material=cem_colors_6.color_trail)

# ---- group: Auxiliary Trails
custom_preview_5 = CustomPreview(Geometry=python_3.auxiliary_trail, Material=cem_colors_6.color_auxiliary_trail)

# ---- group: Support nodes
custom_preview_6 = CustomPreview(Geometry=mesh_sphere_ex, Material=material_5)

# ---- group: Origin nodes
custom_preview_7 = CustomPreview(Geometry=mesh_sphere_ex_2, Material=material_4)

# ---- group: Trail edges
custom_preview_8 = CustomPreview(Geometry=topology_artist_3.trail_edges, Material=list_item_4)

# ----
form_12 = Data(form_3)

cluster_8 = Cluster_2(data=form_12, second_number=min_edge_force)

form_artist_7 = FormArtist(form=form_12, edge_keys=cluster_8)  # -> nodes, support_nodes, edges, loads, reactions; inputs node_keys: list of Int32, edge_keys: list; same code as form_artist
control_points = ControlPoints(Curve=form_artist_7.edges)  # -> Points, Weights, Knots
deconstruct = Deconstruct(Point=flatten(control_points.Points))  # -> XComponent, YComponent, ZComponent
sort_list = SortList(Keys=deconstruct.ZComponent)  # -> Keys, ValuesValuesA
list_item_5 = ListItem(List=sort_list.Keys, Index=0, Wrap=True)
construct_point = ConstructPoint(XCoordinate=0, YCoordinate=0, ZCoordinate=list_item_5)
xy_plane = XYPlane(Origin=construct_point)
project = Project(Geometry=form_artist_7.edges, Plane=xy_plane)  # -> Geometry, Transform

# ---- group: Projection 2d
custom_preview_9 = CustomPreview(Geometry=project.Geometry, Material=ColourSwatch(SwatchColor=RGB(82, 82, 82)))

# ==== cluster Cluster
curve = ClusterInput()
curve_2 = ClusterInput()
explode = Explode(Curve=curve, Recursive=True)  # -> Segments, Vertices
explode_2 = Explode(Curve=curve_2, Recursive=True)  # -> Segments, Vertices
line = Line(StartPoint=explode.Vertices, EndPoint=explode_2.Vertices)
count = ClusterInput()
divide_curve = DivideCurve(Curve=line, Count=count, Kinks=False)  # -> Points, Tangents, Parameters
cull_index = CullIndex(List=divide_curve.Points, Indices="-1", Wrap=True)
flip_matrix = FlipMatrix(Data=cull_index)
loads = ClusterOutput(explode.Vertices)
supporets = ClusterOutput(explode_2.Vertices)
polyline = PolyLine(Vertices=divide_curve.Points, Closed=False)
polyline_2 = PolyLine(Vertices=flip_matrix, Closed=False)
explode_3 = Explode(Curve=polyline, Recursive=True)  # -> Segments, Vertices
explode_4 = Explode(Curve=polyline_2, Recursive=True)  # -> Segments, Vertices
segments = ClusterOutput(explode_3.Segments)
segments_2 = ClusterOutput(explode_4.Segments)

# ==== cluster Cluster_2
data = ClusterInput()
data_2 = Data(data)
edge_results = EdgeResults(form=data_2)  # -> lengths, forces; inputs edge_keys: list
#   port form: A COMPAS CEM form diagram.
#   port edge_keys: A selection of edge keys to query the results on. Defaults to all the edge keys.
#   port lengths: The edge lengths.
#   port forces: The edge forces.
# ---------- edge_results: Python ----------
"""
Extract the post form-finding results of the edges in a form diagram.
"""
from ghpythonlib.componentbase import executingcomponent as component


class EdgeResultsComponent(component):
    def RunScript(self, form, edge_keys):
        if form:
            edge_keys = edge_keys or list(form.edges())
            lengths = [form.edge_length_2(ed) for ed in edge_keys]
            forces = [form.edge_force(ed) for ed in edge_keys]
            return lengths, forces
# ---------- end edge_results ----------
disassemble_form_diagram = DisassembleFormDiagram(form=data_2)  # -> node_keys, support_node_keys, edge_keys
#   port form: A COMPAS CEM form diagram.
#   port node_keys: All the node keys in the form diagram.
#   port support_node_keys: The keys of the support nodes in the form diagram.
#   port edge_keys: All the edge keys in the form diagram.
# ---------- disassemble_form_diagram: Python ----------
"""
Disassemble a form diagram into its constituent parts.
"""
from ghpythonlib.componentbase import executingcomponent as component


class FormDisassemblyComponent(component):
    def RunScript(self, form):
        if form:
            edge_keys = list(form.edges())
            node_keys = list(form.nodes())
            support_node_keys = list(form.support_nodes())

            return node_keys, support_node_keys, edge_keys
# ---------- end disassemble_form_diagram ----------
absolute = Absolute(Value=edge_results.forces)
second_number = ClusterInput()
larger_than = LargerThan(FirstNumber=absolute, SecondNumber=second_number)  # -> LargerThan, OrEqualTo
cull_pattern = CullPattern(List=disassemble_form_diagram.edge_keys, CullPattern=larger_than.LargerThan)
list = ClusterOutput(cull_pattern)

# ==== cluster Cluster_3
number = ClusterInput()
form = ClusterInput()
force_min = ClusterInput()
force_scale = ClusterInput()
number_2 = Number(number)
formartist = FormArtist(form=form, force_min=force_min, force_scale=force_scale)  # -> nodes, support_nodes, edges, loads, reactions; inputs node_keys: list of Int32, edge_keys: list
#   port form: A COMPAS CEM topology diagram.
#   port node_keys: A selection of the node keys in the diagram. Defaults to all the node keys.
#   port edge_keys: A selection of the edge keys in the diagram. Defaults to all the edge keys.
#   port force_min: The smallest force magnitude to draw. Defaults to 1e-3
#   port force_scale: The scale of the loads and the reactions. Defaults to 1.
#   port nodes: The nodes of the diagram as points.
#   port support_nodes: The support nodes of the diagram as points
#   port edges: The edges of the diagram as lines.
#   port loads: The applied loads as lines.
#   port reactions: The reaction forces at the supports, as lines.
# ---------- formartist: Python ----------
"""
Draw a form diagram.
"""
from ghpythonlib.componentbase import executingcomponent as component

from compas_cem.ghpython import FormArtist


class FormArtistComponent(component):
    def RunScript(self, form, node_keys, edge_keys, force_min, force_scale):
        node_keys = node_keys or None
        edge_keys = edge_keys or None
        force_min = force_min or 1e-3
        force_scale = force_scale or 1

        if not form:
            return

        artist = FormArtist(form, artist_type=FormArtist)

        nodes = artist.draw_nodes(node_keys)
        edges = artist.draw_edges(edge_keys)
        support_nodes = artist.draw_nodes_support(node_keys)

        loads = artist.draw_loads(node_keys, min_load=force_min, scale=force_scale)
        reactions = artist.draw_reactions(node_keys, min_force=force_min, scale=force_scale)

        return nodes, support_nodes, edges, loads, reactions
# ---------- end formartist ----------
B = ClusterInput()
B_2 = ClusterInput()
division = Division(A=number_2, B=B)
flip = FlipCurve(Curve=formartist.reactions)  # -> Curve, Flag
eval = EvaluateLength(Curve=flip.Curve, Length=number_2, Normalized=False)  # -> Point, Tangent, Parameter
shatter = Shatter(Curve=graft(flip.Curve), Parameters=graft(eval.Parameter))
division_2 = Division(A=division, B=B_2)
pframe = PerpFrame(Curve=flip.Curve, Parameter=eval.Parameter)
item = ListItem(List=shatter, Index=0, Wrap=True)  # -> Item1, Item
pflip = FlipPlane(Plane=pframe, ReverseX=False, ReverseY=False, SwapAxes=True)
cone = Cone(Base=pflip, Radius=division, Length=number_2)  # -> Cone, Tip
pipe = Pipe(Curve=item.Item1, Radius=division_2, Caps=2)
cap_holes = CapHoles(Brep=cone.Cone)
brep = Brep(cap_holes)
brep_2 = Brep(pipe)
brep_3 = Brep([brep_2, brep])
brep_4 = ClusterOutput(brep_3)

# ==== cluster Cluster_4
number = ClusterInput()
form = ClusterInput()
force_min = ClusterInput()
force_scale = ClusterInput()
number_2 = Number(number)
formartist = FormArtist(form=form, force_min=force_min, force_scale=force_scale)  # -> nodes, support_nodes, edges, loads, reactions; inputs node_keys: list of Int32, edge_keys: list; same code as formartist
B = ClusterInput()
division = Division(A=number_2, B=B)
flip = FlipCurve(Curve=formartist.loads)  # -> Curve, Flag
B_2 = ClusterInput()
eval = EvaluateLength(Curve=flip.Curve, Length=number_2, Normalized=False)  # -> Point, Tangent, Parameter
shatter = Shatter(Curve=graft(flip.Curve), Parameters=graft(eval.Parameter))
division_2 = Division(A=division, B=B_2)
pframe = PerpFrame(Curve=flip.Curve, Parameter=eval.Parameter)
item = ListItem(List=shatter, Index=0, Wrap=True)  # -> Item1, Item
pflip = FlipPlane(Plane=pframe, ReverseX=False, ReverseY=False, SwapAxes=True)
cone = Cone(Base=pflip, Radius=division, Length=number_2)  # -> Cone, Tip
pipe = Pipe(Curve=item.Item1, Radius=division_2, Caps=2)
cap_holes = CapHoles(Brep=cone.Cone)
brep = Brep(cap_holes)
brep_2 = Brep(pipe)
brep_3 = Brep([brep_2, brep])
brep_4 = ClusterOutput(brep_3)

# ==== cluster Cluster_5
curve = ClusterInput()
end_points = EndPoints(Curve=curve)  # -> Start, End
vector_2pt = Vector2Pt(PointA=end_points.Start, PointB=end_points.End, Unitize=False)  # -> Vector, Length
reverse = Reverse(Vector=vector_2pt.Vector)
vector = ClusterOutput(vector_2pt.Vector)
move = Move(Geometry=end_points.Start, Motion=reverse)  # -> Geometry, Transform
geometry = ClusterOutput(move.Geometry)
