# Grasshopper definition spiral_staircase.ghx (Grasshopper 1.0.7)

length_bounds_deviation_edge_chord_b_m = Slider(50, range=0..200)
length_bounds_deviation_edge_chord_a_m = Slider(50, range=0..200)
max_iterations_optimization = Slider(100, range=0..1000)
force_bounds_deviation_edge_bracing_kn = Slider(10, range=0..100)
number = Number(length_bounds_deviation_edge_chord_b_m)
number_2 = Number(force_bounds_deviation_edge_bracing_kn)
number_3 = Number(length_bounds_deviation_edge_chord_a_m)
integer = Integer(max_iterations_optimization)

# ---- group: Chord B
horizontaloffset_b = Slider(0.35, range=0..2)
verticaloffset_b = Slider(0, range=-2..2)
num = Number(horizontaloffset_b)
num_2 = Number(verticaloffset_b)

# ---- group: Chord A
horizontaloffset_a = Slider(0.35, range=0..2)
verticaloffset_a = Slider(0, range=-2..2)
num_3 = Number(horizontaloffset_a)
num_4 = Number(verticaloffset_a)

# ----
target_height_difference = Slider(3, range=0..10)
target_step_height = Slider(0.16, range=0..1)
num_5 = Number(target_height_difference)
num_6 = Number(target_step_height)

node_load_kn = Slider(0.5, range=0..1)
negative = Negative(Value=node_load_kn)
number_4 = Number(negative)

# ---- group: Chord B
value_list = ValueList({"Tension": 1, "Compression": -1}, selected="Tension")
number_5 = Number(value_list)

# ---- group: Chord A
value_list_2 = ValueList({"Tension": 1, "Compression": -1}, selected="Compression")
number_6 = Number(value_list_2)

# ---- group: Bracing
value_list_3 = ValueList({"Tension": 1, "Compression": -1}, selected="Compression")
number_7 = Number(value_list_3)

force_kn = Slider(1, range=0..5)
number_8 = Number(force_kn)

# ---- group: Chord B
force_kn_2 = Slider(7, range=0..20)
number_9 = Number(force_kn_2)

# ---- group: Chord A
force_kn_3 = Slider(6, range=0..20)
number_10 = Number(force_kn_3)

# ---- group: Import generator middle curve from Rhino
# COMPAS CEM
# Copyright (c) 2021 Rafael Pastrana
# Color Code
# Trail Edges
# Deviation Edges
# Loads
# Supports
# Optimization
# Topology/Form Diagram
# Topology Visualization
# Form Visualization
# JSON serialization
# Don’t modify (unless you know what you are doing)
floorplancrv_center_of_stair = Curve(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)

# ---- group: Calculate number of steps
num_7 = Number(num_6)
num_8 = Number(num_5)
division = Division(A=num_8, B=num_7)
round = Round(Number=division)  # -> Nearest, Floor, Ceiling
int = Integer(round.Ceiling)
panel = Panel(round.Ceiling)

# ---- group: Make spatial generator curve
floorplancrv_center_of_stair_2 = Curve(floorplancrv_center_of_stair)
int_2 = Integer(int)
num_9 = Number(num_5)
int_3 = Integer(int)
cluster = Cluster_2(C=floorplancrv_center_of_stair_2, curve=floorplancrv_center_of_stair_2, N=int_2, A_2=num_9, B=int_3, A=int_3)  # -> arithmetic_mean, curve_2
curve = Curve(cluster.curve_2)
number_11 = Number(cluster.arithmetic_mean)

# ---- group: Extract points and displacement vectors from curve
crv = Curve(curve)
int_4 = Integer(int)
cluster_2 = Cluster_4(G=crv, N_2=int_4, C=crv, N=int_4)  # -> O, Z, Y
vector = Vector(cluster_2.Z)
vector_2 = Vector(cluster_2.Y)
pt = Point(cluster_2.O)

# ----
number_12 = Number(number_11)
average_chord_segment_length = Panel(number_12)

# ---- group: Chords points
vector_3 = Vector(vector)
num_10 = Number(num_3)
num_11 = Number(num_4)
num_12 = Number(num_2)
pt_2 = Point(pt)
vector_4 = Vector(vector_2)
num_13 = Number(num)
cluster_3 = Cluster_5(G=pt_2, V_2=vector_3, B_2=num_10, G_2=pt_2, V=vector_4, value=num_11, B=num_13, value_2=num_12)  # -> G_3, G_4
pt_3 = Point(cluster_3.G_4)
pt_4 = Point(cluster_3.G_3)

# ---- group: Chord B
pt_5 = Point(pt_3)
pline = PolyLine(Vertices=pt_5, Closed=False)
cluster_4 = Cluster(polyline=pline)  # -> trails_2, deviation_2, support_2, free_nodes_2
trail = Line(cluster_4.trails_2)
deviation = Line(cluster_4.deviation_2)
support = Point(cluster_4.support_2)
support_2 = Point(cluster_4.free_nodes_2)

# ---- group: Chord A
pt_6 = Point(pt_4)
pline_2 = PolyLine(Vertices=pt_6, Closed=False)
cluster_5 = Cluster(polyline=pline_2)  # -> trails_2, deviation_2, support_2, free_nodes_2
support_3 = Point(cluster_5.support_2)
deviation_2 = Line(cluster_5.deviation_2)
support_4 = Point(cluster_5.free_nodes_2)
trail_2 = Line(cluster_5.trails_2)

# ---- group: Bracing
pt_7 = Point(pt_4)
pt_8 = Point(pt_3)
line = Line(StartPoint=pt_7, EndPoint=pt_8)
curve_2 = Curve(line)

# ----
pt_9 = Point(pt_4)
pt_10 = Point(pt_3)
number_13 = Number(number_4)
unit_z = UnitZ(Factor=number_13)
nodeload = NodeLoad(point=[pt_9, pt_10], vector=unit_z)  # -> node_load; inputs point: Point3d, vector: Vector3d
#   port point: The position of the node where to apply the load.
#   port vector: The load vector.
#   port node_load: A COMPAS CEM node load.
# ---------- nodeload: Python ----------
"""
Create a load vector to be applied at a node.
"""
from ghpythonlib.componentbase import executingcomponent as component

from compas_rhino.geometry import RhinoPoint
from compas_rhino.geometry import RhinoVector

from compas_cem.loads import NodeLoad


class NodeLoadComponent(component):
    def RunScript(self, point, vector):
        if not (point and vector):
            return

        point = RhinoPoint.from_geometry(point).to_compas()
        vector = RhinoVector.from_geometry(vector).to_compas()

        return NodeLoad.from_point_and_vector(point, vector)
# ---------- end nodeload ----------

curve_3 = Curve(deviation)
number_14 = Number(number_9)
number_15 = Number(number_5)
multiplication = Multiplication(A=number_14, B=number_15)
deviationedge = DeviationEdge(line=curve_3, force=multiplication)  # -> deviation_edge; inputs line: Line
#   port line: A line that defines the end nodes of the edge.
#   port force: The desired force on the edge. If negative, the edge is in compression. Otherwise, it is in tension.
#   port deviation_edge: A COMPAS CEM deviation edge.
# ---------- deviationedge: Python ----------
"""
Create a deviation edge from a line.
"""
from ghpythonlib.componentbase import executingcomponent as component

from compas_cem.elements import DeviationEdge

from compas_rhino.geometry import RhinoLine


class DeviationEdgeComponent(component):
    def RunScript(self, line, force):
        if not line or force is None:
            return
        line = RhinoLine.from_geometry(line).to_compas()
        return DeviationEdge.from_line(line, force=force)
# ---------- end deviationedge ----------

curve_4 = Curve(curve_2)
number_16 = Number(number_8)
number_17 = Number(number_7)
multiplication_2 = Multiplication(A=number_16, B=number_17)
deviationedge_2 = DeviationEdge(line=curve_4, force=multiplication_2)  # -> deviation_edge; inputs line: Line; same code as deviationedge

support_5 = Point(support)
support_6 = Point(support_3)
nodesupport = NodeSupport(point=support_6)  # -> node_support; inputs point: Point3d
#   port point: The position of the node where to assign a support.
#   port node_support: A COMPAS CEM node support.
# ---------- nodesupport: Python ----------
"""
Create a node support from a point.
"""
from ghpythonlib.componentbase import executingcomponent as component

from compas_rhino.geometry import RhinoPoint
from compas_cem.supports import NodeSupport


class NodeSupportComponent(component):
    def RunScript(self, point):
        if not point:
            return

        xyz = RhinoPoint.from_geometry(point).to_compas()
        return NodeSupport.from_point(xyz)
# ---------- end nodesupport ----------
nodesupport_2 = NodeSupport(point=support_5)  # -> node_support; inputs point: Point3d; same code as nodesupport

curve_5 = Curve(deviation_2)
number_18 = Number(number_10)
number_19 = Number(number_6)
multiplication_3 = Multiplication(A=number_18, B=number_19)
deviationedge_3 = DeviationEdge(line=curve_5, force=multiplication_3)  # -> deviation_edge; inputs line: Line; same code as deviationedge

number_20 = Number(number_6)
curve_6 = Curve(trail_2)
length = Length(Curve=curve_6)
multiplication_4 = Multiplication(A=length, B=number_20)
trailedge = TrailEdge(line=curve_6, length=multiplication_4)  # -> trail_edge; inputs line: Line, plane: Plane
#   port line: A line that defines the end nodes of the edge.
#   port length: The signed length of the edge. If negative, the edge is in compression. Otherwise, it is in tension. The length magnitude is ignored if a plane is supplied.
#   port plane: An optional plane to define the length of the trail edge relative to the projection of its start node onto the plane. The force state will be that specified by the length input parameter.
#   port trail_edge: A COMPAS CEM trail edge.
# ---------- trailedge: Python ----------
"""
Create a trail edge from a rhino line.
"""
from ghpythonlib.componentbase import executingcomponent as component

from compas_rhino.geometry import RhinoLine
from compas_rhino.geometry import RhinoPlane

from compas_cem.elements import TrailEdge


class TrailEdgeComponent(component):
    def RunScript(self, line, length, plane):
        if not line or length is None:
            return

        if plane is not None:
            plane = RhinoPlane.from_geometry(plane).to_compas()
        line = RhinoLine.from_geometry(line).to_compas()
        return TrailEdge.from_line(line, length=length, plane=plane)
# ---------- end trailedge ----------

number_21 = Number(number_5)
curve_7 = Curve(trail)
length_2 = Length(Curve=curve_7)
multiplication_5 = Multiplication(A=length_2, B=number_21)
trailedge_2 = TrailEdge(line=curve_7, length=multiplication_5)  # -> trail_edge; inputs line: Line, plane: Plane; same code as trailedge

entwine = Entwine(Branch00=nodesupport, Branch01=nodesupport_2, FlattenInputs=True)
entwine_2 = Entwine(Branch00=trailedge, Branch01=trailedge_2, FlattenInputs=True)
entwine_3 = Entwine(Branch00=deviationedge_3, Branch01=deviationedge, Branch02=deviationedge_2, FlattenInputs=True)
data = Data(entwine_2)
data_2 = Data(entwine_3)
data_3 = Data(entwine)
data_4 = Data(nodeload)
data_5 = Data(data)
data_6 = Data(data_2)
data_7 = Data(data_4)
data_8 = Data(data_3)
assemble_topology_diagram = AssembleTopologyDiagram(trail_edges=flatten(data_5), deviation_edges=flatten(data_6), loads=flatten(data_7), supports=flatten(data_8))  # -> topology; inputs trail_edges: list, deviation_edges: list, loads: list, supports: list, add_auxiliary_trails: Boolean
#   port trail_edges: The COMPAS CEM trail edges to add to the diagram.
#   port deviation_edges: The COMPAS CEM deviation edges to add to the diagram.
#   port loads: The COMPAS CEM loads to add to the diagram.
#   port supports: The COMPAS CEM supports to add to the diagram.
#   port add_auxiliary_trails: Append auxiliary trails to the free nodes of the topology diagram. Defaults to False.
#   port topology: A COMPAS CEM topology diagram.
# ---------- assemble_topology_diagram: Python ----------
"""
Assemble a topology diagram.
"""
from ghpythonlib.componentbase import executingcomponent as component

from compas_cem.diagrams import TopologyDiagram


class AssembleTopologyDiagramComponent(component):
    def RunScript(self, trail_edges, deviation_edges, loads, supports, add_auxiliary_trails):

        add_auxiliary_trails = add_auxiliary_trails or False
        topology = TopologyDiagram()

        if trail_edges:
            for trail_edge in trail_edges:
                if trail_edge:
                    topology.add_edge(trail_edge)

        if deviation_edges:
            for deviation_edge in deviation_edges:
                if deviation_edge:
                    topology.add_edge(deviation_edge)

        if loads:
            for load in loads:
                if load:
                    topology.add_load(load)

        if supports:
            for support in supports:
                if support:
                    topology.add_support(support)

        if trail_edges and supports:
            topology.build_trails(add_auxiliary_trails)

        return topology
# ---------- end assemble_topology_diagram ----------
data_9 = Data(assemble_topology_diagram)

data_10 = Data(data_9)
form_finding = FormFinding(topology=data_10)  # -> form; inputs tmax: Int32
#   port topology: A COMPAS CEM topology diagram.
#   port tmax: The maximum number of iterations to run the form-finding algorithm for. Defaults to 100.
#   port eta: The convergence threshold of the form-finding algorithm. Default to 1e-6.
#   port form: A COMPAS CEM form diagram in static equilibrium.
# ---------- form_finding: Python ----------
"""
Generate a form diagram in static equilibrium.
"""
from ghpythonlib.componentbase import executingcomponent as component

from compas_cem.equilibrium import static_equilibrium


class FormFindingComponent(component):
    def RunScript(self, topology, tmax, eta):
        tmax = tmax or 100
        eta = eta or 1e-6
        if topology:
            return static_equilibrium(topology, tmax=tmax, eta=eta)
# ---------- end form_finding ----------
data_11 = Data(form_finding)

forces_scale = Slider(0.4, range=0..1)
sphere_radius = Slider(0.04, range=0..1)
dash_length = Slider(0.03, range=0..0.1)
forces_min = Slider(0.001, range=0..0.001)
number_22 = Number(forces_scale)
number_23 = Number(sphere_radius)
number_24 = Number(dash_length)
number_25 = Number(forces_min)

# ---- group: Display all edges in gray
topology = Data(data_9)
topology_artist = TopologyArtist(topology=topology)  # -> nodes, origin_nodes, support_nodes, edges, trail_edges, deviation_edges, trails, loads; inputs node_keys: list of Int32, edge_keys: list
#   port topology: A COMPAS CEM topology diagram.
#   port node_keys: A selection of the node keys in the diagram. Defaults to all the node keys.
#   port edge_keys: A selection of the edge keys in the diagram. Defaults to all the edge keys.
#   port force_min: The minimum force magnitude to plot. Defaults to 1e-3.
#   port force_scale: The scaling factor of the loads. Defaults to 1.
#   port nodes: The nodes in the diagram as points.
#   port origin_nodes: The origin nodes in the diagram as points.
#   port support_nodes: The support nodes in the diagram as points.
#   port edges: The edges in the diagram as lines.
#   port trail_edges: The trail edges in the diagram as lines.
#   port deviation_edges: The deviation edges in the diagram as lines.
#   port trails: The trails in the diagram as polylines.
#   port loads: The applied node loads as lines.
# ---------- topology_artist: Python ----------
"""
Draw a topology diagram.
"""
from ghpythonlib.componentbase import executingcomponent as component

from compas_cem.ghpython import TopologyArtist


class TopologyArtistComponent(component):
    def RunScript(self, topology, node_keys, edge_keys, force_min, force_scale):
        node_keys = node_keys or None
        edge_keys = edge_keys or None
        force_min = force_min or 1e-3
        force_scale = force_scale or 1.0
        if topology:
            artist = TopologyArtist(topology, artist_type=TopologyArtist)

            nodes = artist.draw_nodes(node_keys)
            origin_nodes = artist.draw_nodes_origin(node_keys)
            support_nodes = artist.draw_nodes_support(node_keys)

            edges = artist.draw_edges(edge_keys)
            trail_edges = artist.draw_edges_trail(edge_keys)
            deviation_edges = artist.draw_edges_deviation(edge_keys)

            trails = artist.draw_trails()

            loads = artist.draw_loads(node_keys, min_load=force_min, scale=force_scale)

            return nodes, origin_nodes, support_nodes, edges, trail_edges, deviation_edges, trails, loads
# ---------- end topology_artist ----------
custom_preview = CustomPreview(Geometry=topology_artist.edges, Material=ColourSwatch(SwatchColor=RGB(0, 0, 0)))

# ----
pipe_min_radius = Slider(0.005, range=0..0.01)
loads_radius_scale = Slider(0.04, range=0..1)
arrow_head_ratio = Slider(2, range=0..10)
pipe_max_radius = Slider(0.02, range=0..0.1)
reactions_radius_scale = Slider(0.1, range=0..1)
arrow_height_ratio = Slider(3, range=0..10)
number_26 = Number(pipe_min_radius)
number_27 = Number(pipe_max_radius)
number_28 = Number(reactions_radius_scale)
number_29 = Number(loads_radius_scale)
number_30 = Number(arrow_height_ratio)
number_31 = Number(arrow_head_ratio)

edge_result_to_display = ValueList({"Forces": 0, "Lengths": 1}, selected="Forces")
forces_min_2 = Slider(0.001, range=0..0.001)
forces_scale_2 = Slider(0.4, range=0..1)
number_32 = Number(forces_min_2)
number_33 = Number(forces_scale_2)
integer_2 = Integer(edge_result_to_display)

colour_swatch = ColourSwatch(SwatchColor=RGBA(156, 156, 156, 195))

integer_3 = Integer(integer)
data_12 = Data(data_9)
data_13 = Data(data_9)
crv_2 = Curve(deviation_2)
number_34 = Number(number_3)
data_14 = Data(data_9)
crv_3 = Curve(deviation)
number_35 = Number(number)
crv_4 = Curve(curve_2)
number_36 = Number(number_2)
data_15 = Data(data_9)
pt_11 = Point(pt_4)
data_16 = Data(data_9)
pt_12 = Point(pt_3)
data_17 = Data(data_9)
edgesearch = EdgeSearch(diagram=data_12, line=flatten(crv_4))  # -> edge; inputs line: list of Line
#   port diagram: A COMPAS CEM topology or form diagram.
#   port line: The lines to search for in the diagram.
#   port edge: The edge keys.
# ---------- edgesearch: Python ----------
"""
Search a node key in a topology or a form diagram using a point.
"""
from ghpythonlib.componentbase import executingcomponent as component

from compas.utilities import geometric_key
from compas_rhino.geometry import RhinoLine


class EdgeSearchComponent(component):
    def RunScript(self, diagram, line):
        if diagram and line:

            edge = []
            for ln in line:
                ln = RhinoLine.from_geometry(ln).to_compas()

                eg = []
                for point in (ln.start, ln.end):
                    gkey = geometric_key(point, diagram.tol)
                    node = diagram.gkey_node[gkey]
                    eg.append(node)
                edge.append(tuple(eg))

            return edge
# ---------- end edgesearch ----------
edgesearch_2 = EdgeSearch(diagram=data_13, line=flatten(crv_2))  # -> edge; inputs line: list of Line; same code as edgesearch
edgesearch_3 = EdgeSearch(diagram=data_14, line=flatten(crv_3))  # -> edge; inputs line: list of Line; same code as edgesearch
nodesearch = NodeSearch(diagram=data_16, point=pt_12)  # -> node; inputs point: list of Point3d
#   port diagram: A COMPAS CEM topology or form diagram.
#   port point: The points to search for in the diagram.
#   port node: The node keys.
# ---------- nodesearch: Python ----------
"""
Search a node key in a topology or a form diagram using a point.
"""
from ghpythonlib.componentbase import executingcomponent as component

from compas.utilities import geometric_key
from compas_rhino.geometry import RhinoPoint


class NodeSearchComponent(component):
    def RunScript(self, diagram, point):
        if point and diagram:
            node = []
            for pt in point:
                pt = RhinoPoint.from_geometry(pt).to_compas()
                gkey = geometric_key(pt, diagram.tol)
                node.append(diagram.gkey_node[gkey])
            return node
# ---------- end nodesearch ----------
nodesearch_2 = NodeSearch(diagram=data_15, point=pt_11)  # -> node; inputs point: list of Point3d; same code as nodesearch
deviationedgeforceparameter = DeviationEdgeForceParameter(edge_key=edgesearch_2, bound_low=number_34, bound_up=number_34)  # -> parameter
#   port edge_key: The key of a COMPAS CEM deviation edge.
#   port bound_low: The lower bound of the edge optimization parameter. Calculated as the initial edge parameter minus the absolute value of this bound.
#   port bound_up: The upper bound of the edge optimization parameter. Calculated as the initial edge parameter plus the absolute value of this bound.
#   port parameter: A COMPAS CEM deviation edge force parameter.
# ---------- deviationedgeforceparameter: Python ----------
"""
Set the force of a deviation edge as an optimization parameter.
"""
from ghpythonlib.componentbase import executingcomponent as component

from compas_cem.optimization import DeviationEdgeParameter


class DeviationEdgeParameterComponent(component):
    def RunScript(self, edge_key, bound_low, bound_up):
        if edge_key and bound_low is not None and bound_up is not None:
            return DeviationEdgeParameter(edge_key, bound_low, bound_up)
# ---------- end deviationedgeforceparameter ----------
deviationedgeforceparameter_2 = DeviationEdgeForceParameter(edge_key=edgesearch_3, bound_low=number_35, bound_up=number_35)  # -> parameter; same code as deviationedgeforceparameter
deviationedgeforceparameter_3 = DeviationEdgeForceParameter(edge_key=edgesearch, bound_low=number_36, bound_up=number_36)  # -> parameter; same code as deviationedgeforceparameter
pointconstraint = PointConstraint(node_key=nodesearch_2, point=pt_11)  # -> constraint; inputs node_key: Int32, point: Point3d
#   port node_key: The key of a COMPAS CEM node.
#   port point: The target point.
#   port weight: The weight of the constraint in the optimization problem. Defaults to one.
#   port constraint: A COMPAS CEM node point constraint.
# ---------- pointconstraint: Python ----------
"""
Pull the position of a node to a target point.
"""
from ghpythonlib.componentbase import executingcomponent as component

from compas_cem.optimization import PointConstraint
from compas_rhino.geometry import RhinoPoint


class PointConstraintComponent(component):
    def RunScript(self, node_key, point, weight):
        weight = weight or 1.0
        if node_key is not None and point:
            point = RhinoPoint.from_geometry(point).to_compas()
            return PointConstraint(node_key, point, weight)
# ---------- end pointconstraint ----------
pointconstraint_2 = PointConstraint(node_key=nodesearch, point=pt_12)  # -> constraint; inputs node_key: Int32, point: Point3d; same code as pointconstraint
entwine_4 = Entwine(
    Branch00=deviationedgeforceparameter,
    Branch01=deviationedgeforceparameter_2,
    Branch02=deviationedgeforceparameter_3,
    FlattenInputs=True)  # -> flatten(Result)
entwine_5 = Entwine(Branch00=pointconstraint, Branch01=pointconstraint_2, FlattenInputs=True)  # -> flatten(Result)
proxyserver = ProxyServer(start=Toggle(True), stop=Toggle(False))  # inputs start: Boolean, stop: Boolean
#   port start: Launch the COMPAS CEM proxy server. The proxy is kept open to be re-used and thus save start up time.
#   port stop: Shut down the proxy server.
# ---------- proxyserver: Python ----------
"""
Create an RPC proxy server to solve a constrained form-finding problem via CPython"
"""
from ghpythonlib.componentbase import executingcomponent as component

from scriptcontext import sticky

from compas.rpc import Proxy
from compas_cem import PROXY_PORT


class CEMProxyComponent(component):
    def RunScript(self, start, stop):

        if not (start or stop):
            return

        if start:
            proxy = Proxy("compas_cem.optimization", port=PROXY_PORT)
            sticky["proxy_cem"] = proxy

        if stop:
            proxy = Proxy(port=PROXY_PORT)
            proxy.stop_server()
            if "proxy_cem" in sticky:
                del sticky["proxy_cem"]
# ---------- end proxyserver ----------

constrainedformfinding = ConstrainedFormFinding(solve=Toggle(True), topology=data_17, constraints=entwine_5, parameters=entwine_4, iters_max=integer_3)  # -> topology, form, objective, grad_norm, iters, time, status; inputs solve: Boolean, constraints: list, parameters: list, iters_max: Int32, tmax: Int32
#   port solve: Kickstarts the solution of the constrained form-finding problem.
#   port topology: A COMPAS CEM topology diagram.
#   port constraints: A list of COMPAS CEM optimization constraints.
#   port parameters: A list of COMPAS CEM optimization parameters.
#   port algorithm: The name of the gradient-based local optimization algorithm to use. Defaults to SLSQP. Currently supported algorithms are: - SLSQP: Sequential Least Squares Programming - LBFGS: Low-Storage Broyden-Fletcher-Goldfarb-Shanno - MMA: Method of Moving Asymptotes - TNEWTON: Preconditioned Truncated Newton - AUGLAG: Augmented Lagrangian -VAR: Limited-Memory Variable-Metric Algorithm
#   port iters_max: The maximum number of iterations to run the optimization algorithm for. If it is equal to -1, then there is no iteration limit. Defaults to 100.
#   port eps: The convergence threshold for the output value of the objective function. Defaults to 1e-6.
#   port kappa: The convergence threshold for the norm of the gradient of the objective function. Defaults to 1e-8.
#   port tmax: The maximum number of iterations to run the form-finding algorithm for. Defaults to 100.
#   port eta: The convergence threshold of the form-finding algorithm. Defaults to 1e-6.
#   port topology: A COMPAS CEM topology diagram with optimized parameters.
#   port form: A COMPAS CEM form diagram in static equilibrium.
#   port objective: The resulting output value of the objective function.
#   port grad_norm: The norm of the gradient of the objective function.
#   port iters: The elapsed number of optimization iterations.
#   port time: The total optimization runtime in seconds.
#   port status: The final status of the optimization process.
# ---------- constrainedformfinding: Python ----------
"""
Generate a form diagram in static equilibrium such that it meets user-defined constraints.
"""
from ghpythonlib.componentbase import executingcomponent as component
from scriptcontext import sticky

from compas.rpc import Proxy


class ConstrainedFormFindingComponent(component):
    def RunScript(self, solve, topology, constraints, parameters, algorithm, iters_max, eps, kappa, tmax, eta):
        algorithm = algorithm or "SLSQP"
        iters_max = iters_max or 100
        eps = eps or 1e-6
        kappa = kappa or 1e-8
        tmax = tmax or 100
        eta = eta or 1e-6

        if not (solve and topology and constraints and parameters):
            return

        topology = topology.copy()

        # clean constraints and parameters from None
        constraints = [c for c in constraints if c is not None]
        parameters = [p for p in parameters if p is not None]

        # fetch optimization proxy from scriptcontext
        opt = sticky.get("proxy_cem")
        proxy_temp_exists = opt is not None

        # create temporary proxy server if unavailable from scriptcontext
        if not proxy_temp_exists:
            opt = Proxy("compas_cem.optimization")

        # solve constrained form-finding problem
        solution = opt.solve_proxy(topology=topology,
                                   constraints=constraints,
                                   parameters=parameters,
                                   algorithm=algorithm,
                                   iters=iters_max,
                                   eps=eps,
                                   kappa=kappa,
                                   tmax=tmax,
                                   eta=eta)

        # shut down temporary proxy
        if not proxy_temp_exists:
            opt.stop_server()

        # unpack solution
        topology, form, objective, grad_norm, iters, time, status = solution

        return topology, form, objective, grad_norm, iters, time, status
# ---------- end constrainedformfinding ----------

panel_2 = Panel(constrainedformfinding.status)
panel_3 = Panel(constrainedformfinding.objective)
panel_4 = Panel(constrainedformfinding.grad_norm)
panel_5 = Panel(constrainedformfinding.iters)
panel_6 = Panel(constrainedformfinding.time)
data_18 = Data(constrainedformfinding.form)

# ---- group: Select what form diagram to display
# 03-A Display form diagram
what_to_display = ValueList({"Form": 0, "Constrained Form": 1}, selected="Constrained Form")
constrained_form = Data(data_18)
form = Data(data_11)
filter = StreamFilter(Gate=what_to_display, Stream0=form, Stream1=constrained_form)
form_2 = Data(filter)

# ----
form_3 = Data(form_2)

number_37 = Number(number_33)
number_38 = Number(number_32)
number_39 = Number(number_29)
number_40 = Number(number_30)
number_41 = Number(number_31)
form_4 = Data(form_3)
cluster_6 = Cluster_6(form=form_4, force_min=number_38, force_scale=number_37, number=number_39, B=number_40, B_2=number_41)
cem_colors = CEMColors()  # -> color_tension, color_compression, color_edge, color_node, color_node_support, color_node_origin, color_load, color_reaction, color_trail, color_auxiliary_trail
#   port color_tension: The color for edges under a tension force.
#   port color_compression: The color for edges under a compression force.
#   port color_edge: The color for a regular edge.
#   port color_node: The color for a regular node.
#   port color_node_support: The color for a support node.
#   port color_node_origin: The color for an origin node.
#   port color_load: The color for an applied load.
#   port color_reaction: The color for a reaction force.
#   port color_trail: The color to paint a trail.
#   port color_auxiliary_trail: The color to paint an auxiliary trail.
# ---------- cem_colors: Python ----------
"""
Get the artists color scheme for the objects of the CEM framework.
"""
from ghpythonlib.componentbase import executingcomponent as component

from compas_cem import COLORS
import rhinoscriptsyntax as rs


class ArtistColorsComponent(component):
    def RunScript(self):
        colors = {key: rs.CreateColor(c) for key, c in COLORS.items()}

        color_tension = colors["tension"]
        color_compression = colors["compression"]
        color_edge = colors["edge"]
        color_node = colors["node"]
        color_node_support = colors["node_support"]
        color_node_origin = colors["node_origin"]
        color_load = colors["load"]
        color_reaction = colors["support_force"]
        color_trail = colors["trail"]
        color_auxiliary_trail = colors["auxiliary_trail"]

        colors = (color_tension, color_compression, color_edge, color_node, color_node_support, color_node_origin, color_load, color_reaction, color_trail, color_auxiliary_trail)

        return colors
# ---------- end cem_colors ----------
material = CreateMaterial(
    Diffuse=cem_colors.color_load,
    Specular=RGB(255, 255, 255),
    Emission=cem_colors.color_load,
    Transparency="0.2",
    Shine="100")

form_5 = Data(form_3)
number_42 = Number(number_30)
number_43 = Number(number_31)
number_44 = Number(number_32)
number_45 = Number(number_33)
number_46 = Number(number_28)
division_2 = Division(A=number_45, B="20")
cluster_7 = Cluster_7(form=form_5, force_min=number_44, force_scale=division_2, number=number_46, B=number_42, B_2=number_43)

topology_2 = Data(data_9)
form_6 = Data(form_3)

pt_13 = Point(pt_4)
pt_14 = Point(pt_3)
entwine_6 = Entwine(Branch00=pt_14, Branch01=pt_13, FlattenInputs=True)
node_search = NodeSearch(diagram=topology_2, point=flatten(entwine_6))  # -> node_key; inputs point: Point3d
#   port diagram: A COMPAS CEM topology or form diagram.
#   port point: The point to search for in the diagram.
#   port node_key: The found node key.
# ---------- node_search: Python ----------
"""
Search a node key in a topology or a form diagram using a point.
"""
from ghpythonlib.componentbase import executingcomponent as component

from compas.utilities import geometric_key
from compas_rhino.geometry import RhinoPoint


class NodeSearchComponent(component):
    def RunScript(self, diagram, point):
        if point and diagram:
            pt = RhinoPoint.from_geometry(point).to_compas()
            gkey = geometric_key(pt, diagram.tol)
            return diagram.gkey_node[gkey]
# ---------- end node_search ----------
form_artist = FormArtist(form=form_6, node_keys=node_search)  # -> nodes, support_nodes, edges, loads, reactions; inputs node_keys: list of Int32, edge_keys: list
#   port form: A COMPAS CEM topology diagram.
#   port node_keys: A selection of the node keys in the diagram. Defaults to all the node keys.
#   port edge_keys: A selection of the edge keys in the diagram. Defaults to all the edge keys.
#   port force_min: The smallest force magnitude to draw. Defaults to 1e-3
#   port force_scale: The scale of the loads and the reactions. Defaults to 1.
#   port nodes: The nodes of the diagram as points.
#   port support_nodes: The support nodes of the diagram as points
#   port edges: The edges of the diagram as lines.
#   port loads: The applied loads as lines.
#   port reactions: The reaction forces at the supports, as lines.
# ---------- form_artist: Python ----------
"""
Draw a form diagram.
"""
from ghpythonlib.componentbase import executingcomponent as component

from compas_cem.ghpython import FormArtist


class FormArtistComponent(component):
    def RunScript(self, form, node_keys, edge_keys, force_min, force_scale):
        node_keys = node_keys or None
        edge_keys = edge_keys or None
        force_min = force_min or 1e-3
        force_scale = force_scale or 1
        if form:
            artist = FormArtist(form, artist_type=FormArtist)

            nodes = artist.draw_nodes(node_keys)
            edges = artist.draw_edges(edge_keys)
            support_nodes = artist.draw_nodes_support(node_keys)

            loads = artist.draw_loads(node_keys, min_load=force_min, scale=force_scale)
            reactions = artist.draw_reactions(node_keys, min_force=force_min, scale=force_scale)

            return nodes, support_nodes, edges, loads, reactions
# ---------- end form_artist ----------
line_2 = Line(StartPoint=flatten(form_artist.nodes), EndPoint=flatten(entwine_6))
polyline = PolyLine(Vertices=entwine_6, Closed=False)
dash_pattern = DashPattern(Curve=line_2, Pattern="0.01")  # -> Dashes, Gaps

form_7 = Data(form_3)
number_47 = Number(number_26)
number_48 = Number(number_27)
form_artist_2 = FormArtist(form=form_7)  # -> nodes, support_nodes, edges, loads, reactions; inputs node_keys: list of Int32, edge_keys: list; same code as form_artist
cem_colors_2 = CEMColors()  # -> color_tension, color_compression, color_edge, color_node, color_node_support, color_node_origin, color_load, color_reaction, color_trail, color_auxiliary_trail; same code as cem_colors
edge_results = EdgeResults(form=form_7)  # -> lengths, forces; inputs edge_keys: list
#   port form: A COMPAS CEM form diagram.
#   port edge_keys: A selection of edge keys to query the results on. Defaults to all the edge keys.
#   port lengths: The edge lengths.
#   port forces: The edge forces.
# ---------- edge_results: Python ----------
"""
Extract the post form-finding results of the edges in a form diagram.
"""
from ghpythonlib.componentbase import executingcomponent as component


class EdgeResultsComponent(component):
    def RunScript(self, form, edge_keys):
        if form:
            edge_keys = edge_keys or list(form.edges())
            lengths = [form.edge_length_2(ed) for ed in edge_keys]
            forces = [form.edge_force(ed) for ed in edge_keys]
            return lengths, forces
# ---------- end edge_results ----------
dom = ConstructDomain(DomainStart=number_47, DomainEnd=number_48)
abs = Absolute(Value=edge_results.forces)
merge = Merge(Data1=cem_colors_2.color_compression, Data2=cem_colors_2.color_tension)
bnd = Bounds(Numbers=abs)
larger_than = LargerThan(FirstNumber=edge_results.forces, SecondNumber=0)  # -> LargerThan, OrEqualTo
remap = RemapNumbers(Value=abs, Source=bnd, Target=dom)  # -> Mapped, Clipped
pipe = Pipe(Curve=form_artist_2.edges, Radius=remap.Mapped, Caps=2)  # -> flatten(Pipe)
list_item = ListItem(List=merge, Index=larger_than.OrEqualTo, Wrap=True)
material_2 = CreateMaterial(Diffuse=list_item, Specular=RGB(255, 255, 255), Emission=list_item, Transparency=0, Shine="100")

form_8 = Data(form_3)
form_artist_3 = FormArtist(form=form_8)  # -> nodes, support_nodes, edges, loads, reactions; inputs node_keys: list of Int32, edge_keys: list; same code as form_artist
control_points = ControlPoints(Curve=form_artist_3.edges)  # -> Points, Weights, Knots
deconstruct = Deconstruct(Point=flatten(control_points.Points))  # -> XComponent, YComponent, ZComponent
sort_list = SortList(Keys=deconstruct.ZComponent)  # -> Keys, ValuesValuesA
list_item_2 = ListItem(List=sort_list.Keys, Index=0, Wrap=True)
construct_point = ConstructPoint(XCoordinate=0, YCoordinate=0, ZCoordinate=list_item_2)
xy_plane = XYPlane(Origin=construct_point)
project = Project(Geometry=form_artist_3.edges, Plane=xy_plane)  # -> Geometry, Transform

form_9 = Data(form_3)
integer_4 = Integer(integer_2)
form_artist_4 = FormArtist(form=form_9)  # -> nodes, support_nodes, edges, loads, reactions; inputs node: list of Int32, edge: list
#   port form: A COMPAS CEM topology diagram.
#   port node: A selection of the nodes in the diagram. Defaults to all the nodes.
#   port edge: A selection of the edges in the diagram. Defaults to all the edges.
#   port force_min: The smallest force magnitude to draw. Defaults to 1e-3
#   port force_scale: The scale of the loads and the reactions. Defaults to 1.
#   port nodes: The nodes of the diagram as points.
#   port support_nodes: The support nodes of the diagram as points
#   port edges: The edges of the diagram as lines.
#   port loads: The applied loads as lines.
#   port reactions: The reaction forces at the supports, as lines.
# ---------- form_artist_4: Python ----------
"""
Draw a form diagram.
"""
from ghpythonlib.componentbase import executingcomponent as component

from compas_cem.ghpython import FormArtist


class FormArtistComponent(component):
    def RunScript(self, form, node, edge, force_min, force_scale):
        node = node or None
        edge = edge or None
        force_min = force_min or 1e-3
        force_scale = force_scale or 1
        if form:
            artist = FormArtist(form, artist_type=FormArtist)

            nodes = artist.draw_nodes(node)
            edges = artist.draw_edges(edge)
            support_nodes = artist.draw_nodes_support(node)

            loads = artist.draw_loads(node, min_load=force_min, scale=force_scale)
            reactions = artist.draw_reactions(node, min_force=force_min, scale=force_scale)

            return nodes, support_nodes, edges, loads, reactions
# ---------- end form_artist_4 ----------
edgeresults = EdgeResults(form=form_9)  # -> length, force; inputs edge: list
#   port form: A COMPAS CEM form diagram.
#   port edge: A selection of edge keys to query the results on. Defaults to all the edges.
#   port length: The edge lengths.
#   port force: The edge forces.
# ---------- edgeresults: Python ----------
"""
Extract the post form-finding results of the edges in a form diagram.
"""
from ghpythonlib.componentbase import executingcomponent as component


class EdgeResultsComponent(component):
    def RunScript(self, form, edge):
        if form:
            edge = edge or list(form.edges())
            length = [form.edge_length_2(ed) for ed in edge]
            force = [form.edge_force(ed) for ed in edge]
            return length, force
# ---------- end edgeresults ----------
curve_middle = CurveMiddle(Curve=form_artist_4.edges)
stream_filter = StreamFilter(Gate=integer_4, Stream0=edgeresults.force, Stream1=edgeresults.length)
ghpython_script = GhPythonScript(x=stream_filter)  # -> out, a
# ---------- ghpython_script: Python ----------
a = round(x, 2)
# ---------- end ghpython_script ----------

form_10 = Data(form_3)
form_artist_5 = FormArtist(form=form_10)  # -> nodes, support_nodes, edges, loads, reactions; inputs node_keys: list of Int32, edge_keys: list; same code as form_artist
disassemble_form_diagram = DisassembleFormDiagram(form=form_10)  # -> node_keys, support_node_keys, edge_keys
#   port form: A COMPAS CEM form diagram.
#   port node_keys: All the node keys in the form diagram.
#   port support_node_keys: The keys of the support nodes in the form diagram.
#   port edge_keys: All the edge keys in the form diagram.
# ---------- disassemble_form_diagram: Python ----------
"""
Disassemble a form diagram into its constituent parts.
"""
from ghpythonlib.componentbase import executingcomponent as component


class FormDisassemblyComponent(component):
    def RunScript(self, form):
        if form:
            edge_keys = list(form.edges())
            node_keys = list(form.nodes())
            support_node_keys = list(form.support_nodes())

            return node_keys, support_node_keys, edge_keys
# ---------- end disassemble_form_diagram ----------
curve_middle_2 = CurveMiddle(Curve=form_artist_5.edges)

form_11 = Data(form_3)
number_49 = Number(number_32)
number_50 = Number(number_33)
form_artist_6 = FormArtist(form=form_11, force_min=number_49, force_scale=number_50)  # -> nodes, support_nodes, edges, loads, reactions; inputs node_keys: list of Int32, edge_keys: list; same code as form_artist
cem_colors_3 = CEMColors()  # -> color_tension, color_compression, color_edge, color_node, color_node_support, color_node_origin, color_load, color_reaction, color_trail, color_auxiliary_trail; same code as cem_colors
cluster_8 = Cluster_3(curve=form_artist_6.loads)  # -> vector, geometry
unit_vector = UnitVector(Vector=cluster_8.vector)
vector_length = VectorLength(Vector=cluster_8.vector)
multiplication_6 = Multiplication(A=unit_vector, B=vector_length)
move = Move(Geometry=cluster_8.geometry, Motion=multiplication_6)  # -> Geometry, Transform

form_12 = Data(form_3)
number_51 = Number(number_32)
number_52 = Number(number_33)
form_artist_7 = FormArtist(form=form_12, force_min=number_51, force_scale=number_52)  # -> nodes, support_nodes, edges, loads, reactions; inputs node_keys: list of Int32, edge_keys: list; same code as form_artist
cem_colors_4 = CEMColors()  # -> color_tension, color_compression, color_edge, color_node, color_node_support, color_node_origin, color_load, color_reaction, color_trail, color_auxiliary_trail; same code as cem_colors
cluster_9 = Cluster_3(curve=form_artist_7.reactions)  # -> vector, geometry
vector_length_2 = VectorLength(Vector=cluster_9.vector)
unit_vector_2 = UnitVector(Vector=cluster_9.vector)
multiplication_7 = Multiplication(A=unit_vector_2, B=vector_length_2)
move_2 = Move(Geometry=cluster_9.geometry, Motion=multiplication_7)  # -> Geometry, Transform

form_13 = Data(form_3)
form_artist_8 = FormArtist(form=form_13)  # -> nodes, support_nodes, edges, loads, reactions; inputs node_keys: list of Int32, edge_keys: list; same code as form_artist
edgeresults_2 = EdgeResults(form=form_13)  # -> length, force; inputs edge: list; same code as edgeresults
cem_colors_5 = CEMColors()  # -> color_tension, color_compression, color_edge, color_node, color_node_support, color_node_origin, color_load, color_reaction, color_trail, color_auxiliary_trail; same code as cem_colors
larger_than_2 = LargerThan(FirstNumber=edgeresults_2.force, SecondNumber=0)  # -> LargerThan, OrEqualTo
merge_2 = Merge(Data1=cem_colors_5.color_compression, Data2=cem_colors_5.color_tension)
list_item_3 = ListItem(List=merge_2, Index=larger_than_2.OrEqualTo, Wrap=True)

colour = Colour(ColourSwatch(SwatchColor=RGB(76, 76, 76)))
material_3 = CreateMaterial(Diffuse=colour, Specular=RGB(255, 255, 255), Emission=colour, Transparency="0.2", Shine="100")

# ---- group: Curve constraints
custom_preview_2 = CustomPreview(Geometry=polyline, Material=ColourSwatch(SwatchColor=RGB(82, 82, 82)))

# ---- group: Projection 2d
custom_preview_3 = CustomPreview(Geometry=project.Geometry, Material=ColourSwatch(SwatchColor=RGB(82, 82, 82)))

# ---- group: Distance to curves
custom_preview_4 = CustomPreview(Geometry=dash_pattern.Dashes, Material=ColourSwatch(SwatchColor=RGB(168, 168, 168)))

# ---- group: Edges
custom_preview_5 = CustomPreview(Geometry=form_artist_8.edges, Material=list_item_3)

# ---- group: Node keys
text_tag = TextTag(Location=form_artist_5.nodes, Text=disassemble_form_diagram.node_keys, Colour=colour_swatch)

# ---- group: Edge keys
text_tag_2 = TextTag(Location=curve_middle_2, Text=disassemble_form_diagram.edge_keys, Colour=colour_swatch)

# ---- group: Edge results
text_tag_3 = TextTag(Location=curve_middle, Text=ghpython_script.a, Colour=ColourSwatch(SwatchColor=RGBA(94, 94, 94, 195)))

# ---- group: Loads
vector_display_ex = VectorDisplayEx(Point=move.Geometry, Vector=cluster_8.vector, Colour=cem_colors_3.color_load, Width=2)

# ---- group: Reactions
vector_display_ex_2 = VectorDisplayEx(Point=move_2.Geometry, Vector=cluster_9.vector, Colour=cem_colors_4.color_reaction, Width=2)

# ---- group: Reactions - Piped
preview = CustomPreview(Geometry=cluster_7, Material=material_3)

# ---- group: Loads - Piped
preview_2 = CustomPreview(Geometry=cluster_6, Material=material)

# ---- group: Edges - Piped
preview_3 = CustomPreview(Geometry=pipe, Material=material_2)

# ----
# 03-B Display topology diagram
topology_3 = Data(data_9)
translation_x = Slider(0, range=0..100)
translation_y = Slider(3, range=0..10)
number_53 = Number(translation_x)
number_54 = Number(number_53)
negative_2 = Negative(Value=number_54)
number_55 = Number(translation_y)
number_56 = Number(number_55)
negative_3 = Negative(Value=number_56)

# ---- group: Translate topology diagram
ghpython_script_2 = GhPythonScript(topology=topology_3, x=negative_2, y=negative_3)  # -> out, topology
# ---------- ghpython_script_2: Python ----------
from compas.geometry import Translation
from compas.datastructures import network_transformed



translation = Translation.from_vector([x, y, 0.0])
topology = network_transformed(topology, translation)
# ---------- end ghpython_script_2 ----------

# ----
topology_4 = Data(ghpython_script_2.topology)

topology_5 = Data(topology_4)
number_57 = Number(number_25)
number_58 = Number(number_22)
topology_artist_2 = TopologyArtist(topology=topology_5, force_min=number_57, force_scale=number_58)  # -> nodes, origin_nodes, support_nodes, edges, trail_edges, deviation_edges, trails, loads; inputs node_keys: list of Int32, edge_keys: list; same code as topology_artist
cem_colors_6 = CEMColors()  # -> color_tension, color_compression, color_edge, color_node, color_node_support, color_node_origin, color_load, color_reaction, color_trail, color_auxiliary_trail; same code as cem_colors
cluster_10 = Cluster_3(curve=topology_artist_2.loads)  # -> vector, geometry
vector_length_3 = VectorLength(Vector=cluster_10.vector)
unit_vector_3 = UnitVector(Vector=cluster_10.vector)
multiplication_8 = Multiplication(A=unit_vector_3, B=vector_length_3)
move_3 = Move(Geometry=cluster_10.geometry, Motion=multiplication_8)  # -> Geometry, Transform

topology_6 = Data(topology_4)
topology_artist_3 = TopologyArtist(topology=topology_6)  # -> nodes, origin_nodes, support_nodes, edges, trail_edges, deviation_edges, trails, loads; inputs node_keys: list of Int32, edge_keys: list; same code as topology_artist
disassemble_topology_diagram = DisassembleTopologyDiagram(topology=topology_6)  # -> node_keys, origin_node_keys, support_node_keys, edge_keys, trail_edge_keys, deviation_edge_keys, trail_keys, auxiliary_trail_keys
#   port topology: A COMPAS CEM topology diagram.
#   port node_keys: All the node keys in the topology diagram.
#   port origin_node_keys: The keys of the origin nodes in the topology diagram.
#   port support_node_keys: The keys of the support nodes in the topology diagram.
#   port edge_keys: All the edge keys in the topology diagram.
#   port trail_edge_keys: The keys of the trail edges in the topology diagram.
#   port deviation_edge_keys: The keys of the deviation edges in the topology diagram.
#   port trail_keys: The keys of the trails in the topology diagram.
#   port auxiliary_trail_keys: The keys of the auxiliary trails in the topology diagram.
# ---------- disassemble_topology_diagram: Python ----------
"""
Disassemble a topology diagram into its constituent parts.
"""
from ghpythonlib.componentbase import executingcomponent as component


class TopologyDisassemblyComponent(component):
    def RunScript(self, topology):
        if topology:
            trail_keys = list(topology.trails())
            auxiliary_trail_keys = list(topology.auxiliary_trails())

            edge_keys = list(topology.edges())
            trail_edge_keys = list(topology.trail_edges())
            deviation_edge_keys = list(topology.deviation_edges())

            node_keys = list(topology.nodes())
            origin_node_keys = list(topology.origin_nodes())
            support_node_keys = list(topology.support_nodes())

            return node_keys, origin_node_keys, support_node_keys, edge_keys, trail_edge_keys, deviation_edge_keys, trail_keys, auxiliary_trail_keys
# ---------- end disassemble_topology_diagram ----------
curve_middle_3 = CurveMiddle(Curve=topology_artist_3.edges)

topology_7 = Data(topology_4)

topology_8 = Data(topology_4)
number_59 = Number(number_24)
cem_colors_7 = CEMColors()  # -> color_tension, color_compression, color_edge, color_node, color_node_support, color_node_origin, color_load, color_reaction, color_trail, color_auxiliary_trail; same code as cem_colors
disassemble_topology_diagram_2 = DisassembleTopologyDiagram(topology=topology_8)  # -> node_keys, origin_node_keys, support_node_keys, edge_keys, trail_edge_keys, deviation_edge_keys, trail_keys, auxiliary_trail_keys; same code as disassemble_topology_diagram
python = GhPythonScript(
    trail=disassemble_topology_diagram_2.trail_edge_keys,
    auxiliary_trail=disassemble_topology_diagram_2.auxiliary_trail_keys)  # -> out, trail; inputs trail: list, auxiliary_trail: list
# ---------- python: Python ----------
trail = [tr for tr in trail if tr not in auxiliary_trail]
# ---------- end python ----------
topology_artist_4 = TopologyArtist(topology=topology_8, edge_keys=python.trail)  # -> nodes, origin_nodes, support_nodes, edges, trail_edges, deviation_edges, trails, loads; inputs node_keys: list of Int32, edge_keys: list; same code as topology_artist
topology_artist_5 = TopologyArtist(topology=topology_8)  # -> nodes, origin_nodes, support_nodes, edges, trail_edges, deviation_edges, trails, loads; inputs node_keys: list of Int32, edge_keys: list; same code as topology_artist
python_2 = GhPythonScript(topology=topology_8, auxiliary_trail=disassemble_topology_diagram_2.auxiliary_trail_keys)  # -> out, auxiliary_trail; inputs auxiliary_trail: list
# ---------- python_2: Python ----------
from compas_cem.ghpython import TopologyArtist


if auxiliary_trail is not None:
    artist = TopologyArtist(topology, artist_type=TopologyArtist)
   
    if auxiliary_trail is not None:
        auxiliary_trail = artist.draw_edges_trail(auxiliary_trail)
# ---------- end python_2 ----------
edge_results_2 = EdgeResults(form=topology_8, edge_keys=python.trail)  # -> lengths, forces; inputs edge_keys: list; same code as edge_results
edge_results_3 = EdgeResults(form=topology_8, edge_keys=disassemble_topology_diagram_2.deviation_edge_keys)  # -> lengths, forces; inputs edge_keys: list; same code as edge_results
merge_3 = Merge(Data1=cem_colors_7.color_compression, Data2=cem_colors_7.color_tension)
larger = LargerThan(FirstNumber=edge_results_3.forces, SecondNumber=0)  # -> LargerThan, OrEqualTo
larger_2 = LargerThan(FirstNumber=edge_results_2.lengths, SecondNumber=0)  # -> LargerThan, OrEqualTo
list_item_4 = ListItem(List=merge_3, Index=larger.OrEqualTo, Wrap=True)
list_item_5 = ListItem(List=merge_3, Index=larger_2.OrEqualTo, Wrap=True)
dash_pattern_2 = DashPattern(Curve=topology_artist_5.deviation_edges, Pattern=number_59)  # -> Dashes, Gaps

topology_9 = Data(topology_4)
number_60 = Number(number_23)
topology_artist_6 = TopologyArtist(topology=topology_9)  # -> nodes, origin_nodes, support_nodes, edges, trail_edges, deviation_edges, trails, loads; inputs node_keys: list of Int32, edge_keys: list; same code as topology_artist
cem_colors_8 = CEMColors()  # -> color_tension, color_compression, color_edge, color_node, color_node_support, color_node_origin, color_load, color_reaction, color_trail, color_auxiliary_trail; same code as cem_colors
mesh_sphere_ex = MeshSphereEx(Base=topology_artist_6.support_nodes, Radius=number_60, Count=2)

disassemble_topology_diagram_3 = DisassembleTopologyDiagram(topology=topology_7)  # -> node_keys, origin_node_keys, support_node_keys, edge_keys, trail_edge_keys, deviation_edge_keys, trail_keys, auxiliary_trail_keys; same code as disassemble_topology_diagram
python_3 = GhPythonScript(
    trail=disassemble_topology_diagram_3.trail_edge_keys,
    auxiliary_trail=disassemble_topology_diagram_3.auxiliary_trail_keys)  # -> out, trail; inputs trail: list, auxiliary_trail: list; same code as python
entwine_7 = Entwine(Branch00=python_3.trail, Branch01=disassemble_topology_diagram_3.deviation_edge_keys, FlattenInputs=True)
topology_artist_7 = TopologyArtist(topology=topology_7, edge_keys=entwine_7)  # -> nodes, origin_nodes, support_nodes, edges, trail_edges, deviation_edges, trails, loads; inputs node_keys: list of Int32, edge_keys: list; same code as topology_artist
edge_results_4 = EdgeResults(form=topology_7, edge_keys=python_3.trail)  # -> lengths, forces; inputs edge_keys: list; same code as edge_results
edge_results_5 = EdgeResults(form=topology_7, edge_keys=disassemble_topology_diagram_3.deviation_edge_keys)  # -> lengths, forces; inputs edge_keys: list; same code as edge_results
curve_middle_4 = CurveMiddle(Curve=topology_artist_7.edges)
merge_4 = Merge(Data1=edge_results_4.lengths, Data2=edge_results_5.forces)  # -> flatten(Result)

mesh_sphere_ex_2 = MeshSphereEx(Base=topology_artist_6.origin_nodes, Radius=number_60, Count=2)
material_4 = CreateMaterial(
    Diffuse=cem_colors_8.color_node_origin,
    Specular=RGB(255, 255, 255),
    Emission=cem_colors_8.color_node_origin,
    Transparency="0.2",
    Shine="100")
material_5 = CreateMaterial(
    Diffuse=cem_colors_8.color_node_support,
    Specular=RGB(255, 255, 255),
    Emission=cem_colors_8.color_node_support,
    Transparency="0.2",
    Shine="100")

# ---- group: Edges design parameters
text_tag_4 = TextTag(Location=flatten(curve_middle_4), Text=merge_4, Colour=ColourSwatch(SwatchColor=RGBA(156, 156, 156, 195)))

# ---- group: Node keys
text_tag_5 = TextTag(
    Location=topology_artist_3.nodes,
    Text=disassemble_topology_diagram.node_keys,
    Colour=ColourSwatch(SwatchColor=RGBA(156, 156, 156, 195)))

# ---- group: Edge keys
text_tag_6 = TextTag(
    Location=curve_middle_3,
    Text=disassemble_topology_diagram.edge_keys,
    Colour=ColourSwatch(SwatchColor=RGBA(156, 156, 156, 195)))

# ---- group: Loads
vector_display_ex_3 = VectorDisplayEx(Point=move_3.Geometry, Vector=cluster_10.vector, Colour=cem_colors_6.color_load, Width=2)

# ---- group: Deviation edges
custom_preview_6 = CustomPreview(Geometry=dash_pattern_2.Dashes, Material=graft(list_item_4))

# ---- group: Trails
custom_preview_7 = CustomPreview(Geometry=topology_artist_5.trails, Material=cem_colors_7.color_trail)

# ---- group: Auxiliary Trails
custom_preview_8 = CustomPreview(Geometry=python_2.auxiliary_trail, Material=cem_colors_7.color_auxiliary_trail)

# ---- group: Support nodes
custom_preview_9 = CustomPreview(Geometry=mesh_sphere_ex, Material=material_5)

# ---- group: Origin nodes
custom_preview_10 = CustomPreview(Geometry=mesh_sphere_ex_2, Material=material_4)

# ---- group: Trail edges
custom_preview_11 = CustomPreview(Geometry=topology_artist_4.trail_edges, Material=list_item_5)

# ==== cluster Cluster
polyline = ClusterInput()
polyline_2 = Curve(polyline)
explode = Explode(Curve=polyline_2, Recursive=True)  # -> Segments, Vertices
explode_2 = Explode(Curve=polyline_2, Recursive=True)  # -> Segments, Vertices
lng = ListLength(List=explode.Vertices)
cull_i = CullIndex(List=explode_2.Segments, Indices=expr("(x/2)-1", lng), Wrap=True)
item = ListItem(List=explode_2.Segments, Index=expr("(x/2)-1", lng), Wrap=True)
item_2 = ListItem(List=explode.Vertices, Index=[0, -1], Wrap=True)
cull_i_2 = CullIndex(List=explode.Vertices, Indices=[0, -1], Wrap=True)
trails = Line(cull_i)
deviation = Line(item)
support = Point(item_2)
free_nodes = Point(cull_i_2)
trails_2 = ClusterOutput(trails)
deviation_2 = ClusterOutput(deviation)
support_2 = ClusterOutput(support)
free_nodes_2 = ClusterOutput(free_nodes)

# ==== cluster Cluster_2
A = ClusterInput()
C = ClusterInput()
N = ClusterInput()
A_2 = ClusterInput()
B = ClusterInput()
addition = Addition(A=A, B="1")
divide = DivideCurve(Curve=C, Count=N, Kinks=False)  # -> Points, Tangents, Parameters
division = Division(A=A_2, B=B)
curve = ClusterInput()
shatter = Shatter(Curve=curve, Parameters=divide.Parameters)
series = Series(Start=0, Step=division, Count=addition)
unit_z = UnitZ(Factor=series)
length = Length(Curve=shatter)
move = Move(Geometry=divide.Points, Motion=unit_z)  # -> Geometry, Transform
average = Average(Input=length)
interpolate = Interpolate(Vertices=move.Geometry, Degree=3, Periodic=False, KnotStyle=1)  # -> Curve, Length, Domain
arithmetic_mean = ClusterOutput(average)
curve_2 = ClusterOutput(interpolate.Curve)

# ==== cluster Cluster_3
curve = ClusterInput()
end_points = EndPoints(Curve=curve)  # -> Start, End
vector_2pt = Vector2Pt(PointA=end_points.Start, PointB=end_points.End, Unitize=False)  # -> Vector, Length
reverse = Reverse(Vector=vector_2pt.Vector)
vector = ClusterOutput(vector_2pt.Vector)
move = Move(Geometry=end_points.Start, Motion=reverse)  # -> Geometry, Transform
geometry = ClusterOutput(move.Geometry)

# ==== cluster Cluster_4
G = ClusterInput()
project = Project(Geometry=G, Plane=PlaneXY(0, 0, 0))  # -> Geometry, Transform
C = ClusterInput()
N = ClusterInput()
N_2 = ClusterInput()
unit_z = UnitZ(Factor=1)
divide = DivideCurve(Curve=C, Count=N, Kinks=False)  # -> Points, Tangents, Parameters
divide_2 = DivideCurve(Curve=project.Geometry, Count=N_2, Kinks=False)  # -> Points, Tangents, Parameters
construct_plane = ConstructPlane(Origin=divide.Points, XAxis=divide_2.Tangents, YAxis=unit_z)
pl = PlaneNormal(Origin=divide.Points, ZAxis=divide_2.Tangents)
align = AlignPlanes(Planes=pl)
align_2 = AlignPlanes(Planes=construct_plane)
deplane = DeconstructPlane(Plane=align_2)  # -> Origin, XAxis, YAxis, ZAxis
O = ClusterOutput(deplane.Origin)
Z = ClusterOutput(deplane.ZAxis)
Y = ClusterOutput(deplane.YAxis)

# ==== cluster Cluster_5
value = ClusterInput()
value_2 = ClusterInput()
V = ClusterInput()
V_2 = ClusterInput()
negative = Negative(Value=value)
negative_2 = Negative(Value=value_2)
unit = UnitVector(Vector=V)
unit_2 = UnitVector(Vector=V_2)
B = ClusterInput()
B_2 = ClusterInput()
multiplication = Multiplication(A=unit_2, B=B)
multiplication_2 = Multiplication(A=unit, B=negative_2)
multiplication_3 = Multiplication(A=unit, B=negative)
multiplication_4 = Multiplication(A=unit_2, B=B_2)
G = ClusterInput()
G_2 = ClusterInput()
rev = Reverse(Vector=multiplication)
move = Move(Geometry=G, Motion=multiplication_4)  # -> Geometry, Transform
move_2 = Move(Geometry=G_2, Motion=rev)  # -> Geometry, Transform
move_3 = Move(Geometry=move.Geometry, Motion=multiplication_3)  # -> Geometry, Transform
move_4 = Move(Geometry=move_2.Geometry, Motion=multiplication_2)  # -> Geometry, Transform
G_3 = ClusterOutput(move_3.Geometry)
G_4 = ClusterOutput(move_4.Geometry)

# ==== cluster Cluster_6
number = ClusterInput()
form = ClusterInput()
force_min = ClusterInput()
force_scale = ClusterInput()
form_artist = FormArtist(form=form, force_min=force_min, force_scale=force_scale)  # -> nodes, support_nodes, edges, loads, reactions; inputs node_keys: list of Int32, edge_keys: list
#   port form: A COMPAS CEM topology diagram.
#   port node_keys: A selection of the node keys in the diagram. Defaults to all the node keys.
#   port edge_keys: A selection of the edge keys in the diagram. Defaults to all the edge keys.
#   port force_min: The smallest force magnitude to draw. Defaults to 1e-3
#   port force_scale: The scale of the loads and the reactions. Defaults to 1.
#   port nodes: The nodes of the diagram as points.
#   port support_nodes: The support nodes of the diagram as points
#   port edges: The edges of the diagram as lines.
#   port loads: The applied loads as lines.
#   port reactions: The reaction forces at the supports, as lines.
# ---------- form_artist: Python ----------
"""
Draw a form diagram.
"""
from ghpythonlib.componentbase import executingcomponent as component

from compas_cem.ghpython import FormArtist


class FormArtistComponent(component):
    def RunScript(self, form, node_keys, edge_keys, force_min, force_scale):
        node_keys = node_keys or None
        edge_keys = edge_keys or None
        force_min = force_min or 1e-3
        force_scale = force_scale or 1
        if form:
            artist = FormArtist(form)

            nodes = artist.draw_nodes(node_keys)
            edges = artist.draw_edges(edge_keys)
            support_nodes = artist.draw_nodes_support(node_keys)

            loads = artist.draw_loads(node_keys, min_load=force_min, scale=force_scale)
            reactions = artist.draw_reactions(node_keys, min_force=force_min, scale=force_scale)

            return nodes, support_nodes, edges, loads, reactions
# ---------- end form_artist ----------
number_2 = Number(number)
B = ClusterInput()
division = Division(A=number_2, B=B)
flip = FlipCurve(Curve=form_artist.loads)  # -> Curve, Flag
B_2 = ClusterInput()
eval = EvaluateLength(Curve=flip.Curve, Length=number_2, Normalized=False)  # -> Point, Tangent, Parameter
shatter = Shatter(Curve=graft(flip.Curve), Parameters=graft(eval.Parameter))
division_2 = Division(A=division, B=B_2)
pframe = PerpFrame(Curve=flip.Curve, Parameter=eval.Parameter)
item = ListItem(List=shatter, Index=0, Wrap=True)  # -> Item1, Item
pflip = FlipPlane(Plane=pframe, ReverseX=False, ReverseY=False, SwapAxes=True)
cone = Cone(Base=pflip, Radius=division, Length=number_2)  # -> Cone, Tip
pipe = Pipe(Curve=item.Item1, Radius=division_2, Caps=2)
cap_holes = CapHoles(Brep=cone.Cone)
brep = Brep(cap_holes)
brep_2 = Brep(pipe)
brep_3 = Brep([brep_2, brep])
brep_4 = ClusterOutput(brep_3)

# ==== cluster Cluster_7
number = ClusterInput()
form = ClusterInput()
force_min = ClusterInput()
force_scale = ClusterInput()
number_2 = Number(number)
form_artist = FormArtist(form=form, force_min=force_min, force_scale=force_scale)  # -> nodes, support_nodes, edges, loads, reactions; inputs node_keys: list of Int32, edge_keys: list; same code as form_artist
B = ClusterInput()
B_2 = ClusterInput()
division = Division(A=number_2, B=B)
flip = FlipCurve(Curve=form_artist.reactions)  # -> Curve, Flag
eval = EvaluateLength(Curve=flip.Curve, Length=number_2, Normalized=False)  # -> Point, Tangent, Parameter
shatter = Shatter(Curve=graft(flip.Curve), Parameters=graft(eval.Parameter))
division_2 = Division(A=division, B=B_2)
pframe = PerpFrame(Curve=flip.Curve, Parameter=eval.Parameter)
item = ListItem(List=shatter, Index=0, Wrap=True)  # -> Item1, Item
pflip = FlipPlane(Plane=pframe, ReverseX=False, ReverseY=False, SwapAxes=True)
cone = Cone(Base=pflip, Radius=division, Length=number_2)  # -> Cone, Tip
pipe = Pipe(Curve=item.Item1, Radius=division_2, Caps=2)
cap_holes = CapHoles(Brep=cone.Cone)
brep = Brep(cap_holes)
brep_2 = Brep(pipe)
brep_3 = Brep([brep_2, brep])
brep_4 = ClusterOutput(brep_3)
