# Grasshopper definition tensegrity_jessen.ghx (Grasshopper 1.0.7)

# ---- group: Struts
value_list = ValueList({"Tension": 1, "Compression": -1}, selected="Compression")
deviation_edge_force_kn = Slider(1.2, range=0..10)
number = Number(value_list)
number_2 = Number(deviation_edge_force_kn)

# ---- group: Ties
value_list_2 = ValueList({"Tension": 1, "Compression": -1}, selected="Tension")
deviation_edge_force_kn_2 = Slider(1, range=0..10)
number_3 = Number(value_list_2)
number_4 = Number(deviation_edge_force_kn_2)

# ----
deviation_edge_force_bound_a_m = Slider(1, range=0..1)
deviation_edge_force_bound_b_kn = Slider(5, range=0..10)
number_5 = Number(deviation_edge_force_bound_a_m)
number_6 = Number(deviation_edge_force_bound_b_kn)

# ----
# COMPAS CEM
# Copyright (c) 2021 Rafael Pastrana
# Color Code
# Trail Edges
# Deviation Edges
# Loads
# Supports
# Optimization
# Topology/Form Diagram
# Topology Visualization
# Form Visualization
# JSON serialization
# Don’t modify (unless you know what you are doing)
tensegrity_scale = Slider(3, range=0..5)
number_7 = Number(tensegrity_scale)

origin_nodes_bounds_m = Slider(1, range=0..1)
number_8 = Number(origin_nodes_bounds_m)

unit_size = Panel("1")
number_9 = Number(number_7)
create_initial_tensegrity_points = CreateInitialTensegrityPoints(number=unit_size)
draw_icosahedron = DrawIcosahedron(A=create_initial_tensegrity_points, B=number_9)
series = Panel("8")
split_cables_strut_lines = SplitCablesStrutLines(curve=draw_icosahedron, count=series)  # -> vertices, segments
ghpython_script = GhPythonScript(points=simplify(split_cables_strut_lines.vertices))  # -> out, lines; inputs points: tree of Point3d
# ---------- ghpython_script: Python ----------
from compas_rhino.geometry import RhinoLine
from compas_rhino.geometry import RhinoPoint

from compas.datastructures import Mesh
from compas.utilities import flatten

from compas_ghpython.utilities import ghtree_to_list
from compas_ghpython.artists import MeshArtist

from compas_ghpython import draw_lines

from Rhino.Geometry import Point3d
from Rhino.Geometry import Line


polygons = []
for pt_list in ghtree_to_list(points):
    polygon = [RhinoPoint.from_geometry(pt).to_compas() for pt in pt_list]
    polygons.append(polygon)

mesh = Mesh.from_polygons(polygons)

lines = []
for u, v in mesh.edges():
    if mesh.is_edge_on_boundary(u, v):
        continue
    # expect two faces per edge
    face_a, face_b = mesh.edge_faces(u, v)
    difference_nodes = set(mesh.face_vertices(face_a)).symmetric_difference(set(mesh.face_vertices(face_b)))    
    line = [Point3d(*mesh.vertex_coordinates(node)) for node in difference_nodes]
    lines.append(Line(*line))
# ---------- end ghpython_script ----------
curve = Curve(ghpython_script.lines)
curve_2 = Curve(split_cables_strut_lines.segments)

# ---- group: Ties
number_10 = Number(number_4)
number_11 = Number(number_3)
curve_3 = Curve(curve_2)
multiplication = Multiplication(A=number_10, B=number_11)
deviationedge = DeviationEdge(line=curve_3, force=multiplication)  # -> deviation_edge; inputs line: Line
#   port line: A line that defines the end nodes of the edge.
#   port force: The desired force on the edge. If negative, the edge is in compression. Otherwise, it is in tension.
#   port deviation_edge: A COMPAS CEM deviation edge.
# ---------- deviationedge: Python ----------
"""
Create a deviation edge from a line.
"""
from ghpythonlib.componentbase import executingcomponent as component

from compas_cem.elements import DeviationEdge

from compas_rhino.geometry import RhinoLine


class DeviationEdgeComponent(component):
    def RunScript(self, line, force):
        if not line or force is None:
            return
        line = RhinoLine.from_geometry(line).to_compas()
        return DeviationEdge.from_line(line, force=force)
# ---------- end deviationedge ----------

# ---- group: Struts
curve_4 = Curve(curve)
number_12 = Number(number_2)
number_13 = Number(number)
multiplication_2 = Multiplication(A=number_12, B=number_13)
deviationedge_2 = DeviationEdge(line=curve_4, force=multiplication_2)  # -> deviation_edge; inputs line: Line; same code as deviationedge

# ----
assembletopologydiagram = AssembleTopologyDiagram(deviation_edges=flatten([deviationedge_2, deviationedge]), add_auxiliary_trails=Toggle(True))  # -> topology; inputs trail_edges: list, deviation_edges: list, loads: list, supports: list, add_auxiliary_trails: Boolean
#   port trail_edges: The COMPAS CEM trail edges to add to the diagram.
#   port deviation_edges: The COMPAS CEM deviation edges to add to the diagram.
#   port loads: The COMPAS CEM loads to add to the diagram.
#   port supports: The COMPAS CEM supports to add to the diagram.
#   port add_auxiliary_trails: Append auxiliary trails to the free nodes of the topology diagram. Defaults to False.
#   port topology: A COMPAS CEM topology diagram.
# ---------- assembletopologydiagram: Python ----------
"""
Assemble a topology diagram.
"""
from ghpythonlib.componentbase import executingcomponent as component

from compas_cem.diagrams import TopologyDiagram


class AssembleTopologyDiagramComponent(component):
    def RunScript(self, trail_edges, deviation_edges, loads, supports, add_auxiliary_trails):

        add_auxiliary_trails = add_auxiliary_trails or False
        topology = TopologyDiagram()

        if trail_edges:
            for trail_edge in trail_edges:
                if trail_edge:
                    topology.add_edge(trail_edge)

        if deviation_edges:
            for deviation_edge in deviation_edges:
                if deviation_edge:
                    topology.add_edge(deviation_edge)

        if loads:
            for load in loads:
                if load:
                    topology.add_load(load)

        if supports:
            for support in supports:
                if support:
                    topology.add_support(support)

        if trail_edges and supports:
            topology.build_trails(add_auxiliary_trails)

        elif deviation_edges and add_auxiliary_trails:
            topology.build_trails(add_auxiliary_trails)

        return topology
# ---------- end assembletopologydiagram ----------
formfinding = FormFinding(topology=assembletopologydiagram)  # -> form; inputs kmax: Int32, tmax: Int32
#   port topology: A COMPAS CEM topology diagram.
#   port kmax: The maximum number of sequences to run the form-finding algorithm for. Defaults to all the sequences in the diagram.
#   port tmax: The maximum number of iterations to run the form-finding algorithm for. Defaults to 100.
#   port eta: The convergence threshold of the form-finding algorithm. Default to 1e-6.
#   port form: A COMPAS CEM form diagram in static equilibrium.
# ---------- formfinding: Python ----------
"""
Generate a form diagram in static equilibrium.
"""
from ghpythonlib.componentbase import executingcomponent as component

from compas_cem.equilibrium import static_equilibrium


class FormFindingComponent(component):
    def RunScript(self, topology, kmax, tmax, eta):
        eta = eta or 1e-6
        tmax = tmax or 100

        if not topology:
            return

        return static_equilibrium(topology, kmax=kmax, tmax=tmax, eta=eta)
# ---------- end formfinding ----------
data = Data(formfinding)
data_2 = Data(assembletopologydiagram)

forces_scale = Slider(0.4, range=0..1)
sphere_radius = Slider(0.06, range=0..1)
dash_length = Slider(0.03, range=0..0.1)
forces_min = Slider(0.001, range=0..0.001)
number_14 = Number(forces_scale)
number_15 = Number(sphere_radius)
number_16 = Number(dash_length)
number_17 = Number(forces_min)

# ---- group: Display all edges in gray
topology = Data()
topology_artist = TopologyArtist(topology=topology)  # -> nodes, origin_nodes, support_nodes, edges, trail_edges, deviation_edges, trails, loads; inputs node_keys: list of Int32, edge_keys: list
#   port topology: A COMPAS CEM topology diagram.
#   port node_keys: A selection of the node keys in the diagram. Defaults to all the node keys.
#   port edge_keys: A selection of the edge keys in the diagram. Defaults to all the edge keys.
#   port force_min: The minimum force magnitude to plot. Defaults to 1e-3.
#   port force_scale: The scaling factor of the loads. Defaults to 1.
#   port nodes: The nodes in the diagram as points.
#   port origin_nodes: The origin nodes in the diagram as points.
#   port support_nodes: The support nodes in the diagram as points.
#   port edges: The edges in the diagram as lines.
#   port trail_edges: The trail edges in the diagram as lines.
#   port deviation_edges: The deviation edges in the diagram as lines.
#   port trails: The trails in the diagram as polylines.
#   port loads: The applied node loads as lines.
# ---------- topology_artist: Python ----------
"""
Draw a topology diagram.
"""
from ghpythonlib.componentbase import executingcomponent as component

from compas_cem.ghpython import TopologyArtist


class TopologyArtistComponent(component):
    def RunScript(self, topology, node_keys, edge_keys, force_min, force_scale):
        node_keys = node_keys or None
        edge_keys = edge_keys or None
        force_min = force_min or 1e-3
        force_scale = force_scale or 1.0
        if topology:
            artist = TopologyArtist(topology)

            nodes = artist.draw_nodes(node_keys)
            origin_nodes = artist.draw_nodes_origin(node_keys)
            support_nodes = artist.draw_nodes_support(node_keys)

            edges = artist.draw_edges(edge_keys)
            trail_edges = artist.draw_edges_trail(edge_keys)
            deviation_edges = artist.draw_edges_deviation(edge_keys)

            trails = artist.draw_trails()

            loads = artist.draw_loads(node_keys, min_load=force_min, scale=force_scale)

            return nodes, origin_nodes, support_nodes, edges, trail_edges, deviation_edges, trails, loads
# ---------- end topology_artist ----------
custom_preview = CustomPreview(Geometry=topology_artist.edges, Material=ColourSwatch(SwatchColor=RGB(0, 0, 0)))

# ----
pipe_min_radius = Slider(0.02, range=0..0.1)
pipe_max_radius = Slider(0.11, range=0..0.4)
loads_radius_scale = Slider(0.55, range=0..1)
reactions_radius_scale = Slider(0.24, range=0..1)
arrow_height_ratio = Slider(3, range=0..10)
arrow_head_ratio = Slider(2, range=0..10)
number_18 = Number(reactions_radius_scale)
number_19 = Number(pipe_min_radius)
number_20 = Number(pipe_max_radius)
number_21 = Number(loads_radius_scale)
number_22 = Number(arrow_height_ratio)
number_23 = Number(arrow_head_ratio)

edge_result_to_display = ValueList({"Forces": 0, "Lengths": 1}, selected="Forces")
forces_scale_2 = Slider(1, range=0..2)
forces_min_2 = Slider(0.001, range=0..0.001)
number_24 = Number(forces_min_2)
integer = Integer(edge_result_to_display)
number_25 = Number(forces_scale_2)

min_edge_force = Panel("0.001")

colour_swatch = ColourSwatch(SwatchColor=RGBA(156, 156, 156, 195))

number_26 = Number(number_5)
number_27 = Number(number_6)
number_28 = Number(number_8)
curve_5 = Curve(curve_4)
curve_6 = Curve(curve_3)
data_3 = Data(data_2)
data_4 = Data(data_3)
data_5 = Data(data_3)
disassemble_topology_diagram = DisassembleTopologyDiagram(topology=data_4)  # -> node_keys, origin_node_keys, support_node_keys, edge_keys, trail_edge_keys, deviation_edge_keys, trail_keys, auxiliary_trail_keys
#   port topology: A COMPAS CEM topology diagram.
#   port node_keys: All the node keys in the topology diagram.
#   port origin_node_keys: The keys of the origin nodes in the topology diagram.
#   port support_node_keys: The keys of the support nodes in the topology diagram.
#   port edge_keys: All the edge keys in the topology diagram.
#   port trail_edge_keys: The keys of the trail edges in the topology diagram.
#   port deviation_edge_keys: The keys of the deviation edges in the topology diagram.
#   port trail_keys: The keys of the trails in the topology diagram.
#   port auxiliary_trail_keys: The keys of the auxiliary trails in the topology diagram.
# ---------- disassemble_topology_diagram: Python ----------
"""
Disassemble a topology diagram into its constituent parts.
"""
from ghpythonlib.componentbase import executingcomponent as component


class TopologyDisassemblyComponent(component):
    def RunScript(self, topology):
        if topology:
            trail_keys = list(topology.trails())
            auxiliary_trail_keys = list(topology.auxiliary_trails())

            edge_keys = list(topology.edges())
            trail_edge_keys = list(topology.trail_edges())
            deviation_edge_keys = list(topology.deviation_edges())

            node_keys = list(topology.nodes())
            origin_node_keys = list(topology.origin_nodes())
            support_node_keys = list(topology.support_nodes())

            return node_keys, origin_node_keys, support_node_keys, edge_keys, trail_edge_keys, deviation_edge_keys, trail_keys, auxiliary_trail_keys
# ---------- end disassemble_topology_diagram ----------
edge_search = EdgeSearch(diagram=data_5, line=curve_5)  # -> flatten(edge_key); inputs line: Line
#   port diagram: A COMPAS CEM topology or form diagram.
#   port line: The line to search for in the diagram.
#   port edge_key: The edge key in the diagram.
# ---------- edge_search: Python ----------
"""
Search for an edge key in a topology or a form diagram using a line.
"""
from ghpythonlib.componentbase import executingcomponent as component

from compas_rhino.geometry import RhinoLine
from compas.utilities import geometric_key


class EdgeSearchComponent(component):
    def RunScript(self, diagram, line):
        if diagram and line:

            line = RhinoLine.from_geometry(line).to_compas()

            eg = []
            for point in (line.start, line.end):
                gkey = geometric_key(point, diagram.tol)
                node = diagram.gkey_node[gkey]
                eg.append(node)

            return [tuple(eg)]
# ---------- end edge_search ----------
edge_search_2 = EdgeSearch(diagram=data_5, line=curve_6)  # -> flatten(edge_key); inputs line: Line; same code as edge_search
origin_node_z_parameter = OriginNodeZParameter(node_key=disassemble_topology_diagram.origin_node_keys, bound_low=number_28, bound_up=number_28)  # -> parameter; inputs node_key: Int32
#   port node_key: The key of a COMPAS CEM origin node.
#   port bound_low: The lower bound of the node optimization parameter. It is calculated as the initial node parameter minus the absolute value of this bound.
#   port bound_up: The upper bound of the node optimization parameter. It is calculated as the initial node parameter plus the absolute value of this bound.
#   port parameter: A COMPAS CEM origin node Z parameter.
# ---------- origin_node_z_parameter: Python ----------
"""
Set the Z coordinate of an origin node as an optimization parameter.
"""
from ghpythonlib.componentbase import executingcomponent as component

from compas_cem.optimization import OriginNodeZParameter


class OriginNodeZParameterComponent(component):
    def RunScript(self, node_key, bound_low, bound_up):
        if node_key is not None and bound_low is not None and bound_up is not None:
            return OriginNodeZParameter(node_key, bound_low, bound_up)
# ---------- end origin_node_z_parameter ----------
origin_node_x_parameter = OriginNodeXParameter(node_key=disassemble_topology_diagram.origin_node_keys, bound_low=number_28, bound_up=number_28)  # -> parameter; inputs node_key: Int32
#   port node_key: The key of a COMPAS CEM origin node.
#   port bound_low: The lower bound of the node optimization parameter. Its value is calculated as the initial node parameter minus the absolute value of this bound.
#   port bound_up: The upper bound of the node optimization parameter. Its value is calculated as the initial node parameter plus the absolute value of this bound.
#   port parameter: A COMPAS CEM origin node X parameter.
# ---------- origin_node_x_parameter: Python ----------
"""
Set the X coordinate of an origin node as an optimization parameter.
"""
from ghpythonlib.componentbase import executingcomponent as component

from compas_cem.optimization import OriginNodeXParameter


class OriginNodeXParameterComponent(component):
    def RunScript(self, node_key, bound_low, bound_up):
        if node_key is not None and bound_low is not None and bound_up is not None:
            return OriginNodeXParameter(node_key, bound_low, bound_up)
# ---------- end origin_node_x_parameter ----------
origin_node_y_parameter = OriginNodeYParameter(node_key=disassemble_topology_diagram.origin_node_keys, bound_low=number_28, bound_up=number_28)  # -> parameter; inputs node_key: Int32
#   port node_key: The key of a COMPAS CEM origin node.
#   port bound_low: The lower bound of the node optimization parameter. Its value is calculated as the initial node parameter minus the absolute value of this bound.
#   port bound_up: The upper bound of the node optimization parameter. Its value is calculated as the initial node parameter plus the absolute value of this bound.
#   port parameter: A COMPAS CEM origin node Y parameter.
# ---------- origin_node_y_parameter: Python ----------
"""
Set the Y coordinate of an origin node as an optimization parameter.
"""
from ghpythonlib.componentbase import executingcomponent as component

from compas_cem.optimization import OriginNodeYParameter


class OriginNodeYParameterComponent(component):
    def RunScript(self, node_key, bound_low, bound_up):
        if node_key is not None and bound_low is not None and bound_up is not None:
            return OriginNodeYParameter(node_key, bound_low, bound_up)
# ---------- end origin_node_y_parameter ----------
deviation_edge_force_parameter = DeviationEdgeForceParameter(edge_key=edge_search, bound_low=number_27, bound_up=number_26)  # -> parameter
#   port edge_key: The key of a COMPAS CEM deviation edge.
#   port bound_low: The lower bound of the edge optimization parameter. Its value is calculated as the initial edge parameter minus the absolute value of this bound.
#   port bound_up: The upper bound of the edge optimization parameter. Its value is calculated as the initial edge parameter plus the absolute value of this bound.
#   port parameter: A COMPAS CEM deviation edge force parameter.
# ---------- deviation_edge_force_parameter: Python ----------
"""
Set the force of a deviation edge as an optimization parameter.
"""
from ghpythonlib.componentbase import executingcomponent as component

from compas_cem.optimization import DeviationEdgeParameter


class DeviationEdgeParameterComponent(component):
    def RunScript(self, edge_key, bound_low, bound_up):
        if edge_key and bound_low is not None and bound_up is not None:
            return DeviationEdgeParameter(edge_key, bound_low, bound_up)
# ---------- end deviation_edge_force_parameter ----------
deviation_edge_force_parameter_2 = DeviationEdgeForceParameter(edge_key=edge_search_2, bound_up=number_26)  # -> parameter; same code as deviation_edge_force_parameter
trail_edge_force_constraint = TrailEdgeForceConstraint(edge_key=disassemble_topology_diagram.auxiliary_trail_keys, force="0.0")  # -> constraint
#   port edge_key: The key of a COMPAS CEM trail edge.
#   port force: The target force.
#   port weight: The weight of the constraint in the optimization problem. Defaults to one.
#   port constraint: A COMPAS CEM trail force constraint.
# ---------- trail_edge_force_constraint: Python ----------
"""
Make the force on a trail edge to reach a goal force value.
"""
from ghpythonlib.componentbase import executingcomponent as component

from compas_cem.optimization import TrailEdgeForceConstraint


class TrailEdgeForceConstraintComponent(component):
    def RunScript(self, edge_key, force, weight):
        weight = weight or 1.0
        if edge_key and force is not None:
            return TrailEdgeForceConstraint(edge_key, force, weight)
# ---------- end trail_edge_force_constraint ----------
merge = Merge(
    Data1=origin_node_z_parameter,
    Data2=origin_node_x_parameter,
    Data3=origin_node_y_parameter,
    Data4=deviation_edge_force_parameter,
    Data5=deviation_edge_force_parameter_2)  # -> flatten(Result)
proxyserver = ProxyServer(start=Toggle(True), stop=Toggle(False))  # inputs start: Boolean, stop: Boolean
#   port start: Launch the COMPAS CEM proxy server. The proxy is kept open to be re-used and thus save start up time.
#   port stop: Shut down the proxy server.
# ---------- proxyserver: Python ----------
"""
Create an RPC proxy server to solve a constrained form-finding problem via CPython"
"""
from ghpythonlib.componentbase import executingcomponent as component

from scriptcontext import sticky

from compas.rpc import Proxy
from compas_cem import PROXY_PORT


class CEMProxyComponent(component):
    def RunScript(self, start, stop):

        if not (start or stop):
            return

        if start:
            proxy = Proxy("compas_cem.optimization", port=PROXY_PORT)
            sticky["proxy_cem"] = proxy

        if stop:
            proxy = Proxy(port=PROXY_PORT)
            proxy.stop_server()
            if "proxy_cem" in sticky:
                del sticky["proxy_cem"]
# ---------- end proxyserver ----------

constrainedformfinding = ConstrainedFormFinding(solve=Toggle(True), topology=data_3, constraints=trail_edge_force_constraint, parameters=merge, algorithm="LBFGS")  # -> topology, form, objective, grad_norm, iters, time, status; inputs solve: Boolean, constraints: list, parameters: list, iters_max: Int32, tmax: Int32
#   port solve: Kickstarts the solution of the constrained form-finding problem.
#   port topology: A COMPAS CEM topology diagram.
#   port constraints: A list of COMPAS CEM optimization constraints.
#   port parameters: A list of COMPAS CEM optimization parameters.
#   port algorithm: The name of the gradient-based local optimization algorithm to use. Defaults to SLSQP. Currently supported algorithms are: - SLSQP: Sequential Least Squares Programming - LBFGS: Low-Storage Broyden-Fletcher-Goldfarb-Shanno - AUGLAG: Augmented Lagrangian - MMA: Method of Moving Asymptotes - TNEWTON: Preconditioned Truncated Newton
#   port iters_max: The maximum number of iterations to run the optimization algorithm for. If it is equal to -1, then there is no iteration limit. Defaults to 100.
#   port eps: The minimum objective or norm of the gradient to declare convergence. Defaults to 1e-6.
#   port tmax: The maximum number of iterations to run the form-finding algorithm for. Defaults to 100.
#   port eta: The convergence threshold of the form-finding algorithm. Defaults to 1e-6.
#   port topology: A COMPAS CEM topology diagram with optimized parameters.
#   port form: A COMPAS CEM form diagram in static equilibrium.
#   port objective: The resulting output value of the objective function.
#   port grad_norm: The norm of the gradient of the objective function.
#   port iters: The elapsed number of optimization iterations.
#   port time: The total optimization runtime in seconds.
#   port status: The final status of the optimization process.
# ---------- constrainedformfinding: Python ----------
"""
Generate a form diagram in static equilibrium such that it meets user-defined constraints.
"""
from ghpythonlib.componentbase import executingcomponent as component
from scriptcontext import sticky

from compas.rpc import Proxy


class ConstrainedFormFindingComponent(component):
    def RunScript(self, solve, topology, constraints, parameters, algorithm, iters_max, eps, tmax, eta):
        algorithm = algorithm or "SLSQP"
        iters_max = iters_max or 100
        eps = eps or 1e-6
        tmax = tmax or 100
        eta = eta or 1e-6

        if not (solve and topology and constraints and parameters):
            return

        topology = topology.copy()

        # clean constraints and parameters from None
        constraints = [c for c in constraints if c is not None]
        parameters = [p for p in parameters if p is not None]

        # fetch optimization proxy from scriptcontext
        opt = sticky.get("proxy_cem")
        proxy_temp_exists = False

        # create temporary proxy server if unavailable from scriptcontext
        if not opt:
            opt = Proxy("compas_cem.optimization")
            proxy_temp_exists = False

        # solve constrained form-finding problem
        solution = opt.solve_proxy(topology=topology,
                                   constraints=constraints,
                                   parameters=parameters,
                                   algorithm=algorithm,
                                   iters=iters_max,
                                   eps=eps,
                                   tmax=tmax,
                                   eta=eta)

        # shut down temporary proxy
        if proxy_temp_exists:
            opt.stop_server()

        # unpack solution
        topology, form, objective, grad_norm, iters, time, status = solution

        return topology, form, objective, grad_norm, iters, time, status
# ---------- end constrainedformfinding ----------

panel = Panel(constrainedformfinding.time)
panel_2 = Panel(constrainedformfinding.status)
panel_3 = Panel(constrainedformfinding.grad_norm)
panel_4 = Panel(constrainedformfinding.iters)
panel_5 = Panel(constrainedformfinding.objective)
data_6 = Data(constrainedformfinding.form)

# ---- group: Select what form diagram to display
what_to_display = ValueList({"Form": 0, "Constrained Form": 1}, selected="Form")
constrained_form = Data(data_6)
form = Data(data)
filter = StreamFilter(Gate=what_to_display, Stream0=form, Stream1=constrained_form)
form_2 = Data(filter)

# ----
form_3 = Data(form_2)

min_edge_force_2 = Panel("0.001")
number_29 = Number(number_19)
number_30 = Number(number_20)
form_4 = Data(form_3)
cluster = Cluster(data=form_4, second_number=min_edge_force_2)
cem_colors = CEMColors()  # -> color_tension, color_compression, color_edge, color_node, color_node_support, color_node_origin, color_load, color_reaction, color_trail, color_auxiliary_trail
#   port color_tension: The color for edges under a tension force.
#   port color_compression: The color for edges under a compression force.
#   port color_edge: The color for a regular edge.
#   port color_node: The color for a regular node.
#   port color_node_support: The color for a support node.
#   port color_node_origin: The color for an origin node.
#   port color_load: The color for an applied load.
#   port color_reaction: The color for a reaction force.
#   port color_trail: The color to paint a trail.
#   port color_auxiliary_trail: The color to paint an auxiliary trail.
# ---------- cem_colors: Python ----------
"""
Get the artists color scheme for the objects of the CEM framework.
"""
from ghpythonlib.componentbase import executingcomponent as component

from compas_cem import COLORS
import rhinoscriptsyntax as rs


class ArtistColorsComponent(component):
    def RunScript(self):
        colors = {key: rs.CreateColor(c) for key, c in COLORS.items()}

        color_tension = colors["tension"]
        color_compression = colors["compression"]
        color_edge = colors["edge"]
        color_node = colors["node"]
        color_node_support = colors["node_support"]
        color_node_origin = colors["node_origin"]
        color_load = colors["load"]
        color_reaction = colors["support_force"]
        color_trail = colors["trail"]
        color_auxiliary_trail = colors["auxiliary_trail"]

        colors = (color_tension, color_compression, color_edge, color_node, color_node_support, color_node_origin, color_load, color_reaction, color_trail, color_auxiliary_trail)

        return colors
# ---------- end cem_colors ----------
edge_results = EdgeResults(form=form_4, edge_keys=cluster)  # -> lengths, forces; inputs edge_keys: list; same code as edge_results
form_artist = FormArtist(form=form_4, edge_keys=cluster, force_min="0.01")  # -> nodes, support_nodes, edges, loads, reactions; inputs node_keys: list of Int32, edge_keys: list
#   port form: A COMPAS CEM topology diagram.
#   port node_keys: A selection of the node keys in the diagram. Defaults to all the node keys.
#   port edge_keys: A selection of the edge keys in the diagram. Defaults to all the edge keys.
#   port force_min: The smallest force magnitude to draw. Defaults to 1e-3
#   port force_scale: The scale of the loads and the reactions. Defaults to 1.
#   port nodes: The nodes of the diagram as points.
#   port support_nodes: The support nodes of the diagram as points
#   port edges: The edges of the diagram as lines.
#   port loads: The applied loads as lines.
#   port reactions: The reaction forces at the supports, as lines.
# ---------- form_artist: Python ----------
"""
Draw a form diagram.
"""
from ghpythonlib.componentbase import executingcomponent as component

from compas_cem.ghpython import FormArtist


class FormArtistComponent(component):
    def RunScript(self, form, node_keys, edge_keys, force_min, force_scale):
        node_keys = node_keys or None
        edge_keys = edge_keys or None
        force_min = force_min or 1e-3
        force_scale = force_scale or 1
        if form:
            artist = FormArtist(form, artist_type=FormArtist)

            nodes = artist.draw_nodes(node_keys)
            edges = artist.draw_edges(edge_keys)
            support_nodes = artist.draw_nodes_support(node_keys)

            loads = artist.draw_loads(node_keys, min_load=force_min, scale=force_scale)
            reactions = artist.draw_reactions(node_keys, min_force=force_min, scale=force_scale)

            return nodes, support_nodes, edges, loads, reactions
# ---------- end form_artist ----------
dom = ConstructDomain(DomainStart=number_29, DomainEnd=number_30)
abs = Absolute(Value=edge_results.forces)
merge_2 = Merge(Data1=cem_colors.color_compression, Data2=cem_colors.color_tension)
bnd = Bounds(Numbers=abs)
larger_than = LargerThan(FirstNumber=edge_results.forces, SecondNumber=0)  # -> LargerThan, OrEqualTo
length = Length(Curve=form_artist.edges)
remap = RemapNumbers(Value=abs, Source=bnd, Target=dom)  # -> Mapped, Clipped
larger_than_2 = LargerThan(FirstNumber=length, SecondNumber="0.01")  # -> LargerThan, OrEqualTo
list_item = ListItem(List=merge_2, Index=larger_than.OrEqualTo, Wrap=True)
material = CreateMaterial(Diffuse=list_item, Specular=RGB(255, 255, 255), Emission=list_item, Transparency=0, Shine="100")
cull_pattern = CullPattern(List=form_artist.edges, CullPattern=larger_than_2.LargerThan)
cull_pattern_2 = CullPattern(List=remap.Mapped, CullPattern=larger_than_2.LargerThan)
pipe = Pipe(Curve=cull_pattern, Radius=cull_pattern_2, Caps=2)  # -> flatten(Pipe)

number_31 = Number(number_25)
form_5 = Data(form_3)
number_32 = Number(number_24)
number_33 = Number(number_21)
number_34 = Number(number_22)
number_35 = Number(number_23)
cluster_2 = Cluster_4(form=form_5, force_min=number_32, force_scale=number_31, number=number_33, B=number_34, B_2=number_35)
cem_colors_2 = CEMColors()  # -> color_tension, color_compression, color_edge, color_node, color_node_support, color_node_origin, color_load, color_reaction, color_trail, color_auxiliary_trail; same code as cem_colors
unit_z = UnitZ(Factor="2")
move = Move(Geometry=cluster_2, Motion=unit_z)  # -> Geometry, Transform
material_2 = CreateMaterial(
    Diffuse=cem_colors_2.color_load,
    Specular=RGB(255, 255, 255),
    Emission=cem_colors_2.color_load,
    Transparency="0.2",
    Shine="100")

form_6 = Data(form_3)
number_36 = Number(number_24)
number_37 = Number(number_25)
number_38 = Number(number_22)
number_39 = Number(number_23)
number_40 = Number(number_18)
division = Division(A=number_37, B="2")
cluster_3 = Cluster_3(form=form_6, force_min=number_36, force_scale=division, number=number_40, B=number_38, B_2=number_39)

form_7 = Data(form_3)
integer_2 = Integer(integer)
form_artist_2 = FormArtist(form=form_7)  # -> nodes, support_nodes, edges, loads, reactions; inputs node: list of Int32, edge: list
#   port form: A COMPAS CEM topology diagram.
#   port node: A selection of the nodes in the diagram. Defaults to all the nodes.
#   port edge: A selection of the edges in the diagram. Defaults to all the edges.
#   port force_min: The smallest force magnitude to draw. Defaults to 1e-3
#   port force_scale: The scale of the loads and the reactions. Defaults to 1.
#   port nodes: The nodes of the diagram as points.
#   port support_nodes: The support nodes of the diagram as points
#   port edges: The edges of the diagram as lines.
#   port loads: The applied loads as lines.
#   port reactions: The reaction forces at the supports, as lines.
# ---------- form_artist_2: Python ----------
"""
Draw a form diagram.
"""
from ghpythonlib.componentbase import executingcomponent as component

from compas_cem.ghpython import FormArtist


class FormArtistComponent(component):
    def RunScript(self, form, node, edge, force_min, force_scale):
        node = node or None
        edge = edge or None
        force_min = force_min or 1e-3
        force_scale = force_scale or 1
        if form:
            artist = FormArtist(form, artist_type=FormArtist)

            nodes = artist.draw_nodes(node)
            edges = artist.draw_edges(edge)
            support_nodes = artist.draw_nodes_support(node)

            loads = artist.draw_loads(node, min_load=force_min, scale=force_scale)
            reactions = artist.draw_reactions(node, min_force=force_min, scale=force_scale)

            return nodes, support_nodes, edges, loads, reactions
# ---------- end form_artist_2 ----------
curve_middle = CurveMiddle(Curve=form_artist_2.edges)
edgeresults = EdgeResults(form=form_7)  # -> length, force; inputs edge: list
#   port form: A COMPAS CEM form diagram.
#   port edge: A selection of edge keys to query the results on. Defaults to all the edges.
#   port length: The edge lengths.
#   port force: The edge forces.
# ---------- edgeresults: Python ----------
"""
Extract the post form-finding results of the edges in a form diagram.
"""
from ghpythonlib.componentbase import executingcomponent as component


class EdgeResultsComponent(component):
    def RunScript(self, form, edge):
        if form:
            edge = edge or list(form.edges())
            length = [form.edge_length_2(ed) for ed in edge]
            force = [form.edge_force(ed) for ed in edge]
            return length, force
# ---------- end edgeresults ----------
stream_filter = StreamFilter(Gate=integer_2, Stream0=edgeresults.force, Stream1=edgeresults.length)
ghpython_script_2 = GhPythonScript(x=stream_filter)  # -> out, a
# ---------- ghpython_script_2: Python ----------
a = round(x, 2)
# ---------- end ghpython_script_2 ----------

form_8 = Data(form_3)
form_artist_3 = FormArtist(form=form_8)  # -> nodes, support_nodes, edges, loads, reactions; inputs node_keys: list of Int32, edge_keys: list; same code as form_artist
disassemble_form_diagram = DisassembleFormDiagram(form=form_8)  # -> node_keys, support_node_keys, edge_keys; same code as disassemble_form_diagram
curve_middle_2 = CurveMiddle(Curve=form_artist_3.edges)

form_9 = Data(form_3)
number_41 = Number(number_24)
number_42 = Number(number_25)
form_artist_4 = FormArtist(form=form_9, force_min=number_41, force_scale=number_42)  # -> nodes, support_nodes, edges, loads, reactions; inputs node_keys: list of Int32, edge_keys: list; same code as form_artist
cem_colors_3 = CEMColors()  # -> color_tension, color_compression, color_edge, color_node, color_node_support, color_node_origin, color_load, color_reaction, color_trail, color_auxiliary_trail; same code as cem_colors
cluster_4 = Cluster_2(curve=form_artist_4.reactions)  # -> vector, geometry
vector_length = VectorLength(Vector=cluster_4.vector)
unit_vector = UnitVector(Vector=cluster_4.vector)
multiplication_3 = Multiplication(A=unit_vector, B=vector_length)
move_2 = Move(Geometry=cluster_4.geometry, Motion=multiplication_3)  # -> Geometry, Transform

form_10 = Data(form_3)
number_43 = Number(number_24)
number_44 = Number(number_25)
form_artist_5 = FormArtist(form=form_10, force_min=number_43, force_scale=number_44)  # -> nodes, support_nodes, edges, loads, reactions; inputs node_keys: list of Int32, edge_keys: list; same code as form_artist
cem_colors_4 = CEMColors()  # -> color_tension, color_compression, color_edge, color_node, color_node_support, color_node_origin, color_load, color_reaction, color_trail, color_auxiliary_trail; same code as cem_colors
cluster_5 = Cluster_2(curve=form_artist_5.loads)  # -> vector, geometry
unit_vector_2 = UnitVector(Vector=cluster_5.vector)
vector_length_2 = VectorLength(Vector=cluster_5.vector)
multiplication_4 = Multiplication(A=unit_vector_2, B=vector_length_2)
move_3 = Move(Geometry=cluster_5.geometry, Motion=multiplication_4)  # -> Geometry, Transform

# ----
# 03-A Display form diagram
form_11 = Data(form_3)
form_artist_6 = FormArtist(form=form_11)  # -> nodes, support_nodes, edges, loads, reactions; inputs node_keys: list of Int32, edge_keys: list; same code as form_artist
edgeresults_2 = EdgeResults(form=form_11)  # -> length, force; inputs edge: list; same code as edgeresults
cem_colors_5 = CEMColors()  # -> color_tension, color_compression, color_edge, color_node, color_node_support, color_node_origin, color_load, color_reaction, color_trail, color_auxiliary_trail; same code as cem_colors
larger_than_3 = LargerThan(FirstNumber=edgeresults_2.force, SecondNumber=0)  # -> LargerThan, OrEqualTo
merge_3 = Merge(Data1=cem_colors_5.color_compression, Data2=cem_colors_5.color_tension)
list_item_2 = ListItem(List=merge_3, Index=larger_than_3.OrEqualTo, Wrap=True)

edgeresults_3 = EdgeResults(form=form_7)  # -> length, force; inputs edge: list; same code as edgeresults
larger_than_4 = LargerThan(FirstNumber=edgeresults_3.force, SecondNumber="0.001")  # -> LargerThan, OrEqualTo
cull_pattern_3 = CullPattern(List=material, CullPattern=larger_than_2.LargerThan)
colour = Colour(ColourSwatch(SwatchColor=RGB(76, 76, 76)))
material_3 = CreateMaterial(Diffuse=colour, Specular=RGB(255, 255, 255), Emission=colour, Transparency="0.2", Shine="100")

# ---- group: Edges
custom_preview_2 = CustomPreview(Geometry=form_artist_6.edges, Material=list_item_2)

# ---- group: Node keys
text_tag = TextTag(Location=form_artist_3.nodes, Text=disassemble_form_diagram.node_keys, Colour=colour_swatch)

# ---- group: Edge keys
text_tag_2 = TextTag(Location=curve_middle_2, Text=disassemble_form_diagram.edge_keys, Colour=colour_swatch)

# ---- group: Edge results
text_tag_3 = TextTag(Location=curve_middle, Text=ghpython_script_2.a, Colour=ColourSwatch(SwatchColor=RGBA(94, 94, 94, 195)))

# ---- group: Loads
vector_display_ex = VectorDisplayEx(Point=move_3.Geometry, Vector=cluster_5.vector, Colour=cem_colors_4.color_load, Width=2)

# ---- group: Reactions
vector_display_ex_2 = VectorDisplayEx(Point=move_2.Geometry, Vector=cluster_4.vector, Colour=cem_colors_3.color_reaction, Width=2)

# ---- group: Reactions - Piped
preview = CustomPreview(Geometry=cluster_3, Material=material_3)

# ---- group: Loads - Piped
preview_2 = CustomPreview(Geometry=move.Geometry, Material=material_2)

# ---- group: Edges - Piped
preview_3 = CustomPreview(Geometry=pipe, Material=cull_pattern_3)

# ----
topology_2 = Data(data_2)
translation_x = Slider(0, range=0..100)
translation_y = Slider(15, range=0..20)
number_45 = Number(translation_x)
number_46 = Number(number_45)
negative = Negative(Value=number_46)
number_47 = Number(translation_y)
number_48 = Number(number_47)
negative_2 = Negative(Value=number_48)

# ---- group: Translate topology diagram
ghpython_script_3 = GhPythonScript(topology=topology_2, x=negative, y=negative_2)  # -> out, topology
# ---------- ghpython_script_3: Python ----------
from compas.geometry import Translation
from compas.datastructures import network_transformed



translation = Translation.from_vector([x, y, 0.0])
topology = network_transformed(topology, translation)
# ---------- end ghpython_script_3 ----------

# ----
topology_3 = Data(ghpython_script_3.topology)

# ----
# 03-B Display topology diagram
topology_4 = Data(topology_3)
disassemble_topology_diagram_2 = DisassembleTopologyDiagram(topology=topology_4)  # -> node_keys, origin_node_keys, support_node_keys, edge_keys, trail_edge_keys, deviation_edge_keys, trail_keys, auxiliary_trail_keys; same code as disassemble_topology_diagram
topologyartist = TopologyArtist(topology=topology_4)  # -> nodes, origin_nodes, support_nodes, edges, trail_edges, deviation_edges, trails, loads; inputs node_keys: list of Int32, edge_keys: list
#   port topology: A COMPAS CEM topology diagram.
#   port node_keys: A selection of the node keys in the diagram. Defaults to all the node keys.
#   port edge_keys: A selection of the edge keys in the diagram. Defaults to all the edge keys.
#   port force_min: The minimum force magnitude to plot. Defaults to 1e-3.
#   port force_scale: The scaling factor of the loads. Defaults to 1.
#   port nodes: The nodes in the diagram as points.
#   port origin_nodes: The origin nodes in the diagram as points.
#   port support_nodes: The support nodes in the diagram as points.
#   port edges: The edges in the diagram as lines.
#   port trail_edges: The trail edges in the diagram as lines.
#   port deviation_edges: The deviation edges in the diagram as lines.
#   port trails: The trails in the diagram as polylines.
#   port loads: The applied node loads as lines.
# ---------- topologyartist: Python ----------
"""
Draw a topology diagram.
"""
from ghpythonlib.componentbase import executingcomponent as component

from compas_cem.ghpython import TopologyArtist


class TopologyArtistComponent(component):
    def RunScript(self, topology, node_keys, edge_keys, force_min, force_scale):
        node_keys = node_keys or None
        edge_keys = edge_keys or None
        force_min = force_min or 1e-3
        force_scale = force_scale or 1.0

        if not topology:
            return

        artist = TopologyArtist(topology, artist_type=TopologyArtist)

        nodes = artist.draw_nodes(node_keys)
        origin_nodes = artist.draw_nodes_origin(node_keys)
        support_nodes = artist.draw_nodes_support(node_keys)

        edges = artist.draw_edges(edge_keys)
        trail_edges = artist.draw_edges_trail(edge_keys)
        deviation_edges = artist.draw_edges_deviation(edge_keys)

        trails = artist.draw_trails()

        loads = artist.draw_loads(node_keys, min_load=force_min, scale=force_scale)

        return nodes, origin_nodes, support_nodes, edges, trail_edges, deviation_edges, trails, loads
# ---------- end topologyartist ----------
curve_middle_3 = CurveMiddle(Curve=topologyartist.edges)

topology_5 = Data(topology_3)
number_49 = Number(number_17)
number_50 = Number(number_14)
topology_artist_2 = TopologyArtist(topology=topology_5, force_min=number_49, force_scale=number_50)  # -> nodes, origin_nodes, support_nodes, edges, trail_edges, deviation_edges, trails, loads; inputs node_keys: list of Int32, edge_keys: list
#   port topology: A COMPAS CEM topology diagram.
#   port node_keys: A selection of the node keys in the diagram. Defaults to all the node keys.
#   port edge_keys: A selection of the edge keys in the diagram. Defaults to all the edge keys.
#   port force_min: The minimum force magnitude to plot. Defaults to 1e-3.
#   port force_scale: The scaling factor of the loads. Defaults to 1.
#   port nodes: The nodes in the diagram as points.
#   port origin_nodes: The origin nodes in the diagram as points.
#   port support_nodes: The support nodes in the diagram as points.
#   port edges: The edges in the diagram as lines.
#   port trail_edges: The trail edges in the diagram as lines.
#   port deviation_edges: The deviation edges in the diagram as lines.
#   port trails: The trails in the diagram as polylines.
#   port loads: The applied node loads as lines.
# ---------- topology_artist_2: Python ----------
"""
Draw a topology diagram.
"""
from ghpythonlib.componentbase import executingcomponent as component

from compas_cem.ghpython import TopologyArtist


class TopologyArtistComponent(component):
    def RunScript(self, topology, node_keys, edge_keys, force_min, force_scale):
        node_keys = node_keys or None
        edge_keys = edge_keys or None
        force_min = force_min or 1e-3
        force_scale = force_scale or 1.0
        if topology:
            artist = TopologyArtist(topology, artist_type=TopologyArtist)

            nodes = artist.draw_nodes(node_keys)
            origin_nodes = artist.draw_nodes_origin(node_keys)
            support_nodes = artist.draw_nodes_support(node_keys)

            edges = artist.draw_edges(edge_keys)
            trail_edges = artist.draw_edges_trail(edge_keys)
            deviation_edges = artist.draw_edges_deviation(edge_keys)

            trails = artist.draw_trails()

            loads = artist.draw_loads(node_keys, min_load=force_min, scale=force_scale)

            return nodes, origin_nodes, support_nodes, edges, trail_edges, deviation_edges, trails, loads
# ---------- end topology_artist_2 ----------
cem_colors_6 = CEMColors()  # -> color_tension, color_compression, color_edge, color_node, color_node_support, color_node_origin, color_load, color_reaction, color_trail, color_auxiliary_trail; same code as cem_colors
cluster_6 = Cluster_2(curve=topology_artist_2.loads)  # -> vector, geometry
vector_length_3 = VectorLength(Vector=cluster_6.vector)
unit_vector_3 = UnitVector(Vector=cluster_6.vector)
multiplication_5 = Multiplication(A=unit_vector_3, B=vector_length_3)
move_4 = Move(Geometry=cluster_6.geometry, Motion=multiplication_5)  # -> Geometry, Transform

topology_6 = Data(topology_3)
number_51 = Number(number_16)
disassemble_topology_diagram_3 = DisassembleTopologyDiagram(topology=topology_6)  # -> node_keys, origin_node_keys, support_node_keys, edge_keys, trail_edge_keys, deviation_edge_keys, trail_keys, auxiliary_trail_keys; same code as disassemble_topology_diagram
cem_colors_7 = CEMColors()  # -> color_tension, color_compression, color_edge, color_node, color_node_support, color_node_origin, color_load, color_reaction, color_trail, color_auxiliary_trail; same code as cem_colors
python = GhPythonScript(
    trail=disassemble_topology_diagram_3.trail_edge_keys,
    auxiliary_trail=disassemble_topology_diagram_3.auxiliary_trail_keys)  # -> out, trail; inputs trail: list, auxiliary_trail: list
# ---------- python: Python ----------
trail = [tr for tr in trail if tr not in auxiliary_trail]
# ---------- end python ----------
topology_artist_3 = TopologyArtist(topology=topology_6, edge_keys=python.trail)  # -> nodes, origin_nodes, support_nodes, edges, trail_edges, deviation_edges, trails, loads; inputs node_keys: list of Int32, edge_keys: list; same code as topology_artist_2
topology_artist_4 = TopologyArtist(topology=topology_6)  # -> nodes, origin_nodes, support_nodes, edges, trail_edges, deviation_edges, trails, loads; inputs node_keys: list of Int32, edge_keys: list; same code as topology_artist_2
python_2 = GhPythonScript(topology=topology_6, auxiliary_trail=disassemble_topology_diagram_3.auxiliary_trail_keys)  # -> out, auxiliary_trail; inputs auxiliary_trail: list
# ---------- python_2: Python ----------
from compas_cem.ghpython import TopologyArtist


if auxiliary_trail is not None:
    artist = TopologyArtist(topology, artist_type=TopologyArtist)
   
    if auxiliary_trail is not None:
        auxiliary_trail = artist.draw_edges_trail(auxiliary_trail)
# ---------- end python_2 ----------
edge_results_2 = EdgeResults(form=topology_6, edge_keys=python.trail)  # -> lengths, forces; inputs edge_keys: list; same code as edge_results
edge_results_3 = EdgeResults(form=topology_6, edge_keys=disassemble_topology_diagram_3.deviation_edge_keys)  # -> lengths, forces; inputs edge_keys: list; same code as edge_results
merge_4 = Merge(Data1=cem_colors_7.color_compression, Data2=cem_colors_7.color_tension)
larger = LargerThan(FirstNumber=edge_results_3.forces, SecondNumber=0)  # -> LargerThan, OrEqualTo
larger_2 = LargerThan(FirstNumber=edge_results_2.lengths, SecondNumber=0)  # -> LargerThan, OrEqualTo
list_item_3 = ListItem(List=merge_4, Index=larger.OrEqualTo, Wrap=True)
list_item_4 = ListItem(List=merge_4, Index=larger_2.OrEqualTo, Wrap=True)
dash_pattern = DashPattern(Curve=topology_artist_4.deviation_edges, Pattern=number_51)  # -> Dashes, Gaps

number_52 = Number(number_15)
topology_7 = Data(topology_3)
topology_artist_5 = TopologyArtist(topology=topology_7)  # -> nodes, origin_nodes, support_nodes, edges, trail_edges, deviation_edges, trails, loads; inputs node_keys: list of Int32, edge_keys: list; same code as topology_artist_2
cem_colors_8 = CEMColors()  # -> color_tension, color_compression, color_edge, color_node, color_node_support, color_node_origin, color_load, color_reaction, color_trail, color_auxiliary_trail; same code as cem_colors
mesh_sphere_ex = MeshSphereEx(Base=topology_artist_5.support_nodes, Radius=number_52, Count=2)

topology_8 = Data(topology_3)

disassemble_topology_diagram_4 = DisassembleTopologyDiagram(topology=topology_8)  # -> node_keys, origin_node_keys, support_node_keys, edge_keys, trail_edge_keys, deviation_edge_keys, trail_keys, auxiliary_trail_keys; same code as disassemble_topology_diagram
python_3 = GhPythonScript(
    trail=disassemble_topology_diagram_4.trail_edge_keys,
    auxiliary_trail=disassemble_topology_diagram_4.auxiliary_trail_keys)  # -> out, trail; inputs trail: list, auxiliary_trail: list; same code as python
entwine = Entwine(Branch00=python_3.trail, Branch01=disassemble_topology_diagram_4.deviation_edge_keys, FlattenInputs=True)
topology_artist_6 = TopologyArtist(topology=topology_8, edge_keys=entwine)  # -> nodes, origin_nodes, support_nodes, edges, trail_edges, deviation_edges, trails, loads; inputs node_keys: list of Int32, edge_keys: list; same code as topology_artist_2
edge_results_4 = EdgeResults(form=topology_8, edge_keys=python_3.trail)  # -> lengths, forces; inputs edge_keys: list; same code as edge_results
edge_results_5 = EdgeResults(form=topology_8, edge_keys=disassemble_topology_diagram_4.deviation_edge_keys)  # -> lengths, forces; inputs edge_keys: list; same code as edge_results
curve_middle_4 = CurveMiddle(Curve=topology_artist_6.edges)
merge_5 = Merge(Data1=edge_results_4.lengths, Data2=edge_results_5.forces)  # -> flatten(Result)

mesh_sphere_ex_2 = MeshSphereEx(Base=topology_artist_5.origin_nodes, Radius=number_52, Count=2)
material_4 = CreateMaterial(
    Diffuse=cem_colors_8.color_node_origin,
    Specular=RGB(255, 255, 255),
    Emission=cem_colors_8.color_node_origin,
    Transparency="0.2",
    Shine="100")
material_5 = CreateMaterial(
    Diffuse=cem_colors_8.color_node_support,
    Specular=RGB(255, 255, 255),
    Emission=cem_colors_8.color_node_support,
    Transparency="0.2",
    Shine="100")

# ---- group: Edges design parameters
text_tag_4 = TextTag(Location=flatten(curve_middle_4), Text=merge_5, Colour=ColourSwatch(SwatchColor=RGBA(156, 156, 156, 195)))

# ---- group: Node keys
text_tag_5 = TextTag(
    Location=topologyartist.nodes,
    Text=disassemble_topology_diagram_2.node_keys,
    Colour=ColourSwatch(SwatchColor=RGBA(156, 156, 156, 195)))

# ---- group: Edge keys
text_tag_6 = TextTag(
    Location=curve_middle_3,
    Text=disassemble_topology_diagram_2.edge_keys,
    Colour=ColourSwatch(SwatchColor=RGBA(156, 156, 156, 195)))

# ---- group: Loads
vector_display_ex_3 = VectorDisplayEx(Point=move_4.Geometry, Vector=cluster_6.vector, Colour=cem_colors_6.color_load, Width=2)

# ---- group: Deviation edges
custom_preview_3 = CustomPreview(Geometry=dash_pattern.Dashes, Material=graft(list_item_3))

# ---- group: Trails
custom_preview_4 = CustomPreview(Geometry=topology_artist_4.trails, Material=cem_colors_7.color_trail)

# ---- group: Auxiliary Trails
custom_preview_5 = CustomPreview(Geometry=python_2.auxiliary_trail, Material=cem_colors_7.color_auxiliary_trail)

# ---- group: Support nodes
custom_preview_6 = CustomPreview(Geometry=mesh_sphere_ex, Material=material_5)

# ---- group: Origin nodes
custom_preview_7 = CustomPreview(Geometry=mesh_sphere_ex_2, Material=material_4)

# ---- group: Trail edges
custom_preview_8 = CustomPreview(Geometry=topology_artist_3.trail_edges, Material=list_item_4)

# ----
form_12 = Data(form_3)

cluster_7 = Cluster(data=form_12, second_number=min_edge_force)

form_artist_7 = FormArtist(form=form_12, edge_keys=cluster_7)  # -> nodes, support_nodes, edges, loads, reactions; inputs node_keys: list of Int32, edge_keys: list; same code as form_artist
control_points = ControlPoints(Curve=form_artist_7.edges)  # -> Points, Weights, Knots
deconstruct = Deconstruct(Point=flatten(control_points.Points))  # -> XComponent, YComponent, ZComponent
sort_list = SortList(Keys=deconstruct.ZComponent)  # -> Keys, ValuesValuesA
list_item_5 = ListItem(List=sort_list.Keys, Index=0, Wrap=True)
construct_point = ConstructPoint(XCoordinate=0, YCoordinate=0, ZCoordinate=list_item_5)
xy_plane = XYPlane(Origin=construct_point)
project = Project(Geometry=form_artist_7.edges, Plane=xy_plane)  # -> Geometry, Transform

# ---- group: Projection 2d
custom_preview_9 = CustomPreview(Geometry=project.Geometry, Material=ColourSwatch(SwatchColor=RGB(82, 82, 82)))

# ==== cluster Cluster
data = ClusterInput()
data_2 = Data(data)
edge_results = EdgeResults(form=data_2)  # -> lengths, forces; inputs edge_keys: list
#   port form: A COMPAS CEM form diagram.
#   port edge_keys: A selection of edge keys to query the results on. Defaults to all the edge keys.
#   port lengths: The edge lengths.
#   port forces: The edge forces.
# ---------- edge_results: Python ----------
"""
Extract the post form-finding results of the edges in a form diagram.
"""
from ghpythonlib.componentbase import executingcomponent as component


class EdgeResultsComponent(component):
    def RunScript(self, form, edge_keys):
        if form:
            edge_keys = edge_keys or list(form.edges())
            lengths = [form.edge_length_2(ed) for ed in edge_keys]
            forces = [form.edge_force(ed) for ed in edge_keys]
            return lengths, forces
# ---------- end edge_results ----------
disassemble_form_diagram = DisassembleFormDiagram(form=data_2)  # -> node_keys, support_node_keys, edge_keys
#   port form: A COMPAS CEM form diagram.
#   port node_keys: All the node keys in the form diagram.
#   port support_node_keys: The keys of the support nodes in the form diagram.
#   port edge_keys: All the edge keys in the form diagram.
# ---------- disassemble_form_diagram: Python ----------
"""
Disassemble a form diagram into its constituent parts.
"""
from ghpythonlib.componentbase import executingcomponent as component


class FormDisassemblyComponent(component):
    def RunScript(self, form):
        if form:
            edge_keys = list(form.edges())
            node_keys = list(form.nodes())
            support_node_keys = list(form.support_nodes())

            return node_keys, support_node_keys, edge_keys
# ---------- end disassemble_form_diagram ----------
absolute = Absolute(Value=edge_results.forces)
second_number = ClusterInput()
larger_than = LargerThan(FirstNumber=absolute, SecondNumber=second_number)  # -> LargerThan, OrEqualTo
cull_pattern = CullPattern(List=disassemble_form_diagram.edge_keys, CullPattern=larger_than.LargerThan)
list = ClusterOutput(cull_pattern)

# ==== cluster CreateInitialTensegrityPoints
number = ClusterInput()
number_2 = Number(number)
negative = Negative(Value=number_2)
merge = Merge(Data1=number_2, Data2=negative)
golden_ratio = GoldenRatio(Factor=merge)
cross_reference = CrossReference(ListListA=merge, ListListB=merge, CrossMode=1)  # -> ListListA, ListListB
division = Division(A=number_2, B=golden_ratio)
construct_point = ConstructPoint(XCoordinate=graft(golden_ratio), YCoordinate=0, ZCoordinate=division)
construct_point_2 = ConstructPoint(
    XCoordinate=graft(cross_reference.ListListA),
    YCoordinate=cross_reference.ListListB,
    ZCoordinate=cross_reference.ListListA)
construct_point_3 = ConstructPoint(XCoordinate=graft(division), YCoordinate=golden_ratio, ZCoordinate=0)
construct_point_4 = ConstructPoint(XCoordinate=0, YCoordinate=graft(division), ZCoordinate=golden_ratio)
entwine = Entwine(
    Branch00=construct_point_2,
    Branch01=construct_point_4,
    Branch02=construct_point,
    Branch03=construct_point_3,
    FlattenInputs=True)
create_set = CreateSet(List=flatten(entwine))  # -> Set, Map
set = ClusterOutput(create_set.Set)

# ==== cluster SplitCablesStrutLines
count = ClusterInput()
curve = ClusterInput()
series = Series(Start=0, Step=1, Count=count)
curve_2 = Curve(curve)
cull_index = CullIndex(List=curve_2, Indices=series, Wrap=True)
list_item = ListItem(List=curve_2, Index=series, Wrap=True)
explode = Explode(Curve=cull_index, Recursive=True)  # -> Segments, Vertices
explode_2 = Explode(Curve=list_item, Recursive=True)  # -> Segments, Vertices
vertices = ClusterOutput(explode.Vertices)
segments = ClusterOutput(explode_2.Segments)

# ==== cluster DrawIcosahedron
A = ClusterInput()
B = ClusterInput()
multiplication = Multiplication(A=A, B=B)
facet = FacetDome(Points=flatten(multiplication))  # -> Pattern, Dome
P = ClusterOutput(facet.Pattern)

# ==== cluster Cluster_2
curve = ClusterInput()
end_points = EndPoints(Curve=curve)  # -> Start, End
vector_2pt = Vector2Pt(PointA=end_points.Start, PointB=end_points.End, Unitize=False)  # -> Vector, Length
reverse = Reverse(Vector=vector_2pt.Vector)
vector = ClusterOutput(vector_2pt.Vector)
move = Move(Geometry=end_points.Start, Motion=reverse)  # -> Geometry, Transform
geometry = ClusterOutput(move.Geometry)

# ==== cluster Cluster_3
number = ClusterInput()
form = ClusterInput()
force_min = ClusterInput()
force_scale = ClusterInput()
number_2 = Number(number)
formartist = FormArtist(form=form, force_min=force_min, force_scale=force_scale)  # -> nodes, support_nodes, edges, loads, reactions; inputs node_keys: list of Int32, edge_keys: list
#   port form: A COMPAS CEM topology diagram.
#   port node_keys: A selection of the node keys in the diagram. Defaults to all the node keys.
#   port edge_keys: A selection of the edge keys in the diagram. Defaults to all the edge keys.
#   port force_min: The smallest force magnitude to draw. Defaults to 1e-3
#   port force_scale: The scale of the loads and the reactions. Defaults to 1.
#   port nodes: The nodes of the diagram as points.
#   port support_nodes: The support nodes of the diagram as points
#   port edges: The edges of the diagram as lines.
#   port loads: The applied loads as lines.
#   port reactions: The reaction forces at the supports, as lines.
# ---------- formartist: Python ----------
"""
Draw a form diagram.
"""
from ghpythonlib.componentbase import executingcomponent as component

from compas_cem.ghpython import FormArtist


class FormArtistComponent(component):
    def RunScript(self, form, node_keys, edge_keys, force_min, force_scale):
        node_keys = node_keys or None
        edge_keys = edge_keys or None
        force_min = force_min or 1e-3
        force_scale = force_scale or 1

        if not form:
            return

        artist = FormArtist(form, artist_type=FormArtist)

        nodes = artist.draw_nodes(node_keys)
        edges = artist.draw_edges(edge_keys)
        support_nodes = artist.draw_nodes_support(node_keys)

        loads = artist.draw_loads(node_keys, min_load=force_min, scale=force_scale)
        reactions = artist.draw_reactions(node_keys, min_force=force_min, scale=force_scale)

        return nodes, support_nodes, edges, loads, reactions
# ---------- end formartist ----------
B = ClusterInput()
B_2 = ClusterInput()
division = Division(A=number_2, B=B)
flip = FlipCurve(Curve=formartist.reactions)  # -> Curve, Flag
eval = EvaluateLength(Curve=flip.Curve, Length=number_2, Normalized=False)  # -> Point, Tangent, Parameter
shatter = Shatter(Curve=graft(flip.Curve), Parameters=graft(eval.Parameter))
division_2 = Division(A=division, B=B_2)
pframe = PerpFrame(Curve=flip.Curve, Parameter=eval.Parameter)
item = ListItem(List=shatter, Index=0, Wrap=True)  # -> Item1, Item
pflip = FlipPlane(Plane=pframe, ReverseX=False, ReverseY=False, SwapAxes=True)
cone = Cone(Base=pflip, Radius=division, Length=number_2)  # -> Cone, Tip
pipe = Pipe(Curve=item.Item1, Radius=division_2, Caps=2)
cap_holes = CapHoles(Brep=cone.Cone)
brep = Brep(cap_holes)
brep_2 = Brep(pipe)
brep_3 = Brep([brep_2, brep])
brep_4 = ClusterOutput(brep_3)

# ==== cluster Cluster_4
number = ClusterInput()
form = ClusterInput()
force_min = ClusterInput()
force_scale = ClusterInput()
form_artist = FormArtist(form=form, force_min=force_min, force_scale=force_scale)  # -> nodes, support_nodes, edges, loads, reactions; inputs node_keys: list of Int32, edge_keys: list
#   port form: A COMPAS CEM topology diagram.
#   port node_keys: A selection of the node keys in the diagram. Defaults to all the node keys.
#   port edge_keys: A selection of the edge keys in the diagram. Defaults to all the edge keys.
#   port force_min: The smallest force magnitude to draw. Defaults to 1e-3
#   port force_scale: The scale of the loads and the reactions. Defaults to 1.
#   port nodes: The nodes of the diagram as points.
#   port support_nodes: The support nodes of the diagram as points
#   port edges: The edges of the diagram as lines.
#   port loads: The applied loads as lines.
#   port reactions: The reaction forces at the supports, as lines.
# ---------- form_artist: Python ----------
"""
Draw a form diagram.
"""
from ghpythonlib.componentbase import executingcomponent as component

from compas_cem.ghpython import FormArtist


class FormArtistComponent(component):
    def RunScript(self, form, node_keys, edge_keys, force_min, force_scale):
        node_keys = node_keys or None
        edge_keys = edge_keys or None
        force_min = force_min or 1e-3
        force_scale = force_scale or 1
        if form:
            artist = FormArtist(form)

            nodes = artist.draw_nodes(node_keys)
            edges = artist.draw_edges(edge_keys)
            support_nodes = artist.draw_nodes_support(node_keys)

            loads = artist.draw_loads(node_keys, min_load=force_min, scale=force_scale)
            reactions = artist.draw_reactions(node_keys, min_force=force_min, scale=force_scale)

            return nodes, support_nodes, edges, loads, reactions
# ---------- end form_artist ----------
number_2 = Number(number)
B = ClusterInput()
division = Division(A=number_2, B=B)
flip = FlipCurve(Curve=form_artist.loads)  # -> Curve, Flag
B_2 = ClusterInput()
eval = EvaluateLength(Curve=flip.Curve, Length=number_2, Normalized=False)  # -> Point, Tangent, Parameter
shatter = Shatter(Curve=graft(flip.Curve), Parameters=graft(eval.Parameter))
division_2 = Division(A=division, B=B_2)
pframe = PerpFrame(Curve=flip.Curve, Parameter=eval.Parameter)
item = ListItem(List=shatter, Index=0, Wrap=True)  # -> Item1, Item
pflip = FlipPlane(Plane=pframe, ReverseX=False, ReverseY=False, SwapAxes=True)
cone = Cone(Base=pflip, Radius=division, Length=number_2)  # -> Cone, Tip
pipe = Pipe(Curve=item.Item1, Radius=division_2, Caps=2)
cap_holes = CapHoles(Brep=cone.Cone)
brep = Brep(cap_holes)
brep_2 = Brep(pipe)
brep_3 = Brep([brep_2, brep])
brep_4 = ClusterOutput(brep_3)
